# Dynamo graph script.dyn (Dynamo 2.6.2.15705)
# packages: Data-Shapes 2022.2.103, Structural Design 2021.1.22, Orchid 206.3.0.8161, Clockwork for Dynamo 2.x 2.4.0, Genius Loci 2021.11.10, spring nodes 210.1.1, Rhythm 2021.7.2

code_block = CodeBlock { 0.5; }
o_document_activeview = Orchid.RevitProject.Common.Document.ActiveView()
code_block_2 = CodeBlock { "Structural Rebar"; }
o_document_activeview_2 = Orchid.RevitProject.Common.Document.ActiveView()
firstItem = List.FirstItem()  # unwired: list
byBestFitThroughPoints = Line.ByBestFitThroughPoints()  # unwired: bestFitPoints
byUnion = Solid.ByUnion()  # unwired: solids
code_block_3 = CodeBlock { "Armadura Cabezal"; }
file_path = Filename("..\..\..\..\..\..\..\..\..\..\Arainco\Arainco.png")
code_block_4 = CodeBlock { "INICIAR"; "CANCELAR"; true; 430; 170; 650; }
categories_ᶜᵒⁿᵛᵉʳᵗᵉᵈ_ᵈʳᵒᵖᵈᵒʷⁿ = CodeBlock { "Seleccionar Muros a Armar"; "SELECCIONAR"; Revit.Category.ByName(["Walls","Structural Foundations"]); }
selectmodelelements_data = Custom[SelectModelElements Data](InputName=categories_ᶜᵒⁿᵛᵉʳᵗᵉᵈ_ᵈʳᵒᵖᵈᵒʷⁿ.out0, ButtonText=categories_ᶜᵒⁿᵛᵉʳᵗᵉᵈ_ᵈʳᵒᵖᵈᵒʷⁿ.out1, CategoryFilter=categories_ᶜᵒⁿᵛᵉʳᵗᵉᵈ_ᵈʳᵒᵖᵈᵒʷⁿ.out2)  # package Data-Shapes; Creates a Revit element selection input for UI.MultipleInputForm++ . Check out www.data-shapes.net for more infos!
code_block_5 = CodeBlock { "Seleccionar Cara de\nDistribucion"; "SELECCIONAR"; }
selectfaces_data = Custom[SelectFaces Data](InputName=code_block_5.out0, ButtonText=code_block_5.out1)  # package Data-Shapes; Creates a Revit face selection input for UI.MultipleInputForm++. Check out www.data-shapes.net for more infos!
code_block_6 = CodeBlock { "Puntos de Empalme"; "SELECCIONAR"; }
selectfaces_data_2 = Custom[SelectFaces Data](InputName=code_block_6.out0, ButtonText=code_block_6.out1)
code_block_7 = CodeBlock { "Datos de Armadura"; }
code_block_8 = CodeBlock { "Diametro"; }
element_types_ᶜᵒⁿᵛᵉʳᵗᵉᵈ_ᵈʳᵒᵖᵈᵒʷⁿ = CodeBlock { DSCore.Types.FindTypeByNameInAssembly("RebarBarType", "RevitAPI"); }
all_elements_of_type = ElementsOfType(element_type=element_types_ᶜᵒⁿᵛᵉʳᵗᵉᵈ_ᵈʳᵒᵖᵈᵒʷⁿ)
code_block_9 = CodeBlock(t5=all_elements_of_type)
# ---------- code_block_9.designscript (8 lines) ----------
t4 = t5;
t1 = t4;
num1 = Properties.RebarDiameter(t1);
t2 = DSCore.List.SortByKey(t1, num1);
t3 = Dictionary.ValueAtKey(t2, "sorted list");
str1 = Revit.Elements.Element.Name(t3);
0;
false;
# ----------------------------------------
dropdown_data = Custom[DropDown Data](InputName=code_block_8, Keys=code_block_9.str1, Values=code_block_9.t3, DefaultValueIndex=code_block_9.out6, Sorted_optional=code_block_9.out7)  # package Data-Shapes; Create data for DropDown input in UI.MultiInputForm ++ . Check out www.data-shapes.net for more infos.
code_block_10 = CodeBlock { "Cantidad de Barras"; "2"; true; }
textbox_data = Custom[TextBox Data](InputName=code_block_10.out0, DefaultText=code_block_10.out1, IsNumberEntry=code_block_10.out2)  # package Data-Shapes; Create Data for TextBox input in UI.MultipleInputForm ++ . Check out www.data-shapes.net for more informations
code_block_11 = CodeBlock { "Capa"; ["1ª Capa", "2ª Capa", "3ª Capa", "4ª Capa", "5ª Capa"]; [40, 90, 140, 190, 240]; 0; }
dropdown_data_2 = Custom[DropDown Data](InputName=code_block_11.out0, Keys=code_block_11.out1, Values=code_block_11.out2, DefaultValueIndex=code_block_11.out3)
list_create = List.Create(item0=dropdown_data, item1=textbox_data, item2=dropdown_data_2)
inputgroup_data = Custom[InputGroup Data](GroupTitle=code_block_7, Inputs=list_create)  # package Data-Shapes; Creates a group of inputs for UI.MultipleInputForm ++ . Check out www.data-shapes.net for more infos !
list_create_2 = List.Create(item0=selectmodelelements_data, item1=selectfaces_data, item2=selectfaces_data_2, item3=inputgroup_data)
multipleinputform = Custom[MultipleInputForm ++](Description_optional=code_block_3, Logo_optional=file_path, ButtonText_optional=code_block_4.out0, Inputs=list_create_2, Toggle=code_block_4.out2, CancelButtonText_optional=code_block_4.out1, MaxHeight_optional=code_block_4.out5, Width_optional=code_block_4.out3, LabelWidth_optional=code_block_4.out4)  # package Data-Shapes; Create a form with multiple inputs. see www.data-shapes.net for tutorials and infos!
code_block_12 = CodeBlock(l=multipleinputform.User_Inputs)
# ---------- code_block_12.designscript (12 lines) ----------
l;
[Imperative]
{
	if (l == null)
	{
		return = [[],[],[],[],[],[]];
	}
	else
	{
		return = l;
	}
};
# ----------------------------------------
code_block_13 = CodeBlock(x=code_block_12.out1) { x; }
code_block_14 = CodeBlock(x=code_block_13) { x[0]; }
geometry = Element.Geometry(element=code_block_14)
flatten = List.Flatten(list=geometry)
function_apply = ApplyFunction(func=byUnion, arg1=flatten)
code_block_15 = CodeBlock(l=function_apply)
# ---------- code_block_15.designscript (12 lines) ----------
l;
[Imperative]
{
	if (l == null)
	{
		return = [];
	}
	else
	{
		return = l;
	}
};
# ----------------------------------------
byLoft = Surface.ByLoft()  # unwired: crossSections
code_block_16 = CodeBlock(x=code_block_13) { x[1]; }
flipNormalDirection = Surface.FlipNormalDirection(surface=code_block_16)
code_block_17 = CodeBlock { 0.5; }
normalAtParameter = Surface.NormalAtParameter(surface=flipNormalDirection, u=code_block_17, v=code_block_17)
code_block_18 = CodeBlock(x=code_block_13) { x[5]; }
translate = Geometry.Translate(geometry=flipNormalDirection, direction=normalAtParameter, distance=code_block_18)
perimeterCurves = Surface.PerimeterCurves(surface=translate)
flatten_2 = List.Flatten(list=perimeterCurves)
code_block_19 = CodeBlock { null; }
replaceEmptyLists = Custom[List.ReplaceEmptyLists](seq=flatten_2, Replacement=code_block_19)  # package Clockwork for Dynamo 2.x; Replaces all empty lists within a given list with a substitute
code_block_20 = CodeBlock(x=replaceEmptyLists)
# ---------- code_block_20.designscript (13 lines) ----------
x;

[Imperative]
{
	if (x == null)
	{
		return = [null,null,null];
	}
	else
	{
		return = x;
	}
};
# ----------------------------------------
code_block_21 = CodeBlock { [0,2]; }
getItemAtIndex = List.GetItemAtIndex(list=code_block_20.out1, index=code_block_21)
list_clean = Custom[List Clean](list=getItemAtIndex)  # package Genius Loci; Removes all Null, Empty and Blank from a list or nested list of lists.
code_block_22 = CodeBlock { 100000; }
extendEnd = Curve.ExtendEnd(curve=list_clean, distance=code_block_22)
code_block_23 = CodeBlock { 100000; }
extendStart = Curve.ExtendStart(curve=extendEnd, distance=code_block_23)
function_apply_2 = ApplyFunction(func=byLoft, arg1=extendStart)
intersect = Geometry.Intersect(geometry=code_block_15.out1, other=function_apply_2)
code_block_24 = CodeBlock { 0.5; }
pointAtParameter = Surface.PointAtParameter(surface=intersect, v=code_block_24)
code_block_25 = CodeBlock { 1; 0.5; }
pointAtParameter_2 = Surface.PointAtParameter(surface=intersect, u=code_block_25.out0, v=code_block_25.out1)
list_create_3 = List.Create(item0=pointAtParameter, item1=pointAtParameter_2)
flatten_3 = List.Flatten(list=list_create_3)
function_apply_3 = ApplyFunction(func=byBestFitThroughPoints, arg1=flatten_3)
code_block_26 = CodeBlock(l=function_apply_3)  # same code as code_block_15
direction = Line.Direction(line=code_block_26.out1)
Z = Vector.Z(vector=direction)
code_block_27 = CodeBlock { 0; }
lt = Z < code_block_27
reverse = Curve.Reverse(curve=code_block_26.out1)
if_ = If(test=lt, true=reverse, false=code_block_26.out1)
code_block_28 = CodeBlock(line1=if_) { curve1 = Autodesk.Curve.ExtendStart(line1, -50); curve2 = Autodesk.Curve.ExtendEnd(curve1, -20); }
code_block_29 = CodeBlock(x=code_block_13) { x[2]; }
code_block_30 = CodeBlock { 0.5; }
pointAtParameter_3 = Surface.PointAtParameter(surface=code_block_29, u=code_block_30, v=code_block_30)
byOriginNormal = Plane.ByOriginNormal(origin=pointAtParameter_3)
intersect_2 = Geometry.Intersect(geometry=code_block_28.curve2, other=byOriginNormal)
flatten_4 = List.Flatten(list=intersect_2)
splitByPoints = Curve.SplitByPoints(curve=code_block_28.curve2, points=flatten_4)
code_block_31 = CodeBlock(x=code_block_13) { x[1]; }
flipNormalDirection_2 = Surface.FlipNormalDirection(surface=code_block_31)
byBestFitThroughPoints_2 = Line.ByBestFitThroughPoints()  # unwired: bestFitPoints
code_block_32 = CodeBlock { 0.5; }
pointAtParameter_4 = Surface.PointAtParameter(surface=code_block_31, v=code_block_32)
code_block_33 = CodeBlock { 1; 0.5; }
pointAtParameter_5 = Surface.PointAtParameter(surface=code_block_31, u=code_block_33.out0, v=code_block_33.out1)
list_create_4 = List.Create(item0=pointAtParameter_4, item1=pointAtParameter_5)
flatten_5 = List.Flatten(list=list_create_4)
function_apply_4 = ApplyFunction(func=byBestFitThroughPoints_2, arg1=flatten_5)
code_block_34 = CodeBlock(l=function_apply_4)  # same code as code_block_15
code_block_35 = CodeBlock { 90; 0.5; }
planeAtParameter = Curve.PlaneAtParameter(curve=code_block_34.out1, param=code_block_35.out1)
rotate = Geometry.Rotate(geometry=flipNormalDirection_2, basePlane=planeAtParameter, degrees=code_block_35.out0)
code_block_36 = CodeBlock { 0.5; }
normalAtParameter_2 = Surface.NormalAtParameter(surface=rotate, u=code_block_36, v=code_block_36)
code_block_37 = CodeBlock(x=code_block_14) { x; }
getCategory = Element.GetCategory()  # unwired: element
function_apply_5 = ApplyFunction(func=getCategory, arg1=code_block_37)
string_from_object = FromObject(obj=function_apply_5)
code_block_38 = CodeBlock { "Walls"; }
eq = string_from_object == code_block_38
code_block_39 = CodeBlock(l=eq)
# ---------- code_block_39.designscript (12 lines) ----------
l;
[Imperative]
{
	if (l == false)
	{
		return = [];
	}
	else
	{
		return = l;
	}
};
# ----------------------------------------
filterByBoolMask = List.FilterByBoolMask(list=code_block_37, mask=code_block_39.out1)
geometry_2 = Element.Geometry(element=filterByBoolMask.in)
flatten_6 = List.Flatten(list=geometry_2)
code_block_40 = CodeBlock { 0.2; }
pointAtParameter_6 = Curve.PointAtParameter(curve=splitByPoints, param=code_block_40)
doesIntersect = Geometry.DoesIntersect(geometry=flatten_6@L1, other=pointAtParameter_6@L2, lacing=Longest)
o_list_anytrue = Orchid.Common.List.AnyTrue(list=doesIntersect)
filterByBoolMask_2 = List.FilterByBoolMask(list=filterByBoolMask.in, mask=o_list_anytrue)
code_block_41 = CodeBlock(t6=filterByBoolMask_2.in)
# ---------- code_block_41.designscript (6 lines) ----------
t4 = t6;
t2 = t4;
t1 = Revit.Elements.Element.GetParameterValueByName(t2, "Type");
t3 = Revit.Elements.Element.GetParameterValueByName(t1, "Width");
t5 = t3 / 2;
t7 = t5 - 40;
# ----------------------------------------
translate_2 = Geometry.Translate(geometry=splitByPoints, direction=normalAtParameter_2, distance=code_block_41.t7, lacing=Longest)
code_block_42 = CodeBlock(x=code_block_13) { x[3]; }
traslapo_armadura = CodeBlock(rebar=code_block_42)
# ---------- traslapo_armadura.designscript (5 lines) ----------
diametro_barra = Strings.ToString(Properties.RebarDiameter(rebar),"");
key = ["8","10","12","16","18","22","25","28","32","36"];
val = [570, 710, 860, 1140, 1290, 1960, 2230, 2500, 2850, 3210];
dict_traslapo = Dictionary.ByKeysValues(key, val);
t3 = Dictionary.ValueAtKey(dict_traslapo, diametro_barra);
# ----------------------------------------
extendEnd_2 = Curve.ExtendEnd(curve=translate_2, distance=traslapo_armadura.t3)
function_apply_6 = ApplyFunction(func=firstItem, arg1=extendEnd_2)
element_types_ᶜᵒⁿᵛᵉʳᵗᵉᵈ_ᵈʳᵒᵖᵈᵒʷⁿ_2 = CodeBlock { DSCore.Types.FindTypeByNameInAssembly("RebarHookType", "RevitAPI"); }
all_elements_of_type_2 = ElementsOfType(element_type=element_types_ᶜᵒⁿᵛᵉʳᵗᵉᵈ_ᵈʳᵒᵖᵈᵒʷⁿ_2)
rebar_hook_type_at_start = CodeBlock(t3=all_elements_of_type_2)
# ---------- rebar_hook_type_at_start.designscript (5 lines) ----------
t1 = t3;
str2 = Revit.Elements.Element.Name(t1);
t2 = str2 == "Standard - 90 deg.";
t4 = DSCore.List.FilterByBoolMask(t3, t2);
t5 = Dictionary.ValueAtKey(t4, "in");
# ----------------------------------------
direction_2 = Line.Direction(line=code_block_34.out1)
Z_2 = Vector.Z(vector=direction_2)
code_block_43 = CodeBlock { 0; }
lt_2 = Z_2 < code_block_43
code_block_44 = CodeBlock { "Left"; "Right"; }
if_2 = If(test=lt_2, true=code_block_44.out0, false=code_block_44.out1)
firstItem_2 = List.FirstItem()  # unwired: list
function_apply_7 = ApplyFunction(func=firstItem_2, arg1=filterByBoolMask_2.in)
reverse_2 = Vector.Reverse(vector=normalAtParameter_2)
code_block_45 = CodeBlock(curves=function_apply_6, rebarBarType=code_block_42, startHookType=rebar_hook_type_at_start.t5, startHookOrientation=if_2, endtHookOrientation=if_2, hostElement=function_apply_7, vector=reverse_2)
# ---------- code_block_45.designscript (18 lines) ----------
//curves
curves;
//rebarStyle
"Standard";
//rebarBarType
rebarBarType;
//startHookType
startHookType;
//endHookType
null;
//startHookOrientation
startHookOrientation;
//endtHookOrientation
endtHookOrientation;
//hostElement
hostElement;
//vector
vector;
# ----------------------------------------
fromCurves = StructuralDesign.Rebar.Create.FromCurves(curves=code_block_45.curves@L1, rebarStyle=code_block_45.out1@L1, rebarBarType=code_block_45.rebarBarType@L1, startHookType=code_block_45.startHookType@L1, endHookType=code_block_45.out4@L1, startHookOrientation=code_block_45.startHookOrientation@L1, endHookOrientation=code_block_45.endtHookOrientation@L1, hostElement=code_block_45.hostElement@L1, vector=code_block_45.vector@L1, lacing=Longest)
code_block_46 = CodeBlock(t2=filterByBoolMask_2.in)
# ---------- code_block_46.designscript (3 lines) ----------
t1 = Revit.Elements.Element.GetParameterValueByName(t2, "Type");
t3 = Revit.Elements.Element.GetParameterValueByName(t1, "Width");
t4 = t3 - 80;
# ----------------------------------------
code_block_47 = CodeBlock(x=code_block_13) { x[4]; }
setLayoutAsFixedNumber = StructuralDesign.Rebar.Layout.SetLayoutAsFixedNumber(rebar=fromCurves, arrayLength=code_block_46.t4, numberOfBarPositions=code_block_47)
element_types_ᶜᵒⁿᵛᵉʳᵗᵉᵈ_ᵈʳᵒᵖᵈᵒʷⁿ_3 = CodeBlock { DSCore.Types.FindTypeByNameInAssembly("RebarShape", "RevitAPI"); }
all_elements_of_type_3 = ElementsOfType(element_type=element_types_ᶜᵒⁿᵛᵉʳᵗᵉᵈ_ᵈʳᵒᵖᵈᵒʷⁿ_3)
code_block_48 = CodeBlock(t1=all_elements_of_type_3)
# ---------- code_block_48.designscript (5 lines) ----------
"Shape";
str2 = Revit.Elements.Element.Name(t1);
t2 = str2 == "R_S_01";
t3 = DSCore.List.FilterByBoolMask(t1, t2);
t4 = Dictionary.ValueAtKey(t3, "in");
# ----------------------------------------
setParameterByName = Element.SetParameterByName(element=setLayoutAsFixedNumber, parameterName=code_block_48.out0, value=code_block_48.t4, lacing=Longest)
rebarCenterlineCurves = StructuralDesign.Rebar.Properties.RebarCenterlineCurves(rebar=setParameterByName)
flatten_7 = List.Flatten(list=rebarCenterlineCurves)
code_block_49 = CodeBlock(x=code_block_13) { x[5]; }
string_from_object_2 = FromObject(obj=code_block_49)
traslapo_armadura_2 = CodeBlock(capa=string_from_object_2)
# ---------- traslapo_armadura_2.designscript (4 lines) ----------
key = ["40", "90", "140", "190", "240"];
val = [0.8, 0.7, 0.6, 0.5, 0.4];
dict_capa = Dictionary.ByKeysValues(key, val);
t3 = Dictionary.ValueAtKey(dict_capa, capa);
# ----------------------------------------
pointAtParameter_7 = Curve.PointAtParameter(curve=flatten_7, param=traslapo_armadura_2.t3)
flatten_8 = List.Flatten(list=pointAtParameter_7)
code_block_50 = CodeBlock()
# ---------- code_block_50.designscript (4 lines) ----------
family1 = Revit.Family.ByName("EST_A_STRUCTURAL REBAR TAG_STANDAR");
familytype1 = Revit.Elements.FamilyType.ByFamilyAndName(family1, "R_S_01");
true;
true;
# ----------------------------------------
create_tag = Custom[Create Tag](view=o_document_activeview_2@L1, element=setParameterByName@L1, TagLocation=flatten_8@L1, TagType=code_block_50.familytype1@L1, addLeader=code_block_50.out2@L1, RunIt=code_block_50.out3@L1, lacing=Longest)  # package Genius Loci; Works only in Revit 2018 and later. Creates a tag at a given location, of given type and in a supplied view. The node also works with Linked Elements (except space and area), Multi Category tag and Material Tag. Based on an archilab node
flatten_9 = List.Flatten(list=create_tag)
code_block_51 = CodeBlock(x=code_block_13) { x[1]; }
code_block_52 = CodeBlock(x=code_block_51) { x; }
code_block_53 = CodeBlock { 0.5; }
normalAtParameter_3 = Surface.NormalAtParameter(surface=code_block_52, u=code_block_53, v=code_block_53)
code_block_54 = CodeBlock { 600; }
translate_3 = Geometry.Translate(geometry=code_block_52, direction=normalAtParameter_3, distance=code_block_54)
code_block_55 = CodeBlock { 0.5; }
pointAtParameter_8 = Surface.PointAtParameter(surface=translate_3, u=code_block_55, v=code_block_55)
byOriginNormal_2 = Plane.ByOriginNormal(origin=pointAtParameter_8, normal=normalAtParameter_3)
ꟿ_point_pullontoplane = Custom[ꟿ Point.PullOntoPlane](point=flatten_8, plane=byOriginNormal_2)  # package spring nodes; Pulls (projects) the point onto the input plane, following the plane normal.
tag_setlocation = Custom[Tag SetLocation](tag=flatten_9, location=ꟿ_point_pullontoplane)  # package Genius Loci; Moves the head of the tag to the given location point.
o_document_activeview_3 = Orchid.RevitProject.Common.Document.ActiveView()
byBestFitThroughPoints_3 = Line.ByBestFitThroughPoints()  # unwired: bestFitPoints
byUnion_2 = Solid.ByUnion()  # unwired: solids
code_block_56 = CodeBlock(x=code_block_12.out1) { x; }
code_block_57 = CodeBlock(x=code_block_56) { x[0]; }
geometry_3 = Element.Geometry(element=code_block_57)
flatten_10 = List.Flatten(list=geometry_3)
function_apply_8 = ApplyFunction(func=byUnion_2, arg1=flatten_10)
code_block_58 = CodeBlock(l=function_apply_8)  # same code as code_block_15
byLoft_2 = Surface.ByLoft()  # unwired: crossSections
code_block_59 = CodeBlock(x=code_block_56) { x[1]; }
flipNormalDirection_3 = Surface.FlipNormalDirection(surface=code_block_59)
code_block_60 = CodeBlock { 0.5; }
normalAtParameter_4 = Surface.NormalAtParameter(surface=flipNormalDirection_3, u=code_block_60, v=code_block_60)
code_block_61 = CodeBlock(x=code_block_56) { x[5]; }
translate_4 = Geometry.Translate(geometry=flipNormalDirection_3, direction=normalAtParameter_4, distance=code_block_61)
perimeterCurves_2 = Surface.PerimeterCurves(surface=translate_4)
flatten_11 = List.Flatten(list=perimeterCurves_2)
code_block_62 = CodeBlock { null; }
replaceEmptyLists_2 = Custom[List.ReplaceEmptyLists](seq=flatten_11, Replacement=code_block_62)
code_block_63 = CodeBlock(x=replaceEmptyLists_2)  # same code as code_block_20
code_block_64 = CodeBlock { [0,2]; }
getItemAtIndex_2 = List.GetItemAtIndex(list=code_block_63.out1, index=code_block_64)
list_clean_2 = Custom[List Clean](list=getItemAtIndex_2)
code_block_65 = CodeBlock { 100000; }
extendEnd_3 = Curve.ExtendEnd(curve=list_clean_2, distance=code_block_65)
code_block_66 = CodeBlock { 100000; }
extendStart_2 = Curve.ExtendStart(curve=extendEnd_3, distance=code_block_66)
function_apply_9 = ApplyFunction(func=byLoft_2, arg1=extendStart_2)
intersect_3 = Geometry.Intersect(geometry=code_block_58.out1, other=function_apply_9)
code_block_67 = CodeBlock { 0.5; }
pointAtParameter_9 = Surface.PointAtParameter(surface=intersect_3, v=code_block_67)
code_block_68 = CodeBlock { 1; 0.5; }
pointAtParameter_10 = Surface.PointAtParameter(surface=intersect_3, u=code_block_68.out0, v=code_block_68.out1)
list_create_5 = List.Create(item0=pointAtParameter_9, item1=pointAtParameter_10)
flatten_12 = List.Flatten(list=list_create_5)
function_apply_10 = ApplyFunction(func=byBestFitThroughPoints_3, arg1=flatten_12)
code_block_69 = CodeBlock(l=function_apply_10)  # same code as code_block_15
direction_3 = Line.Direction(line=code_block_69.out1)
Z_3 = Vector.Z(vector=direction_3)
code_block_70 = CodeBlock { 0; }
lt_3 = Z_3 < code_block_70
reverse_3 = Curve.Reverse(curve=code_block_69.out1)
if_3 = If(test=lt_3, true=reverse_3, false=code_block_69.out1)
code_block_71 = CodeBlock(line1=if_3) { curve1 = Autodesk.Curve.ExtendStart(line1, -50); curve2 = Autodesk.Curve.ExtendEnd(curve1, -20); }
code_block_72 = CodeBlock(x=code_block_56) { x[2]; }
code_block_73 = CodeBlock { 0.5; }
pointAtParameter_11 = Surface.PointAtParameter(surface=code_block_72, u=code_block_73, v=code_block_73)
byOriginNormal_3 = Plane.ByOriginNormal(origin=pointAtParameter_11)
intersect_4 = Geometry.Intersect(geometry=code_block_71.curve2, other=byOriginNormal_3)
flatten_13 = List.Flatten(list=intersect_4)
splitByPoints_2 = Curve.SplitByPoints(curve=code_block_71.curve2, points=flatten_13)
code_block_74 = CodeBlock(x=code_block_56) { x[1]; }
flipNormalDirection_4 = Surface.FlipNormalDirection(surface=code_block_74)
byBestFitThroughPoints_4 = Line.ByBestFitThroughPoints()  # unwired: bestFitPoints
code_block_75 = CodeBlock { 0.5; }
pointAtParameter_12 = Surface.PointAtParameter(surface=code_block_74, v=code_block_75)
code_block_76 = CodeBlock { 1; 0.5; }
pointAtParameter_13 = Surface.PointAtParameter(surface=code_block_74, u=code_block_76.out0, v=code_block_76.out1)
list_create_6 = List.Create(item0=pointAtParameter_12, item1=pointAtParameter_13)
flatten_14 = List.Flatten(list=list_create_6)
function_apply_11 = ApplyFunction(func=byBestFitThroughPoints_4, arg1=flatten_14)
code_block_77 = CodeBlock(l=function_apply_11)  # same code as code_block_15
code_block_78 = CodeBlock { 90; 0.5; }
planeAtParameter_2 = Curve.PlaneAtParameter(curve=code_block_77.out1, param=code_block_78.out1)
rotate_2 = Geometry.Rotate(geometry=flipNormalDirection_4, basePlane=planeAtParameter_2, degrees=code_block_78.out0)
code_block_79 = CodeBlock { 0.5; }
normalAtParameter_5 = Surface.NormalAtParameter(surface=rotate_2, u=code_block_79, v=code_block_79)
code_block_80 = CodeBlock(x=code_block_57) { x; }
getCategory_2 = Element.GetCategory()  # unwired: element
function_apply_12 = ApplyFunction(func=getCategory_2, arg1=code_block_80)
string_from_object_3 = FromObject(obj=function_apply_12)
code_block_81 = CodeBlock { "Walls"; }
eq_2 = string_from_object_3 == code_block_81
code_block_82 = CodeBlock(l=eq_2)  # same code as code_block_39
filterByBoolMask_3 = List.FilterByBoolMask(list=code_block_80, mask=code_block_82.out1)
geometry_4 = Element.Geometry(element=filterByBoolMask_3.in)
flatten_15 = List.Flatten(list=geometry_4)
code_block_83 = CodeBlock { 0.2; }
pointAtParameter_14 = Curve.PointAtParameter(curve=splitByPoints_2, param=code_block_83)
doesIntersect_2 = Geometry.DoesIntersect(geometry=flatten_15@L1, other=pointAtParameter_14@L2, lacing=Longest)
o_list_anytrue_2 = Orchid.Common.List.AnyTrue(list=doesIntersect_2)
filterByBoolMask_4 = List.FilterByBoolMask(list=filterByBoolMask_3.in, mask=o_list_anytrue_2)
code_block_84 = CodeBlock(t6=filterByBoolMask_4.in)  # same code as code_block_41
translate_5 = Geometry.Translate(geometry=splitByPoints_2, direction=normalAtParameter_5, distance=code_block_84.t7, lacing=Longest)
code_block_85 = CodeBlock(x=code_block_56) { x[3]; }
traslapo_armadura_3 = CodeBlock(rebar=code_block_85)  # same code as traslapo_armadura
extendEnd_4 = Curve.ExtendEnd(curve=translate_5, distance=traslapo_armadura_3.t3)
ꟿ_list_dropfirstlast = Custom[ꟿ List.DropFirstLast](list=extendEnd_4)  # package spring nodes; Removes the first and last items from the list
direction_4 = Line.Direction(line=code_block_77.out1)
Z_4 = Vector.Z(vector=direction_4)
code_block_86 = CodeBlock { 0; }
lt_4 = Z_4 < code_block_86
code_block_87 = CodeBlock { "Left"; "Right"; }
if_4 = If(test=lt_4, true=code_block_87.out0, false=code_block_87.out1)
ꟿ_list_dropfirstlast_2 = Custom[ꟿ List.DropFirstLast](list=filterByBoolMask_4.in)
reverse_4 = Vector.Reverse(vector=normalAtParameter_5)
code_block_88 = CodeBlock(curves=ꟿ_list_dropfirstlast.rest, rebarBarType=code_block_85, startHookOrientation=if_4, endtHookOrientation=if_4, hostElement=ꟿ_list_dropfirstlast_2.rest, vector=reverse_4)
# ---------- code_block_88.designscript (18 lines) ----------
//curves
curves;
//rebarStyle
"Standard";
//rebarBarType
rebarBarType;
//startHookType
null;
//endHookType
null;
//startHookOrientation
startHookOrientation;
//endtHookOrientation
endtHookOrientation;
//hostElement
hostElement;
//vector
vector;
# ----------------------------------------
fromCurves_2 = StructuralDesign.Rebar.Create.FromCurves(curves=code_block_88.curves@L1, rebarStyle=code_block_88.out1@L1, rebarBarType=code_block_88.rebarBarType@L1, startHookType=code_block_88.out3@L1, endHookType=code_block_88.out4@L1, startHookOrientation=code_block_88.startHookOrientation@L1, endHookOrientation=code_block_88.endtHookOrientation@L1, hostElement=code_block_88.hostElement@L1, vector=code_block_88.vector@L1, lacing=Longest)
code_block_89 = CodeBlock(t2=filterByBoolMask_4.in)  # same code as code_block_46
code_block_90 = CodeBlock(x=code_block_56) { x[4]; }
setLayoutAsFixedNumber_2 = StructuralDesign.Rebar.Layout.SetLayoutAsFixedNumber(rebar=fromCurves_2, arrayLength=code_block_89.t4, numberOfBarPositions=code_block_90)
element_types_ᶜᵒⁿᵛᵉʳᵗᵉᵈ_ᵈʳᵒᵖᵈᵒʷⁿ_4 = CodeBlock { DSCore.Types.FindTypeByNameInAssembly("RebarShape", "RevitAPI"); }
all_elements_of_type_4 = ElementsOfType(element_type=element_types_ᶜᵒⁿᵛᵉʳᵗᵉᵈ_ᵈʳᵒᵖᵈᵒʷⁿ_4)
code_block_91 = CodeBlock(t1=all_elements_of_type_4)
# ---------- code_block_91.designscript (5 lines) ----------
"Shape";
str2 = Revit.Elements.Element.Name(t1);
t2 = str2 == "R_S_00";
t3 = DSCore.List.FilterByBoolMask(t1, t2);
t4 = Dictionary.ValueAtKey(t3, "in");
# ----------------------------------------
setParameterByName_2 = Element.SetParameterByName(element=setLayoutAsFixedNumber_2, parameterName=code_block_91.out0, value=code_block_91.t4, lacing=Longest)
rebarCenterlineCurves_2 = StructuralDesign.Rebar.Properties.RebarCenterlineCurves(rebar=setParameterByName_2)
code_block_92 = CodeBlock(x=code_block_56) { x[5]; }
string_from_object_4 = FromObject(obj=code_block_92)
traslapo_armadura_4 = CodeBlock(capa=string_from_object_4)  # same code as traslapo_armadura_2
pointAtParameter_15 = Curve.PointAtParameter(curve=rebarCenterlineCurves_2, param=traslapo_armadura_4.t3)
flatten_16 = List.Flatten(list=pointAtParameter_15)
code_block_93 = CodeBlock()
# ---------- code_block_93.designscript (4 lines) ----------
family1 = Revit.Family.ByName("EST_A_STRUCTURAL REBAR TAG_STANDAR");
familytype1 = Revit.Elements.FamilyType.ByFamilyAndName(family1, "R_S_00");
true;
true;
# ----------------------------------------
create_tag_2 = Custom[Create Tag](view=o_document_activeview_3@L1, element=setParameterByName_2@L1, TagLocation=flatten_16@L1, TagType=code_block_93.familytype1@L1, addLeader=code_block_93.out2@L1, RunIt=code_block_93.out3@L1, lacing=Longest)
flatten_17 = List.Flatten(list=create_tag_2)
code_block_94 = CodeBlock(x=code_block_56) { x[1]; }
code_block_95 = CodeBlock(x=code_block_94) { x; }
code_block_96 = CodeBlock { 0.5; }
normalAtParameter_6 = Surface.NormalAtParameter(surface=code_block_95, u=code_block_96, v=code_block_96)
code_block_97 = CodeBlock { 600; }
translate_6 = Geometry.Translate(geometry=code_block_95, direction=normalAtParameter_6, distance=code_block_97)
code_block_98 = CodeBlock { 0.5; }
pointAtParameter_16 = Surface.PointAtParameter(surface=translate_6, u=code_block_98, v=code_block_98)
byOriginNormal_4 = Plane.ByOriginNormal(origin=pointAtParameter_16, normal=normalAtParameter_6)
ꟿ_point_pullontoplane_2 = Custom[ꟿ Point.PullOntoPlane](point=flatten_16, plane=byOriginNormal_4, lacing=Longest)
tag_setlocation_2 = Custom[Tag SetLocation](tag=flatten_17, location=ꟿ_point_pullontoplane_2)
o_document_activeview_4 = Orchid.RevitProject.Common.Document.ActiveView()
lastItem = List.LastItem()  # unwired: list
byBestFitThroughPoints_5 = Line.ByBestFitThroughPoints()  # unwired: bestFitPoints
byUnion_3 = Solid.ByUnion()  # unwired: solids
code_block_99 = CodeBlock(x=code_block_12.out1) { x; }
code_block_100 = CodeBlock(x=code_block_99) { x[0]; }
geometry_5 = Element.Geometry(element=code_block_100)
flatten_18 = List.Flatten(list=geometry_5)
function_apply_13 = ApplyFunction(func=byUnion_3, arg1=flatten_18)
code_block_101 = CodeBlock(l=function_apply_13)  # same code as code_block_15
byLoft_3 = Surface.ByLoft()  # unwired: crossSections
code_block_102 = CodeBlock(x=code_block_99) { x[1]; }
flipNormalDirection_5 = Surface.FlipNormalDirection(surface=code_block_102)
code_block_103 = CodeBlock { 0.5; }
normalAtParameter_7 = Surface.NormalAtParameter(surface=flipNormalDirection_5, u=code_block_103, v=code_block_103)
code_block_104 = CodeBlock(x=code_block_99) { x[5]; }
translate_7 = Geometry.Translate(geometry=flipNormalDirection_5, direction=normalAtParameter_7, distance=code_block_104)
perimeterCurves_3 = Surface.PerimeterCurves(surface=translate_7)
flatten_19 = List.Flatten(list=perimeterCurves_3)
code_block_105 = CodeBlock { null; }
replaceEmptyLists_3 = Custom[List.ReplaceEmptyLists](seq=flatten_19, Replacement=code_block_105)
code_block_106 = CodeBlock(x=replaceEmptyLists_3)  # same code as code_block_20
code_block_107 = CodeBlock { [0,2]; }
getItemAtIndex_3 = List.GetItemAtIndex(list=code_block_106.out1, index=code_block_107)
list_clean_3 = Custom[List Clean](list=getItemAtIndex_3)
code_block_108 = CodeBlock { 100000; }
extendEnd_5 = Curve.ExtendEnd(curve=list_clean_3, distance=code_block_108)
code_block_109 = CodeBlock { 100000; }
extendStart_3 = Curve.ExtendStart(curve=extendEnd_5, distance=code_block_109)
function_apply_14 = ApplyFunction(func=byLoft_3, arg1=extendStart_3)
intersect_5 = Geometry.Intersect(geometry=code_block_101.out1, other=function_apply_14)
code_block_110 = CodeBlock { 0.5; }
pointAtParameter_17 = Surface.PointAtParameter(surface=intersect_5, v=code_block_110)
code_block_111 = CodeBlock { 1; 0.5; }
pointAtParameter_18 = Surface.PointAtParameter(surface=intersect_5, u=code_block_111.out0, v=code_block_111.out1)
list_create_7 = List.Create(item0=pointAtParameter_17, item1=pointAtParameter_18)
flatten_20 = List.Flatten(list=list_create_7)
function_apply_15 = ApplyFunction(func=byBestFitThroughPoints_5, arg1=flatten_20)
code_block_112 = CodeBlock(l=function_apply_15)  # same code as code_block_15
direction_5 = Line.Direction(line=code_block_112.out1)
Z_5 = Vector.Z(vector=direction_5)
code_block_113 = CodeBlock { 0; }
lt_5 = Z_5 < code_block_113
reverse_5 = Curve.Reverse(curve=code_block_112.out1)
if_5 = If(test=lt_5, true=reverse_5, false=code_block_112.out1)
code_block_114 = CodeBlock(line1=if_5) { curve1 = Autodesk.Curve.ExtendStart(line1, -50); curve2 = Autodesk.Curve.ExtendEnd(curve1, -20); }
code_block_115 = CodeBlock(x=code_block_99) { x[2]; }
code_block_116 = CodeBlock { 0.5; }
pointAtParameter_19 = Surface.PointAtParameter(surface=code_block_115, u=code_block_116, v=code_block_116)
byOriginNormal_5 = Plane.ByOriginNormal(origin=pointAtParameter_19)
intersect_6 = Geometry.Intersect(geometry=code_block_114.curve2, other=byOriginNormal_5)
flatten_21 = List.Flatten(list=intersect_6)
splitByPoints_3 = Curve.SplitByPoints(curve=code_block_114.curve2, points=flatten_21)
code_block_117 = CodeBlock(x=code_block_99) { x[1]; }
flipNormalDirection_6 = Surface.FlipNormalDirection(surface=code_block_117)
byBestFitThroughPoints_6 = Line.ByBestFitThroughPoints()  # unwired: bestFitPoints
code_block_118 = CodeBlock { 0.5; }
pointAtParameter_20 = Surface.PointAtParameter(surface=code_block_117, v=code_block_118)
code_block_119 = CodeBlock { 1; 0.5; }
pointAtParameter_21 = Surface.PointAtParameter(surface=code_block_117, u=code_block_119.out0, v=code_block_119.out1)
list_create_8 = List.Create(item0=pointAtParameter_20, item1=pointAtParameter_21)
flatten_22 = List.Flatten(list=list_create_8)
function_apply_16 = ApplyFunction(func=byBestFitThroughPoints_6, arg1=flatten_22)
code_block_120 = CodeBlock(l=function_apply_16)  # same code as code_block_15
code_block_121 = CodeBlock { 90; 0.5; }
planeAtParameter_3 = Curve.PlaneAtParameter(curve=code_block_120.out1, param=code_block_121.out1)
rotate_3 = Geometry.Rotate(geometry=flipNormalDirection_6, basePlane=planeAtParameter_3, degrees=code_block_121.out0)
code_block_122 = CodeBlock { 0.5; }
normalAtParameter_8 = Surface.NormalAtParameter(surface=rotate_3, u=code_block_122, v=code_block_122)
code_block_123 = CodeBlock(x=code_block_100) { x; }
getCategory_3 = Element.GetCategory()  # unwired: element
function_apply_17 = ApplyFunction(func=getCategory_3, arg1=code_block_123)
string_from_object_5 = FromObject(obj=function_apply_17)
code_block_124 = CodeBlock { "Walls"; }
eq_3 = string_from_object_5 == code_block_124
code_block_125 = CodeBlock(l=eq_3)  # same code as code_block_39
filterByBoolMask_5 = List.FilterByBoolMask(list=code_block_123, mask=code_block_125.out1)
geometry_6 = Element.Geometry(element=filterByBoolMask_5.in)
flatten_23 = List.Flatten(list=geometry_6)
code_block_126 = CodeBlock { 0.2; }
pointAtParameter_22 = Curve.PointAtParameter(curve=splitByPoints_3, param=code_block_126)
doesIntersect_3 = Geometry.DoesIntersect(geometry=flatten_23@L1, other=pointAtParameter_22@L2, lacing=Longest)
o_list_anytrue_3 = Orchid.Common.List.AnyTrue(list=doesIntersect_3)
filterByBoolMask_6 = List.FilterByBoolMask(list=filterByBoolMask_5.in, mask=o_list_anytrue_3)
code_block_127 = CodeBlock(t6=filterByBoolMask_6.in)  # same code as code_block_41
translate_8 = Geometry.Translate(geometry=splitByPoints_3, direction=normalAtParameter_8, distance=code_block_127.t7, lacing=Longest)
function_apply_18 = ApplyFunction(func=lastItem, arg1=translate_8)
code_block_128 = CodeBlock(x=code_block_99) { x[3]; }
element_types_ᶜᵒⁿᵛᵉʳᵗᵉᵈ_ᵈʳᵒᵖᵈᵒʷⁿ_5 = CodeBlock { DSCore.Types.FindTypeByNameInAssembly("RebarHookType", "RevitAPI"); }
all_elements_of_type_5 = ElementsOfType(element_type=element_types_ᶜᵒⁿᵛᵉʳᵗᵉᵈ_ᵈʳᵒᵖᵈᵒʷⁿ_5)
rebar_hook_type_at_start_2 = CodeBlock(t3=all_elements_of_type_5)  # same code as rebar_hook_type_at_start
direction_6 = Line.Direction(line=code_block_120.out1)
Z_6 = Vector.Z(vector=direction_6)
code_block_129 = CodeBlock { 0; }
lt_6 = Z_6 < code_block_129
code_block_130 = CodeBlock { "Left"; "Right"; }
if_6 = If(test=lt_6, true=code_block_130.out0, false=code_block_130.out1)
lastItem_2 = List.LastItem()  # unwired: list
function_apply_19 = ApplyFunction(func=lastItem_2, arg1=filterByBoolMask_6.in)
reverse_6 = Vector.Reverse(vector=normalAtParameter_8)
code_block_131 = CodeBlock(curves=function_apply_18, rebarBarType=code_block_128, endHookType=rebar_hook_type_at_start_2.t5, startHookOrientation=if_6, endtHookOrientation=if_6, hostElement=function_apply_19, vector=reverse_6)
# ---------- code_block_131.designscript (18 lines) ----------
//curves
curves;
//rebarStyle
"Standard";
//rebarBarType
rebarBarType;
//startHookType
null;
//endHookType
endHookType;
//startHookOrientation
startHookOrientation;
//endtHookOrientation
endtHookOrientation;
//hostElement
hostElement;
//vector
vector;
# ----------------------------------------
fromCurves_3 = StructuralDesign.Rebar.Create.FromCurves(curves=code_block_131.curves@L1, rebarStyle=code_block_131.out1@L1, rebarBarType=code_block_131.rebarBarType@L1, startHookType=code_block_131.out3@L1, endHookType=code_block_131.endHookType@L1, startHookOrientation=code_block_131.startHookOrientation@L1, endHookOrientation=code_block_131.endtHookOrientation@L1, hostElement=code_block_131.hostElement@L1, vector=code_block_131.vector@L1, lacing=Longest)
code_block_132 = CodeBlock(t2=filterByBoolMask_6.in)  # same code as code_block_46
code_block_133 = CodeBlock(x=code_block_99) { x[4]; }
setLayoutAsFixedNumber_3 = StructuralDesign.Rebar.Layout.SetLayoutAsFixedNumber(rebar=fromCurves_3, arrayLength=code_block_132.t4, numberOfBarPositions=code_block_133)
element_types_ᶜᵒⁿᵛᵉʳᵗᵉᵈ_ᵈʳᵒᵖᵈᵒʷⁿ_6 = CodeBlock { DSCore.Types.FindTypeByNameInAssembly("RebarShape", "RevitAPI"); }
all_elements_of_type_6 = ElementsOfType(element_type=element_types_ᶜᵒⁿᵛᵉʳᵗᵉᵈ_ᵈʳᵒᵖᵈᵒʷⁿ_6)
code_block_134 = CodeBlock(t1=all_elements_of_type_6)  # same code as code_block_48
setParameterByName_3 = Element.SetParameterByName(element=setLayoutAsFixedNumber_3, parameterName=code_block_134.out0, value=code_block_134.t4, lacing=Longest)
rebarCenterlineCurves_3 = StructuralDesign.Rebar.Properties.RebarCenterlineCurves(rebar=setParameterByName_3)
code_block_135 = CodeBlock(x=code_block_99) { x[5]; }
string_from_object_6 = FromObject(obj=code_block_135)
traslapo_armadura_5 = CodeBlock(capa=string_from_object_6)  # same code as traslapo_armadura_2
pointAtParameter_23 = Curve.PointAtParameter(curve=rebarCenterlineCurves_3, param=traslapo_armadura_5.t3)
flatten_24 = List.Flatten(list=pointAtParameter_23)
code_block_136 = CodeBlock()  # same code as code_block_50
create_tag_3 = Custom[Create Tag](view=o_document_activeview_4@L1, element=setParameterByName_3@L1, TagLocation=flatten_24@L1, TagType=code_block_136.familytype1@L1, addLeader=code_block_136.out2@L1, RunIt=code_block_136.out3@L1, lacing=Longest)
flatten_25 = List.Flatten(list=create_tag_3)
code_block_137 = CodeBlock(x=code_block_99) { x[1]; }
code_block_138 = CodeBlock(x=code_block_137) { x; }
code_block_139 = CodeBlock { 0.5; }
normalAtParameter_9 = Surface.NormalAtParameter(surface=code_block_138, u=code_block_139, v=code_block_139)
code_block_140 = CodeBlock { 600; }
translate_9 = Geometry.Translate(geometry=code_block_138, direction=normalAtParameter_9, distance=code_block_140)
code_block_141 = CodeBlock { 0.5; }
pointAtParameter_24 = Surface.PointAtParameter(surface=translate_9, u=code_block_141, v=code_block_141)
byOriginNormal_6 = Plane.ByOriginNormal(origin=pointAtParameter_24, normal=normalAtParameter_9)
ꟿ_point_pullontoplane_3 = Custom[ꟿ Point.PullOntoPlane](point=flatten_24, plane=byOriginNormal_6)
tag_setlocation_3 = Custom[Tag SetLocation](tag=flatten_25, location=ꟿ_point_pullontoplane_3)
list_create_9 = List.Create(item0=tag_setlocation, item1=tag_setlocation_2, item2=tag_setlocation_3)
firstItem_3 = List.FirstItem(list=list_create_9)
o_datastream_await = Orchid.Common.DataStream.Await(pass=code_block_2, waitFor=firstItem_3)
byName = Category.ByName(name=o_datastream_await)
o_document_activeview_5 = Orchid.RevitProject.Common.Document.ActiveView()
all_elements_of_category_in_view = ElementsOfCategoryInView(Category=byName, View=o_document_activeview_5)
code_block_142 = CodeBlock { "Shape"; }
getParameterValueByName = Element.GetParameterValueByName(element=all_elements_of_category_in_view, parameterName=code_block_142)
name = Element.Name(element=getParameterValueByName)
code_block_143 = CodeBlock()
# ---------- code_block_143.designscript (4 lines) ----------
[
"R_S_00",
"R_S_01"
];
# ----------------------------------------
eq_4 = name@L1 == code_block_143@L2  # lacing=Longest
o_list_anytrue_4 = Orchid.Common.List.AnyTrue(list=eq_4@L2)
filterByBoolMask_7 = List.FilterByBoolMask(list=all_elements_of_category_in_view, mask=o_list_anytrue_4)
rebarCenterlineCurves_4 = StructuralDesign.Rebar.Properties.RebarCenterlineCurves(rebar=filterByBoolMask_7.in)
flatten_26 = List.Flatten(list=rebarCenterlineCurves_4)
intersect_7 = Geometry.Intersect(geometry=flatten_26@L1, other=flatten_26@L2, lacing=Longest)
flatten_27 = List.Flatten(list=intersect_7)
length = Curve.Length(curve=flatten_27)
code_block_144 = CodeBlock { [570, 710, 860, 1140, 1290, 1960, 2230, 2500, 2850, 3210]; }
eq_5 = length@L1 == code_block_144@L2  # lacing=Longest
o_list_anytrue_5 = Orchid.Common.List.AnyTrue(list=eq_5@L2)
filterByBoolMask_8 = List.FilterByBoolMask(list=flatten_27, mask=o_list_anytrue_5)
pruneDuplicates = Custom[Geometry.PruneDuplicates](GeometryList=filterByBoolMask_8.in)  # package Data-Shapes; Removes all duplicate geometries from list.
o_document_activeview_6 = Orchid.RevitProject.Common.Document.ActiveView()
plane = Custom[View.Plane](view=o_document_activeview_6)  # package Clockwork for Dynamo 2.x; Retrieves the plane of a given view
pullOntoPlane = Curve.PullOntoPlane(curve=pruneDuplicates, plane=plane)
family_types_ᶜᵒⁿᵛᵉʳᵗᵉᵈ_ᵈʳᵒᵖᵈᵒʷⁿ = CodeBlock { Revit.Elements.FamilyType.ByName("EST_D_DEATIL ITEM_EMPALME"); }
o_document_activeview_7 = Orchid.RevitProject.Common.Document.ActiveView()
byCurve = Custom[DetailComponent.ByCurve](curve=pullOntoPlane, familyType=family_types_ᶜᵒⁿᵛᵉʳᵗᵉᵈ_ᵈʳᵒᵖᵈᵒʷⁿ, view=o_document_activeview_7)  # package Clockwork for Dynamo 2.x; Places a line-based detail component in a given view
end = Revit.Transaction.Transaction.End(input=byCurve)
familyinstance_2d_geometry = Custom[FamilyInstance 2D Geometry](element=end)  # package Genius Loci; Gets the curves of the family instance. Works only with the family categories : Generic Annotation and Detail Item.
code_block_145 = CodeBlock { [1, 3]; }
getItemAtIndex_4 = List.GetItemAtIndex(list=familyinstance_2d_geometry@L2, index=code_block_145)
code_block_146 = CodeBlock { 0.5; }
pointAtParameter_25 = Curve.PointAtParameter(curve=getItemAtIndex_4, param=code_block_146)
byBestFitThroughPoints_7 = Line.ByBestFitThroughPoints(bestFitPoints=pointAtParameter_25@L2)
byJoinedCurves = PolyCurve.ByJoinedCurves(curves=familyinstance_2d_geometry)
byPatch = Surface.ByPatch(closedCurve=byJoinedCurves)
code_block_147 = CodeBlock { 0.5; }
normalAtParameter_10 = Surface.NormalAtParameter(surface=byPatch, u=code_block_147, v=code_block_147)
byLine = StructuralDesign.Model.Geom.Vector.ByLine(line=byBestFitThroughPoints_7)
code_block_148 = CodeBlock { 90; }
rotate_4 = Vector.Rotate(vector=normalAtParameter_10, axis=byLine, degrees=code_block_148)
code_block_149 = CodeBlock { 300; }
translate_10 = Geometry.Translate(geometry=byBestFitThroughPoints_7, direction=rotate_4, distance=code_block_149)
code_block_150 = CodeBlock { "Right"; }
familyinstance_reference_byname = Custom[FamilyInstance Reference ByName](familyInstance=end, name=code_block_150)  # package Genius Loci; Works only in Revit 2018.1 and later. Gets the reference corresponding to the named reference plane in the instance's family.
code_block_151 = CodeBlock { "Left"; }
familyinstance_reference_byname_2 = Custom[FamilyInstance Reference ByName](familyInstance=end, name=code_block_151)
list_create_10 = List.Create(item0=familyinstance_reference_byname.Reference, item1=familyinstance_reference_byname_2.Reference)
transpose = List.Transpose(lists=list_create_10)
element_types_ᶜᵒⁿᵛᵉʳᵗᵉᵈ_ᵈʳᵒᵖᵈᵒʷⁿ_7 = CodeBlock { DSCore.Types.FindTypeByNameInAssembly("DimensionType", "RevitAPI"); }
all_elements_of_type_7 = ElementsOfType(element_type=element_types_ᶜᵒⁿᵛᵉʳᵗᵉᵈ_ᵈʳᵒᵖᵈᵒʷⁿ_7)
name_2 = Element.Name(element=all_elements_of_type_7)
code_block_152 = CodeBlock { "Linear - 2.5mm Arial"; }
eq_6 = name_2 == code_block_152
filterByBoolMask_9 = List.FilterByBoolMask(list=all_elements_of_type_7, mask=eq_6)
dimension_byreferences = Custom[Dimension ByReferences](view=o_document_activeview@L1, line=translate_10@L1, references=transpose@L2, dimensionType=filterByBoolMask_9.in@L1, lacing=Longest)  # package Genius Loci; Creates a new linear dimension from at least two geometric references of an object.
end_2 = Revit.Transaction.Transaction.End(input=dimension_byreferences)
code_block_153 = CodeBlock()
# ---------- code_block_153.designscript (6 lines) ----------
[
"Structural Columns",
"Structural Foundations",
"Structural Framing",
"Walls"
];
# ----------------------------------------
byName_2 = Category.ByName(name=code_block_153)
o_document_activeview_8 = Orchid.RevitProject.Common.Document.ActiveView()
all_elements_of_category_in_view_2 = ElementsOfCategoryInView(Category=byName_2, View=o_document_activeview_8)
flatten_28 = List.Flatten(list=all_elements_of_category_in_view_2)
geometry_7 = Element.Geometry(element=flatten_28)
flatten_29 = List.Flatten(list=geometry_7)
byUnion_4 = Solid.ByUnion(solids=flatten_29)
ʳʰʸᵗʰᵐ_dimensions_getcurve = Rhythm.Revit.Elements.Dimensions.GetCurve(dimension=end_2)
flatten_30 = List.Flatten(list=ʳʰʸᵗʰᵐ_dimensions_getcurve)
code_block_154 = CodeBlock { 0.5; }
pointAtParameter_26 = Curve.PointAtParameter(curve=flatten_30, param=code_block_154)
code_block_155 = CodeBlock { 50; 500; 50; }
byLengths = Cuboid.ByLengths(origin=pointAtParameter_26, width=code_block_155.out0, length=code_block_155.out1, height=code_block_155.out2)
doesIntersect_4 = Geometry.DoesIntersect(geometry=byUnion_4@L1, other=byLengths@L2, lacing=Longest)
flatten_31 = List.Flatten(list=doesIntersect_4)
filterByBoolMask_10 = List.FilterByBoolMask(list=end_2, mask=flatten_31)
ʳʰʸᵗʰᵐ_dimensions = Rhythm.Revit.Elements.Dimensions.GetReferenceElements(dimension=filterByBoolMask_10.in)
flatten_32 = List.Flatten(list=ʳʰʸᵗʰᵐ_dimensions)
uniqueItems = List.UniqueItems(list=flatten_32)
familyinstance_2d_geometry_2 = Custom[FamilyInstance 2D Geometry](element=uniqueItems)
code_block_156 = CodeBlock { [1, 3]; }
getItemAtIndex_5 = List.GetItemAtIndex(list=familyinstance_2d_geometry_2@L2, index=code_block_156)
code_block_157 = CodeBlock { 0.5; }
pointAtParameter_27 = Curve.PointAtParameter(curve=getItemAtIndex_5, param=code_block_157)
byBestFitThroughPoints_8 = Line.ByBestFitThroughPoints(bestFitPoints=pointAtParameter_27@L2)
code_block_158 = CodeBlock { 0.5; }
pointAtParameter_28 = Curve.PointAtParameter(curve=byBestFitThroughPoints_8, param=code_block_158)
byJoinedCurves_2 = PolyCurve.ByJoinedCurves(curves=familyinstance_2d_geometry_2)
byPatch_2 = Surface.ByPatch(closedCurve=byJoinedCurves_2)
code_block_159 = CodeBlock { 0.5; }
normalAtParameter_11 = Surface.NormalAtParameter(surface=byPatch_2, u=code_block_159, v=code_block_159)
byLine_2 = StructuralDesign.Model.Geom.Vector.ByLine(line=byBestFitThroughPoints_8)
code_block_160 = CodeBlock { 90; }
rotate_5 = Vector.Rotate(vector=normalAtParameter_11, axis=byLine_2, degrees=code_block_160)
byOriginNormal_7 = Plane.ByOriginNormal(origin=pointAtParameter_28, normal=rotate_5)
mirror = Custom[Element.Mirror](element=filterByBoolMask_10.in@L1, plane=byOriginNormal_7@L1)  # package Clockwork for Dynamo 2.x; Mirrors an element about a given plane.
