# Dynamo graph armadura_sup_muro_script.dyn "armadura_horizontal" (Dynamo 2.6.2.15705)
# packages: Data-Shapes 2022.2.103, Structural Design 2021.1.22, Genius Loci 2021.11.10, Orchid 206.3.0.8161, Rhythm 2021.7.2, archi-lab.net 2022.210.2419

o_document_activeview = Orchid.RevitProject.Common.Document.ActiveView()
byBestFitThroughPoints = Line.ByBestFitThroughPoints()  # unwired: bestFitPoints
firstItem = List.FirstItem()  # unwired: list
code_block = CodeBlock { "Armadura Superior en Muro (Barra Unica)"; }
file_path = Filename("..\..\..\..\..\..\..\..\..\..\Arainco\Arainco.png")
code_block_2 = CodeBlock { "INICIAR"; "CANCELAR"; true; 430; 170; 650; }
categories_ᶜᵒⁿᵛᵉʳᵗᵉᵈ_ᵈʳᵒᵖᵈᵒʷⁿ = CodeBlock { "Seleccionar Muro a Armar"; "SELECCIONAR"; Revit.Category.ByName(["Walls","Structural Foundations"]); }
selectmodelelements_data = Custom[SelectModelElements Data](InputName=categories_ᶜᵒⁿᵛᵉʳᵗᵉᵈ_ᵈʳᵒᵖᵈᵒʷⁿ.out0, ButtonText=categories_ᶜᵒⁿᵛᵉʳᵗᵉᵈ_ᵈʳᵒᵖᵈᵒʷⁿ.out1, CategoryFilter=categories_ᶜᵒⁿᵛᵉʳᵗᵉᵈ_ᵈʳᵒᵖᵈᵒʷⁿ.out2)  # package Data-Shapes; Creates a Revit element selection input for UI.MultipleInputForm++ . Check out www.data-shapes.net for more infos!
code_block_3 = CodeBlock { "Datos de Armadura"; }
code_block_4 = CodeBlock { "Diametro"; }
element_types_ᶜᵒⁿᵛᵉʳᵗᵉᵈ_ᵈʳᵒᵖᵈᵒʷⁿ = CodeBlock { DSCore.Types.FindTypeByNameInAssembly("RebarBarType", "RevitAPI"); }
all_elements_of_type = ElementsOfType(element_type=element_types_ᶜᵒⁿᵛᵉʳᵗᵉᵈ_ᵈʳᵒᵖᵈᵒʷⁿ)
code_block_5 = CodeBlock(t5=all_elements_of_type)
# ---------- code_block_5.designscript (8 lines) ----------
t4 = t5;
t1 = t4;
num1 = Properties.RebarDiameter(t1);
t2 = DSCore.List.SortByKey(t1, num1);
t3 = Dictionary.ValueAtKey(t2, "sorted list");
str1 = Revit.Elements.Element.Name(t3);
0;
false;
# ----------------------------------------
dropdown_data = Custom[DropDown Data](InputName=code_block_4, Keys=code_block_5.str1, Values=code_block_5.t3, DefaultValueIndex=code_block_5.out6, Sorted_optional=code_block_5.out7)  # package Data-Shapes; Create data for DropDown input in UI.MultiInputForm ++ . Check out www.data-shapes.net for more infos.
code_block_6 = CodeBlock { "Cantidad de Barras"; "2"; true; }
textbox_data = Custom[TextBox Data](InputName=code_block_6.out0, DefaultText=code_block_6.out1, IsNumberEntry=code_block_6.out2)  # package Data-Shapes; Create Data for TextBox input in UI.MultipleInputForm ++ . Check out www.data-shapes.net for more informations
code_block_7 = CodeBlock { "Capa"; ["1ª Capa", "2ª Capa", "3ª Capa", "4ª Capa", "5ª Capa"]; [40, 90, 140, 190, 240]; 0; }
dropdown_data_2 = Custom[DropDown Data](InputName=code_block_7.out0, Keys=code_block_7.out1, Values=code_block_7.out2, DefaultValueIndex=code_block_7.out3)
list_create = List.Create(item0=dropdown_data, item1=textbox_data, item2=dropdown_data_2)
inputgroup_data = Custom[InputGroup Data](GroupTitle=code_block_3, Inputs=list_create)  # package Data-Shapes; Creates a group of inputs for UI.MultipleInputForm ++ . Check out www.data-shapes.net for more infos !
list_create_2 = List.Create(item0=selectmodelelements_data, item1=inputgroup_data)
multipleinputform = Custom[MultipleInputForm ++](Description_optional=code_block, Logo_optional=file_path, ButtonText_optional=code_block_2.out0, Inputs=list_create_2, Toggle=code_block_2.out2, CancelButtonText_optional=code_block_2.out1, MaxHeight_optional=code_block_2.out5, Width_optional=code_block_2.out3, LabelWidth_optional=code_block_2.out4)  # package Data-Shapes; Create a form with multiple inputs. see www.data-shapes.net for tutorials and infos!
code_block_8 = CodeBlock(l=multipleinputform.User_Inputs)
# ---------- code_block_8.designscript (12 lines) ----------
l;
[Imperative]
{
	if (l == null)
	{
		return = [[],[],[],[],[],[]];
	}
	else
	{
		return = l;
	}
};
# ----------------------------------------
code_block_9 = CodeBlock(x=code_block_8.out1) { x; }
code_block_10 = CodeBlock(x=code_block_9) { x[0]; }
geometry = Element.Geometry(element=code_block_10)
flatten = List.Flatten(list=geometry)
faces = Topology.Faces(topology=flatten)
surfaceGeometry = Face.SurfaceGeometry(face=faces)
flatten_2 = List.Flatten(list=surfaceGeometry)
code_block_11 = CodeBlock { 0.5; }
normalAtParameter = Surface.NormalAtParameter(surface=flatten_2, u=code_block_11, v=code_block_11)
ZAxis = Vector.ZAxis()
isAlmostEqualTo = Vector.IsAlmostEqualTo(vector=normalAtParameter, other=ZAxis)
filterByBoolMask = List.FilterByBoolMask(list=flatten_2, mask=isAlmostEqualTo)
function_apply = ApplyFunction(func=firstItem, arg1=filterByBoolMask.in)
code_block_12 = CodeBlock(l=function_apply)
# ---------- code_block_12.designscript (12 lines) ----------
l;
[Imperative]
{
	if (l == null)
	{
		return = [];
	}
	else
	{
		return = l;
	}
};
# ----------------------------------------
flipNormalDirection = Surface.FlipNormalDirection(surface=code_block_12.out1)
code_block_13 = CodeBlock { 0.5; }
normalAtParameter_2 = Surface.NormalAtParameter(surface=flipNormalDirection, u=code_block_13, v=code_block_13)
code_block_14 = CodeBlock(x=code_block_9) { x[1]; x[0]; x[3]; x[2]; }
translate = Geometry.Translate(geometry=flipNormalDirection, direction=normalAtParameter_2, distance=code_block_14.out2)
code_block_15 = CodeBlock(x=translate) { x; }
code_block_16 = CodeBlock { [0, 1]; [0.5, 0.5]; }
pointAtParameter = Surface.PointAtParameter(surface=code_block_15, u=code_block_16.out0, v=code_block_16.out1)
function_apply_2 = ApplyFunction(func=byBestFitThroughPoints, arg1=pointAtParameter)
code_block_17 = CodeBlock(l=function_apply_2)  # same code as code_block_12
code_block_18 = CodeBlock { -20; }
extendStart = Curve.ExtendStart(curve=code_block_17.out1, distance=code_block_18)
extendEnd = Curve.ExtendEnd(curve=extendStart, distance=code_block_18)
code_block_19 = CodeBlock(x=translate) { x; }
code_block_20 = CodeBlock { 0.5; }
pointAtParameter_2 = Surface.PointAtParameter(surface=code_block_19, u=code_block_20, v=code_block_20)
byBestFitThroughPoints_2 = Line.ByBestFitThroughPoints()  # unwired: bestFitPoints
code_block_21 = CodeBlock { [0, 1]; [0.5, 0.5]; }
pointAtParameter_3 = Surface.PointAtParameter(surface=code_block_19, u=code_block_21.out0, v=code_block_21.out1)
function_apply_3 = ApplyFunction(func=byBestFitThroughPoints_2, arg1=pointAtParameter_3)
code_block_22 = CodeBlock(l=function_apply_3)  # same code as code_block_12
byLine = StructuralDesign.Model.Geom.Vector.ByLine(line=code_block_22.out1)
code_block_23 = CodeBlock { 90; }
rotate = Geometry.Rotate(geometry=code_block_19, origin=pointAtParameter_2, axis=byLine, degrees=code_block_23)
code_block_24 = CodeBlock { 0.5; }
normalAtParameter_3 = Surface.NormalAtParameter(surface=rotate, u=code_block_24, v=code_block_24)
code_block_25 = CodeBlock(t6=code_block_10)
# ---------- code_block_25.designscript (6 lines) ----------
t4 = t6;
t2 = t4;
t1 = Revit.Elements.Element.GetParameterValueByName(t2, "Type");
t3 = Revit.Elements.Element.GetParameterValueByName(t1, "Width");
t5 = t3 / 2;
t7 = t5 - 40;
# ----------------------------------------
translate_2 = Geometry.Translate(geometry=extendEnd, direction=normalAtParameter_3, distance=code_block_25.t7)
element_types_ᶜᵒⁿᵛᵉʳᵗᵉᵈ_ᵈʳᵒᵖᵈᵒʷⁿ_2 = CodeBlock { DSCore.Types.FindTypeByNameInAssembly("RebarHookType", "RevitAPI"); }
all_elements_of_type_2 = ElementsOfType(element_type=element_types_ᶜᵒⁿᵛᵉʳᵗᵉᵈ_ᵈʳᵒᵖᵈᵒʷⁿ_2)
rebar_hook_type_at_start = CodeBlock(t3=all_elements_of_type_2)
# ---------- rebar_hook_type_at_start.designscript (5 lines) ----------
t1 = t3;
str2 = Revit.Elements.Element.Name(t1);
t2 = str2 == "Standard - 90 deg.";
t4 = DSCore.List.FilterByBoolMask(t3, t2);
t5 = Dictionary.ValueAtKey(t4, "in");
# ----------------------------------------
reverse = Vector.Reverse(vector=normalAtParameter_3)
code_block_26 = CodeBlock(curves=translate_2, rebarBarType=code_block_14.out0, startHookType=rebar_hook_type_at_start.t5, endHookType=rebar_hook_type_at_start.t5, hostElement=code_block_14.out1, vector=reverse)
# ---------- code_block_26.designscript (18 lines) ----------
//curves
curves;
//rebarStyle
"Standard";
//rebarBarType
rebarBarType;
//startHookType
startHookType;
//endHookType
endHookType;
//startHookOrientation
"Right";
//endtHookOrientation
"Right";
//hostElement
hostElement;
//vector
vector;
# ----------------------------------------
fromCurves = StructuralDesign.Rebar.Create.FromCurves(curves=code_block_26.curves@L1, rebarStyle=code_block_26.out1@L1, rebarBarType=code_block_26.rebarBarType@L1, startHookType=code_block_26.startHookType@L1, endHookType=code_block_26.endHookType@L1, startHookOrientation=code_block_26.out5@L1, endHookOrientation=code_block_26.out6@L1, hostElement=code_block_26.hostElement@L1, vector=code_block_26.vector@L1, lacing=Longest)
code_block_27 = CodeBlock(t2=code_block_14.out1)
# ---------- code_block_27.designscript (3 lines) ----------
t1 = Revit.Elements.Element.GetParameterValueByName(t2, "Type");
t3 = Revit.Elements.Element.GetParameterValueByName(t1, "Width");
t4 = t3 - 80;
# ----------------------------------------
setLayoutAsFixedNumber = StructuralDesign.Rebar.Layout.SetLayoutAsFixedNumber(rebar=fromCurves, arrayLength=code_block_27.t4, numberOfBarPositions=code_block_14.out3)
code_block_28 = CodeBlock(x=setLayoutAsFixedNumber) { x; }
rebarCenterlineCurves = StructuralDesign.Rebar.Properties.RebarCenterlineCurves(rebar=code_block_28)
flatten_3 = List.Flatten(list=rebarCenterlineCurves)
code_block_29 = CodeBlock { 0.1; }
pointAtParameter_4 = Curve.PointAtParameter(curve=flatten_3, param=code_block_29)
code_block_30 = CodeBlock()
# ---------- code_block_30.designscript (4 lines) ----------
family1 = Revit.Family.ByName("EST_A_STRUCTURAL REBAR TAG_STANDAR");
familytype1 = Revit.Elements.FamilyType.ByFamilyAndName(family1, "R_S_02");
false;
true;
# ----------------------------------------
create_tag = Custom[Create Tag](view=o_document_activeview, element=code_block_28, TagLocation=pointAtParameter_4, TagType=code_block_30.familytype1, addLeader=code_block_30.out2, RunIt=code_block_30.out3)  # package Genius Loci; Works only in Revit 2018 and later. Creates a tag at a given location, of given type and in a supplied view. The node also works with Linked Elements (except space and area), Multi Category tag and Material Tag. Based on an archilab node
ʳʰʸᵗʰᵐ_tags_getheadposition = Rhythm.Revit.Elements.Tags.GetHeadPosition(tag=create_tag)
code_block_31 = CodeBlock { 0.5; }
normalAtParameter_4 = Surface.NormalAtParameter(surface=code_block_12.out1, u=code_block_31, v=code_block_31)
code_block_32 = CodeBlock { 400; }
translate_3 = Geometry.Translate(geometry=ʳʰʸᵗʰᵐ_tags_getheadposition, direction=normalAtParameter_4, distance=code_block_32)
planeAtParameter = Curve.PlaneAtParameter(curve=flatten_3)
normal = Plane.Normal(plane=planeAtParameter)
code_block_33 = CodeBlock { 600; }
translate_4 = Geometry.Translate(geometry=translate_3, direction=normal, distance=code_block_33)
tag_setlocation = Custom[Tag SetLocation](tag=create_tag, location=translate_4)  # package Genius Loci; Moves the head of the tag to the given location point.
code_block_34 = CodeBlock { "Free"; }
setLeader = archilab.Revit.Elements.Tags.SetLeader(tag=tag_setlocation, leaderEnd=pointAtParameter_4, leaderElbow=translate_3, leaderEndCondition=code_block_34)
