# Dynamo graph arm_empotrada_segmentoUnico_script.dyn (Dynamo 2.6.2.15705)
# packages: Data-Shapes 2022.2.103, Structural Design 2021.1.22, Genius Loci 2021.11.10, Orchid 206.3.0.8161, Clockwork for Dynamo 2.x 2.4.0

o_document_activeview = Orchid.RevitProject.Common.Document.ActiveView()
code_block = CodeBlock { "Empotrada Pata Superior Segmento Unico"; }
file_path = Filename("..\..\..\..\..\..\..\..\..\..\Arainco\Arainco.png")
code_block_2 = CodeBlock { "INICIAR"; "CANCELAR"; true; 430; 170; 650; }
categories_ᶜᵒⁿᵛᵉʳᵗᵉᵈ_ᵈʳᵒᵖᵈᵒʷⁿ = CodeBlock { "Seleccionar Muros a Armar"; "SELECCIONAR"; Revit.Category.ByName(["Walls","Structural Foundations"]); }
selectmodelelements_data = Custom[SelectModelElements Data](InputName=categories_ᶜᵒⁿᵛᵉʳᵗᵉᵈ_ᵈʳᵒᵖᵈᵒʷⁿ.out0, ButtonText=categories_ᶜᵒⁿᵛᵉʳᵗᵉᵈ_ᵈʳᵒᵖᵈᵒʷⁿ.out1, CategoryFilter=categories_ᶜᵒⁿᵛᵉʳᵗᵉᵈ_ᵈʳᵒᵖᵈᵒʷⁿ.out2)  # package Data-Shapes; Creates a Revit element selection input for UI.MultipleInputForm++ . Check out www.data-shapes.net for more infos!
code_block_3 = CodeBlock { "Seleccionar Cara de\nDistribucion"; "SELECCIONAR"; }
selectfaces_data = Custom[SelectFaces Data](InputName=code_block_3.out0, ButtonText=code_block_3.out1)  # package Data-Shapes; Creates a Revit face selection input for UI.MultipleInputForm++. Check out www.data-shapes.net for more infos!
code_block_4 = CodeBlock { "Datos de Armadura"; }
code_block_5 = CodeBlock { "Diametro"; }
element_types_ᶜᵒⁿᵛᵉʳᵗᵉᵈ_ᵈʳᵒᵖᵈᵒʷⁿ = CodeBlock { DSCore.Types.FindTypeByNameInAssembly("RebarBarType", "RevitAPI"); }
all_elements_of_type = ElementsOfType(element_type=element_types_ᶜᵒⁿᵛᵉʳᵗᵉᵈ_ᵈʳᵒᵖᵈᵒʷⁿ)
code_block_6 = CodeBlock(t5=all_elements_of_type)
# ---------- code_block_6.designscript (8 lines) ----------
t4 = t5;
t1 = t4;
num1 = Properties.RebarDiameter(t1);
t2 = DSCore.List.SortByKey(t1, num1);
t3 = Dictionary.ValueAtKey(t2, "sorted list");
str1 = Revit.Elements.Element.Name(t3);
0;
false;
# ----------------------------------------
dropdown_data = Custom[DropDown Data](InputName=code_block_5, Keys=code_block_6.str1, Values=code_block_6.t3, DefaultValueIndex=code_block_6.out6, Sorted_optional=code_block_6.out7)  # package Data-Shapes; Create data for DropDown input in UI.MultiInputForm ++ . Check out www.data-shapes.net for more infos.
code_block_7 = CodeBlock { "Cantidad de Barras"; "2"; true; }
textbox_data = Custom[TextBox Data](InputName=code_block_7.out0, DefaultText=code_block_7.out1, IsNumberEntry=code_block_7.out2)  # package Data-Shapes; Create Data for TextBox input in UI.MultipleInputForm ++ . Check out www.data-shapes.net for more informations
code_block_8 = CodeBlock { "Capa"; ["1ª Capa", "2ª Capa", "3ª Capa", "4ª Capa", "5ª Capa"]; [40, 140, 240, 340, 440]; 0; }
dropdown_data_2 = Custom[DropDown Data](InputName=code_block_8.out0, Keys=code_block_8.out1, Values=code_block_8.out2, DefaultValueIndex=code_block_8.out3)
list_create = List.Create(item0=dropdown_data, item1=textbox_data, item2=dropdown_data_2)
inputgroup_data = Custom[InputGroup Data](GroupTitle=code_block_4, Inputs=list_create)  # package Data-Shapes; Creates a group of inputs for UI.MultipleInputForm ++ . Check out www.data-shapes.net for more infos !
list_create_2 = List.Create(item0=selectmodelelements_data, item1=selectfaces_data, item2=inputgroup_data)
multipleinputform = Custom[MultipleInputForm ++](Description_optional=code_block, Logo_optional=file_path, ButtonText_optional=code_block_2.out0, Inputs=list_create_2, Toggle=code_block_2.out2, CancelButtonText_optional=code_block_2.out1, MaxHeight_optional=code_block_2.out5, Width_optional=code_block_2.out3, LabelWidth_optional=code_block_2.out4)  # package Data-Shapes; Create a form with multiple inputs. see www.data-shapes.net for tutorials and infos!
code_block_9 = CodeBlock(l=multipleinputform.User_Inputs)
# ---------- code_block_9.designscript (12 lines) ----------
l;
[Imperative]
{
	if (l == null)
	{
		return = [[],[],[],[],[],[],[]];
	}
	else
	{
		return = l;
	}
};
# ----------------------------------------
code_block_10 = CodeBlock(x=code_block_9.out1) { x; }
code_block_11 = CodeBlock(muros=code_block_10) { muros[0]; }
o_document_activeview_2 = Orchid.RevitProject.Common.Document.ActiveView()
plane = Custom[View.Plane](view=o_document_activeview_2)  # package Clockwork for Dynamo 2.x; Retrieves the plane of a given view
code_block_12 = CodeBlock(muros=code_block_11, view_plane=plane)
# ---------- code_block_12.designscript (16 lines) ----------
muros;
category = Revit.Elements.Element.GetCategory(muros);
category_name = Revit.Category.Name(category);
mask = category_name == "Walls";
element = DSCore.List.FilterByBoolMask(muros, mask)["in"];
element_type = Revit.Elements.Element.GetParameterValueByName(element, "Type");
element_width = Revit.Elements.Element.GetParameterValueByName(element_type, "Width");
dist_traslacion_curva = (element_width[0] / 2) - 40;
view_plane;
view_plane_normal = Autodesk.Plane.Normal(view_plane);
elem_geom = Revit.Elements.Element.Geometry(muros);
elem_geom_flat = DSCore.List.Flatten(elem_geom, -1);
centroid_geom = Autodesk.Solid.Centroid(elem_geom_flat);
plane = Autodesk.Plane.ByOriginNormal(centroid_geom, view_plane_normal);
elem_geom_scaled = Autodesk.Geometry.Scale(elem_geom_flat, plane, 1, 5, 1);
elem_geom_union = Autodesk.Solid.ByUnion(elem_geom_scaled);
# ----------------------------------------
code_block_13 = CodeBlock(capa=code_block_10) { capa[4]; }
code_block_14 = CodeBlock(distribucion=code_block_10) { distribucion[1]; }
code_block_15 = CodeBlock(capa=code_block_13, distribucion=code_block_14)
# ---------- code_block_15.designscript (10 lines) ----------
capa;
distribucion;

vector1 = Autodesk.Surface.NormalAtParameter(distribucion, 0.5, 0.5);
vector2 = Autodesk.Vector.Reverse(vector1);
surface = Autodesk.Geometry.Translate(distribucion, vector2, capa)[0];
point = Autodesk.Surface.PointAtParameter(surface, 0.5, 0.5);
surface_normal = Autodesk.Surface.NormalAtParameter(surface, 0.5, 0.5);
plane = Autodesk.Plane.ByOriginNormal(point, Autodesk.Vector.ZAxis());
scaled_surface = Autodesk.Geometry.Scale(surface, plane, 1, 1, 50);
# ----------------------------------------
code_block_16 = CodeBlock(solid=code_block_12.elem_geom_union, plane_cut=code_block_15.scaled_surface)
# ---------- code_block_16.designscript (13 lines) ----------
solid;
plane_cut;

geometry1 = Autodesk.Geometry.Intersect(solid, plane_cut);
point1 = Autodesk.Surface.PointAtParameter(geometry1, 0.5, 0.5);
vector1 = Autodesk.Vector.ZAxis();
geometry2 = Autodesk.Geometry.Rotate(geometry1, point1, vector1, 90);
geometry11 = geometry2;
point11 = Autodesk.Surface.PointAtParameter(geometry11, 0.5, 0.5);
vector11 = Autodesk.Surface.NormalAtPoint(geometry11, point11);
plane1 = Autodesk.Plane.ByOriginNormal(point11, vector11);
geometry3 = Autodesk.Geometry.Scale(geometry2, plane1, 1, 15, 1);
geometry4 = Autodesk.Geometry.Intersect(geometry1, plane1)[0];
# ----------------------------------------
control_de_flujo = Python(IN[0]=code_block_16.geometry4)
# ---------- control_de_flujo.python (9 lines) ----------
var = IN[0]
lst = None

if var == lst:
	x = [] 
else:
	x = var

OUT = x
# ----------------------------------------
code_block_17 = CodeBlock(t1=control_de_flujo)
# ---------- code_block_17.designscript (4 lines) ----------
vector1 = Autodesk.Vector.ZAxis();
vector2 = StructuralDesign.Vector.ByLine(t1);
bool1 = Autodesk.Vector.IsAlmostEqualTo(vector1, vector2);
curve1 = Autodesk.Curve.Reverse(t1);
# ----------------------------------------
if_ = If(test=code_block_17.bool1, true=code_block_17.curve1, false=control_de_flujo)
reverse = Curve.Reverse(curve=if_)
code_block_18 = CodeBlock { -20; }
extendEnd = Curve.ExtendEnd(curve=reverse, distance=code_block_18)
normal_para_posicionamiento_de = Python(IN[0]=code_block_16.vector11)  # "Normal para Posicionamiento de Barra"
# ---------- normal_para_posicionamiento_de.python (9 lines) ----------
var = IN[0]
lst = []

if var == lst:
	x = [] 
else:
	x = var[0]

OUT = x
# ----------------------------------------
translate = Geometry.Translate(geometry=extendEnd, direction=normal_para_posicionamiento_de, distance=code_block_12.dist_traslacion_curva, lacing=Longest)
code_block_19 = CodeBlock(tip_barra=code_block_10) { tip_barra[2]; }
traslapo_armadura = CodeBlock(rebar=code_block_19)
# ---------- traslapo_armadura.designscript (5 lines) ----------
diametro_barra = Strings.ToString(Properties.RebarDiameter(rebar),"");
key = ["8","10","12","16","18","22","25","28","32","36"];
val = [570, 710, 860, 1140, 1290, 1960, 2230, 2500, 2850, 3210];
dict_traslapo = Dictionary.ByKeysValues(key, val);
t3 = Dictionary.ValueAtKey(dict_traslapo, diametro_barra);
# ----------------------------------------
extendStart = Curve.ExtendStart(curve=translate, distance=traslapo_armadura.t3)
code_block_20 = CodeBlock(tip_barra=code_block_10) { tip_barra[2]; }
element_types_ᶜᵒⁿᵛᵉʳᵗᵉᵈ_ᵈʳᵒᵖᵈᵒʷⁿ_2 = CodeBlock { DSCore.Types.FindTypeByNameInAssembly("RebarHookType", "RevitAPI"); }
all_elements_of_type_2 = ElementsOfType(element_type=element_types_ᶜᵒⁿᵛᵉʳᵗᵉᵈ_ᵈʳᵒᵖᵈᵒʷⁿ_2)
rebar_hook_type_at_start = CodeBlock(t3=all_elements_of_type_2)
# ---------- rebar_hook_type_at_start.designscript (5 lines) ----------
t1 = t3;
str2 = Revit.Elements.Element.Name(t1);
t2 = str2 == "Standard - 90 deg.";
t4 = DSCore.List.FilterByBoolMask(t3, t2);
t5 = Dictionary.ValueAtKey(t4, "in");
# ----------------------------------------
reverse_2 = Vector.Reverse(vector=normal_para_posicionamiento_de)
code_block_21 = CodeBlock(curves=extendStart, rebarBarType=code_block_20, endHookType=rebar_hook_type_at_start.t5, hostElement=code_block_12.element, vector=reverse_2)
# ---------- code_block_21.designscript (18 lines) ----------
//curves
curves;
//rebarStyle
"Standard";
//rebarBarType
rebarBarType;
//startHookType
null;
//endHookType
endHookType;
//startHookOrientation
"Left";
//endtHookOrientation
"Left";
//hostElement
hostElement[0];
//vector
vector;
# ----------------------------------------
fromCurves = StructuralDesign.Rebar.Create.FromCurves(curves=code_block_21.curves@L1, rebarStyle=code_block_21.out1@L1, rebarBarType=code_block_21.rebarBarType@L1, startHookType=code_block_21.out3@L1, endHookType=code_block_21.endHookType@L1, startHookOrientation=code_block_21.out5@L1, endHookOrientation=code_block_21.out6@L1, hostElement=code_block_21.out7@L1, vector=code_block_21.vector@L1, lacing=Longest)
element_types_ᶜᵒⁿᵛᵉʳᵗᵉᵈ_ᵈʳᵒᵖᵈᵒʷⁿ_3 = CodeBlock { DSCore.Types.FindTypeByNameInAssembly("RebarShape", "RevitAPI"); }
all_elements_of_type_3 = ElementsOfType(element_type=element_types_ᶜᵒⁿᵛᵉʳᵗᵉᵈ_ᵈʳᵒᵖᵈᵒʷⁿ_3)
code_block_22 = CodeBlock(t1=all_elements_of_type_3)
# ---------- code_block_22.designscript (5 lines) ----------
"Shape";
str2 = Revit.Elements.Element.Name(t1);
t2 = str2 == "R_S_01";
t3 = DSCore.List.FilterByBoolMask(t1, t2);
t4 = Dictionary.ValueAtKey(t3, "in");
# ----------------------------------------
setParameterByName = Element.SetParameterByName(element=fromCurves, parameterName=code_block_22.out0, value=code_block_22.t4, lacing=Longest)
code_block_23 = CodeBlock { "Capa"; }
string_from_object = FromObject(obj=code_block_13)
numero_de_capa = CodeBlock(capa=string_from_object)
# ---------- numero_de_capa.designscript (4 lines) ----------
key = ["40", "90", "140", "190", "240"];
val = ["1", "2", "3", "4", "5"];
dict_capa = Dictionary.ByKeysValues(key, val);
t3 = Dictionary.ValueAtKey(dict_capa, capa);
# ----------------------------------------
setParameterByName_2 = Element.SetParameterByName(element=setParameterByName, parameterName=code_block_23, value=numero_de_capa.t3)
desplazamiento_barra = CodeBlock(t2=code_block_12.element)
# ---------- desplazamiento_barra.designscript (3 lines) ----------
t1 = Revit.Elements.Element.GetParameterValueByName(t2[0], "Type");
t3 = Revit.Elements.Element.GetParameterValueByName(t1, "Width");
t4 = t3 - 80;
# ----------------------------------------
code_block_24 = CodeBlock(cant_barra=code_block_10) { cant_barra[3]; }
setLayoutAsFixedNumber = StructuralDesign.Rebar.Layout.SetLayoutAsFixedNumber(rebar=setParameterByName_2, arrayLength=desplazamiento_barra.t4, numberOfBarPositions=code_block_24)
code_block_25 = CodeBlock(t3=string_from_object)
# ---------- code_block_25.designscript (4 lines) ----------
t1 = ["40", "90", "140", "190", "240"];
t2 = [0.1, 0.2, 0.3, 0.4, 0.5];
dictionary1 = Dictionary.ByKeysValues(t1, t2);
t4 = Dictionary.ValueAtKey(dictionary1, t3);
# ----------------------------------------
code_block_26 = CodeBlock(distribucion=code_block_10) { distribucion[1]; }
plano_para_ajustar_tag = CodeBlock(t2=code_block_26)
# ---------- plano_para_ajustar_tag.designscript (6 lines) ----------
t1 = t2;
vector1 = Autodesk.Surface.NormalAtParameter(t1, 0.5, 0.5);
geometry1 = Autodesk.Geometry.Translate(t1, vector1, 900);
point1 = Autodesk.Surface.PointAtParameter(geometry1, 0.5, 0.5);
vector2 = Autodesk.Surface.NormalAtPoint(geometry1, point1);
plane1 = Autodesk.Plane.ByOriginNormal(point1, vector2);
# ----------------------------------------
code_block_27 = CodeBlock(element2=setLayoutAsFixedNumber, des_etiqueta=code_block_25.t4, plane1=plano_para_ajustar_tag.plane1)
# ---------- code_block_27.designscript (6 lines) ----------
element1 = element2;
curve1 = Properties.RebarCenterlineCurves(element1, false, true, true, true, 0);
t1 = DSCore.List.Flatten(curve1, -1);
point1 = Autodesk.Curve.PointAtParameter(t1, des_etiqueta);
t2 = DSCore.List.Flatten(point1, -1);
point2 = Points.PullOntoPlane(t2, plane1);
# ----------------------------------------
code_block_28 = CodeBlock()
# ---------- code_block_28.designscript (4 lines) ----------
family1 = Revit.Family.ByName("EST_A_STRUCTURAL REBAR TAG_STANDAR");
familytype1 = Revit.Elements.FamilyType.ByFamilyAndName(family1, "R_S_01");
true;
true;
# ----------------------------------------
create_tag = Custom[Create Tag](view=o_document_activeview@L1, element=setLayoutAsFixedNumber@L1, TagLocation=code_block_27.t2@L1, TagType=code_block_28.familytype1@L1, addLeader=code_block_28.out2@L1, RunIt=code_block_28.out3@L1, lacing=Longest)  # package Genius Loci; Works only in Revit 2018 and later. Creates a tag at a given location, of given type and in a supplied view. The node also works with Linked Elements (except space and area), Multi Category tag and Material Tag. Based on an archilab node
flatten = List.Flatten(list=create_tag)
tag_setlocation = Custom[Tag SetLocation](tag=flatten, location=code_block_27.point2)  # package Genius Loci; Moves the head of the tag to the given location point.
