# Dynamo graph script.dyn (Dynamo 2.6.2.15705)
# packages: Data-Shapes 2022.2.103, Structural Design 2021.1.22, Clockwork for Dynamo 2.x 2.4.0, Genius Loci 2021.11.10, Crumple 2022.2.13, Orchid 206.3.0.8161, BIM4Struc.Rebar 1.3.0

byLoft = Surface.ByLoft()  # unwired: crossSections
byJoinedCurves = PolyCurve.ByJoinedCurves()  # unwired: curves
code_block = CodeBlock { "Malla Final"; }
file_path = Filename("..\..\..\..\..\..\..\..\..\..\Arainco\Arainco.png")
code_block_2 = CodeBlock { "INICIAR"; "CANCELAR"; true; 430; 170; 650; }
categories_ᶜᵒⁿᵛᵉʳᵗᵉᵈ_ᵈʳᵒᵖᵈᵒʷⁿ = CodeBlock { "Seleccionar Muro"; "SELECCIONAR"; t1 = "Walls"; category1 = Revit.Category.ByName(t1); }
selectmodelelements_data = Custom[SelectModelElements Data](InputName=categories_ᶜᵒⁿᵛᵉʳᵗᵉᵈ_ᵈʳᵒᵖᵈᵒʷⁿ.out0, ButtonText=categories_ᶜᵒⁿᵛᵉʳᵗᵉᵈ_ᵈʳᵒᵖᵈᵒʷⁿ.out1, CategoryFilter=categories_ᶜᵒⁿᵛᵉʳᵗᵉᵈ_ᵈʳᵒᵖᵈᵒʷⁿ.category1)  # package Data-Shapes; Creates a Revit element selection input for UI.MultipleInputForm++ . Check out www.data-shapes.net for more infos!
code_block_3 = CodeBlock { "Malla Vertical"; }
code_block_4 = CodeBlock { "Diametro"; }
element_types_ᶜᵒⁿᵛᵉʳᵗᵉᵈ_ᵈʳᵒᵖᵈᵒʷⁿ = CodeBlock { DSCore.Types.FindTypeByNameInAssembly("RebarBarType", "RevitAPI"); }
all_elements_of_type = ElementsOfType(element_type=element_types_ᶜᵒⁿᵛᵉʳᵗᵉᵈ_ᵈʳᵒᵖᵈᵒʷⁿ)
code_block_5 = CodeBlock(t5=all_elements_of_type)
# ---------- code_block_5.designscript (8 lines) ----------
t4 = t5;
t1 = t4;
num1 = Properties.RebarDiameter(t1);
t2 = DSCore.List.SortByKey(t1, num1);
t3 = Dictionary.ValueAtKey(t2, "sorted list");
str1 = Revit.Elements.Element.Name(t3);
0;
false;
# ----------------------------------------
dropdown_data = Custom[DropDown Data](InputName=code_block_4, Keys=code_block_5.str1, Values=code_block_5.t3, DefaultValueIndex=code_block_5.out6, Sorted_optional=code_block_5.out7)  # package Data-Shapes; Create data for DropDown input in UI.MultiInputForm ++ . Check out www.data-shapes.net for more infos.
code_block_6 = CodeBlock { "Distanciamiento"; "200"; true; }
textbox_data = Custom[TextBox Data](InputName=code_block_6.out0, DefaultText=code_block_6.out1, IsNumberEntry=code_block_6.out2)  # package Data-Shapes; Create Data for TextBox input in UI.MultipleInputForm ++ . Check out www.data-shapes.net for more informations
list_create = List.Create(item0=dropdown_data, item1=textbox_data)
inputgroup_data = Custom[InputGroup Data](GroupTitle=code_block_3, Inputs=list_create)  # package Data-Shapes; Creates a group of inputs for UI.MultipleInputForm ++ . Check out www.data-shapes.net for more infos !
code_block_7 = CodeBlock { "Malla Horizontal"; }
code_block_8 = CodeBlock { "Diametro"; }
element_types_ᶜᵒⁿᵛᵉʳᵗᵉᵈ_ᵈʳᵒᵖᵈᵒʷⁿ_2 = CodeBlock { DSCore.Types.FindTypeByNameInAssembly("RebarBarType", "RevitAPI"); }
all_elements_of_type_2 = ElementsOfType(element_type=element_types_ᶜᵒⁿᵛᵉʳᵗᵉᵈ_ᵈʳᵒᵖᵈᵒʷⁿ_2)
code_block_9 = CodeBlock(t5=all_elements_of_type_2)  # same code as code_block_5
dropdown_data_2 = Custom[DropDown Data](InputName=code_block_8, Keys=code_block_9.str1, Values=code_block_9.t3, DefaultValueIndex=code_block_9.out6, Sorted_optional=code_block_9.out7)
code_block_10 = CodeBlock { "Distanciamiento"; "200"; true; }
textbox_data_2 = Custom[TextBox Data](InputName=code_block_10.out0, DefaultText=code_block_10.out1, IsNumberEntry=code_block_10.out2)
list_create_2 = List.Create(item0=dropdown_data_2, item1=textbox_data_2)
inputgroup_data_2 = Custom[InputGroup Data](GroupTitle=code_block_7, Inputs=list_create_2)
list_create_3 = List.Create(item0=selectmodelelements_data, item1=inputgroup_data, item2=inputgroup_data_2)
multipleinputform = Custom[MultipleInputForm ++](Description_optional=code_block, Logo_optional=file_path, ButtonText_optional=code_block_2.out0, Inputs=list_create_3, Toggle=code_block_2.out2, CancelButtonText_optional=code_block_2.out1, MaxHeight_optional=code_block_2.out5, Width_optional=code_block_2.out3, LabelWidth_optional=code_block_2.out4)  # package Data-Shapes; Create a form with multiple inputs. see www.data-shapes.net for tutorials and infos!
code_block_11 = CodeBlock(l=multipleinputform.User_Inputs)
# ---------- code_block_11.designscript (12 lines) ----------
l;
[Imperative]
{
	if (l == null)
	{
		return = [[],[],[],[],[],[]];
	}
	else
	{
		return = l;
	}
};
# ----------------------------------------
code_block_12 = CodeBlock(x=code_block_11.out1) { x; }
code_block_13 = CodeBlock(malla_vertical=code_block_12) { malla_vertical[0]; malla_vertical[1]; malla_vertical[2]; malla_vertical[3]; }
code_block_14 = CodeBlock(x=code_block_13.out0) { x; }
code_block_15 = CodeBlock(x=code_block_14) { x; }
getCategory = Element.GetCategory(element=code_block_15)
string_from_object = FromObject(obj=getCategory)
code_block_16 = CodeBlock { "Walls"; }
eq = string_from_object == code_block_16
filterByBoolMask = List.FilterByBoolMask(list=code_block_15, mask=eq)
geometry = Element.Geometry(element=filterByBoolMask.in)
flatten = List.Flatten(list=geometry)
getLocation = Element.GetLocation(element=filterByBoolMask.in)
code_block_17 = CodeBlock { 0.5; }
planeAtParameter = Curve.PlaneAtParameter(curve=getLocation, param=code_block_17)
intersect = Geometry.Intersect(geometry=flatten, other=planeAtParameter)
perimeterCurves = Surface.PerimeterCurves(surface=intersect)
flatten_2 = List.Flatten(list=perimeterCurves)
function_apply = ApplyFunction(func=byJoinedCurves, arg1=flatten_2)
code_block_18 = CodeBlock(x=function_apply)
# ---------- code_block_18.designscript (13 lines) ----------
x;

[Imperative]
{
	if (x == null)
	{
		return = [];
	}
	else
	{
		return = x;
	}
};
# ----------------------------------------
curves = PolyCurve.Curves(polyCurve=code_block_18.out1)
code_block_19 = CodeBlock { null; }
replaceEmptyLists = Custom[List.ReplaceEmptyLists](seq=curves, Replacement=code_block_19)  # package Clockwork for Dynamo 2.x; Replaces all empty lists within a given list with a substitute
code_block_20 = CodeBlock(x=replaceEmptyLists)
# ---------- code_block_20.designscript (13 lines) ----------
x;

[Imperative]
{
	if (x == null)
	{
		return = [null,null,null];
	}
	else
	{
		return = x;
	}
};
# ----------------------------------------
code_block_21 = CodeBlock { [0,2]; }
getItemAtIndex = List.GetItemAtIndex(list=code_block_20.out1@L2, index=code_block_21)
code_block_22 = CodeBlock(l=getItemAtIndex)
# ---------- code_block_22.designscript (12 lines) ----------
l;
[Imperative]
{
	if (l[0][0] == null)
	{
		return = [];
	}
	else
	{
		return = l;
	}
};
# ----------------------------------------
code_block_23 = CodeBlock { 8000; }
extendStart = Curve.ExtendStart(curve=code_block_22.out1, distance=code_block_23)
extendEnd = Curve.ExtendEnd(curve=extendStart, distance=code_block_23)
function_apply_2 = ApplyFunction(func=byLoft, arg1=extendEnd)
byUnion = Solid.ByUnion()  # unwired: solids
code_block_24 = CodeBlock(x=code_block_14) { x; }
geometry_2 = Element.Geometry(element=code_block_24)
flatten_3 = List.Flatten(list=geometry_2)
function_apply_3 = ApplyFunction(func=byUnion, arg1=flatten_3)
code_block_25 = CodeBlock(x=function_apply_3)  # same code as code_block_18
intersect_2 = Geometry.Intersect(geometry=function_apply_2, other=code_block_25.out1)
flatten_4 = List.Flatten(list=intersect_2)
elementcentroid = Custom[© ElementCentroid](element=filterByBoolMask.in)  # package Crumple; Returns the centroid of the element's axis-aligned bounding box.
normalAtPoint = Surface.NormalAtPoint(surface=flatten_4, point=elementcentroid)
code_block_26 = CodeBlock(vector1=normalAtPoint) { plane1 = Autodesk.Plane.XY(); vector2 = Autodesk.Vector.Rotate(vector1, plane1, 90); }
o_document_activeview = Orchid.RevitProject.Common.Document.ActiveView()
byJoinedCurves_2 = PolyCurve.ByJoinedCurves()  # unwired: curves
byJoinedCurves_3 = PolyCurve.ByJoinedCurves()  # unwired: curves
byJoinedCurves_4 = PolyCurve.ByJoinedCurves()  # unwired: curves
byJoinedCurves_5 = PolyCurve.ByJoinedCurves()  # unwired: curves
code_block_27 = CodeBlock(x=code_block_14) { x; }
code_block_28 = CodeBlock { "Length"; }
getParameterValueByName = Element.GetParameterValueByName(element=code_block_27, parameterName=code_block_28)
round = Math.Round(number=getParameterValueByName)
code_block_29 = CodeBlock(t2=round) { t1 = t2 / 2; t3 = t1 - 200; t4 = t3 * -1; }
translate = Geometry.Translate(geometry=flatten_4, direction=normalAtPoint, distance=code_block_29.t4)
perimeterCurves_2 = Surface.PerimeterCurves(surface=translate)
function_apply_4 = ApplyFunction(func=byJoinedCurves_5, arg1=perimeterCurves_2)
code_block_30 = CodeBlock(x=function_apply_4)  # same code as code_block_18
code_block_31 = CodeBlock { -20; false; }
offset = PolyCurve.Offset(polyCurve=code_block_30.out1, signedDistance=code_block_31.out0, extendCircular=code_block_31.out1)
function_apply_5 = ApplyFunction(func=byJoinedCurves_4, arg1=offset)
code_block_32 = CodeBlock(x=function_apply_5)  # same code as code_block_18
curves_2 = PolyCurve.Curves(polyCurve=code_block_32.out1)
code_block_33 = CodeBlock { null; }
replaceEmptyLists_2 = Custom[List.ReplaceEmptyLists](seq=curves_2, Replacement=code_block_33)
code_block_34 = CodeBlock(x=replaceEmptyLists_2)
# ---------- code_block_34.designscript (13 lines) ----------
x;

[Imperative]
{
	if (x == null)
	{
		return = [null,null,null,null];
	}
	else
	{
		return = x;
	}
};
# ----------------------------------------
code_block_35 = CodeBlock { [0,1]; }
getItemAtIndex_2 = List.GetItemAtIndex(list=code_block_34.out1@L2, index=code_block_35)
code_block_36 = CodeBlock(l=getItemAtIndex_2)  # same code as code_block_22
function_apply_6 = ApplyFunction(func=byJoinedCurves_3, arg1=code_block_36.out1)
code_block_37 = CodeBlock(x=function_apply_6)  # same code as code_block_18
curves_3 = PolyCurve.Curves(polyCurve=code_block_37.out1)
reverse = Curve.Reverse(curve=curves_3)
code_block_38 = CodeBlock { 1; }
code_block_39 = CodeBlock { 20; }
extendStart_2 = Curve.ExtendStart(curve=reverse, distance=code_block_39)
code_block_40 = CodeBlock { 1; }
getItemAtIndex_3 = List.GetItemAtIndex(list=extendStart_2@L2, index=code_block_40)
replaceItemAtIndex = List.ReplaceItemAtIndex(list=reverse@L2, index=code_block_38@L1, item=getItemAtIndex_3@L1)
function_apply_7 = ApplyFunction(func=byJoinedCurves_2, arg1=replaceItemAtIndex)
code_block_41 = CodeBlock(x=function_apply_7)  # same code as code_block_18
curves_4 = PolyCurve.Curves(polyCurve=code_block_41.out1)
code_block_42 = CodeBlock(rebar_bar_type=code_block_13.out1)
# ---------- code_block_42.designscript (8 lines) ----------
//RebaarStyle
"Standard";
//RebarHookOrientation
"Right";
//Rebar Hook Type;
null;
//RebarBarType
rebar_bar_type;
# ----------------------------------------
element_types_ᶜᵒⁿᵛᵉʳᵗᵉᵈ_ᵈʳᵒᵖᵈᵒʷⁿ_3 = CodeBlock { DSCore.Types.FindTypeByNameInAssembly("RebarHookType", "RevitAPI"); }
all_elements_of_type_3 = ElementsOfType(element_type=element_types_ᶜᵒⁿᵛᵉʳᵗᵉᵈ_ᵈʳᵒᵖᵈᵒʷⁿ_3)
rebar_hook_type_at_end = CodeBlock(t3=all_elements_of_type_3)
# ---------- rebar_hook_type_at_end.designscript (5 lines) ----------
t1 = t3;
str2 = Revit.Elements.Element.Name(t1);
t2 = str2 == "Malla - 135 deg.";
t4 = DSCore.List.FilterByBoolMask(t3, t2);
t5 = Dictionary.ValueAtKey(t4, "in");
# ----------------------------------------
code_block_43 = CodeBlock { null; }
fromCurves = StructuralDesign.Rebar.Create.FromCurves(curves=curves_4@L2, rebarStyle=code_block_42.out0@L1, rebarBarType=code_block_42.rebar_bar_type@L1, startHookType=rebar_hook_type_at_end.t5@L1, endHookType=code_block_43@L1, startHookOrientation=code_block_42.out1@L1, endHookOrientation=code_block_42.out1@L1, hostElement=filterByBoolMask.in@L1, vector=normalAtPoint@L1, lacing=Longest)
distanciamiento_barras = CodeBlock(distanciamiento_barras=code_block_13.out2) { distanciamiento_barras; }
code_block_44 = CodeBlock { 400; }
sub = round - code_block_44
setLayoutAsMaximumSpacing = StructuralDesign.Rebar.Layout.SetLayoutAsMaximumSpacing(rebar=fromCurves, spacing=distanciamiento_barras, arrayLength=sub)
show_middle_rebar = Python(IN[0]=setLayoutAsMaximumSpacing)
# ---------- show_middle_rebar.python (53 lines) ----------
# BIBLIOTECAS
# ............................................................................
import clr
import sys

# Para trabajar con nodos nativos de Revit: Ojo con las conversiones
clr.AddReference('RevitNodes')
import Revit
clr.ImportExtensions(Revit.Elements)
clr.ImportExtensions(Revit.GeometryConversion)

# Para trabajar con la RevitAPI
clr.AddReference('RevitAPI')
import Autodesk
from Autodesk.Revit.DB import *
from Autodesk.Revit.DB.Architecture import *
from Autodesk.Revit.ApplicationServices import *
from Autodesk.Revit.DB.Structure import *

# Para trabajar contra el documento y hacer transacciones
clr.AddReference('RevitServices')
from RevitServices.Persistence import DocumentManager
from RevitServices.Transactions import TransactionManager
# Identificadores
doc = DocumentManager.Instance.CurrentDBDocument

# FUNCIONES
# ............................................................................



# ENTRADAS
# ............................................................................
rebar = UnwrapElement(IN[0])
view = doc.ActiveView

# CODIGO
# ............................................................................
# Se inicia la transaccion
TransactionManager.Instance.EnsureInTransaction(doc)

rebar_list = []

for r in rebar:
	r.SetPresentationMode(view, RebarPresentationMode.Middle)
	rebar_list.append(r)

TransactionManager.Instance.TransactionTaskDone()


# SALIDA
# ............................................................................
OUT = rebar_list
# ----------------------------------------
code_block_45 = CodeBlock { 1; }
byProperties = Revit.Filter.OverrideGraphicSettings.ByProperties(cutLineWeight=code_block_45, projectionLineWeight=code_block_45)
overrideInView = Element.OverrideInView(element=show_middle_rebar, overrides=byProperties)
o_document_activeview_2 = Orchid.RevitProject.Common.Document.ActiveView()
getFullGeometryForView = Custom[Rebar.GetFullGeometryForView](rebar=overrideInView, view=o_document_activeview_2)  # package BIM4Struc.Rebar; Generates full geometry for the Rebar for a specific view.
o_list_clean = Orchid.Common.List.Clean(list=getFullGeometryForView)
code_block_46 = CodeBlock(x=o_list_clean)  # same code as code_block_18
length = Curve.Length(curve=code_block_46.out1)
maximumItem = List.MaximumItem(list=length)
eq_2 = length == maximumItem
filterByBoolMask_2 = List.FilterByBoolMask(list=code_block_46.out1, mask=eq_2)
code_block_47 = CodeBlock { 0.6; }
pointAtParameter = Curve.PointAtParameter(curve=filterByBoolMask_2.in, param=code_block_47)
code_block_48 = CodeBlock()
# ---------- code_block_48.designscript (4 lines) ----------
family1 = Revit.Family.ByName("EST_A_STRUCTURAL REBAR TAG_MALLA");
familytype1 = Revit.Elements.FamilyType.ByFamilyAndName(family1, "R_M_00");
false;
true;
# ----------------------------------------
create_tag = Custom[Create Tag](view=o_document_activeview@L1, element=overrideInView@L1, TagLocation=pointAtParameter@L1, TagType=code_block_48.familytype1@L1, addLeader=code_block_48.out2@L1, RunIt=code_block_48.out3@L1, lacing=Longest)  # package Genius Loci; Works only in Revit 2018 and later. Creates a tag at a given location, of given type and in a supplied view. The node also works with Linked Elements (except space and area), Multi Category tag and Material Tag. Based on an archilab node
o_document_activeview_3 = Orchid.RevitProject.Common.Document.ActiveView()
byJoinedCurves_6 = PolyCurve.ByJoinedCurves()  # unwired: curves
intersect_3 = Geometry.Intersect()  # unwired: geometry, other
byLoft_2 = Surface.ByLoft()  # unwired: crossSections
code_block_49 = CodeBlock(x=code_block_11.out1) { x; }
code_block_50 = CodeBlock(malla_horizontal=code_block_49) { malla_horizontal[0]; malla_horizontal[3]; malla_horizontal[4]; }
code_block_51 = CodeBlock(x=code_block_50.out0) { x; }
getCategory_2 = Element.GetCategory(element=code_block_51)
string_from_object_2 = FromObject(obj=getCategory_2)
code_block_52 = CodeBlock { "Walls"; }
eq_3 = string_from_object_2 == code_block_52
filterByBoolMask_3 = List.FilterByBoolMask(list=code_block_51, mask=eq_3)
geometry_3 = Element.Geometry(element=filterByBoolMask_3.in)
flatten_5 = List.Flatten(list=geometry_3)
centroid = Solid.Centroid(solid=flatten_5)
byOriginNormal = Plane.ByOriginNormal(origin=centroid)
intersect_4 = Geometry.Intersect(geometry=flatten_5, other=byOriginNormal)
flatten_6 = List.Flatten(list=intersect_4)
perimeterCurves_3 = Surface.PerimeterCurves(surface=flatten_6)
code_block_53 = CodeBlock { null; }
replaceEmptyLists_3 = Custom[List.ReplaceEmptyLists](seq=perimeterCurves_3, Replacement=code_block_53)
code_block_54 = CodeBlock(x=replaceEmptyLists_3)  # same code as code_block_34
code_block_55 = CodeBlock { [1,3]; }
getItemAtIndex_4 = List.GetItemAtIndex(list=code_block_54.out1@L2, index=code_block_55)
list_clean = Custom[List Clean](list=getItemAtIndex_4)  # package Genius Loci; Removes all Null, Empty and Blank from a list or nested list of lists.
code_block_56 = CodeBlock { 1000; }
extendEnd_2 = Curve.ExtendEnd(curve=list_clean, distance=code_block_56)
extendStart_3 = Curve.ExtendStart(curve=extendEnd_2, distance=code_block_56)
function_apply_8 = ApplyFunction(func=byLoft_2, arg1=extendStart_3)
byUnion_2 = Solid.ByUnion()  # unwired: solids
geometry_4 = Element.Geometry()  # unwired: element
filterByBoolMask_4 = List.FilterByBoolMask()  # unwired: list, mask
get_joined_elements = Custom[Get Joined Elements](element=filterByBoolMask_3.in@L1)  # package Genius Loci; Returns all elements joined to the given element.
getCategory_3 = Element.GetCategory()  # unwired: element
function_apply_9 = ApplyFunction(func=getCategory_3, arg1=get_joined_elements)
string_from_object_3 = FromObject(obj=function_apply_9)
code_block_57 = CodeBlock { "Walls"; }
eq_4 = string_from_object_3 == code_block_57
function_apply_10 = ApplyFunction(func=filterByBoolMask_4.in, arg1=get_joined_elements, arg2=eq_4)
code_block_58 = CodeBlock(x=function_apply_10)  # same code as code_block_18
count = List.Count(list=filterByBoolMask_3.in)
ofRepeatedItem = List.OfRepeatedItem(item=code_block_58.out1, amount=count)
addItemToFront = List.AddItemToFront(item=filterByBoolMask_3.in@L1, list=ofRepeatedItem@L2)
function_apply_11 = ApplyFunction(func=geometry_4, arg1=addItemToFront)
list_clean_2 = Custom[List Clean](list=function_apply_11)
flatten_7 = List.Flatten(list=list_clean_2@L3)
function_apply_12 = ApplyFunction(func=byUnion_2, arg1=flatten_7)
function_apply_13 = ApplyFunction(func=intersect_3, arg1=function_apply_8, arg2=function_apply_12)
code_block_59 = CodeBlock(x=function_apply_13)  # same code as code_block_18
flatten_8 = List.Flatten(list=code_block_59.out1)
normalAtPoint_2 = Surface.NormalAtPoint(surface=flatten_8, point=centroid)
code_block_60 = CodeBlock { "Unconnected Height"; }
getParameterValueByName_2 = Element.GetParameterValueByName(element=filterByBoolMask_3.in, parameterName=code_block_60)
code_block_61 = CodeBlock(t2=getParameterValueByName_2) { t1 = t2 / 2; t3 = t1 - 100; t4 = t3 * -1; }
translate_2 = Geometry.Translate(geometry=flatten_8, direction=normalAtPoint_2, distance=code_block_61.t4)
perimeterCurves_4 = Surface.PerimeterCurves(surface=translate_2)
function_apply_14 = ApplyFunction(func=byJoinedCurves_6, arg1=perimeterCurves_4)
code_block_62 = CodeBlock(l=function_apply_14)
# ---------- code_block_62.designscript (12 lines) ----------
l;
[Imperative]
{
	if (l == null)
	{
		return = [];
	}
	else
	{
		return = l;
	}
};
# ----------------------------------------
code_block_63 = CodeBlock { -20; }
offset_2 = Curve.Offset(curve=code_block_62.out1, distance=code_block_63)
byJoinedCurves_7 = PolyCurve.ByJoinedCurves(curves=offset_2@L1)
curves_5 = PolyCurve.Curves(polyCurve=byJoinedCurves_7)
code_block_64 = CodeBlock { null; }
replaceEmptyLists_4 = Custom[List.ReplaceEmptyLists](seq=curves_5, Replacement=code_block_64)
code_block_65 = CodeBlock(x=replaceEmptyLists_4)  # same code as code_block_34
code_block_66 = CodeBlock { [0,1]; }
getItemAtIndex_5 = List.GetItemAtIndex(list=code_block_65.out1@L2, index=code_block_66)
code_block_67 = CodeBlock(rebar_bar_type=code_block_50.out1)
# ---------- code_block_67.designscript (8 lines) ----------
//RebaarStyle
"Standard";
//RebarHookOrientation
"Right";
//Rebar Hook Type;
Revit.Elements.ElementSelector.ByElementId(474495);
//RebarBarType
rebar_bar_type;
# ----------------------------------------
fromCurves_2 = StructuralDesign.Rebar.Create.FromCurves(curves=getItemAtIndex_5@L2, rebarStyle=code_block_67.out0@L1, rebarBarType=code_block_67.rebar_bar_type@L1, startHookType=code_block_67.out2@L1, endHookType=code_block_67.out2@L1, startHookOrientation=code_block_67.out1@L1, endHookOrientation=code_block_67.out1@L1, hostElement=filterByBoolMask_3.in@L1, vector=normalAtPoint_2@L1, lacing=Longest)
distanciamiento_barras_2 = CodeBlock(distanciamiento_barras=code_block_50.out2) { distanciamiento_barras; }
code_block_68 = CodeBlock { 350; }
sub_2 = getParameterValueByName_2 - code_block_68
setLayoutAsMaximumSpacing_2 = StructuralDesign.Rebar.Layout.SetLayoutAsMaximumSpacing(rebar=fromCurves_2, spacing=distanciamiento_barras_2, arrayLength=sub_2)
show_middle_rebar_2 = Python(IN[0]=setLayoutAsMaximumSpacing_2)  # same code as show_middle_rebar
code_block_69 = CodeBlock { 1; }
byProperties_2 = Revit.Filter.OverrideGraphicSettings.ByProperties(cutLineWeight=code_block_69, projectionLineWeight=code_block_69)
overrideInView_2 = Element.OverrideInView(element=show_middle_rebar_2, overrides=byProperties_2)
o_document_activeview_4 = Orchid.RevitProject.Common.Document.ActiveView()
getFullGeometryForView_2 = Custom[Rebar.GetFullGeometryForView](rebar=overrideInView_2, view=o_document_activeview_4)
length_2 = Curve.Length(curve=getFullGeometryForView_2)
maximumItem_2 = List.MaximumItem(list=length_2)
eq_5 = length_2 == maximumItem_2
filterByBoolMask_5 = List.FilterByBoolMask(list=getFullGeometryForView_2, mask=eq_5)
code_block_70 = CodeBlock { 0.4; }
pointAtParameter_2 = Curve.PointAtParameter(curve=filterByBoolMask_5.in, param=code_block_70)
code_block_71 = CodeBlock()  # same code as code_block_48
create_tag_2 = Custom[Create Tag](view=o_document_activeview_3@L1, element=overrideInView_2@L1, TagLocation=pointAtParameter_2@L1, TagType=code_block_71.familytype1@L1, addLeader=code_block_71.out2@L1, RunIt=code_block_71.out3@L1, lacing=Longest)
byLoft_3 = Surface.ByLoft()  # unwired: crossSections
byJoinedCurves_8 = PolyCurve.ByJoinedCurves()  # unwired: curves
code_block_72 = CodeBlock(malla_vertical=code_block_12) { malla_vertical[0]; malla_vertical[1]; malla_vertical[2]; malla_vertical[3]; }
code_block_73 = CodeBlock(x=code_block_72.out0) { x; }
code_block_74 = CodeBlock(x=code_block_73) { x; }
getCategory_4 = Element.GetCategory(element=code_block_74)
string_from_object_4 = FromObject(obj=getCategory_4)
code_block_75 = CodeBlock { "Walls"; }
eq_6 = string_from_object_4 == code_block_75
filterByBoolMask_6 = List.FilterByBoolMask(list=code_block_74, mask=eq_6)
geometry_5 = Element.Geometry(element=filterByBoolMask_6.in)
flatten_9 = List.Flatten(list=geometry_5)
getLocation_2 = Element.GetLocation(element=filterByBoolMask_6.in)
code_block_76 = CodeBlock { 0.5; }
planeAtParameter_2 = Curve.PlaneAtParameter(curve=getLocation_2, param=code_block_76)
intersect_5 = Geometry.Intersect(geometry=flatten_9, other=planeAtParameter_2)
perimeterCurves_5 = Surface.PerimeterCurves(surface=intersect_5)
flatten_10 = List.Flatten(list=perimeterCurves_5)
function_apply_15 = ApplyFunction(func=byJoinedCurves_8, arg1=flatten_10)
code_block_77 = CodeBlock(x=function_apply_15)  # same code as code_block_18
curves_6 = PolyCurve.Curves(polyCurve=code_block_77.out1)
code_block_78 = CodeBlock { null; }
replaceEmptyLists_5 = Custom[List.ReplaceEmptyLists](seq=curves_6, Replacement=code_block_78)
code_block_79 = CodeBlock(x=replaceEmptyLists_5)  # same code as code_block_20
code_block_80 = CodeBlock { [0,2]; }
getItemAtIndex_6 = List.GetItemAtIndex(list=code_block_79.out1@L2, index=code_block_80)
code_block_81 = CodeBlock(l=getItemAtIndex_6)  # same code as code_block_22
code_block_82 = CodeBlock { 8000; }
extendStart_4 = Curve.ExtendStart(curve=code_block_81.out1, distance=code_block_82)
extendEnd_3 = Curve.ExtendEnd(curve=extendStart_4, distance=code_block_82)
function_apply_16 = ApplyFunction(func=byLoft_3, arg1=extendEnd_3)
byUnion_3 = Solid.ByUnion()  # unwired: solids
code_block_83 = CodeBlock(x=code_block_73) { x; }
geometry_6 = Element.Geometry(element=code_block_83)
flatten_11 = List.Flatten(list=geometry_6)
function_apply_17 = ApplyFunction(func=byUnion_3, arg1=flatten_11)
code_block_84 = CodeBlock(x=function_apply_17)  # same code as code_block_18
intersect_6 = Geometry.Intersect(geometry=function_apply_16, other=code_block_84.out1)
flatten_12 = List.Flatten(list=intersect_6)
elementcentroid_2 = Custom[© ElementCentroid](element=filterByBoolMask_6.in)
normalAtPoint_3 = Surface.NormalAtPoint(surface=flatten_12, point=elementcentroid_2)
code_block_85 = CodeBlock(vector1=normalAtPoint_3) { plane1 = Autodesk.Plane.XY(); vector2 = Autodesk.Vector.Rotate(vector1, plane1, 90); }
byJoinedCurves_9 = PolyCurve.ByJoinedCurves()  # unwired: curves
byJoinedCurves_10 = PolyCurve.ByJoinedCurves()  # unwired: curves
byJoinedCurves_11 = PolyCurve.ByJoinedCurves()  # unwired: curves
byJoinedCurves_12 = PolyCurve.ByJoinedCurves()  # unwired: curves
code_block_86 = CodeBlock(x=code_block_73) { x; }
code_block_87 = CodeBlock { "Length"; }
getParameterValueByName_3 = Element.GetParameterValueByName(element=code_block_86, parameterName=code_block_87)
round_2 = Math.Round(number=getParameterValueByName_3)
rebarDiameter = StructuralDesign.Rebar.Properties.RebarDiameter(rebar=code_block_72.out1)
code_block_88 = CodeBlock(t2=round_2, barDiameter=rebarDiameter) { t1 = t2 / 2; t3 = t1 - 200; t4 = t3 * -1 + barDiameter; }
translate_3 = Geometry.Translate(geometry=flatten_12, direction=normalAtPoint_3, distance=code_block_88.t4)
perimeterCurves_6 = Surface.PerimeterCurves(surface=translate_3)
function_apply_18 = ApplyFunction(func=byJoinedCurves_12, arg1=perimeterCurves_6)
code_block_89 = CodeBlock(x=function_apply_18)  # same code as code_block_18
code_block_90 = CodeBlock { -20; false; }
offset_3 = PolyCurve.Offset(polyCurve=code_block_89.out1, signedDistance=code_block_90.out0, extendCircular=code_block_90.out1)
function_apply_19 = ApplyFunction(func=byJoinedCurves_11, arg1=offset_3)
code_block_91 = CodeBlock(x=function_apply_19)  # same code as code_block_18
curves_7 = PolyCurve.Curves(polyCurve=code_block_91.out1)
code_block_92 = CodeBlock { null; }
replaceEmptyLists_6 = Custom[List.ReplaceEmptyLists](seq=curves_7, Replacement=code_block_92)
code_block_93 = CodeBlock(x=replaceEmptyLists_6)  # same code as code_block_34
code_block_94 = CodeBlock { [0,3]; }
getItemAtIndex_7 = List.GetItemAtIndex(list=code_block_93.out1@L2, index=code_block_94)
code_block_95 = CodeBlock(l=getItemAtIndex_7)  # same code as code_block_22
function_apply_20 = ApplyFunction(func=byJoinedCurves_10, arg1=code_block_95.out1)
code_block_96 = CodeBlock(x=function_apply_20)  # same code as code_block_18
curves_8 = PolyCurve.Curves(polyCurve=code_block_96.out1)
reverse_2 = Curve.Reverse(curve=curves_8)
code_block_97 = CodeBlock { 1; }
code_block_98 = CodeBlock { 20; }
extendStart_5 = Curve.ExtendStart(curve=reverse_2, distance=code_block_98)
code_block_99 = CodeBlock { 1; }
getItemAtIndex_8 = List.GetItemAtIndex(list=extendStart_5@L2, index=code_block_99)
replaceItemAtIndex_2 = List.ReplaceItemAtIndex(list=reverse_2@L2, index=code_block_97@L1, item=getItemAtIndex_8@L1)
function_apply_21 = ApplyFunction(func=byJoinedCurves_9, arg1=replaceItemAtIndex_2)
code_block_100 = CodeBlock(x=function_apply_21)  # same code as code_block_18
curves_9 = PolyCurve.Curves(polyCurve=code_block_100.out1)
code_block_101 = CodeBlock(rebar_bar_type=code_block_72.out1)
# ---------- code_block_101.designscript (8 lines) ----------
//RebaarStyle
"Standard";
//RebarHookOrientation
"Left";
//Rebar Hook Type;
null;
//RebarBarType
rebar_bar_type;
# ----------------------------------------
element_types_ᶜᵒⁿᵛᵉʳᵗᵉᵈ_ᵈʳᵒᵖᵈᵒʷⁿ_4 = CodeBlock { DSCore.Types.FindTypeByNameInAssembly("RebarHookType", "RevitAPI"); }
all_elements_of_type_4 = ElementsOfType(element_type=element_types_ᶜᵒⁿᵛᵉʳᵗᵉᵈ_ᵈʳᵒᵖᵈᵒʷⁿ_4)
rebar_hook_type_at_end_2 = CodeBlock(t3=all_elements_of_type_4)  # same code as rebar_hook_type_at_end
code_block_102 = CodeBlock { null; }
fromCurves_3 = StructuralDesign.Rebar.Create.FromCurves(curves=curves_9@L2, rebarStyle=code_block_101.out0@L1, rebarBarType=code_block_101.rebar_bar_type@L1, startHookType=rebar_hook_type_at_end_2.t5@L1, endHookType=code_block_102@L1, startHookOrientation=code_block_101.out1@L1, endHookOrientation=code_block_101.out1@L1, hostElement=filterByBoolMask_6.in@L1, vector=normalAtPoint_3@L1, lacing=Longest)
distanciamiento_barras_3 = CodeBlock(distanciamiento_barras=code_block_72.out2) { distanciamiento_barras; }
code_block_103 = CodeBlock { 400; }
sub_3 = round_2 - code_block_103
setLayoutAsMaximumSpacing_3 = StructuralDesign.Rebar.Layout.SetLayoutAsMaximumSpacing(rebar=fromCurves_3, spacing=distanciamiento_barras_3, arrayLength=sub_3)
show_middle_rebar_3 = Python(IN[0]=setLayoutAsMaximumSpacing_3)  # same code as show_middle_rebar
code_block_104 = CodeBlock { 255; }
byARGB = Color.ByARGB(a=code_block_104, r=code_block_104, g=code_block_104, b=code_block_104)
code_block_105 = CodeBlock { 1; }
byProperties_3 = Revit.Filter.OverrideGraphicSettings.ByProperties(cutLineColor=byARGB, projectionLineColor=byARGB, cutLineWeight=code_block_105, projectionLineWeight=code_block_105)
overrideInView_3 = Element.OverrideInView(element=show_middle_rebar_3, overrides=byProperties_3)
byJoinedCurves_13 = PolyCurve.ByJoinedCurves()  # unwired: curves
intersect_7 = Geometry.Intersect()  # unwired: geometry, other
byLoft_4 = Surface.ByLoft()  # unwired: crossSections
code_block_106 = CodeBlock(malla_horizontal=code_block_49) { malla_horizontal[0]; malla_horizontal[3]; malla_horizontal[4]; }
code_block_107 = CodeBlock(x=code_block_106.out0) { x; }
getCategory_5 = Element.GetCategory(element=code_block_107)
string_from_object_5 = FromObject(obj=getCategory_5)
code_block_108 = CodeBlock { "Walls"; }
eq_7 = string_from_object_5 == code_block_108
filterByBoolMask_7 = List.FilterByBoolMask(list=code_block_107, mask=eq_7)
geometry_7 = Element.Geometry(element=filterByBoolMask_7.in)
flatten_13 = List.Flatten(list=geometry_7)
centroid_2 = Solid.Centroid(solid=flatten_13)
byOriginNormal_2 = Plane.ByOriginNormal(origin=centroid_2)
intersect_8 = Geometry.Intersect(geometry=flatten_13, other=byOriginNormal_2)
flatten_14 = List.Flatten(list=intersect_8)
perimeterCurves_7 = Surface.PerimeterCurves(surface=flatten_14)
code_block_109 = CodeBlock { null; }
replaceEmptyLists_7 = Custom[List.ReplaceEmptyLists](seq=perimeterCurves_7, Replacement=code_block_109)
code_block_110 = CodeBlock(x=replaceEmptyLists_7)  # same code as code_block_34
code_block_111 = CodeBlock { [1,3]; }
getItemAtIndex_9 = List.GetItemAtIndex(list=code_block_110.out1@L2, index=code_block_111)
list_clean_3 = Custom[List Clean](list=getItemAtIndex_9)
code_block_112 = CodeBlock { 1000; }
extendEnd_4 = Curve.ExtendEnd(curve=list_clean_3, distance=code_block_112)
extendStart_6 = Curve.ExtendStart(curve=extendEnd_4, distance=code_block_112)
function_apply_22 = ApplyFunction(func=byLoft_4, arg1=extendStart_6)
byUnion_4 = Solid.ByUnion()  # unwired: solids
geometry_8 = Element.Geometry()  # unwired: element
filterByBoolMask_8 = List.FilterByBoolMask()  # unwired: list, mask
get_joined_elements_2 = Custom[Get Joined Elements](element=filterByBoolMask_7.in@L1)
getCategory_6 = Element.GetCategory()  # unwired: element
function_apply_23 = ApplyFunction(func=getCategory_6, arg1=get_joined_elements_2)
string_from_object_6 = FromObject(obj=function_apply_23)
code_block_113 = CodeBlock { "Walls"; }
eq_8 = string_from_object_6 == code_block_113
function_apply_24 = ApplyFunction(func=filterByBoolMask_8.in, arg1=get_joined_elements_2, arg2=eq_8)
code_block_114 = CodeBlock(x=function_apply_24)  # same code as code_block_18
count_2 = List.Count(list=filterByBoolMask_7.in)
ofRepeatedItem_2 = List.OfRepeatedItem(item=code_block_114.out1, amount=count_2)
addItemToFront_2 = List.AddItemToFront(item=filterByBoolMask_7.in@L1, list=ofRepeatedItem_2@L2)
function_apply_25 = ApplyFunction(func=geometry_8, arg1=addItemToFront_2)
list_clean_4 = Custom[List Clean](list=function_apply_25)
flatten_15 = List.Flatten(list=list_clean_4@L3)
function_apply_26 = ApplyFunction(func=byUnion_4, arg1=flatten_15)
function_apply_27 = ApplyFunction(func=intersect_7, arg1=function_apply_22, arg2=function_apply_26)
code_block_115 = CodeBlock(x=function_apply_27)  # same code as code_block_18
flatten_16 = List.Flatten(list=code_block_115.out1)
normalAtPoint_4 = Surface.NormalAtPoint(surface=flatten_16, point=centroid_2)
code_block_116 = CodeBlock { "Unconnected Height"; }
getParameterValueByName_4 = Element.GetParameterValueByName(element=filterByBoolMask_7.in, parameterName=code_block_116)
rebarDiameter_2 = StructuralDesign.Rebar.Properties.RebarDiameter(rebar=code_block_106.out1)
code_block_117 = CodeBlock(t5=getParameterValueByName_4, num1=rebarDiameter_2) { t2 = t5; t1 = t2 / 2; t3 = t1 - 100; t4 = t3 * -1; t6 = t4 + num1; }
translate_4 = Geometry.Translate(geometry=flatten_16, direction=normalAtPoint_4, distance=code_block_117.t6)
perimeterCurves_8 = Surface.PerimeterCurves(surface=translate_4)
function_apply_28 = ApplyFunction(func=byJoinedCurves_13, arg1=perimeterCurves_8)
code_block_118 = CodeBlock(l=function_apply_28)  # same code as code_block_62
code_block_119 = CodeBlock { -20; }
offset_4 = Curve.Offset(curve=code_block_118.out1, distance=code_block_119)
byJoinedCurves_14 = PolyCurve.ByJoinedCurves(curves=offset_4@L1)
curves_10 = PolyCurve.Curves(polyCurve=byJoinedCurves_14)
code_block_120 = CodeBlock { null; }
replaceEmptyLists_8 = Custom[List.ReplaceEmptyLists](seq=curves_10, Replacement=code_block_120)
code_block_121 = CodeBlock(x=replaceEmptyLists_8)  # same code as code_block_34
code_block_122 = CodeBlock { [2,3]; }
getItemAtIndex_10 = List.GetItemAtIndex(list=code_block_121.out1@L2, index=code_block_122)
code_block_123 = CodeBlock(rebar_bar_type=code_block_106.out1)  # same code as code_block_67
fromCurves_4 = StructuralDesign.Rebar.Create.FromCurves(curves=getItemAtIndex_10@L2, rebarStyle=code_block_123.out0@L1, rebarBarType=code_block_123.rebar_bar_type@L1, startHookType=code_block_123.out2@L1, endHookType=code_block_123.out2@L1, startHookOrientation=code_block_123.out1@L1, endHookOrientation=code_block_123.out1@L1, hostElement=filterByBoolMask_7.in@L1, vector=normalAtPoint_4@L1, lacing=Longest)
distanciamiento_barras_4 = CodeBlock(distanciamiento_barras=code_block_106.out2) { distanciamiento_barras; }
code_block_124 = CodeBlock { 350; }
sub_4 = getParameterValueByName_4 - code_block_124
setLayoutAsMaximumSpacing_4 = StructuralDesign.Rebar.Layout.SetLayoutAsMaximumSpacing(rebar=fromCurves_4, spacing=distanciamiento_barras_4, arrayLength=sub_4)
show_middle_rebar_4 = Python(IN[0]=setLayoutAsMaximumSpacing_4)  # same code as show_middle_rebar
code_block_125 = CodeBlock { 255; }
byARGB_2 = Color.ByARGB(a=code_block_125, r=code_block_125, g=code_block_125, b=code_block_125)
code_block_126 = CodeBlock { 1; }
byProperties_4 = Revit.Filter.OverrideGraphicSettings.ByProperties(cutLineColor=byARGB_2, projectionLineColor=byARGB_2, cutLineWeight=code_block_126, projectionLineWeight=code_block_126)
overrideInView_4 = Element.OverrideInView(element=show_middle_rebar_4, overrides=byProperties_4)
code_block_127 = CodeBlock { 1; }
shiftIndices = List.ShiftIndices(list=curves_3, amount=code_block_127)
code_block_128 = CodeBlock { 1; }
shiftIndices_2 = List.ShiftIndices(list=curves_8, amount=code_block_128)
