# Dynamo graph DM_Intermedia_script.dyn (Dynamo 2.6.2.15705)
# packages: Structural Design 2021.1.22, Data-Shapes 2022.2.103, Clockwork for Dynamo 2.x 2.4.0, Genius Loci 2021.11.10, Orchid 206.3.0.8161, BIM4Struc.Rebar 1.3.0

o_document_activeview = Orchid.RevitProject.Common.Document.ActiveView()
byJoinedCurves = PolyCurve.ByJoinedCurves()  # unwired: curves
code_block = CodeBlock { "Doble Malla - Intermedia"; }
file_path = Filename("..\..\..\..\..\..\..\..\..\..\Arainco\Arainco.png")
code_block_2 = CodeBlock { "INICIAR"; "CANCELAR"; true; 430; 170; 650; }
categories_ᶜᵒⁿᵛᵉʳᵗᵉᵈ_ᵈʳᵒᵖᵈᵒʷⁿ = CodeBlock { "Seleccionar Muros a Armar"; "SELECCIONAR"; Revit.Category.ByName("Walls"); }
selectmodelelements_data = Custom[SelectModelElements Data](InputName=categories_ᶜᵒⁿᵛᵉʳᵗᵉᵈ_ᵈʳᵒᵖᵈᵒʷⁿ.out0, ButtonText=categories_ᶜᵒⁿᵛᵉʳᵗᵉᵈ_ᵈʳᵒᵖᵈᵒʷⁿ.out1, CategoryFilter=categories_ᶜᵒⁿᵛᵉʳᵗᵉᵈ_ᵈʳᵒᵖᵈᵒʷⁿ.out2)  # package Data-Shapes; Creates a Revit element selection input for UI.MultipleInputForm++ . Check out www.data-shapes.net for more infos!
code_block_3 = CodeBlock { "Malla Vertical"; }
code_block_4 = CodeBlock { "Diametro"; }
element_types_ᶜᵒⁿᵛᵉʳᵗᵉᵈ_ᵈʳᵒᵖᵈᵒʷⁿ = CodeBlock { DSCore.Types.FindTypeByNameInAssembly("RebarBarType", "RevitAPI"); }
all_elements_of_type = ElementsOfType(element_type=element_types_ᶜᵒⁿᵛᵉʳᵗᵉᵈ_ᵈʳᵒᵖᵈᵒʷⁿ)
code_block_5 = CodeBlock(t5=all_elements_of_type)
# ---------- code_block_5.designscript (8 lines) ----------
t4 = t5;
t1 = t4;
num1 = Properties.RebarDiameter(t1);
t2 = DSCore.List.SortByKey(t1, num1);
t3 = Dictionary.ValueAtKey(t2, "sorted list");
str1 = Revit.Elements.Element.Name(t3);
0;
false;
# ----------------------------------------
dropdown_data = Custom[DropDown Data](InputName=code_block_4, Keys=code_block_5.str1, Values=code_block_5.t3, DefaultValueIndex=code_block_5.out6, Sorted_optional=code_block_5.out7)  # package Data-Shapes; Create data for DropDown input in UI.MultiInputForm ++ . Check out www.data-shapes.net for more infos.
code_block_6 = CodeBlock { "Distanciamiento"; "200"; true; }
textbox_data = Custom[TextBox Data](InputName=code_block_6.out0, DefaultText=code_block_6.out1, IsNumberEntry=code_block_6.out2)  # package Data-Shapes; Create Data for TextBox input in UI.MultipleInputForm ++ . Check out www.data-shapes.net for more informations
list_create = List.Create(item0=dropdown_data, item1=textbox_data)
inputgroup_data = Custom[InputGroup Data](GroupTitle=code_block_3, Inputs=list_create)  # package Data-Shapes; Creates a group of inputs for UI.MultipleInputForm ++ . Check out www.data-shapes.net for more infos !
code_block_7 = CodeBlock { "Malla Horizontal"; }
code_block_8 = CodeBlock { "Diametro"; }
element_types_ᶜᵒⁿᵛᵉʳᵗᵉᵈ_ᵈʳᵒᵖᵈᵒʷⁿ_2 = CodeBlock { DSCore.Types.FindTypeByNameInAssembly("RebarBarType", "RevitAPI"); }
all_elements_of_type_2 = ElementsOfType(element_type=element_types_ᶜᵒⁿᵛᵉʳᵗᵉᵈ_ᵈʳᵒᵖᵈᵒʷⁿ_2)
code_block_9 = CodeBlock(t5=all_elements_of_type_2)  # same code as code_block_5
dropdown_data_2 = Custom[DropDown Data](InputName=code_block_8, Keys=code_block_9.str1, Values=code_block_9.t3, DefaultValueIndex=code_block_9.out6, Sorted_optional=code_block_9.out7)
code_block_10 = CodeBlock { "Distanciamiento"; "200"; true; }
textbox_data_2 = Custom[TextBox Data](InputName=code_block_10.out0, DefaultText=code_block_10.out1, IsNumberEntry=code_block_10.out2)
list_create_2 = List.Create(item0=dropdown_data_2, item1=textbox_data_2)
inputgroup_data_2 = Custom[InputGroup Data](GroupTitle=code_block_7, Inputs=list_create_2)
list_create_3 = List.Create(item0=selectmodelelements_data, item1=inputgroup_data, item2=inputgroup_data_2)
multipleinputform = Custom[MultipleInputForm ++](Description_optional=code_block, Logo_optional=file_path, ButtonText_optional=code_block_2.out0, Inputs=list_create_3, Toggle=code_block_2.out2, CancelButtonText_optional=code_block_2.out1, MaxHeight_optional=code_block_2.out5, Width_optional=code_block_2.out3, LabelWidth_optional=code_block_2.out4)  # package Data-Shapes; Create a form with multiple inputs. see www.data-shapes.net for tutorials and infos!
code_block_11 = CodeBlock(l=multipleinputform.User_Inputs)
# ---------- code_block_11.designscript (12 lines) ----------
l;
[Imperative]
{
	if (l == null)
	{
		return = [[],[],[],[],[]];
	}
	else
	{
		return = l;
	}
};
# ----------------------------------------
code_block_12 = CodeBlock(x=code_block_11.out1) { x; }
code_block_13 = CodeBlock(malla_vertical=code_block_12) { malla_vertical[0]; malla_vertical[1]; malla_vertical[2]; malla_vertical[3]; }
muros = CodeBlock(x=code_block_13.out0) { x; }
geometry = Element.Geometry(element=muros)
flatten = List.Flatten(list=geometry)
getLocation = Element.GetLocation(element=muros)
code_block_14 = CodeBlock { 0.5; }
planeAtParameter = Curve.PlaneAtParameter(curve=getLocation, param=code_block_14)
intersect = Geometry.Intersect(geometry=flatten, other=planeAtParameter)
flatten_2 = List.Flatten(list=intersect)
centroid = Solid.Centroid(solid=flatten)
normalAtPoint = Surface.NormalAtPoint(surface=flatten_2, point=centroid)
code_block_15 = CodeBlock { "Length"; }
getParameterValueByName = Element.GetParameterValueByName(element=muros, parameterName=code_block_15)
round = Math.Round(number=getParameterValueByName)
code_block_16 = CodeBlock(t2=round) { t1 = t2 / 2; t3 = t1 - 200; t4 = t3 * -1; }
translate = Geometry.Translate(geometry=flatten_2, direction=normalAtPoint, distance=code_block_16.t4)
perimeterCurves = Surface.PerimeterCurves(surface=translate)
function_apply = ApplyFunction(func=byJoinedCurves, arg1=perimeterCurves)
code_block_17 = CodeBlock(l=function_apply)
# ---------- code_block_17.designscript (12 lines) ----------
l;
[Imperative]
{
	if (l == null)
	{
		return = [];
	}
	else
	{
		return = l;
	}
};
# ----------------------------------------
calculo_posicion_malla_vertical = CodeBlock(t1=code_block_13.out1, t3=code_block_13.out3) { num2 = Properties.RebarDiameter(t1); t2 = num2 / 2; num3 = Properties.RebarDiameter(t3); t4 = t2 + num3; }
code_block_18 = CodeBlock(offSetMalla=calculo_posicion_malla_vertical.t4) { -20-offSetMalla; }
offset = Curve.Offset(curve=code_block_17.out1, distance=code_block_18)
byJoinedCurves_2 = PolyCurve.ByJoinedCurves(curves=offset@L1)
curves = PolyCurve.Curves(polyCurve=byJoinedCurves_2)
code_block_19 = CodeBlock { null; }
replaceEmptyLists = Custom[List.ReplaceEmptyLists](seq=curves, Replacement=code_block_19)  # package Clockwork for Dynamo 2.x; Replaces all empty lists within a given list with a substitute
code_block_20 = CodeBlock(x=replaceEmptyLists)
# ---------- code_block_20.designscript (13 lines) ----------
x;

[Imperative]
{
	if (x == null)
	{
		return = [null,null,null];
	}
	else
	{
		return = x;
	}
};
# ----------------------------------------
code_block_21 = CodeBlock { 2; }
getItemAtIndex = List.GetItemAtIndex(list=code_block_20.out1@L2, index=code_block_21)
code_block_22 = CodeBlock(l=getItemAtIndex)
# ---------- code_block_22.designscript (12 lines) ----------
l;
[Imperative]
{
	if (l[0] == null)
	{
		return = [];
	}
	else
	{
		return = l;
	}
};
# ----------------------------------------
code_block_23 = CodeBlock(t1=code_block_22.out1)
# ---------- code_block_23.designscript (6 lines) ----------
point1 = Autodesk.Curve.StartPoint(t1);
point2 = Autodesk.Curve.EndPoint(t1);
vector1 = Autodesk.Vector.ByTwoPoints(point1, point2);
num2 = Autodesk.Vector.Z(vector1);
t2 = num2 < 0;
curve1 = Autodesk.Curve.Reverse(t1);
# ----------------------------------------
if_ = If(test=code_block_23.t2, true=code_block_23.curve1, false=code_block_22.out1)
traslapo_armadura = CodeBlock(rebar=code_block_13.out1, offsetMalla=calculo_posicion_malla_vertical.t4)
# ---------- traslapo_armadura.designscript (5 lines) ----------
diametro_barra = Strings.ToString(Properties.RebarDiameter(rebar),"");
key = ["8","10","12","16","18","22","25","28","32","36"];
val = [570, 710, 860, 1140, 1290, 1960, 2230, 2500, 2850, 3210];
dict_traslapo = Dictionary.ByKeysValues(key, val);
t3 = Dictionary.ValueAtKey(dict_traslapo, diametro_barra) + offsetMalla + 20;
# ----------------------------------------
extendEnd = Curve.ExtendEnd(curve=if_, distance=traslapo_armadura.t3)
code_block_24 = CodeBlock(offsetMalla=calculo_posicion_malla_vertical.t4) { 20+offsetMalla; }
extendStart = Curve.ExtendStart(curve=extendEnd, distance=code_block_24)
code_block_25 = CodeBlock(rebar_bar_type=code_block_13.out1)
# ---------- code_block_25.designscript (8 lines) ----------
//RebaarStyle
"Standard";
//RebarHookOrientation
"Left";
//Rebar Hook Type;
null;
//RebarBarType
rebar_bar_type;
# ----------------------------------------
fromCurves = StructuralDesign.Rebar.Create.FromCurves(curves=extendStart@L1, rebarStyle=code_block_25.out0@L1, rebarBarType=code_block_25.rebar_bar_type@L1, startHookType=code_block_25.out2@L1, endHookType=code_block_25.out2@L1, startHookOrientation=code_block_25.out1@L1, endHookOrientation=code_block_25.out1@L1, hostElement=code_block_13.out0@L1, vector=normalAtPoint@L1, lacing=Longest)
distanciamiento_barras = CodeBlock(distanciamiento_barras=code_block_13.out2) { distanciamiento_barras; }
code_block_26 = CodeBlock { 400; }
sub = round - code_block_26
setLayoutAsMaximumSpacing = StructuralDesign.Rebar.Layout.SetLayoutAsMaximumSpacing(rebar=fromCurves, spacing=distanciamiento_barras, arrayLength=sub)
element_types_ᶜᵒⁿᵛᵉʳᵗᵉᵈ_ᵈʳᵒᵖᵈᵒʷⁿ_3 = CodeBlock { DSCore.Types.FindTypeByNameInAssembly("RebarShape", "RevitAPI"); }
all_elements_of_type_3 = ElementsOfType(element_type=element_types_ᶜᵒⁿᵛᵉʳᵗᵉᵈ_ᵈʳᵒᵖᵈᵒʷⁿ_3)
code_block_27 = CodeBlock(t1=all_elements_of_type_3)
# ---------- code_block_27.designscript (5 lines) ----------
"Shape";
str2 = Revit.Elements.Element.Name(t1);
t2 = str2 == "R_M_02";
t3 = DSCore.List.FilterByBoolMask(t1, t2);
t4 = Dictionary.ValueAtKey(t3, "in");
# ----------------------------------------
setParameterByName = Element.SetParameterByName(element=setLayoutAsMaximumSpacing, parameterName=code_block_27.out0, value=code_block_27.t4, lacing=Longest)
show_middle_rebar = Python(IN[0]=setParameterByName)
# ---------- show_middle_rebar.python (53 lines) ----------
# BIBLIOTECAS
# ............................................................................
import clr
import sys

# Para trabajar con nodos nativos de Revit: Ojo con las conversiones
clr.AddReference('RevitNodes')
import Revit
clr.ImportExtensions(Revit.Elements)
clr.ImportExtensions(Revit.GeometryConversion)

# Para trabajar con la RevitAPI
clr.AddReference('RevitAPI')
import Autodesk
from Autodesk.Revit.DB import *
from Autodesk.Revit.DB.Architecture import *
from Autodesk.Revit.ApplicationServices import *
from Autodesk.Revit.DB.Structure import *

# Para trabajar contra el documento y hacer transacciones
clr.AddReference('RevitServices')
from RevitServices.Persistence import DocumentManager
from RevitServices.Transactions import TransactionManager
# Identificadores
doc = DocumentManager.Instance.CurrentDBDocument

# FUNCIONES
# ............................................................................



# ENTRADAS
# ............................................................................
rebar = UnwrapElement(IN[0])
view = doc.ActiveView

# CODIGO
# ............................................................................
# Se inicia la transaccion
TransactionManager.Instance.EnsureInTransaction(doc)

rebar_list = []

for r in rebar:
	r.SetPresentationMode(view, RebarPresentationMode.Middle)
	rebar_list.append(r)

TransactionManager.Instance.TransactionTaskDone()


# SALIDA
# ............................................................................
OUT = rebar_list
# ----------------------------------------
code_block_28 = CodeBlock { 1; }
byProperties = Revit.Filter.OverrideGraphicSettings.ByProperties(cutLineWeight=code_block_28, projectionLineWeight=code_block_28)
overrideInView = Element.OverrideInView(element=show_middle_rebar, overrides=byProperties)
o_document_activeview_2 = Orchid.RevitProject.Common.Document.ActiveView()
getFullGeometryForView = Custom[Rebar.GetFullGeometryForView](rebar=overrideInView, view=o_document_activeview_2)  # package BIM4Struc.Rebar; Generates full geometry for the Rebar for a specific view.
length = Curve.Length(curve=getFullGeometryForView)
maximumItem = List.MaximumItem(list=length)
eq = length == maximumItem
filterByBoolMask = List.FilterByBoolMask(list=getFullGeometryForView, mask=eq)
code_block_29 = CodeBlock { 0.6; }
pointAtParameter = Curve.PointAtParameter(curve=filterByBoolMask.in, param=code_block_29)
code_block_30 = CodeBlock()
# ---------- code_block_30.designscript (4 lines) ----------
family1 = Revit.Family.ByName("EST_A_STRUCTURAL REBAR TAG_MALLA");
familytype1 = Revit.Elements.FamilyType.ByFamilyAndName(family1, "R_M_00_VERTICAL");
false;
true;
# ----------------------------------------
create_tag = Custom[Create Tag](view=o_document_activeview@L1, element=overrideInView@L1, TagLocation=pointAtParameter@L1, TagType=code_block_30.familytype1@L1, addLeader=code_block_30.out2@L1, RunIt=code_block_30.out3@L1, lacing=Longest)  # package Genius Loci; Works only in Revit 2018 and later. Creates a tag at a given location, of given type and in a supplied view. The node also works with Linked Elements (except space and area), Multi Category tag and Material Tag. Based on an archilab node
o_document_activeview_3 = Orchid.RevitProject.Common.Document.ActiveView()
byJoinedCurves_3 = PolyCurve.ByJoinedCurves()  # unwired: curves
intersect_2 = Geometry.Intersect()  # unwired: geometry, other
byLoft = Surface.ByLoft()  # unwired: crossSections
code_block_31 = CodeBlock(x=code_block_11.out1) { x; }
code_block_32 = CodeBlock(malla_horizontal=code_block_31) { malla_horizontal[0]; malla_horizontal[3]; malla_horizontal[4]; }
geometry_2 = Element.Geometry(element=code_block_32.out0)
flatten_3 = List.Flatten(list=geometry_2)
centroid_2 = Solid.Centroid(solid=flatten_3)
byOriginNormal = Plane.ByOriginNormal(origin=centroid_2)
intersect_3 = Geometry.Intersect(geometry=flatten_3, other=byOriginNormal)
flatten_4 = List.Flatten(list=intersect_3)
perimeterCurves_2 = Surface.PerimeterCurves(surface=flatten_4)
code_block_33 = CodeBlock { null; }
replaceEmptyLists_2 = Custom[List.ReplaceEmptyLists](seq=perimeterCurves_2, Replacement=code_block_33)
code_block_34 = CodeBlock(x=replaceEmptyLists_2)
# ---------- code_block_34.designscript (13 lines) ----------
x;

[Imperative]
{
	if (x == null)
	{
		return = [null,null,null,null];
	}
	else
	{
		return = x;
	}
};
# ----------------------------------------
code_block_35 = CodeBlock { [1,3]; }
getItemAtIndex_2 = List.GetItemAtIndex(list=code_block_34.out1@L2, index=code_block_35)
list_clean = Custom[List Clean](list=getItemAtIndex_2)  # package Genius Loci; Removes all Null, Empty and Blank from a list or nested list of lists.
code_block_36 = CodeBlock { 1000; }
extendEnd_2 = Curve.ExtendEnd(curve=list_clean, distance=code_block_36)
extendStart_2 = Curve.ExtendStart(curve=extendEnd_2, distance=code_block_36)
function_apply_2 = ApplyFunction(func=byLoft, arg1=extendStart_2)
byUnion = Solid.ByUnion()  # unwired: solids
geometry_3 = Element.Geometry()  # unwired: element
filterByBoolMask_2 = List.FilterByBoolMask()  # unwired: list, mask
get_joined_elements = Custom[Get Joined Elements](element=code_block_32.out0@L1)  # package Genius Loci; Returns all elements joined to the given element.
getCategory = Element.GetCategory()  # unwired: element
function_apply_3 = ApplyFunction(func=getCategory, arg1=get_joined_elements)
string_from_object = FromObject(obj=function_apply_3)
code_block_37 = CodeBlock { "Walls"; }
eq_2 = string_from_object == code_block_37
function_apply_4 = ApplyFunction(func=filterByBoolMask_2.in, arg1=get_joined_elements, arg2=eq_2)
code_block_38 = CodeBlock(x=function_apply_4)
# ---------- code_block_38.designscript (13 lines) ----------
x;

[Imperative]
{
	if (x == null)
	{
		return = [];
	}
	else
	{
		return = x;
	}
};
# ----------------------------------------
count = List.Count(list=code_block_32.out0)
ofRepeatedItem = List.OfRepeatedItem(item=code_block_38.out1, amount=count)
addItemToFront = List.AddItemToFront(item=code_block_32.out0@L1, list=ofRepeatedItem@L2)
function_apply_5 = ApplyFunction(func=geometry_3, arg1=addItemToFront)
list_clean_2 = Custom[List Clean](list=function_apply_5)
flatten_5 = List.Flatten(list=list_clean_2@L3)
function_apply_6 = ApplyFunction(func=byUnion, arg1=flatten_5)
function_apply_7 = ApplyFunction(func=intersect_2, arg1=function_apply_2, arg2=function_apply_6)
code_block_39 = CodeBlock(x=function_apply_7)  # same code as code_block_38
flatten_6 = List.Flatten(list=code_block_39.out1)
normalAtPoint_2 = Surface.NormalAtPoint(surface=flatten_6, point=centroid_2)
code_block_40 = CodeBlock { "Unconnected Height"; }
getParameterValueByName_2 = Element.GetParameterValueByName(element=code_block_32.out0, parameterName=code_block_40)
code_block_41 = CodeBlock(t2=getParameterValueByName_2) { t1 = t2 / 2; t3 = t1 - 100; t4 = t3 * -1; }
translate_2 = Geometry.Translate(geometry=flatten_6, direction=normalAtPoint_2, distance=code_block_41.t4)
perimeterCurves_3 = Surface.PerimeterCurves(surface=translate_2)
function_apply_8 = ApplyFunction(func=byJoinedCurves_3, arg1=perimeterCurves_3)
code_block_42 = CodeBlock(l=function_apply_8)  # same code as code_block_17
code_block_43 = CodeBlock { -20; }
offset_2 = Curve.Offset(curve=code_block_42.out1, distance=code_block_43)
byJoinedCurves_4 = PolyCurve.ByJoinedCurves(curves=offset_2@L1)
curves_2 = PolyCurve.Curves(polyCurve=byJoinedCurves_4)
code_block_44 = CodeBlock { null; }
replaceEmptyLists_3 = Custom[List.ReplaceEmptyLists](seq=curves_2, Replacement=code_block_44)
code_block_45 = CodeBlock(x=replaceEmptyLists_3)  # same code as code_block_34
code_block_46 = CodeBlock { [0,1]; }
getItemAtIndex_3 = List.GetItemAtIndex(list=code_block_45.out1@L2, index=code_block_46)
element_types_ᶜᵒⁿᵛᵉʳᵗᵉᵈ_ᵈʳᵒᵖᵈᵒʷⁿ_4 = CodeBlock { DSCore.Types.FindTypeByNameInAssembly("RebarHookType", "RevitAPI"); }
all_elements_of_type_4 = ElementsOfType(element_type=element_types_ᶜᵒⁿᵛᵉʳᵗᵉᵈ_ᵈʳᵒᵖᵈᵒʷⁿ_4)
rebar_hook_type_at_start = CodeBlock(t3=all_elements_of_type_4)
# ---------- rebar_hook_type_at_start.designscript (6 lines) ----------
t1 = t3;
str2 = Revit.Elements.Element.Name(t1);
t2 = str2 == "Standard - 90 deg.";
t4 = DSCore.List.FilterByBoolMask(t3, t2);
t5 = Dictionary.ValueAtKey(t4, "in");
t6 = Dictionary.ValueAtKey(t4, "out");
# ----------------------------------------
code_block_47 = CodeBlock(RebarHookType=rebar_hook_type_at_start.t5, rebar_bar_type=code_block_32.out1)
# ---------- code_block_47.designscript (8 lines) ----------
//RebaarStyle
"Standard";
//RebarHookOrientation
"Right";
//Rebar Hook Type;
RebarHookType;
//RebarBarType
rebar_bar_type;
# ----------------------------------------
fromCurves_2 = StructuralDesign.Rebar.Create.FromCurves(curves=getItemAtIndex_3@L2, rebarStyle=code_block_47.out0@L1, rebarBarType=code_block_47.rebar_bar_type@L1, startHookType=code_block_47.RebarHookType@L1, endHookType=code_block_47.RebarHookType@L1, startHookOrientation=code_block_47.out1@L1, endHookOrientation=code_block_47.out1@L1, hostElement=code_block_32.out0@L1, vector=normalAtPoint_2@L1, lacing=Longest)
distanciamiento_barras_2 = CodeBlock(distanciamiento_barras=code_block_32.out2) { distanciamiento_barras; }
code_block_48 = CodeBlock { 350; }
sub_2 = getParameterValueByName_2 - code_block_48
setLayoutAsMaximumSpacing_2 = StructuralDesign.Rebar.Layout.SetLayoutAsMaximumSpacing(rebar=fromCurves_2, spacing=distanciamiento_barras_2, arrayLength=sub_2)
element_types_ᶜᵒⁿᵛᵉʳᵗᵉᵈ_ᵈʳᵒᵖᵈᵒʷⁿ_5 = CodeBlock { DSCore.Types.FindTypeByNameInAssembly("RebarShape", "RevitAPI"); }
all_elements_of_type_5 = ElementsOfType(element_type=element_types_ᶜᵒⁿᵛᵉʳᵗᵉᵈ_ᵈʳᵒᵖᵈᵒʷⁿ_5)
code_block_49 = CodeBlock(t1=all_elements_of_type_5)
# ---------- code_block_49.designscript (5 lines) ----------
"Shape";
str2 = Revit.Elements.Element.Name(t1);
t2 = str2 == "R_M_00";
t3 = DSCore.List.FilterByBoolMask(t1, t2);
t4 = Dictionary.ValueAtKey(t3, "in");
# ----------------------------------------
setParameterByName_2 = Element.SetParameterByName(element=setLayoutAsMaximumSpacing_2, parameterName=code_block_49.out0, value=code_block_49.t4, lacing=Longest)
show_middle_rebar_2 = Python(IN[0]=setParameterByName_2)  # same code as show_middle_rebar
code_block_50 = CodeBlock { 1; }
byProperties_2 = Revit.Filter.OverrideGraphicSettings.ByProperties(cutLineWeight=code_block_50, projectionLineWeight=code_block_50)
overrideInView_2 = Element.OverrideInView(element=show_middle_rebar_2, overrides=byProperties_2)
o_document_activeview_4 = Orchid.RevitProject.Common.Document.ActiveView()
getFullGeometryForView_2 = Custom[Rebar.GetFullGeometryForView](rebar=overrideInView_2, view=o_document_activeview_4)
length_2 = Curve.Length(curve=getFullGeometryForView_2)
maximumItem_2 = List.MaximumItem(list=length_2)
eq_3 = length_2 == maximumItem_2
filterByBoolMask_3 = List.FilterByBoolMask(list=getFullGeometryForView_2, mask=eq_3)
code_block_51 = CodeBlock { 0.6; }
pointAtParameter_2 = Curve.PointAtParameter(curve=filterByBoolMask_3.in, param=code_block_51)
code_block_52 = CodeBlock()
# ---------- code_block_52.designscript (4 lines) ----------
family1 = Revit.Family.ByName("EST_A_STRUCTURAL REBAR TAG_MALLA");
familytype1 = Revit.Elements.FamilyType.ByFamilyAndName(family1, "R_M_00_HORIZONTAL");
false;
true;
# ----------------------------------------
create_tag_2 = Custom[Create Tag](view=o_document_activeview_3@L1, element=overrideInView_2@L1, TagLocation=pointAtParameter_2@L1, TagType=code_block_52.familytype1@L1, addLeader=code_block_52.out2@L1, RunIt=code_block_52.out3@L1, lacing=Longest)
byJoinedCurves_5 = PolyCurve.ByJoinedCurves()  # unwired: curves
code_block_53 = CodeBlock(malla_vertical=code_block_12) { malla_vertical[0]; malla_vertical[1]; malla_vertical[2]; malla_vertical[3]; }
muros_2 = CodeBlock(x=code_block_53.out0) { x; }
geometry_4 = Element.Geometry(element=muros_2)
flatten_7 = List.Flatten(list=geometry_4)
getLocation_2 = Element.GetLocation(element=muros_2)
code_block_54 = CodeBlock { 0.5; }
planeAtParameter_2 = Curve.PlaneAtParameter(curve=getLocation_2, param=code_block_54)
intersect_4 = Geometry.Intersect(geometry=flatten_7, other=planeAtParameter_2)
flatten_8 = List.Flatten(list=intersect_4)
centroid_3 = Solid.Centroid(solid=flatten_7)
normalAtPoint_3 = Surface.NormalAtPoint(surface=flatten_8, point=centroid_3)
code_block_55 = CodeBlock { "Length"; }
getParameterValueByName_3 = Element.GetParameterValueByName(element=muros_2, parameterName=code_block_55)
round_2 = Math.Round(number=getParameterValueByName_3)
rebarDiameter = StructuralDesign.Rebar.Properties.RebarDiameter(rebar=code_block_53.out1)
code_block_56 = CodeBlock(t2=round_2, barDiameter=rebarDiameter) { t1 = t2 / 2; t3 = t1 - 200; t4 = t3 * -1 + barDiameter; }
translate_3 = Geometry.Translate(geometry=flatten_8, direction=normalAtPoint_3, distance=code_block_56.t4)
perimeterCurves_4 = Surface.PerimeterCurves(surface=translate_3)
function_apply_9 = ApplyFunction(func=byJoinedCurves_5, arg1=perimeterCurves_4)
code_block_57 = CodeBlock(l=function_apply_9)  # same code as code_block_17
calculo_posicion_malla_vertical_2 = CodeBlock(t1=code_block_53.out1, t3=code_block_53.out3) { num2 = Properties.RebarDiameter(t1); t2 = num2 / 2; num3 = Properties.RebarDiameter(t3); t4 = t2 + num3; }
code_block_58 = CodeBlock(offSetMalla=calculo_posicion_malla_vertical_2.t4) { -20-offSetMalla; }
offset_3 = Curve.Offset(curve=code_block_57.out1, distance=code_block_58)
byJoinedCurves_6 = PolyCurve.ByJoinedCurves(curves=offset_3@L1)
curves_3 = PolyCurve.Curves(polyCurve=byJoinedCurves_6)
code_block_59 = CodeBlock { null; }
replaceEmptyLists_4 = Custom[List.ReplaceEmptyLists](seq=curves_3, Replacement=code_block_59)
code_block_60 = CodeBlock(x=replaceEmptyLists_4)  # same code as code_block_20
code_block_61 = CodeBlock { 0; }
getItemAtIndex_4 = List.GetItemAtIndex(list=code_block_60.out1@L2, index=code_block_61)
code_block_62 = CodeBlock(l=getItemAtIndex_4)  # same code as code_block_22
code_block_63 = CodeBlock(t1=code_block_62.out1)  # same code as code_block_23
if_2 = If(test=code_block_63.t2, true=code_block_63.curve1, false=code_block_62.out1)
traslapo_armadura_2 = CodeBlock(rebar=code_block_53.out1, offsetMalla=calculo_posicion_malla_vertical_2.t4)  # same code as traslapo_armadura
extendEnd_3 = Curve.ExtendEnd(curve=if_2, distance=traslapo_armadura_2.t3)
code_block_64 = CodeBlock(offsetMalla=calculo_posicion_malla_vertical_2.t4) { 20+offsetMalla; }
extendStart_3 = Curve.ExtendStart(curve=extendEnd_3, distance=code_block_64)
code_block_65 = CodeBlock(rebar_bar_type=code_block_53.out1)  # same code as code_block_25
fromCurves_3 = StructuralDesign.Rebar.Create.FromCurves(curves=extendStart_3@L1, rebarStyle=code_block_65.out0@L1, rebarBarType=code_block_65.rebar_bar_type@L1, startHookType=code_block_65.out2@L1, endHookType=code_block_65.out2@L1, startHookOrientation=code_block_65.out1@L1, endHookOrientation=code_block_65.out1@L1, hostElement=code_block_53.out0@L1, vector=normalAtPoint_3@L1, lacing=Longest)
distanciamiento_barras_3 = CodeBlock(distanciamiento_barras=code_block_53.out2) { distanciamiento_barras; }
code_block_66 = CodeBlock { 400; }
sub_3 = round_2 - code_block_66
setLayoutAsMaximumSpacing_3 = StructuralDesign.Rebar.Layout.SetLayoutAsMaximumSpacing(rebar=fromCurves_3, spacing=distanciamiento_barras_3, arrayLength=sub_3)
element_types_ᶜᵒⁿᵛᵉʳᵗᵉᵈ_ᵈʳᵒᵖᵈᵒʷⁿ_6 = CodeBlock { DSCore.Types.FindTypeByNameInAssembly("RebarShape", "RevitAPI"); }
all_elements_of_type_6 = ElementsOfType(element_type=element_types_ᶜᵒⁿᵛᵉʳᵗᵉᵈ_ᵈʳᵒᵖᵈᵒʷⁿ_6)
code_block_67 = CodeBlock(t1=all_elements_of_type_6)  # same code as code_block_27
setParameterByName_3 = Element.SetParameterByName(element=setLayoutAsMaximumSpacing_3, parameterName=code_block_67.out0, value=code_block_67.t4, lacing=Longest)
show_middle_rebar_3 = Python(IN[0]=setParameterByName_3)  # same code as show_middle_rebar
code_block_68 = CodeBlock { 1; }
byProperties_3 = Revit.Filter.OverrideGraphicSettings.ByProperties(cutLineWeight=code_block_68, projectionLineWeight=code_block_68)
overrideInView_3 = Element.OverrideInView(element=show_middle_rebar_3, overrides=byProperties_3)
byJoinedCurves_7 = PolyCurve.ByJoinedCurves()  # unwired: curves
intersect_5 = Geometry.Intersect()  # unwired: geometry, other
byLoft_2 = Surface.ByLoft()  # unwired: crossSections
code_block_69 = CodeBlock(malla_horizontal=code_block_31) { malla_horizontal[0]; malla_horizontal[3]; malla_horizontal[4]; }
geometry_5 = Element.Geometry(element=code_block_69.out0)
flatten_9 = List.Flatten(list=geometry_5)
centroid_4 = Solid.Centroid(solid=flatten_9)
byOriginNormal_2 = Plane.ByOriginNormal(origin=centroid_4)
intersect_6 = Geometry.Intersect(geometry=flatten_9, other=byOriginNormal_2)
flatten_10 = List.Flatten(list=intersect_6)
perimeterCurves_5 = Surface.PerimeterCurves(surface=flatten_10)
code_block_70 = CodeBlock { null; }
replaceEmptyLists_5 = Custom[List.ReplaceEmptyLists](seq=perimeterCurves_5, Replacement=code_block_70)
code_block_71 = CodeBlock(x=replaceEmptyLists_5)  # same code as code_block_34
code_block_72 = CodeBlock { [1,3]; }
getItemAtIndex_5 = List.GetItemAtIndex(list=code_block_71.out1@L2, index=code_block_72)
list_clean_3 = Custom[List Clean](list=getItemAtIndex_5)
code_block_73 = CodeBlock { 1000; }
extendEnd_4 = Curve.ExtendEnd(curve=list_clean_3, distance=code_block_73)
extendStart_4 = Curve.ExtendStart(curve=extendEnd_4, distance=code_block_73)
function_apply_10 = ApplyFunction(func=byLoft_2, arg1=extendStart_4)
byUnion_2 = Solid.ByUnion()  # unwired: solids
geometry_6 = Element.Geometry()  # unwired: element
filterByBoolMask_4 = List.FilterByBoolMask()  # unwired: list, mask
get_joined_elements_2 = Custom[Get Joined Elements](element=code_block_69.out0@L1)
getCategory_2 = Element.GetCategory()  # unwired: element
function_apply_11 = ApplyFunction(func=getCategory_2, arg1=get_joined_elements_2)
string_from_object_2 = FromObject(obj=function_apply_11)
code_block_74 = CodeBlock { "Walls"; }
eq_4 = string_from_object_2 == code_block_74
function_apply_12 = ApplyFunction(func=filterByBoolMask_4.in, arg1=get_joined_elements_2, arg2=eq_4)
code_block_75 = CodeBlock(x=function_apply_12)  # same code as code_block_38
count_2 = List.Count(list=code_block_69.out0)
ofRepeatedItem_2 = List.OfRepeatedItem(item=code_block_75.out1, amount=count_2)
addItemToFront_2 = List.AddItemToFront(item=code_block_69.out0@L1, list=ofRepeatedItem_2@L2)
function_apply_13 = ApplyFunction(func=geometry_6, arg1=addItemToFront_2)
list_clean_4 = Custom[List Clean](list=function_apply_13)
flatten_11 = List.Flatten(list=list_clean_4@L3)
function_apply_14 = ApplyFunction(func=byUnion_2, arg1=flatten_11)
function_apply_15 = ApplyFunction(func=intersect_5, arg1=function_apply_10, arg2=function_apply_14)
code_block_76 = CodeBlock(x=function_apply_15)  # same code as code_block_38
flatten_12 = List.Flatten(list=code_block_76.out1)
normalAtPoint_4 = Surface.NormalAtPoint(surface=flatten_12, point=centroid_4)
code_block_77 = CodeBlock { "Unconnected Height"; }
getParameterValueByName_4 = Element.GetParameterValueByName(element=code_block_69.out0, parameterName=code_block_77)
rebarDiameter_2 = StructuralDesign.Rebar.Properties.RebarDiameter(rebar=code_block_69.out1)
code_block_78 = CodeBlock(t5=getParameterValueByName_4, num1=rebarDiameter_2) { t2 = t5; t1 = t2 / 2; t3 = t1 - 100; t4 = t3 * -1; t6 = t4 + num1; }
translate_4 = Geometry.Translate(geometry=flatten_12, direction=normalAtPoint_4, distance=code_block_78.t6)
perimeterCurves_6 = Surface.PerimeterCurves(surface=translate_4)
function_apply_16 = ApplyFunction(func=byJoinedCurves_7, arg1=perimeterCurves_6)
code_block_79 = CodeBlock(l=function_apply_16)  # same code as code_block_17
code_block_80 = CodeBlock { -20; }
offset_4 = Curve.Offset(curve=code_block_79.out1, distance=code_block_80)
byJoinedCurves_8 = PolyCurve.ByJoinedCurves(curves=offset_4@L1)
curves_4 = PolyCurve.Curves(polyCurve=byJoinedCurves_8)
code_block_81 = CodeBlock { null; }
replaceEmptyLists_6 = Custom[List.ReplaceEmptyLists](seq=curves_4, Replacement=code_block_81)
code_block_82 = CodeBlock(x=replaceEmptyLists_6)  # same code as code_block_34
code_block_83 = CodeBlock { [2,3]; }
getItemAtIndex_6 = List.GetItemAtIndex(list=code_block_82.out1@L2, index=code_block_83)
element_types_ᶜᵒⁿᵛᵉʳᵗᵉᵈ_ᵈʳᵒᵖᵈᵒʷⁿ_7 = CodeBlock { DSCore.Types.FindTypeByNameInAssembly("RebarHookType", "RevitAPI"); }
all_elements_of_type_7 = ElementsOfType(element_type=element_types_ᶜᵒⁿᵛᵉʳᵗᵉᵈ_ᵈʳᵒᵖᵈᵒʷⁿ_7)
rebar_hook_type_at_start_2 = CodeBlock(t3=all_elements_of_type_7)  # same code as rebar_hook_type_at_start
code_block_84 = CodeBlock(RebarHookType=rebar_hook_type_at_start_2.t5, rebar_bar_type=code_block_69.out1)  # same code as code_block_47
fromCurves_4 = StructuralDesign.Rebar.Create.FromCurves(curves=getItemAtIndex_6@L2, rebarStyle=code_block_84.out0@L1, rebarBarType=code_block_84.rebar_bar_type@L1, startHookType=code_block_84.RebarHookType@L1, endHookType=code_block_84.RebarHookType@L1, startHookOrientation=code_block_84.out1@L1, endHookOrientation=code_block_84.out1@L1, hostElement=code_block_69.out0@L1, vector=normalAtPoint_4@L1, lacing=Longest)
distanciamiento_barras_4 = CodeBlock(distanciamiento_barras=code_block_69.out2) { distanciamiento_barras; }
code_block_85 = CodeBlock { 350; }
sub_4 = getParameterValueByName_4 - code_block_85
setLayoutAsMaximumSpacing_4 = StructuralDesign.Rebar.Layout.SetLayoutAsMaximumSpacing(rebar=fromCurves_4, spacing=distanciamiento_barras_4, arrayLength=sub_4)
element_types_ᶜᵒⁿᵛᵉʳᵗᵉᵈ_ᵈʳᵒᵖᵈᵒʷⁿ_8 = CodeBlock { DSCore.Types.FindTypeByNameInAssembly("RebarShape", "RevitAPI"); }
all_elements_of_type_8 = ElementsOfType(element_type=element_types_ᶜᵒⁿᵛᵉʳᵗᵉᵈ_ᵈʳᵒᵖᵈᵒʷⁿ_8)
code_block_86 = CodeBlock(t1=all_elements_of_type_8)  # same code as code_block_49
setParameterByName_4 = Element.SetParameterByName(element=setLayoutAsMaximumSpacing_4, parameterName=code_block_86.out0, value=code_block_86.t4, lacing=Longest)
show_middle_rebar_4 = Python(IN[0]=setParameterByName_4)  # same code as show_middle_rebar
code_block_87 = CodeBlock { 1; }
byProperties_4 = Revit.Filter.OverrideGraphicSettings.ByProperties(cutLineWeight=code_block_87, projectionLineWeight=code_block_87)
overrideInView_4 = Element.OverrideInView(element=show_middle_rebar_4, overrides=byProperties_4)
