# Dynamo graph script.dyn (Dynamo 2.6.2.15705)
# packages: Data-Shapes 2022.2.103, Structural Design 2021.1.22, Clockwork for Dynamo 2.x 2.4.0, Genius Loci 2021.11.10, Crumple 2022.2.13

byJoinedCurves = PolyCurve.ByJoinedCurves()  # unwired: curves
intersect = Geometry.Intersect()  # unwired: geometry, other
byLoft = Surface.ByLoft()  # unwired: crossSections
code_block = CodeBlock { "Doble Malla"; }
code_block_2 = CodeBlock { "INICIAR"; "CANCELAR"; true; 430; 170; 650; }
categories_ᶜᵒⁿᵛᵉʳᵗᵉᵈ_ᵈʳᵒᵖᵈᵒʷⁿ = CodeBlock()
# ---------- categories_ᶜᵒⁿᵛᵉʳᵗᵉᵈ_ᵈʳᵒᵖᵈᵒʷⁿ.designscript (4 lines) ----------
"Seleccionar Muro\ny Fundación";
"SELECCIONAR";
t1 = ["Walls", "Structural Foundations"];
category1 = Revit.Category.ByName(t1);
# ----------------------------------------
selectmodelelements_data = Custom[SelectModelElements Data](InputName=categories_ᶜᵒⁿᵛᵉʳᵗᵉᵈ_ᵈʳᵒᵖᵈᵒʷⁿ.out0, ButtonText=categories_ᶜᵒⁿᵛᵉʳᵗᵉᵈ_ᵈʳᵒᵖᵈᵒʷⁿ.out1, CategoryFilter=categories_ᶜᵒⁿᵛᵉʳᵗᵉᵈ_ᵈʳᵒᵖᵈᵒʷⁿ.category1)  # package Data-Shapes; Creates a Revit element selection input for UI.MultipleInputForm++ . Check out www.data-shapes.net for more infos!
code_block_3 = CodeBlock { "Malla Vertical"; }
code_block_4 = CodeBlock { "Diametro"; }
element_types_ᶜᵒⁿᵛᵉʳᵗᵉᵈ_ᵈʳᵒᵖᵈᵒʷⁿ = CodeBlock { DSCore.Types.FindTypeByNameInAssembly("RebarBarType", "RevitAPI"); }
all_elements_of_type = ElementsOfType(element_type=element_types_ᶜᵒⁿᵛᵉʳᵗᵉᵈ_ᵈʳᵒᵖᵈᵒʷⁿ)
code_block_5 = CodeBlock(t5=all_elements_of_type)
# ---------- code_block_5.designscript (8 lines) ----------
t4 = t5;
t1 = t4;
num1 = Properties.RebarDiameter(t1);
t2 = DSCore.List.SortByKey(t1, num1);
t3 = Dictionary.ValueAtKey(t2, "sorted list");
str1 = Revit.Elements.Element.Name(t3);
0;
false;
# ----------------------------------------
dropdown_data = Custom[DropDown Data](InputName=code_block_4, Keys=code_block_5.str1, Values=code_block_5.t3, DefaultValueIndex=code_block_5.out6, Sorted_optional=code_block_5.out7)  # package Data-Shapes; Create data for DropDown input in UI.MultiInputForm ++ . Check out www.data-shapes.net for more infos.
code_block_6 = CodeBlock { "Distanciamiento"; "200"; true; }
textbox_data = Custom[TextBox Data](InputName=code_block_6.out0, DefaultText=code_block_6.out1, IsNumberEntry=code_block_6.out2)  # package Data-Shapes; Create Data for TextBox input in UI.MultipleInputForm ++ . Check out www.data-shapes.net for more informations
list_create = List.Create(item0=dropdown_data, item1=textbox_data)
inputgroup_data = Custom[InputGroup Data](GroupTitle=code_block_3, Inputs=list_create)  # package Data-Shapes; Creates a group of inputs for UI.MultipleInputForm ++ . Check out www.data-shapes.net for more infos !
code_block_7 = CodeBlock { "Malla Horizontal"; }
code_block_8 = CodeBlock { "Diametro"; }
element_types_ᶜᵒⁿᵛᵉʳᵗᵉᵈ_ᵈʳᵒᵖᵈᵒʷⁿ_2 = CodeBlock { DSCore.Types.FindTypeByNameInAssembly("RebarBarType", "RevitAPI"); }
all_elements_of_type_2 = ElementsOfType(element_type=element_types_ᶜᵒⁿᵛᵉʳᵗᵉᵈ_ᵈʳᵒᵖᵈᵒʷⁿ_2)
code_block_9 = CodeBlock(t5=all_elements_of_type_2)  # same code as code_block_5
dropdown_data_2 = Custom[DropDown Data](InputName=code_block_8, Keys=code_block_9.str1, Values=code_block_9.t3, DefaultValueIndex=code_block_9.out6, Sorted_optional=code_block_9.out7)
code_block_10 = CodeBlock { "Distanciamiento"; "200"; true; }
textbox_data_2 = Custom[TextBox Data](InputName=code_block_10.out0, DefaultText=code_block_10.out1, IsNumberEntry=code_block_10.out2)
list_create_2 = List.Create(item0=dropdown_data_2, item1=textbox_data_2)
inputgroup_data_2 = Custom[InputGroup Data](GroupTitle=code_block_7, Inputs=list_create_2)
list_create_3 = List.Create(item0=selectmodelelements_data, item1=inputgroup_data, item2=inputgroup_data_2)
multipleinputform = Custom[MultipleInputForm ++](Description_optional=code_block, ButtonText_optional=code_block_2.out0, Inputs=list_create_3, Toggle=code_block_2.out2, CancelButtonText_optional=code_block_2.out1, MaxHeight_optional=code_block_2.out5, Width_optional=code_block_2.out3, LabelWidth_optional=code_block_2.out4)  # package Data-Shapes; Create a form with multiple inputs. see www.data-shapes.net for tutorials and infos!
code_block_11 = CodeBlock(l=multipleinputform.User_Inputs)
# ---------- code_block_11.designscript (12 lines) ----------
l;
[Imperative]
{
	if (l == null)
	{
		return = [[],[],[],[],[],[]];
	}
	else
	{
		return = l;
	}
};
# ----------------------------------------
code_block_12 = CodeBlock(x=code_block_11.out1) { x; }  # frozen
code_block_13 = CodeBlock(malla_horizontal=code_block_12) { malla_horizontal[0]; malla_horizontal[3]; malla_horizontal[4]; }
geometry = Element.Geometry(element=code_block_13.out0)
flatten = List.Flatten(list=geometry)
centroid = Solid.Centroid(solid=flatten)
byOriginNormal = Plane.ByOriginNormal(origin=centroid)
intersect_2 = Geometry.Intersect(geometry=flatten, other=byOriginNormal)
flatten_2 = List.Flatten(list=intersect_2)
perimeterCurves = Surface.PerimeterCurves(surface=flatten_2)
code_block_14 = CodeBlock { null; }
replaceEmptyLists = Custom[List.ReplaceEmptyLists](seq=perimeterCurves, Replacement=code_block_14)  # package Clockwork for Dynamo 2.x; Replaces all empty lists within a given list with a substitute
code_block_15 = CodeBlock(x=replaceEmptyLists)
# ---------- code_block_15.designscript (13 lines) ----------
x;

[Imperative]
{
	if (x == null)
	{
		return = [null,null,null,null];
	}
	else
	{
		return = x;
	}
};
# ----------------------------------------
code_block_16 = CodeBlock { [1,3]; }
getItemAtIndex = List.GetItemAtIndex(list=code_block_15.out1@L2, index=code_block_16)
list_clean = Custom[List Clean](list=getItemAtIndex)  # package Genius Loci; Removes all Null, Empty and Blank from a list or nested list of lists.
code_block_17 = CodeBlock { 1000; }
extendEnd = Curve.ExtendEnd(curve=list_clean, distance=code_block_17)
extendStart = Curve.ExtendStart(curve=extendEnd, distance=code_block_17)
function_apply = ApplyFunction(func=byLoft, arg1=extendStart)
byUnion = Solid.ByUnion()  # unwired: solids
geometry_2 = Element.Geometry()  # unwired: element
filterByBoolMask = List.FilterByBoolMask()  # unwired: list, mask
get_joined_elements = Custom[Get Joined Elements](element=code_block_13.out0@L1)  # package Genius Loci; Returns all elements joined to the given element.
getCategory = Element.GetCategory()  # unwired: element
function_apply_2 = ApplyFunction(func=getCategory, arg1=get_joined_elements)
string_from_object = FromObject(obj=function_apply_2)
code_block_18 = CodeBlock { "Walls"; }
eq = string_from_object == code_block_18
function_apply_3 = ApplyFunction(func=filterByBoolMask.in, arg1=get_joined_elements, arg2=eq)
code_block_19 = CodeBlock(x=function_apply_3)
# ---------- code_block_19.designscript (13 lines) ----------
x;

[Imperative]
{
	if (x == null)
	{
		return = [];
	}
	else
	{
		return = x;
	}
};
# ----------------------------------------
count = List.Count(list=code_block_13.out0)
ofRepeatedItem = List.OfRepeatedItem(item=code_block_19.out1, amount=count)
addItemToFront = List.AddItemToFront(item=code_block_13.out0@L1, list=ofRepeatedItem@L2)
function_apply_4 = ApplyFunction(func=geometry_2, arg1=addItemToFront)
list_clean_2 = Custom[List Clean](list=function_apply_4)
flatten_3 = List.Flatten(list=list_clean_2@L3)
function_apply_5 = ApplyFunction(func=byUnion, arg1=flatten_3)
function_apply_6 = ApplyFunction(func=intersect, arg1=function_apply, arg2=function_apply_5)
code_block_20 = CodeBlock(x=function_apply_6)  # same code as code_block_19
flatten_4 = List.Flatten(list=code_block_20.out1)
normalAtPoint = Surface.NormalAtPoint(surface=flatten_4, point=centroid)
code_block_21 = CodeBlock { "Unconnected Height"; }
getParameterValueByName = Element.GetParameterValueByName(element=code_block_13.out0, parameterName=code_block_21)
code_block_22 = CodeBlock(t2=getParameterValueByName) { t1 = t2 / 2; t3 = t1 - 100; t4 = t3 * -1; }
translate = Geometry.Translate(geometry=flatten_4, direction=normalAtPoint, distance=code_block_22.t4)
perimeterCurves_2 = Surface.PerimeterCurves(surface=translate)
function_apply_7 = ApplyFunction(func=byJoinedCurves, arg1=perimeterCurves_2)
code_block_23 = CodeBlock(l=function_apply_7)
# ---------- code_block_23.designscript (12 lines) ----------
l;
[Imperative]
{
	if (l == null)
	{
		return = [];
	}
	else
	{
		return = l;
	}
};
# ----------------------------------------
code_block_24 = CodeBlock { -20; }
offset = Curve.Offset(curve=code_block_23.out1, distance=code_block_24)
byJoinedCurves_2 = PolyCurve.ByJoinedCurves(curves=offset@L1)
curves = PolyCurve.Curves(polyCurve=byJoinedCurves_2)
code_block_25 = CodeBlock { null; }
replaceEmptyLists_2 = Custom[List.ReplaceEmptyLists](seq=curves, Replacement=code_block_25)
code_block_26 = CodeBlock(x=replaceEmptyLists_2)  # same code as code_block_15
code_block_27 = CodeBlock { [0,1]; }
getItemAtIndex_2 = List.GetItemAtIndex(list=code_block_26.out1@L2, index=code_block_27)
code_block_28 = CodeBlock(rebar_bar_type=code_block_13.out1)
# ---------- code_block_28.designscript (8 lines) ----------
//RebaarStyle
"Standard";
//RebarHookOrientation
"Right";
//Rebar Hook Type;
Revit.Elements.ElementSelector.ByElementId(474495);
//RebarBarType
rebar_bar_type;
# ----------------------------------------
fromCurves = StructuralDesign.Rebar.Create.FromCurves(curves=getItemAtIndex_2@L2, rebarStyle=code_block_28.out0@L1, rebarBarType=code_block_28.rebar_bar_type@L1, startHookType=code_block_28.out2@L1, endHookType=code_block_28.out2@L1, startHookOrientation=code_block_28.out1@L1, endHookOrientation=code_block_28.out1@L1, hostElement=code_block_13.out0@L1, vector=normalAtPoint@L1, lacing=Longest)
distanciamiento_barras = CodeBlock(distanciamiento_barras=code_block_13.out2) { distanciamiento_barras; }
code_block_29 = CodeBlock { 350; }
sub = getParameterValueByName - code_block_29
setLayoutAsMaximumSpacing = StructuralDesign.Rebar.Layout.SetLayoutAsMaximumSpacing(rebar=fromCurves, spacing=distanciamiento_barras, arrayLength=sub)
byJoinedCurves_3 = PolyCurve.ByJoinedCurves()  # unwired: curves
intersect_3 = Geometry.Intersect()  # unwired: geometry, other
byLoft_2 = Surface.ByLoft()  # unwired: crossSections
code_block_30 = CodeBlock(malla_horizontal=code_block_12) { malla_horizontal[0]; malla_horizontal[3]; malla_horizontal[4]; }
geometry_3 = Element.Geometry(element=code_block_30.out0)
flatten_5 = List.Flatten(list=geometry_3)
centroid_2 = Solid.Centroid(solid=flatten_5)
byOriginNormal_2 = Plane.ByOriginNormal(origin=centroid_2)
intersect_4 = Geometry.Intersect(geometry=flatten_5, other=byOriginNormal_2)
flatten_6 = List.Flatten(list=intersect_4)
perimeterCurves_3 = Surface.PerimeterCurves(surface=flatten_6)
code_block_31 = CodeBlock { null; }
replaceEmptyLists_3 = Custom[List.ReplaceEmptyLists](seq=perimeterCurves_3, Replacement=code_block_31)
code_block_32 = CodeBlock(x=replaceEmptyLists_3)  # same code as code_block_15
code_block_33 = CodeBlock { [1,3]; }
getItemAtIndex_3 = List.GetItemAtIndex(list=code_block_32.out1@L2, index=code_block_33)
list_clean_3 = Custom[List Clean](list=getItemAtIndex_3)
code_block_34 = CodeBlock { 1000; }
extendEnd_2 = Curve.ExtendEnd(curve=list_clean_3, distance=code_block_34)
extendStart_2 = Curve.ExtendStart(curve=extendEnd_2, distance=code_block_34)
function_apply_8 = ApplyFunction(func=byLoft_2, arg1=extendStart_2)
byUnion_2 = Solid.ByUnion()  # unwired: solids
geometry_4 = Element.Geometry()  # unwired: element
filterByBoolMask_2 = List.FilterByBoolMask()  # unwired: list, mask
get_joined_elements_2 = Custom[Get Joined Elements](element=code_block_30.out0@L1)
getCategory_2 = Element.GetCategory()  # unwired: element
function_apply_9 = ApplyFunction(func=getCategory_2, arg1=get_joined_elements_2)
string_from_object_2 = FromObject(obj=function_apply_9)
code_block_35 = CodeBlock { "Walls"; }
eq_2 = string_from_object_2 == code_block_35
function_apply_10 = ApplyFunction(func=filterByBoolMask_2.in, arg1=get_joined_elements_2, arg2=eq_2)
code_block_36 = CodeBlock(x=function_apply_10)  # same code as code_block_19
count_2 = List.Count(list=code_block_30.out0)
ofRepeatedItem_2 = List.OfRepeatedItem(item=code_block_36.out1, amount=count_2)
addItemToFront_2 = List.AddItemToFront(item=code_block_30.out0@L1, list=ofRepeatedItem_2@L2)
function_apply_11 = ApplyFunction(func=geometry_4, arg1=addItemToFront_2)
list_clean_4 = Custom[List Clean](list=function_apply_11)
flatten_7 = List.Flatten(list=list_clean_4@L3)
function_apply_12 = ApplyFunction(func=byUnion_2, arg1=flatten_7)
function_apply_13 = ApplyFunction(func=intersect_3, arg1=function_apply_8, arg2=function_apply_12)
code_block_37 = CodeBlock(x=function_apply_13)  # same code as code_block_19
flatten_8 = List.Flatten(list=code_block_37.out1)
normalAtPoint_2 = Surface.NormalAtPoint(surface=flatten_8, point=centroid_2)
code_block_38 = CodeBlock { "Unconnected Height"; }
getParameterValueByName_2 = Element.GetParameterValueByName(element=code_block_30.out0, parameterName=code_block_38)
rebarDiameter = StructuralDesign.Rebar.Properties.RebarDiameter(rebar=code_block_30.out1)
code_block_39 = CodeBlock(t5=getParameterValueByName_2, num1=rebarDiameter) { t2 = t5; t1 = t2 / 2; t3 = t1 - 100; t4 = t3 * -1; t6 = t4 + num1; }
translate_2 = Geometry.Translate(geometry=flatten_8, direction=normalAtPoint_2, distance=code_block_39.t6)
perimeterCurves_4 = Surface.PerimeterCurves(surface=translate_2)
function_apply_14 = ApplyFunction(func=byJoinedCurves_3, arg1=perimeterCurves_4)
code_block_40 = CodeBlock(l=function_apply_14)  # same code as code_block_23
code_block_41 = CodeBlock { -20; }
offset_2 = Curve.Offset(curve=code_block_40.out1, distance=code_block_41)
byJoinedCurves_4 = PolyCurve.ByJoinedCurves(curves=offset_2@L1)
curves_2 = PolyCurve.Curves(polyCurve=byJoinedCurves_4)
code_block_42 = CodeBlock { null; }
replaceEmptyLists_4 = Custom[List.ReplaceEmptyLists](seq=curves_2, Replacement=code_block_42)
code_block_43 = CodeBlock(x=replaceEmptyLists_4)  # same code as code_block_15
code_block_44 = CodeBlock { [2,3]; }
getItemAtIndex_4 = List.GetItemAtIndex(list=code_block_43.out1@L2, index=code_block_44)
code_block_45 = CodeBlock(rebar_bar_type=code_block_30.out1)  # same code as code_block_28
fromCurves_2 = StructuralDesign.Rebar.Create.FromCurves(curves=getItemAtIndex_4@L2, rebarStyle=code_block_45.out0@L1, rebarBarType=code_block_45.rebar_bar_type@L1, startHookType=code_block_45.out2@L1, endHookType=code_block_45.out2@L1, startHookOrientation=code_block_45.out1@L1, endHookOrientation=code_block_45.out1@L1, hostElement=code_block_30.out0@L1, vector=normalAtPoint_2@L1, lacing=Longest)
distanciamiento_barras_2 = CodeBlock(distanciamiento_barras=code_block_30.out2) { distanciamiento_barras; }
code_block_46 = CodeBlock { 350; }
sub_2 = getParameterValueByName_2 - code_block_46
setLayoutAsMaximumSpacing_2 = StructuralDesign.Rebar.Layout.SetLayoutAsMaximumSpacing(rebar=fromCurves_2, spacing=distanciamiento_barras_2, arrayLength=sub_2)
byJoinedCurves_5 = PolyCurve.ByJoinedCurves()  # unwired: curves
code_block_47 = CodeBlock(x=code_block_11.out1) { x; }
code_block_48 = CodeBlock(malla_vertical=code_block_47) { malla_vertical[0]; malla_vertical[1]; malla_vertical[2]; malla_vertical[3]; }  # frozen
muros = CodeBlock(x=code_block_48.out0) { x; }
geometry_5 = Element.Geometry(element=muros)
flatten_9 = List.Flatten(list=geometry_5)
getLocation = Element.GetLocation(element=muros)
code_block_49 = CodeBlock { 0.5; }
planeAtParameter = Curve.PlaneAtParameter(curve=getLocation, param=code_block_49)
intersect_5 = Geometry.Intersect(geometry=flatten_9, other=planeAtParameter)
flatten_10 = List.Flatten(list=intersect_5)
centroid_3 = Solid.Centroid(solid=flatten_9)
normalAtPoint_3 = Surface.NormalAtPoint(surface=flatten_10, point=centroid_3)
code_block_50 = CodeBlock { "Length"; }
getParameterValueByName_3 = Element.GetParameterValueByName(element=muros, parameterName=code_block_50)
round = Math.Round(number=getParameterValueByName_3)
code_block_51 = CodeBlock(t2=round) { t1 = t2 / 2; t3 = t1 - 200; t4 = t3 * -1; }
translate_3 = Geometry.Translate(geometry=flatten_10, direction=normalAtPoint_3, distance=code_block_51.t4)
perimeterCurves_5 = Surface.PerimeterCurves(surface=translate_3)
function_apply_15 = ApplyFunction(func=byJoinedCurves_5, arg1=perimeterCurves_5)
code_block_52 = CodeBlock(l=function_apply_15)  # same code as code_block_23
calculo_posicion_malla_vertical = CodeBlock(t1=code_block_48.out1, t3=code_block_48.out3) { num2 = Properties.RebarDiameter(t1); t2 = num2 / 2; num3 = Properties.RebarDiameter(t3); t4 = t2 + num3; }
code_block_53 = CodeBlock(offSetMalla=calculo_posicion_malla_vertical.t4) { -20-offSetMalla; }
offset_3 = Curve.Offset(curve=code_block_52.out1, distance=code_block_53)
byJoinedCurves_6 = PolyCurve.ByJoinedCurves(curves=offset_3@L1)
curves_3 = PolyCurve.Curves(polyCurve=byJoinedCurves_6)
code_block_54 = CodeBlock { null; }
replaceEmptyLists_5 = Custom[List.ReplaceEmptyLists](seq=curves_3, Replacement=code_block_54)
code_block_55 = CodeBlock(x=replaceEmptyLists_5)
# ---------- code_block_55.designscript (13 lines) ----------
x;

[Imperative]
{
	if (x == null)
	{
		return = [null,null,null];
	}
	else
	{
		return = x;
	}
};
# ----------------------------------------
code_block_56 = CodeBlock { 0; }
getItemAtIndex_5 = List.GetItemAtIndex(list=code_block_55.out1@L2, index=code_block_56)
code_block_57 = CodeBlock(l=getItemAtIndex_5)
# ---------- code_block_57.designscript (12 lines) ----------
l;
[Imperative]
{
	if (l[0] == null)
	{
		return = [];
	}
	else
	{
		return = l;
	}
};
# ----------------------------------------
code_block_58 = CodeBlock(t1=code_block_57.out1)
# ---------- code_block_58.designscript (6 lines) ----------
point1 = Autodesk.Curve.StartPoint(t1);
point2 = Autodesk.Curve.EndPoint(t1);
vector1 = Autodesk.Vector.ByTwoPoints(point1, point2);
num2 = Autodesk.Vector.Z(vector1);
t2 = num2 < 0;
curve1 = Autodesk.Curve.Reverse(t1);
# ----------------------------------------
if_ = If(test=code_block_58.t2, true=code_block_58.curve1, false=code_block_57.out1)
traslapo_armadura = CodeBlock(t1=code_block_48.out1, offsetMalla=calculo_posicion_malla_vertical.t4) { num3 = Properties.RebarDiameter(t1); t2 = num3 * 60; t3 = t2 + 100 + 20 + offsetMalla; }
extendEnd_3 = Curve.ExtendEnd(curve=if_, distance=traslapo_armadura.t3)
code_block_59 = CodeBlock(offsetMalla=calculo_posicion_malla_vertical.t4) { 20+offsetMalla; }
extendStart_3 = Curve.ExtendStart(curve=extendEnd_3, distance=code_block_59)
code_block_60 = CodeBlock(rebar_bar_type=code_block_48.out1)
# ---------- code_block_60.designscript (8 lines) ----------
//RebaarStyle
"Standard";
//RebarHookOrientation
"Left";
//Rebar Hook Type;
null;
//RebarBarType
rebar_bar_type;
# ----------------------------------------
fromCurves_3 = StructuralDesign.Rebar.Create.FromCurves(curves=extendStart_3@L1, rebarStyle=code_block_60.out0@L1, rebarBarType=code_block_60.rebar_bar_type@L1, startHookType=code_block_60.out2@L1, endHookType=code_block_60.out2@L1, startHookOrientation=code_block_60.out1@L1, endHookOrientation=code_block_60.out1@L1, hostElement=code_block_48.out0@L1, vector=normalAtPoint_3@L1, lacing=Longest)
distanciamiento_barras_3 = CodeBlock(distanciamiento_barras=code_block_48.out2) { distanciamiento_barras; }
code_block_61 = CodeBlock { 400; }
sub_3 = round - code_block_61
setLayoutAsMaximumSpacing_3 = StructuralDesign.Rebar.Layout.SetLayoutAsMaximumSpacing(rebar=fromCurves_3, spacing=distanciamiento_barras_3, arrayLength=sub_3)
element_types_ᶜᵒⁿᵛᵉʳᵗᵉᵈ_ᵈʳᵒᵖᵈᵒʷⁿ_3 = CodeBlock { DSCore.Types.FindTypeByNameInAssembly("RebarShape", "RevitAPI"); }
all_elements_of_type_3 = ElementsOfType(element_type=element_types_ᶜᵒⁿᵛᵉʳᵗᵉᵈ_ᵈʳᵒᵖᵈᵒʷⁿ_3)
code_block_62 = CodeBlock(t1=all_elements_of_type_3)
# ---------- code_block_62.designscript (5 lines) ----------
"Shape";
str2 = Revit.Elements.Element.Name(t1);
t2 = str2 == "R_M_02";
t3 = DSCore.List.FilterByBoolMask(t1, t2);
t4 = Dictionary.ValueAtKey(t3, "in");
# ----------------------------------------
setParameterByName = Element.SetParameterByName(element=setLayoutAsMaximumSpacing_3, parameterName=code_block_62.out0, value=code_block_62.t4, lacing=Longest)
byLoft_3 = Surface.ByLoft()  # unwired: crossSections
byJoinedCurves_7 = PolyCurve.ByJoinedCurves()  # unwired: curves
code_block_63 = CodeBlock(malla_vertical=code_block_47) { malla_vertical[0]; malla_vertical[1]; malla_vertical[2]; malla_vertical[3]; }
code_block_64 = CodeBlock(x=code_block_63.out0) { x; }
code_block_65 = CodeBlock(x=code_block_64) { x; }
getCategory_3 = Element.GetCategory(element=code_block_65)
string_from_object_3 = FromObject(obj=getCategory_3)
code_block_66 = CodeBlock { "Walls"; }
eq_3 = string_from_object_3 == code_block_66
filterByBoolMask_3 = List.FilterByBoolMask(list=code_block_65, mask=eq_3)
geometry_6 = Element.Geometry(element=filterByBoolMask_3.in)
flatten_11 = List.Flatten(list=geometry_6)
getLocation_2 = Element.GetLocation(element=filterByBoolMask_3.in)
code_block_67 = CodeBlock { 0.5; }
planeAtParameter_2 = Curve.PlaneAtParameter(curve=getLocation_2, param=code_block_67)
intersect_6 = Geometry.Intersect(geometry=flatten_11, other=planeAtParameter_2)
perimeterCurves_6 = Surface.PerimeterCurves(surface=intersect_6)
flatten_12 = List.Flatten(list=perimeterCurves_6)
function_apply_16 = ApplyFunction(func=byJoinedCurves_7, arg1=flatten_12)
code_block_68 = CodeBlock(x=function_apply_16)  # same code as code_block_19
curves_4 = PolyCurve.Curves(polyCurve=code_block_68.out1)
code_block_69 = CodeBlock { null; }
replaceEmptyLists_6 = Custom[List.ReplaceEmptyLists](seq=curves_4, Replacement=code_block_69)
code_block_70 = CodeBlock(x=replaceEmptyLists_6)  # same code as code_block_55
code_block_71 = CodeBlock { [0,2]; }
getItemAtIndex_6 = List.GetItemAtIndex(list=code_block_70.out1@L2, index=code_block_71)
code_block_72 = CodeBlock(l=getItemAtIndex_6)
# ---------- code_block_72.designscript (12 lines) ----------
l;
[Imperative]
{
	if (l[0][0] == null)
	{
		return = [];
	}
	else
	{
		return = l;
	}
};
# ----------------------------------------
code_block_73 = CodeBlock { 8000; }
extendStart_4 = Curve.ExtendStart(curve=code_block_72.out1, distance=code_block_73)
extendEnd_4 = Curve.ExtendEnd(curve=extendStart_4, distance=code_block_73)
function_apply_17 = ApplyFunction(func=byLoft_3, arg1=extendEnd_4)
byUnion_3 = Solid.ByUnion()  # unwired: solids
code_block_74 = CodeBlock(x=code_block_64) { x; }
geometry_7 = Element.Geometry(element=code_block_74)
flatten_13 = List.Flatten(list=geometry_7)
function_apply_18 = ApplyFunction(func=byUnion_3, arg1=flatten_13)
code_block_75 = CodeBlock(x=function_apply_18)  # same code as code_block_19
intersect_7 = Geometry.Intersect(geometry=function_apply_17, other=code_block_75.out1)
flatten_14 = List.Flatten(list=intersect_7)
elementcentroid = Custom[© ElementCentroid](element=filterByBoolMask_3.in)  # package Crumple; Returns the centroid of the element's axis-aligned bounding box.
normalAtPoint_4 = Surface.NormalAtPoint(surface=flatten_14, point=elementcentroid)
code_block_76 = CodeBlock(x=code_block_64) { x; }
code_block_77 = CodeBlock { "Length"; }
getParameterValueByName_4 = Element.GetParameterValueByName(element=code_block_76, parameterName=code_block_77)
round_2 = Math.Round(number=getParameterValueByName_4)
code_block_78 = CodeBlock(t2=round_2) { t1 = t2 / 2; t3 = t1 - 200; t4 = t3 * -1; }
translate_4 = Geometry.Translate(geometry=flatten_14, direction=normalAtPoint_4, distance=code_block_78.t4)
perimeterCurves_7 = Surface.PerimeterCurves(surface=translate_4)
code_block_79 = CodeBlock { null; }
replaceEmptyLists_7 = Custom[List.ReplaceEmptyLists](seq=perimeterCurves_7, Replacement=code_block_79)
code_block_80 = CodeBlock(x=replaceEmptyLists_7)
# ---------- code_block_80.designscript (13 lines) ----------
x;

[Imperative]
{
	if (x == null)
	{
		return = [null,null];
	}
	else
	{
		return = x;
	}
};
# ----------------------------------------
code_block_81 = CodeBlock { 1; }
getItemAtIndex_7 = List.GetItemAtIndex(list=code_block_80.out1@L2, index=code_block_81)
code_block_82 = CodeBlock { -20; }
offset_4 = Curve.Offset(curve=getItemAtIndex_7, distance=code_block_82)
code_block_83 = CodeBlock(l=offset_4)  # same code as code_block_57
code_block_84 = CodeBlock(t1=code_block_83.out1)  # same code as code_block_58
if_2 = If(test=code_block_84.t2, true=code_block_84.curve1, false=code_block_83.out1)
code_block_85 = CodeBlock { -50; }
extendStart_5 = Curve.ExtendStart(curve=if_2, distance=code_block_85)
traslapo_armadura_2 = CodeBlock(t1=code_block_63.out1) { num3 = Properties.RebarDiameter(t1); t2 = num3 * 60; t3 = t2 + 100; }
extendEnd_5 = Curve.ExtendEnd(curve=extendStart_5, distance=traslapo_armadura_2.t3)
code_block_86 = CodeBlock(rebar_bar_type=code_block_63.out1)
# ---------- code_block_86.designscript (8 lines) ----------
//RebaarStyle
"Standard";
//RebarHookOrientation
"Right";
//Rebar Hook Type;
null;
//RebarBarType
rebar_bar_type;
# ----------------------------------------
element_types_ᶜᵒⁿᵛᵉʳᵗᵉᵈ_ᵈʳᵒᵖᵈᵒʷⁿ_4 = CodeBlock { DSCore.Types.FindTypeByNameInAssembly("RebarHookType", "RevitAPI"); }
all_elements_of_type_4 = ElementsOfType(element_type=element_types_ᶜᵒⁿᵛᵉʳᵗᵉᵈ_ᵈʳᵒᵖᵈᵒʷⁿ_4)
rebar_hook_type_at_start = CodeBlock(t3=all_elements_of_type_4)
# ---------- rebar_hook_type_at_start.designscript (6 lines) ----------
t1 = t3;
str2 = Revit.Elements.Element.Name(t1);
t2 = str2 == "Standard - 90 deg.";
t4 = DSCore.List.FilterByBoolMask(t3, t2);
t5 = Dictionary.ValueAtKey(t4, "in");
t6 = Dictionary.ValueAtKey(t4, "out");
# ----------------------------------------
fromCurves_4 = StructuralDesign.Rebar.Create.FromCurves(curves=extendEnd_5@L1, rebarStyle=code_block_86.out0@L1, rebarBarType=code_block_86.rebar_bar_type@L1, startHookType=rebar_hook_type_at_start.t5@L1, endHookType=code_block_86.out2@L1, startHookOrientation=code_block_86.out1@L1, endHookOrientation=code_block_86.out1@L1, hostElement=filterByBoolMask_3.in@L1, vector=normalAtPoint_4@L1, lacing=Longest)
distanciamiento_barras_4 = CodeBlock(distanciamiento_barras=code_block_63.out2) { distanciamiento_barras; }
code_block_87 = CodeBlock { 400; }
sub_4 = round_2 - code_block_87
setLayoutAsMaximumSpacing_4 = StructuralDesign.Rebar.Layout.SetLayoutAsMaximumSpacing(rebar=fromCurves_4, spacing=distanciamiento_barras_4, arrayLength=sub_4)
element_types_ᶜᵒⁿᵛᵉʳᵗᵉᵈ_ᵈʳᵒᵖᵈᵒʷⁿ_5 = CodeBlock { DSCore.Types.FindTypeByNameInAssembly("RebarShape", "RevitAPI"); }
all_elements_of_type_5 = ElementsOfType(element_type=element_types_ᶜᵒⁿᵛᵉʳᵗᵉᵈ_ᵈʳᵒᵖᵈᵒʷⁿ_5)
code_block_88 = CodeBlock(t1=all_elements_of_type_5)
# ---------- code_block_88.designscript (5 lines) ----------
"Shape";
str2 = Revit.Elements.Element.Name(t1);
t2 = str2 == "R_M_03";
t3 = DSCore.List.FilterByBoolMask(t1, t2);
t4 = Dictionary.ValueAtKey(t3, "in");
# ----------------------------------------
setParameterByName_2 = Element.SetParameterByName(element=setLayoutAsMaximumSpacing_4, parameterName=code_block_88.out0, value=code_block_88.t4, lacing=Longest)
