# Dynamo graph EstriboTraba1Segmento_script.dyn (Dynamo 2.6.2.15705)
# packages: Structural Design 2021.1.22, Clockwork for Dynamo 2.x 2.4.0, Orchid 206.3.0.8161, Data-Shapes 2022.2.103, Genius Loci 2021.11.10

code_block = CodeBlock { "Seleccionar Elementos"; }
categories_ᶜᵒⁿᵛᵉʳᵗᵉᵈ_ᵈʳᵒᵖᵈᵒʷⁿ = CodeBlock()
# ---------- categories_ᶜᵒⁿᵛᵉʳᵗᵉᵈ_ᵈʳᵒᵖᵈᵒʷⁿ.designscript (8 lines) ----------
//InputName
"";
//ButtonText
"SELECCIONAR";
//CategoryFilter
Revit.Category.ByName("Structural Framing");
//SelectSingleElement
false;
# ----------------------------------------
selectmodelelements_data = Custom[SelectModelElements Data](InputName=categories_ᶜᵒⁿᵛᵉʳᵗᵉᵈ_ᵈʳᵒᵖᵈᵒʷⁿ.out0, ButtonText=categories_ᶜᵒⁿᵛᵉʳᵗᵉᵈ_ᵈʳᵒᵖᵈᵒʷⁿ.out1, CategoryFilter=categories_ᶜᵒⁿᵛᵉʳᵗᵉᵈ_ᵈʳᵒᵖᵈᵒʷⁿ.out2, SelectSingleElement=categories_ᶜᵒⁿᵛᵉʳᵗᵉᵈ_ᵈʳᵒᵖᵈᵒʷⁿ.out3)  # package Data-Shapes; Creates a Revit element selection input for UI.MultipleInputForm++ . Check out www.data-shapes.net for more infos!
inputgroup_data = Custom[InputGroup Data](GroupTitle=code_block, Inputs=selectmodelelements_data)  # package Data-Shapes; Creates a group of inputs for UI.MultipleInputForm ++ . Check out www.data-shapes.net for more infos !
code_block_2 = CodeBlock { "Estribos"; }
element_types_ᶜᵒⁿᵛᵉʳᵗᵉᵈ_ᵈʳᵒᵖᵈᵒʷⁿ = CodeBlock { DSCore.Types.FindTypeByNameInAssembly("RebarBarType", "RevitAPI"); }
all_elements_of_type = ElementsOfType(element_type=element_types_ᶜᵒⁿᵛᵉʳᵗᵉᵈ_ᵈʳᵒᵖᵈᵒʷⁿ)
code_block_3 = CodeBlock(elem_type=all_elements_of_type)
# ---------- code_block_3.designscript (15 lines) ----------
elem_type;
elem_type_diameter = Properties.RebarDiameter(elem_type);
elem_sorted = DSCore.List.SortByKey(elem_type, elem_type_diameter)["sorted list"];
elem_name = Revit.Elements.Element.Name(elem_sorted);

//InputName
"Diametro";
//Keys
elem_name;
//Values
elem_sorted;
//DefaultValueIndex
0;
//Sorted_optional
false;
# ----------------------------------------
dropdown_data = Custom[DropDown Data](InputName=code_block_3.out4, Keys=code_block_3.out5, Values=code_block_3.out6, DefaultValueIndex=code_block_3.out7, Sorted_optional=code_block_3.out8)  # package Data-Shapes; Create data for DropDown input in UI.MultiInputForm ++ . Check out www.data-shapes.net for more infos.
code_block_4 = CodeBlock()
# ---------- code_block_4.designscript (6 lines) ----------
//InputName
"Espaciamiento";
//DefaultText
"200";
//IsNumberEntry
true;
# ----------------------------------------
textbox_data = Custom[TextBox Data](InputName=code_block_4.out0, DefaultText=code_block_4.out1, IsNumberEntry=code_block_4.out2)  # package Data-Shapes; Create Data for TextBox input in UI.MultipleInputForm ++ . Check out www.data-shapes.net for more informations
list_create = List.Create(item0=dropdown_data, item1=textbox_data)
inputgroup_data_2 = Custom[InputGroup Data](GroupTitle=code_block_2, Inputs=list_create)
list_create_2 = List.Create(item0=inputgroup_data, item1=inputgroup_data_2)
code_block_5 = CodeBlock(inputs=list_create_2)
# ---------- code_block_5.designscript (20 lines) ----------
//Description
"Estribos + Trabas";
//Logo
"C:\\Arainco\\Arainco.png";
//ButtonText
"INICIAR";
//Inputs
inputs;
//Toggle
true;
//LinkToHelp
null;
//CancelButtonText
"CANCELAR";
//MaxHeight
0;
//Width
430;
//LabelWidth
170;
# ----------------------------------------
multipleinputform = Custom[MultipleInputForm ++](Description_optional=code_block_5.out0, Logo_optional=code_block_5.out1, ButtonText_optional=code_block_5.out2, Inputs=code_block_5.inputs, Toggle=code_block_5.out4, LinkToHelp_optional=code_block_5.out5, CancelButtonText_optional=code_block_5.out6, MaxHeight_optional=code_block_5.out7, Width_optional=code_block_5.out8, LabelWidth_optional=code_block_5.out9)  # package Data-Shapes; Create a form with multiple inputs. see www.data-shapes.net for tutorials and infos!
code_block_6 = CodeBlock(l=multipleinputform.User_Inputs)
# ---------- code_block_6.designscript (12 lines) ----------
l;
[Imperative]
{
	if (l == null)
	{
		return = [[],[],[],[],[],[],[],[],[],[]];
	}
	else
	{
		return = l;
	}
};
# ----------------------------------------

# group: 3 Barras
o_document_activeview = Orchid.RevitProject.Common.Document.ActiveView()
element_types_ᶜᵒⁿᵛᵉʳᵗᵉᵈ_ᵈʳᵒᵖᵈᵒʷⁿ_2 = CodeBlock { DSCore.Types.FindTypeByNameInAssembly("RebarHookType", "RevitAPI"); }
all_elements_of_type_2 = ElementsOfType(element_type=element_types_ᶜᵒⁿᵛᵉʳᵗᵉᵈ_ᵈʳᵒᵖᵈᵒʷⁿ_2)
o_document_activeview_2 = Orchid.RevitProject.Common.Document.ActiveView()
plane = Custom[View.Plane](view=o_document_activeview_2)  # package Clockwork for Dynamo 2.x; Retrieves the plane of a given view
code_block_7 = CodeBlock(x=code_block_6.out1, pata=all_elements_of_type_2, view_plane=plane)
# ---------- code_block_7.designscript (163 lines) ----------
elementos = x[0];
tipo_barra_extremos = x[1];
espaciamiento_extremos = x[2];
pata;
pata_names = Revit.Elements.Element.Name(pata);
mask = pata_names == "Stirrup/Tie - 135 deg.";
hook = DSCore.List.FilterByBoolMask(pata, mask)["in"][0];

//Obtener la cantidad de barras para definir cuantos estribos utilizar
rebar_cat = Revit.Category.ByName("Structural Rebar");
str_framing_rebars = Rhythm.Elements.DependentElementsOfCategory(elementos, rebar_cat);
str_framing_rebars_shapes = Revit.Elements.Element.GetParameterValueByName(str_framing_rebars, "Shape");
str_framing_rebars_shapes_names = Revit.Elements.Element.Name(str_framing_rebars_shapes);
str_framing_rebars_mask = DSCore.String.Contains(str_framing_rebars_shapes_names, "R_S_", false);
str_framing_rebars_R_S_ = DSCore.List.GetItemAtIndex(DSCore.List.FilterByBoolMask(str_framing_rebars, str_framing_rebars_mask)["in"]@L2<1>, 0);
str_framing_rebars_quantities = Revit.Elements.Element.GetParameterValueByName(str_framing_rebars_R_S_, "Quantity");

//filtro de elementos en funcion de la cantidad de barras
elementos_mask = str_framing_rebars_quantities == 3;
elem = DSCore.List.FilterByBoolMask(elementos, elementos_mask)["in"];

//Normal plano vista actual
view_plane_normal = Autodesk.Plane.Normal(view_plane);

//Variables para filtrar elementos por categoria
elem_category = Revit.Elements.Element.GetCategory(elem);
elem_category_name = Revit.Category.Name(elem_category);

//Filtrar vigas de hormigon paralelos a la vista actual
structural_framing_mask = elem_category_name == "Structural Framing";
structural_framing = DSCore.List.FilterByBoolMask(elem, structural_framing_mask)["in"];
structural_framing_material = DSCore.List.Flatten(Revit.Elements.Element.GetMaterials(structural_framing, false));
structural_framing_material_name = Revit.Material.Name(structural_framing_material);
structural_framing_material_mask = structural_framing_material_name == "Concrete, Cast-in-Place gray";
structural_framing_hormigon = DSCore.List.FilterByBoolMask(structural_framing, structural_framing_material_mask)["in"];
structural_framing_hormigon_location = Revit.Elements.Element.GetLocation(structural_framing_hormigon);
structural_framing_hormigon_vector = Line.Direction(structural_framing_hormigon_location);
structural_framing_hormigon_centroid = Autodesk.Solid.Centroid(DSCore.List.Flatten(Revit.Elements.Element.Geometry(structural_framing_hormigon)));
structural_framing_hormigon_coo_sys = Autodesk.Curve.CoordinateSystemAtParameter(structural_framing_hormigon_location);
structural_framing_hormigon_vector_mask = Autodesk.Vector.IsParallel(CoordinateSystem.XAxis(structural_framing_hormigon_coo_sys), view_plane_normal);
structural_framing_hormigon_lst = DSCore.List.FilterByBoolMask(structural_framing_hormigon, structural_framing_hormigon_vector_mask)["in"];
structural_framing_hormigon_lst_location = Revit.Elements.Element.GetLocation(structural_framing_hormigon_lst);
structural_framing_hormigon_lst_cut_len = Revit.Elements.Element.GetParameterValueByName(structural_framing_hormigon_lst, "Cut Length");
structural_framing_hormigon_lst_location_len = Autodesk.Curve.Length(structural_framing_hormigon_lst_location);
structural_framing_hormigon_lst_location_start_p = Autodesk.Curve.StartPoint(structural_framing_hormigon_lst_location);
structural_framing_hormigon_lst_location_end_p = Autodesk.Curve.EndPoint(structural_framing_hormigon_lst_location);
structural_framing_hormigon_lst_vector = Autodesk.Vector.ByTwoPoints(structural_framing_hormigon_lst_location_start_p, structural_framing_hormigon_lst_location_end_p);
structural_framing_hormigon_lst_vector_len = Autodesk.Vector.Length(structural_framing_hormigon_lst_vector);

//Altura de Vigas seleccionadas
elem_altura = Revit.Elements.Element.GetParameterValueByName(Revit.Elements.Element.GetParameterValueByName(elem, "Type"), "Height");

//Curva de las Vigas
elem_curve_inicial = Revit.Elements.Element.GetLocation(structural_framing_hormigon_lst);
elem_curve_inicial_len = DesignScript.Curve.Length(elem_curve_inicial);
dif_len = DSCore.Math.Abs(structural_framing_hormigon_lst_cut_len - structural_framing_hormigon_lst_location_len) / 2;
x_1 = Autodesk.Curve.ExtendEnd(Autodesk.Curve.ExtendStart(structural_framing_hormigon_lst_location, (dif_len + 50) * -1), (dif_len + 50) * -1);
x_2 = Autodesk.Curve.ExtendEnd(Autodesk.Curve.ExtendStart(structural_framing_hormigon_lst_location, (dif_len + 50) * -1), (dif_len + 50) * -1);

elem_curve = [Imperative]
{
	if(structural_framing_hormigon_lst_location_len >= structural_framing_hormigon_lst_cut_len)
	{
		return  x_1;
	}
	else
	{
		return  x_2;
	}
};
elem_curve_start_p = Autodesk.Curve.StartPoint(elem_curve);
elem_curve_end_p = Autodesk.Curve.EndPoint(elem_curve);
elem_curve_vector = Autodesk.Vector.ByTwoPoints(elem_curve_start_p, elem_curve_end_p);
elem_curve_vector_len = Autodesk.Vector.Length(elem_curve_vector);

//Geometria a Cortar
g_elem_solid = DSCore.List.Flatten(Revit.Elements.Element.Geometry(structural_framing_hormigon_lst));
g_solid_centroid = Autodesk.Solid.Centroid(g_elem_solid);
g_solid_coo_sys = Autodesk.Curve.CoordinateSystemAtParameter(structural_framing_hormigon_lst_location, 0.5);
g_solid_plane = CoordinateSystem.YZPlane(g_solid_coo_sys);
g_solid_scaled = Autodesk.Geometry.Scale(g_elem_solid, g_solid_plane, 5, 1, 1);

//Geometria Estribo
geom_param_at_point = DesignScript.Curve.ParameterAtPoint(elem_curve, elem_curve_start_p);
geom_plane_at_param = DesignScript.Curve.PlaneAtParameter(elem_curve, geom_param_at_point);
geom_surface = DSCore.List.Flatten(Autodesk.Geometry.Intersect(g_solid_scaled, geom_plane_at_param), -1);
geom_surface_perimeter = Autodesk.Surface.PerimeterCurves(geom_surface);
geom_surface_perimeter_as_polycurve = PolyCurve.Offset(PolyCurve.ByJoinedCurves(geom_surface_perimeter), -25, false);
geom_surface_offset = Autodesk.Surface.ByPatch(geom_surface_perimeter_as_polycurve);
//Estribo 1
geom_surface_perimeter_curves_1 = Autodesk.Geometry.Explode(geom_surface_perimeter_as_polycurve);
//Traba
geom_surface_coo_sys_3 = Autodesk.Surface.CoordinateSystemAtParameter(geom_surface_offset, 0, 0.454257);
geom_surface_cut_plane_3 = CoordinateSystem.ZXPlane(geom_surface_coo_sys_3);
geom_surface_intersect_3 = Autodesk.Geometry.Intersect(geom_surface_offset, geom_surface_cut_plane_3);




//Estribos 1
tag_location = g_solid_centroid;
//curves
geom_surface_perimeter_curves_1;
//rebarStyle
"StirrupTie";
//rebarBarType
tipo_barra_extremos;
//startHookType
hook;
//endHookType
hook;
//startHookOrientation
"Left";
//endtHookOrientation
"Left";
//hostElement
structural_framing_hormigon_lst;
//vector
structural_framing_hormigon_lst_vector;
//spacing
espaciamiento_extremos;
//ArrayLength
elem_curve_vector_len;
//Punto para posicionar tag
tag_location;










//Traba
//curves
geom_surface_intersect_3;
//rebarStyle
"StirrupTie";
//rebarBarType
tipo_barra_extremos;
//startHookType
hook;
//endHookType
hook;
//startHookOrientation
"Right";
//endtHookOrientation
"Right";
//hostElement
structural_framing_hormigon_lst;
//vector
structural_framing_hormigon_lst_vector;
//spacing
espaciamiento_extremos;
//ArrayLength
elem_curve_vector_len;
//Punto para posicionar tag
tag_location;


//
# ----------------------------------------
fromCurves = StructuralDesign.Rebar.Create.FromCurves(curves=code_block_7.out65, rebarStyle=code_block_7.out66, rebarBarType=code_block_7.out67, startHookType=code_block_7.out68, endHookType=code_block_7.out69, startHookOrientation=code_block_7.out70, endHookOrientation=code_block_7.out71, hostElement=code_block_7.out72, vector=code_block_7.out73)
setLayoutAsMaximumSpacing = StructuralDesign.Rebar.Layout.SetLayoutAsMaximumSpacing(rebar=fromCurves, spacing=code_block_7.out74, arrayLength=code_block_7.out75, lacing=Longest)
code_block_8 = CodeBlock { "FirstLast"; }
setRebarPresentation = Custom[SetRebarPresentation](rebarElements=setLayoutAsMaximumSpacing, rebarRepresentation=code_block_8)  # Change de Rebar representation of the selected elements in the active view. Rebar Representations Options - All - FirstLast - Middle
flatten = List.Flatten(list=setRebarPresentation)
code_block_9 = CodeBlock(element=flatten, tag_location=code_block_7.out76)
# ---------- code_block_9.designscript (19 lines) ----------
//Asigna el tipo de estribo (sim, doble, etc...)
Revit.Elements.Element.SetParameterByName(element, "Estribo", "ED.");
tag_location;

//element
element;
//TagLocation
tag_location;
//TagType
family = Revit.Family.ByName("EST_A_STRUCTURAL REBAR TAG_ESTRIBO");
tag_type = Revit.Elements.FamilyType.ByFamilyAndName(family, "R_E_00");
//horizontal
true;
//addLeader
false;
//LinkInstance
null;
//RunIt
true;
# ----------------------------------------
create_tag = Custom[Create Tag](view=o_document_activeview@L1, element=code_block_9.out2@L2, TagLocation=code_block_9.out3@L2, TagType=code_block_9.out5@L1, horizontal=code_block_9.out6@L1, addLeader=code_block_9.out7@L1, LinkInstance=code_block_9.out8@L1, RunIt=code_block_9.out9@L1, lacing=Longest)  # package Genius Loci; Works only in Revit 2018 and later. Creates a tag at a given location, of given type and in a supplied view. The node also works with Linked Elements (except space and area), Multi Category tag and Material Tag. Based on an archilab node
o_document_activeview_3 = Orchid.RevitProject.Common.Document.ActiveView()
fromCurves_2 = StructuralDesign.Rebar.Create.FromCurves(curves=code_block_7.out77, rebarStyle=code_block_7.out78, rebarBarType=code_block_7.out79, startHookType=code_block_7.out80, endHookType=code_block_7.out81, startHookOrientation=code_block_7.out82, endHookOrientation=code_block_7.out83, hostElement=code_block_7.out84, vector=code_block_7.out85)
setLayoutAsMaximumSpacing_2 = StructuralDesign.Rebar.Layout.SetLayoutAsMaximumSpacing(rebar=fromCurves_2, spacing=code_block_7.out86, arrayLength=code_block_7.out87, lacing=Longest)
code_block_10 = CodeBlock { "FirstLast"; }
setRebarPresentation_2 = Custom[SetRebarPresentation](rebarElements=setLayoutAsMaximumSpacing_2, rebarRepresentation=code_block_10)
flatten_2 = List.Flatten(list=setRebarPresentation_2)
element_types_ᶜᵒⁿᵛᵉʳᵗᵉᵈ_ᵈʳᵒᵖᵈᵒʷⁿ_3 = CodeBlock { DSCore.Types.FindTypeByNameInAssembly("RebarShape", "RevitAPI"); }
all_elements_of_type_3 = ElementsOfType(element_type=element_types_ᶜᵒⁿᵛᵉʳᵗᵉᵈ_ᵈʳᵒᵖᵈᵒʷⁿ_3)
code_block_11 = CodeBlock(element=flatten_2, shapes=all_elements_of_type_3, tag_location=code_block_7.out88)
# ---------- code_block_11.designscript (24 lines) ----------
//Asigna el tipo de estribo (sim, doble, etc...)
Revit.Elements.Element.SetParameterByName(element, "Estribo", "Tr.");
//Asigna el Rebar shape
shapes_names = Revit.Elements.Element.Name(shapes);
shapes_mask = shapes_names == "R_T_00";
shape = DSCore.List.FilterByBoolMask(shapes, shapes_mask)["in"][0];
Revit.Elements.Element.SetParameterByName(element, "Shape", shape);
tag_location;

//element
element;
//TagLocation
tag_location;
//TagType
family = Revit.Family.ByName("EST_A_STRUCTURAL REBAR TAG_ESTRIBO");
tag_type = Revit.Elements.FamilyType.ByFamilyAndName(family, "R_T_00");
//horizontal
true;
//addLeader
false;
//LinkInstance
null;
//RunIt
true;
# ----------------------------------------
create_tag_2 = Custom[Create Tag](view=o_document_activeview_3@L1, element=code_block_11.out6@L2, TagLocation=code_block_11.out7@L2, TagType=code_block_11.out9@L1, horizontal=code_block_11.out10@L1, addLeader=code_block_11.out11@L1, LinkInstance=code_block_11.out12@L1, RunIt=code_block_11.out13@L1, lacing=Longest)

# group: 5 Barras
element_types_ᶜᵒⁿᵛᵉʳᵗᵉᵈ_ᵈʳᵒᵖᵈᵒʷⁿ_4 = CodeBlock { DSCore.Types.FindTypeByNameInAssembly("RebarHookType", "RevitAPI"); }
all_elements_of_type_4 = ElementsOfType(element_type=element_types_ᶜᵒⁿᵛᵉʳᵗᵉᵈ_ᵈʳᵒᵖᵈᵒʷⁿ_4)
o_document_activeview_4 = Orchid.RevitProject.Common.Document.ActiveView()
plane_2 = Custom[View.Plane](view=o_document_activeview_4)
code_block_12 = CodeBlock(x=code_block_6.out1, pata=all_elements_of_type_4, view_plane=plane_2)
# ---------- code_block_12.designscript (211 lines) ----------
elementos = x[0];
tipo_barra_extremos = x[1];
espaciamiento_extremos = x[2];
pata;
pata_names = Revit.Elements.Element.Name(pata);
mask = pata_names == "Stirrup/Tie - 135 deg.";
hook = DSCore.List.FilterByBoolMask(pata, mask)["in"][0];

//Obtener la cantidad de barras para definir cuantos estribos utilizar
rebar_cat = Revit.Category.ByName("Structural Rebar");
str_framing_rebars = Rhythm.Elements.DependentElementsOfCategory(elementos, rebar_cat);
str_framing_rebars_shapes = Revit.Elements.Element.GetParameterValueByName(str_framing_rebars, "Shape");
str_framing_rebars_shapes_names = Revit.Elements.Element.Name(str_framing_rebars_shapes);
str_framing_rebars_mask = DSCore.String.Contains(str_framing_rebars_shapes_names, "R_S_", false);
str_framing_rebars_R_S_ = DSCore.List.GetItemAtIndex(DSCore.List.FilterByBoolMask(str_framing_rebars, str_framing_rebars_mask)["in"]@L2<1>, 0);
str_framing_rebars_quantities = Revit.Elements.Element.GetParameterValueByName(str_framing_rebars_R_S_, "Quantity");

//filtro de elementos en funcion de la cantidad de barras
elementos_mask = str_framing_rebars_quantities == 5;
elem = DSCore.List.FilterByBoolMask(elementos, elementos_mask)["in"];

//Normal plano vista actual
view_plane_normal = Autodesk.Plane.Normal(view_plane);

//Variables para filtrar elementos por categoria
elem_category = Revit.Elements.Element.GetCategory(elem);
elem_category_name = Revit.Category.Name(elem_category);

//Filtrar vigas de hormigon paralelos a la vista actual
structural_framing_mask = elem_category_name == "Structural Framing";
structural_framing = DSCore.List.FilterByBoolMask(elem, structural_framing_mask)["in"];
structural_framing_material = DSCore.List.Flatten(Revit.Elements.Element.GetMaterials(structural_framing, false));
structural_framing_material_name = Revit.Material.Name(structural_framing_material);
structural_framing_material_mask = structural_framing_material_name == "Concrete, Cast-in-Place gray";
structural_framing_hormigon = DSCore.List.FilterByBoolMask(structural_framing, structural_framing_material_mask)["in"];
structural_framing_hormigon_location = Revit.Elements.Element.GetLocation(structural_framing_hormigon);
structural_framing_hormigon_vector = Line.Direction(structural_framing_hormigon_location);
structural_framing_hormigon_centroid = Autodesk.Solid.Centroid(DSCore.List.Flatten(Revit.Elements.Element.Geometry(structural_framing_hormigon)));
structural_framing_hormigon_coo_sys = Autodesk.Curve.CoordinateSystemAtParameter(structural_framing_hormigon_location);
structural_framing_hormigon_vector_mask = Autodesk.Vector.IsParallel(CoordinateSystem.XAxis(structural_framing_hormigon_coo_sys), view_plane_normal);
structural_framing_hormigon_lst = DSCore.List.FilterByBoolMask(structural_framing_hormigon, structural_framing_hormigon_vector_mask)["in"];
structural_framing_hormigon_lst_location = Revit.Elements.Element.GetLocation(structural_framing_hormigon_lst);
structural_framing_hormigon_lst_cut_len = Revit.Elements.Element.GetParameterValueByName(structural_framing_hormigon_lst, "Cut Length");
structural_framing_hormigon_lst_location_len = Autodesk.Curve.Length(structural_framing_hormigon_lst_location);
structural_framing_hormigon_lst_location_start_p = Autodesk.Curve.StartPoint(structural_framing_hormigon_lst_location);
structural_framing_hormigon_lst_location_end_p = Autodesk.Curve.EndPoint(structural_framing_hormigon_lst_location);
structural_framing_hormigon_lst_vector = Autodesk.Vector.ByTwoPoints(structural_framing_hormigon_lst_location_start_p, structural_framing_hormigon_lst_location_end_p);
structural_framing_hormigon_lst_vector_len = Autodesk.Vector.Length(structural_framing_hormigon_lst_vector);

//Altura de Vigas seleccionadas
elem_altura = Revit.Elements.Element.GetParameterValueByName(Revit.Elements.Element.GetParameterValueByName(elem, "Type"), "Height");

//Curva de las Vigas
elem_curve_inicial = Revit.Elements.Element.GetLocation(structural_framing_hormigon_lst);
elem_curve_inicial_len = DesignScript.Curve.Length(elem_curve_inicial);
dif_len = DSCore.Math.Abs(structural_framing_hormigon_lst_cut_len - structural_framing_hormigon_lst_location_len) / 2;
x_1 = Autodesk.Curve.ExtendEnd(Autodesk.Curve.ExtendStart(structural_framing_hormigon_lst_location, (dif_len + 50) * -1), (dif_len + 50) * -1);
x_2 = Autodesk.Curve.ExtendEnd(Autodesk.Curve.ExtendStart(structural_framing_hormigon_lst_location, (dif_len + 50) * -1), (dif_len + 50) * -1);

elem_curve = [Imperative]
{
	if(structural_framing_hormigon_lst_location_len >= structural_framing_hormigon_lst_cut_len)
	{
		return  x_1;
	}
	else
	{
		return  x_2;
	}
};
elem_curve_start_p = Autodesk.Curve.StartPoint(elem_curve);
elem_curve_end_p = Autodesk.Curve.EndPoint(elem_curve);
elem_curve_vector = Autodesk.Vector.ByTwoPoints(elem_curve_start_p, elem_curve_end_p);
elem_curve_vector_len = Autodesk.Vector.Length(elem_curve_vector);

//Geometria a Cortar
g_elem_solid = DSCore.List.Flatten(Revit.Elements.Element.Geometry(structural_framing_hormigon_lst));
g_solid_centroid = Autodesk.Solid.Centroid(g_elem_solid);
g_solid_coo_sys = Autodesk.Curve.CoordinateSystemAtParameter(structural_framing_hormigon_lst_location, 0.5);
g_solid_plane = CoordinateSystem.YZPlane(g_solid_coo_sys);
g_solid_scaled = Autodesk.Geometry.Scale(g_elem_solid, g_solid_plane, 5, 1, 1);

//Geometria Estribo
geom_param_at_point = DesignScript.Curve.ParameterAtPoint(elem_curve, elem_curve_start_p);
geom_plane_at_param = DesignScript.Curve.PlaneAtParameter(elem_curve, geom_param_at_point);
geom_surface = DSCore.List.Flatten(Autodesk.Geometry.Intersect(g_solid_scaled, geom_plane_at_param), -1);
geom_surface_perimeter = Autodesk.Surface.PerimeterCurves(geom_surface);
geom_surface_perimeter_as_polycurve = PolyCurve.Offset(PolyCurve.ByJoinedCurves(geom_surface_perimeter), -25, false);
geom_surface_offset = Autodesk.Surface.ByPatch(geom_surface_perimeter_as_polycurve);
//Estribo 1
geom_surface_coo_sys_1 = Autodesk.Surface.CoordinateSystemAtParameter(geom_surface_offset, 0, 0.76715);
geom_surface_cut_plane_1 = CoordinateSystem.ZXPlane(geom_surface_coo_sys_1);
geom_surface_split_1 = Autodesk.Geometry.Split(geom_surface_offset, geom_surface_cut_plane_1);
geom_surface_1 = DSCore.List.GetItemAtIndex(geom_surface_split_1@L2<1>, 1);
geom_surface_perimeter_1 = Autodesk.Surface.PerimeterCurves(geom_surface_1);
geom_surface_perimeter_as_polycurve_1 = PolyCurve.ByJoinedCurves(geom_surface_perimeter_1);
geom_surface_perimeter_curves_1 = Autodesk.Geometry.Explode(geom_surface_perimeter_as_polycurve_1);
//Estribo 2
geom_surface_coo_sys_2 = Autodesk.Surface.CoordinateSystemAtParameter(geom_surface_offset, 0, 0.23285);
geom_surface_cut_plane_2 = CoordinateSystem.ZXPlane(geom_surface_coo_sys_2);
geom_surface_split_2 = Autodesk.Geometry.Split(geom_surface_offset, geom_surface_cut_plane_2);
geom_surface_2 = DSCore.List.GetItemAtIndex(geom_surface_split_2@L2<1>, 0);
geom_surface_perimeter_2 = Autodesk.Surface.PerimeterCurves(geom_surface_2);
geom_surface_perimeter_as_polycurve_2 = PolyCurve.ByJoinedCurves(geom_surface_perimeter_2);
geom_surface_perimeter_curves_2 = Autodesk.Geometry.Explode(geom_surface_perimeter_as_polycurve_2);
//Traba
geom_surface_coo_sys_3 = Autodesk.Surface.CoordinateSystemAtParameter(geom_surface_offset, 0, 0.454257);
geom_surface_cut_plane_3 = CoordinateSystem.ZXPlane(geom_surface_coo_sys_3);
geom_surface_intersect_3 = Autodesk.Geometry.Intersect(geom_surface_offset, geom_surface_cut_plane_3);




//Estribos 1
tag_location = g_solid_centroid;
//curves
geom_surface_perimeter_curves_1;
//rebarStyle
"StirrupTie";
//rebarBarType
tipo_barra_extremos;
//startHookType
hook;
//endHookType
hook;
//startHookOrientation
"Right";
//endtHookOrientation
"Right";
//hostElement
structural_framing_hormigon_lst;
//vector
structural_framing_hormigon_lst_vector;
//spacing
espaciamiento_extremos;
//ArrayLength
elem_curve_vector_len;
//Punto para posicionar tag
tag_location;










//Estribos 2
tag_location;
//curves
geom_surface_perimeter_curves_2;
//rebarStyle
"StirrupTie";
//rebarBarType
tipo_barra_extremos;
//startHookType
hook;
//endHookType
hook;
//startHookOrientation
"Left";
//endtHookOrientation
"Left";
//hostElement
structural_framing_hormigon_lst;
//vector
structural_framing_hormigon_lst_vector;
//spacing
espaciamiento_extremos;
//ArrayLength
elem_curve_vector_len;










//Traba
//curves
geom_surface_intersect_3;
//rebarStyle
"StirrupTie";
//rebarBarType
tipo_barra_extremos;
//startHookType
hook;
//endHookType
hook;
//startHookOrientation
"Right";
//endtHookOrientation
"Right";
//hostElement
structural_framing_hormigon_lst;
//vector
structural_framing_hormigon_lst_vector;
//spacing
espaciamiento_extremos;
//ArrayLength
elem_curve_vector_len;
//Punto para posicionar tag
tag_location;


//
# ----------------------------------------
fromCurves_3 = StructuralDesign.Rebar.Create.FromCurves(curves=code_block_12.out91, rebarStyle=code_block_12.out92, rebarBarType=code_block_12.out93, startHookType=code_block_12.out94, endHookType=code_block_12.out95, startHookOrientation=code_block_12.out96, endHookOrientation=code_block_12.out97, hostElement=code_block_12.out98, vector=code_block_12.out99)
setLayoutAsMaximumSpacing_3 = StructuralDesign.Rebar.Layout.SetLayoutAsMaximumSpacing(rebar=fromCurves_3, spacing=code_block_12.out100, arrayLength=code_block_12.out101, lacing=Longest)
code_block_13 = CodeBlock { "FirstLast"; }
setRebarPresentation_3 = Custom[SetRebarPresentation](rebarElements=setLayoutAsMaximumSpacing_3, rebarRepresentation=code_block_13)
flatten_3 = List.Flatten(list=setRebarPresentation_3)
code_block_14 = CodeBlock(element=flatten_3)
# ---------- code_block_14.designscript (2 lines) ----------
//Asigna el tipo de estribo (sim, doble, etc...)
Revit.Elements.Element.SetParameterByName(element, "Estribo", "ED.");
# ----------------------------------------
o_document_activeview_5 = Orchid.RevitProject.Common.Document.ActiveView()
fromCurves_4 = StructuralDesign.Rebar.Create.FromCurves(curves=code_block_12.out102, rebarStyle=code_block_12.out103, rebarBarType=code_block_12.out104, startHookType=code_block_12.out105, endHookType=code_block_12.out106, startHookOrientation=code_block_12.out107, endHookOrientation=code_block_12.out108, hostElement=code_block_12.out109, vector=code_block_12.out110)
setLayoutAsMaximumSpacing_4 = StructuralDesign.Rebar.Layout.SetLayoutAsMaximumSpacing(rebar=fromCurves_4, spacing=code_block_12.out111, arrayLength=code_block_12.out112, lacing=Longest)
code_block_15 = CodeBlock { "FirstLast"; }
setRebarPresentation_4 = Custom[SetRebarPresentation](rebarElements=setLayoutAsMaximumSpacing_4, rebarRepresentation=code_block_15)
flatten_4 = List.Flatten(list=setRebarPresentation_4)
element_types_ᶜᵒⁿᵛᵉʳᵗᵉᵈ_ᵈʳᵒᵖᵈᵒʷⁿ_5 = CodeBlock { DSCore.Types.FindTypeByNameInAssembly("RebarShape", "RevitAPI"); }
all_elements_of_type_5 = ElementsOfType(element_type=element_types_ᶜᵒⁿᵛᵉʳᵗᵉᵈ_ᵈʳᵒᵖᵈᵒʷⁿ_5)
code_block_16 = CodeBlock(element=flatten_4, shapes=all_elements_of_type_5, tag_location=code_block_12.out113)  # same code as code_block_11
create_tag_3 = Custom[Create Tag](view=o_document_activeview_5@L1, element=code_block_16.out6@L2, TagLocation=code_block_16.out7@L2, TagType=code_block_16.out9@L1, horizontal=code_block_16.out10@L1, addLeader=code_block_16.out11@L1, LinkInstance=code_block_16.out12@L1, RunIt=code_block_16.out13@L1, lacing=Longest)
o_document_activeview_6 = Orchid.RevitProject.Common.Document.ActiveView()
fromCurves_5 = StructuralDesign.Rebar.Create.FromCurves(curves=code_block_12.out78, rebarStyle=code_block_12.out79, rebarBarType=code_block_12.out80, startHookType=code_block_12.out81, endHookType=code_block_12.out82, startHookOrientation=code_block_12.out83, endHookOrientation=code_block_12.out84, hostElement=code_block_12.out85, vector=code_block_12.out86)
setLayoutAsMaximumSpacing_5 = StructuralDesign.Rebar.Layout.SetLayoutAsMaximumSpacing(rebar=fromCurves_5, spacing=code_block_12.out87, arrayLength=code_block_12.out88, lacing=Longest)
code_block_17 = CodeBlock { "FirstLast"; }
setRebarPresentation_5 = Custom[SetRebarPresentation](rebarElements=setLayoutAsMaximumSpacing_5, rebarRepresentation=code_block_17)
flatten_5 = List.Flatten(list=setRebarPresentation_5)
code_block_18 = CodeBlock(element=flatten_5, tag_location=code_block_12.out89)  # same code as code_block_9
create_tag_4 = Custom[Create Tag](view=o_document_activeview_6@L1, element=code_block_18.out2@L2, TagLocation=code_block_18.out3@L2, TagType=code_block_18.out5@L1, horizontal=code_block_18.out6@L1, addLeader=code_block_18.out7@L1, LinkInstance=code_block_18.out8@L1, RunIt=code_block_18.out9@L1, lacing=Longest)

# group: 7 Barras
o_document_activeview_7 = Orchid.RevitProject.Common.Document.ActiveView()
element_types_ᶜᵒⁿᵛᵉʳᵗᵉᵈ_ᵈʳᵒᵖᵈᵒʷⁿ_6 = CodeBlock { DSCore.Types.FindTypeByNameInAssembly("RebarHookType", "RevitAPI"); }
all_elements_of_type_6 = ElementsOfType(element_type=element_types_ᶜᵒⁿᵛᵉʳᵗᵉᵈ_ᵈʳᵒᵖᵈᵒʷⁿ_6)
o_document_activeview_8 = Orchid.RevitProject.Common.Document.ActiveView()
plane_3 = Custom[View.Plane](view=o_document_activeview_8)
code_block_19 = CodeBlock(x=code_block_6.out1, pata=all_elements_of_type_6, view_plane=plane_3)
# ---------- code_block_19.designscript (252 lines) ----------
elementos = x[0];
tipo_barra_extremos = x[1];
espaciamiento_extremos = x[2];
pata;
pata_names = Revit.Elements.Element.Name(pata);
mask = pata_names == "Stirrup/Tie - 135 deg.";
hook = DSCore.List.FilterByBoolMask(pata, mask)["in"][0];

//Obtener la cantidad de barras para definir cuantos estribos utilizar
rebar_cat = Revit.Category.ByName("Structural Rebar");
str_framing_rebars = Rhythm.Elements.DependentElementsOfCategory(elementos, rebar_cat);
str_framing_rebars_shapes = Revit.Elements.Element.GetParameterValueByName(str_framing_rebars, "Shape");
str_framing_rebars_shapes_names = Revit.Elements.Element.Name(str_framing_rebars_shapes);
str_framing_rebars_mask = DSCore.String.Contains(str_framing_rebars_shapes_names, "R_S_", false);
str_framing_rebars_R_S_ = DSCore.List.GetItemAtIndex(DSCore.List.FilterByBoolMask(str_framing_rebars, str_framing_rebars_mask)["in"]@L2<1>, 0);
str_framing_rebars_quantities = Revit.Elements.Element.GetParameterValueByName(str_framing_rebars_R_S_, "Quantity");

//filtro de elementos en funcion de la cantidad de barras
elementos_mask = str_framing_rebars_quantities == 7;
elem = DSCore.List.FilterByBoolMask(elementos, elementos_mask)["in"];

//Normal plano vista actual
view_plane_normal = Autodesk.Plane.Normal(view_plane);

//Variables para filtrar elementos por categoria
elem_category = Revit.Elements.Element.GetCategory(elem);
elem_category_name = Revit.Category.Name(elem_category);

//Filtrar vigas de hormigon paralelos a la vista actual
structural_framing_mask = elem_category_name == "Structural Framing";
structural_framing = DSCore.List.FilterByBoolMask(elem, structural_framing_mask)["in"];
structural_framing_material = DSCore.List.Flatten(Revit.Elements.Element.GetMaterials(structural_framing, false));
structural_framing_material_name = Revit.Material.Name(structural_framing_material);
structural_framing_material_mask = structural_framing_material_name == "Concrete, Cast-in-Place gray";
structural_framing_hormigon = DSCore.List.FilterByBoolMask(structural_framing, structural_framing_material_mask)["in"];
structural_framing_hormigon_location = Revit.Elements.Element.GetLocation(structural_framing_hormigon);
structural_framing_hormigon_vector = Line.Direction(structural_framing_hormigon_location);
structural_framing_hormigon_centroid = Autodesk.Solid.Centroid(DSCore.List.Flatten(Revit.Elements.Element.Geometry(structural_framing_hormigon)));
structural_framing_hormigon_coo_sys = Autodesk.Curve.CoordinateSystemAtParameter(structural_framing_hormigon_location);
structural_framing_hormigon_vector_mask = Autodesk.Vector.IsParallel(CoordinateSystem.XAxis(structural_framing_hormigon_coo_sys), view_plane_normal);
structural_framing_hormigon_lst = DSCore.List.FilterByBoolMask(structural_framing_hormigon, structural_framing_hormigon_vector_mask)["in"];
structural_framing_hormigon_lst_location = Revit.Elements.Element.GetLocation(structural_framing_hormigon_lst);
structural_framing_hormigon_lst_cut_len = Revit.Elements.Element.GetParameterValueByName(structural_framing_hormigon_lst, "Cut Length");
structural_framing_hormigon_lst_location_len = Autodesk.Curve.Length(structural_framing_hormigon_lst_location);
structural_framing_hormigon_lst_location_start_p = Autodesk.Curve.StartPoint(structural_framing_hormigon_lst_location);
structural_framing_hormigon_lst_location_end_p = Autodesk.Curve.EndPoint(structural_framing_hormigon_lst_location);
structural_framing_hormigon_lst_vector = Autodesk.Vector.ByTwoPoints(structural_framing_hormigon_lst_location_start_p, structural_framing_hormigon_lst_location_end_p);
structural_framing_hormigon_lst_vector_len = Autodesk.Vector.Length(structural_framing_hormigon_lst_vector);

//Altura de Vigas seleccionadas
elem_altura = Revit.Elements.Element.GetParameterValueByName(Revit.Elements.Element.GetParameterValueByName(elem, "Type"), "Height");

//Curva de las Vigas
elem_curve_inicial = Revit.Elements.Element.GetLocation(structural_framing_hormigon_lst);
elem_curve_inicial_len = DesignScript.Curve.Length(elem_curve_inicial);
dif_len = DSCore.Math.Abs(structural_framing_hormigon_lst_cut_len - structural_framing_hormigon_lst_location_len) / 2;
x_1 = Autodesk.Curve.ExtendEnd(Autodesk.Curve.ExtendStart(structural_framing_hormigon_lst_location, (dif_len + 50) * -1), (dif_len + 50) * -1);
x_2 = Autodesk.Curve.ExtendEnd(Autodesk.Curve.ExtendStart(structural_framing_hormigon_lst_location, (dif_len + 50) * -1), (dif_len + 50) * -1);

elem_curve = [Imperative]
{
	if(structural_framing_hormigon_lst_location_len >= structural_framing_hormigon_lst_cut_len)
	{
		return  x_1;
	}
	else
	{
		return  x_2;
	}
};
elem_curve_start_p = Autodesk.Curve.StartPoint(elem_curve);
elem_curve_end_p = Autodesk.Curve.EndPoint(elem_curve);
elem_curve_vector = Autodesk.Vector.ByTwoPoints(elem_curve_start_p, elem_curve_end_p);
elem_curve_vector_len = Autodesk.Vector.Length(elem_curve_vector);

//Geometria a Cortar
g_elem_solid = DSCore.List.Flatten(Revit.Elements.Element.Geometry(structural_framing_hormigon_lst));
g_solid_centroid = Autodesk.Solid.Centroid(g_elem_solid);
g_solid_coo_sys = Autodesk.Curve.CoordinateSystemAtParameter(structural_framing_hormigon_lst_location, 0.5);
g_solid_plane = CoordinateSystem.YZPlane(g_solid_coo_sys);
g_solid_scaled = Autodesk.Geometry.Scale(g_elem_solid, g_solid_plane, 5, 1, 1);

//Geometria Estribo
geom_param_at_point = DesignScript.Curve.ParameterAtPoint(elem_curve, elem_curve_start_p);
geom_plane_at_param = DesignScript.Curve.PlaneAtParameter(elem_curve, geom_param_at_point);
geom_surface = DSCore.List.Flatten(Autodesk.Geometry.Intersect(g_solid_scaled, geom_plane_at_param), -1);
geom_surface_perimeter = Autodesk.Surface.PerimeterCurves(geom_surface);
geom_surface_perimeter_as_polycurve = PolyCurve.Offset(PolyCurve.ByJoinedCurves(geom_surface_perimeter), -25, false);
geom_surface_offset = Autodesk.Surface.ByPatch(geom_surface_perimeter_as_polycurve);
//Estribo 1
geom_surface_coo_sys_1 = Autodesk.Surface.CoordinateSystemAtParameter(geom_surface_offset, 0, 0.69333);
geom_surface_cut_plane_1 = CoordinateSystem.ZXPlane(geom_surface_coo_sys_1);
geom_surface_split_1 = Autodesk.Geometry.Split(geom_surface_offset, geom_surface_cut_plane_1);
geom_surface_1 = DSCore.List.GetItemAtIndex(geom_surface_split_1@L2<1>, 1);
geom_surface_perimeter_1 = Autodesk.Surface.PerimeterCurves(geom_surface_1);
geom_surface_perimeter_as_polycurve_1 = PolyCurve.ByJoinedCurves(geom_surface_perimeter_1);
geom_surface_perimeter_curves_1 = Autodesk.Geometry.Explode(geom_surface_perimeter_as_polycurve_1);
//Estribo 2
geom_surface_coo_sys_2 = Autodesk.Surface.CoordinateSystemAtParameter(geom_surface_offset, 0, 0.30667);
geom_surface_cut_plane_2 = CoordinateSystem.ZXPlane(geom_surface_coo_sys_2);
geom_surface_split_2 = Autodesk.Geometry.Split(geom_surface_offset, geom_surface_cut_plane_2);
geom_surface_2 = DSCore.List.GetItemAtIndex(geom_surface_split_2@L2<1>, 0);
geom_surface_perimeter_2 = Autodesk.Surface.PerimeterCurves(geom_surface_2);
geom_surface_perimeter_as_polycurve_2 = PolyCurve.ByJoinedCurves(geom_surface_perimeter_2);
geom_surface_perimeter_curves_2 = Autodesk.Geometry.Explode(geom_surface_perimeter_as_polycurve_2);
//Estribo 3
geom_surface_coo_sys_3_A = Autodesk.Surface.CoordinateSystemAtParameter(geom_surface_offset, 0, 0.15905);
geom_surface_coo_sys_3_B = Autodesk.Surface.CoordinateSystemAtParameter(geom_surface_offset, 0, 0.84095);
geom_surface_cut_plane_3_A = CoordinateSystem.ZXPlane(geom_surface_coo_sys_3_A);
geom_surface_cut_plane_3_B = CoordinateSystem.ZXPlane(geom_surface_coo_sys_3_B);
geom_surface_intersect_3_A = Autodesk.Geometry.Intersect(geom_surface_offset, geom_surface_cut_plane_3_A);
geom_surface_intersect_3_B = Autodesk.Geometry.Intersect(geom_surface_offset, geom_surface_cut_plane_3_B);
geom_surface_transpose = DSCore.List.Flatten(DSCore.List.Transpose([geom_surface_intersect_3_A, geom_surface_intersect_3_B])@L3<1>, -1);
geom_surface_3 = Autodesk.Surface.ByLoft(geom_surface_transpose@L2<1>);
geom_surface_perimeter_curves_3 = Autodesk.Surface.PerimeterCurves(geom_surface_3);
//Traba
geom_surface_coo_sys_3 = Autodesk.Surface.CoordinateSystemAtParameter(geom_surface_offset, 0, 0.454257);
geom_surface_cut_plane_3 = CoordinateSystem.ZXPlane(geom_surface_coo_sys_3);
geom_surface_intersect_3 = Autodesk.Geometry.Intersect(geom_surface_offset, geom_surface_cut_plane_3);

//Estribos 1
tag_location = g_solid_centroid;
//curves
geom_surface_perimeter_curves_1;
//rebarStyle
"StirrupTie";
//rebarBarType
tipo_barra_extremos;
//startHookType
hook;
//endHookType
hook;
//startHookOrientation
"Right";
//endtHookOrientation
"Right";
//hostElement
structural_framing_hormigon_lst;
//vector
structural_framing_hormigon_lst_vector;
//spacing
espaciamiento_extremos;
//ArrayLength
elem_curve_vector_len;
//Punto para posicionar tag
tag_location;










//Estribos 2
tag_location;
//curves
geom_surface_perimeter_curves_2;
//rebarStyle
"StirrupTie";
//rebarBarType
tipo_barra_extremos;
//startHookType
hook;
//endHookType
hook;
//startHookOrientation
"Left";
//endtHookOrientation
"Left";
//hostElement
structural_framing_hormigon_lst;
//vector
structural_framing_hormigon_lst_vector;
//spacing
espaciamiento_extremos;
//ArrayLength
elem_curve_vector_len;
//Punto para posicionar tag










//Estribos 3
tag_location;
//curves
geom_surface_perimeter_curves_3;
//rebarStyle
"StirrupTie";
//rebarBarType
tipo_barra_extremos;
//startHookType
hook;
//endHookType
hook;
//startHookOrientation
"Left";
//endtHookOrientation
"Left";
//hostElement
structural_framing_hormigon_lst;
//vector
structural_framing_hormigon_lst_vector;
//spacing
espaciamiento_extremos;
//ArrayLength
elem_curve_vector_len;










//Traba
//curves
geom_surface_intersect_3;
//rebarStyle
"StirrupTie";
//rebarBarType
tipo_barra_extremos;
//startHookType
hook;
//endHookType
hook;
//startHookOrientation
"Right";
//endtHookOrientation
"Right";
//hostElement
structural_framing_hormigon_lst;
//vector
structural_framing_hormigon_lst_vector;
//spacing
espaciamiento_extremos;
//ArrayLength
elem_curve_vector_len;
//Punto para posicionar tag
tag_location;

//
# ----------------------------------------
fromCurves_6 = StructuralDesign.Rebar.Create.FromCurves(curves=code_block_19.out123, rebarStyle=code_block_19.out124, rebarBarType=code_block_19.out125, startHookType=code_block_19.out126, endHookType=code_block_19.out127, startHookOrientation=code_block_19.out128, endHookOrientation=code_block_19.out129, hostElement=code_block_19.out130, vector=code_block_19.out131)
setLayoutAsMaximumSpacing_6 = StructuralDesign.Rebar.Layout.SetLayoutAsMaximumSpacing(rebar=fromCurves_6, spacing=code_block_19.out133, arrayLength=code_block_19.out132, lacing=Longest)
code_block_20 = CodeBlock { "FirstLast"; }
setRebarPresentation_6 = Custom[SetRebarPresentation](rebarElements=setLayoutAsMaximumSpacing_6, rebarRepresentation=code_block_20)
flatten_6 = List.Flatten(list=setRebarPresentation_6)
element_types_ᶜᵒⁿᵛᵉʳᵗᵉᵈ_ᵈʳᵒᵖᵈᵒʷⁿ_7 = CodeBlock { DSCore.Types.FindTypeByNameInAssembly("RebarShape", "RevitAPI"); }
all_elements_of_type_7 = ElementsOfType(element_type=element_types_ᶜᵒⁿᵛᵉʳᵗᵉᵈ_ᵈʳᵒᵖᵈᵒʷⁿ_7)
code_block_21 = CodeBlock(element=flatten_6, shapes=all_elements_of_type_7, tag_location=code_block_19.out134)  # same code as code_block_11
create_tag_5 = Custom[Create Tag](view=o_document_activeview_7@L1, element=code_block_21.out6@L2, TagLocation=code_block_21.out7@L2, TagType=code_block_21.out9@L1, horizontal=code_block_21.out10@L1, addLeader=code_block_21.out11@L1, LinkInstance=code_block_21.out12@L1, RunIt=code_block_21.out13@L1, lacing=Longest)
fromCurves_7 = StructuralDesign.Rebar.Create.FromCurves(curves=code_block_19.out112, rebarStyle=code_block_19.out113, rebarBarType=code_block_19.out114, startHookType=code_block_19.out115, endHookType=code_block_19.out116, startHookOrientation=code_block_19.out117, endHookOrientation=code_block_19.out118, hostElement=code_block_19.out119, vector=code_block_19.out120)
setLayoutAsMaximumSpacing_7 = StructuralDesign.Rebar.Layout.SetLayoutAsMaximumSpacing(rebar=fromCurves_7, spacing=code_block_19.out121, arrayLength=code_block_19.out122, lacing=Longest)
code_block_22 = CodeBlock { "FirstLast"; }
setRebarPresentation_7 = Custom[SetRebarPresentation](rebarElements=setLayoutAsMaximumSpacing_7, rebarRepresentation=code_block_22)
flatten_7 = List.Flatten(list=setRebarPresentation_7)
code_block_23 = CodeBlock(element=flatten_7)
# ---------- code_block_23.designscript (2 lines) ----------
//Asigna el tipo de estribo (sim, doble, etc...)
Revit.Elements.Element.SetParameterByName(element, "Estribo", "ET.");
# ----------------------------------------
o_document_activeview_9 = Orchid.RevitProject.Common.Document.ActiveView()
fromCurves_8 = StructuralDesign.Rebar.Create.FromCurves(curves=code_block_19.out87, rebarStyle=code_block_19.out88, rebarBarType=code_block_19.out89, startHookType=code_block_19.out90, endHookType=code_block_19.out91, startHookOrientation=code_block_19.out92, endHookOrientation=code_block_19.out93, hostElement=code_block_19.out94, vector=code_block_19.out95)
setLayoutAsMaximumSpacing_8 = StructuralDesign.Rebar.Layout.SetLayoutAsMaximumSpacing(rebar=fromCurves_8, spacing=code_block_19.out96, arrayLength=code_block_19.out97, lacing=Longest)
code_block_24 = CodeBlock { "FirstLast"; }
setRebarPresentation_8 = Custom[SetRebarPresentation](rebarElements=setLayoutAsMaximumSpacing_8, rebarRepresentation=code_block_24)
flatten_8 = List.Flatten(list=setRebarPresentation_8)
code_block_25 = CodeBlock(element=flatten_8, tag_location=code_block_19.out98)
# ---------- code_block_25.designscript (19 lines) ----------
//Asigna el tipo de estribo (sim, doble, etc...)
Revit.Elements.Element.SetParameterByName(element, "Estribo", "ET.");
tag_location;

//element
element;
//TagLocation
tag_location;
//TagType
family = Revit.Family.ByName("EST_A_STRUCTURAL REBAR TAG_ESTRIBO");
tag_type = Revit.Elements.FamilyType.ByFamilyAndName(family, "R_E_00");
//horizontal
true;
//addLeader
false;
//LinkInstance
null;
//RunIt
true;
# ----------------------------------------
create_tag_6 = Custom[Create Tag](view=o_document_activeview_9@L1, element=code_block_25.out2@L2, TagLocation=code_block_25.out3@L2, TagType=code_block_25.out5@L1, horizontal=code_block_25.out6@L1, addLeader=code_block_25.out7@L1, LinkInstance=code_block_25.out8@L1, RunIt=code_block_25.out9@L1, lacing=Longest)
fromCurves_9 = StructuralDesign.Rebar.Create.FromCurves(curves=code_block_19.out100, rebarStyle=code_block_19.out101, rebarBarType=code_block_19.out102, startHookType=code_block_19.out103, endHookType=code_block_19.out104, startHookOrientation=code_block_19.out105, endHookOrientation=code_block_19.out106, hostElement=code_block_19.out107, vector=code_block_19.out108)
setLayoutAsMaximumSpacing_9 = StructuralDesign.Rebar.Layout.SetLayoutAsMaximumSpacing(rebar=fromCurves_9, spacing=code_block_19.out109, arrayLength=code_block_19.out110, lacing=Longest)
code_block_26 = CodeBlock { "FirstLast"; }
setRebarPresentation_9 = Custom[SetRebarPresentation](rebarElements=setLayoutAsMaximumSpacing_9, rebarRepresentation=code_block_26)
flatten_9 = List.Flatten(list=setRebarPresentation_9)
code_block_27 = CodeBlock(element=flatten_9)  # same code as code_block_23
