# Dynamo graph estriboSimple_script.dyn (Dynamo 2.6.2.15705)
# packages: Structural Design 2021.1.22, Clockwork for Dynamo 2.x 2.4.0, Orchid 206.3.0.8161, Data-Shapes 2022.2.103, Genius Loci 2021.11.10

o_document_activeview = Orchid.RevitProject.Common.Document.ActiveView()
code_block = CodeBlock { "Seleccionar Elementos"; }
categories_ᶜᵒⁿᵛᵉʳᵗᵉᵈ_ᵈʳᵒᵖᵈᵒʷⁿ = CodeBlock()
# ---------- categories_ᶜᵒⁿᵛᵉʳᵗᵉᵈ_ᵈʳᵒᵖᵈᵒʷⁿ.designscript (8 lines) ----------
//InputName
"";
//ButtonText
"SELECCIONAR";
//CategoryFilter
Revit.Category.ByName("Structural Framing");
//SelectSingleElement
false;
# ----------------------------------------
selectmodelelements_data = Custom[SelectModelElements Data](InputName=categories_ᶜᵒⁿᵛᵉʳᵗᵉᵈ_ᵈʳᵒᵖᵈᵒʷⁿ.out0, ButtonText=categories_ᶜᵒⁿᵛᵉʳᵗᵉᵈ_ᵈʳᵒᵖᵈᵒʷⁿ.out1, CategoryFilter=categories_ᶜᵒⁿᵛᵉʳᵗᵉᵈ_ᵈʳᵒᵖᵈᵒʷⁿ.out2, SelectSingleElement=categories_ᶜᵒⁿᵛᵉʳᵗᵉᵈ_ᵈʳᵒᵖᵈᵒʷⁿ.out3)  # package Data-Shapes; Creates a Revit element selection input for UI.MultipleInputForm++ . Check out www.data-shapes.net for more infos!
inputgroup_data = Custom[InputGroup Data](GroupTitle=code_block, Inputs=selectmodelelements_data)  # package Data-Shapes; Creates a group of inputs for UI.MultipleInputForm ++ . Check out www.data-shapes.net for more infos !
code_block_2 = CodeBlock { "Estribos Extremos"; }
element_types_ᶜᵒⁿᵛᵉʳᵗᵉᵈ_ᵈʳᵒᵖᵈᵒʷⁿ = CodeBlock { DSCore.Types.FindTypeByNameInAssembly("RebarBarType", "RevitAPI"); }
all_elements_of_type = ElementsOfType(element_type=element_types_ᶜᵒⁿᵛᵉʳᵗᵉᵈ_ᵈʳᵒᵖᵈᵒʷⁿ)
code_block_3 = CodeBlock(elem_type=all_elements_of_type)
# ---------- code_block_3.designscript (15 lines) ----------
elem_type;
elem_type_diameter = Properties.RebarDiameter(elem_type);
elem_sorted = DSCore.List.SortByKey(elem_type, elem_type_diameter)["sorted list"];
elem_name = Revit.Elements.Element.Name(elem_sorted);

//InputName
"Diametro";
//Keys
elem_name;
//Values
elem_sorted;
//DefaultValueIndex
0;
//Sorted_optional
false;
# ----------------------------------------
dropdown_data = Custom[DropDown Data](InputName=code_block_3.out4, Keys=code_block_3.out5, Values=code_block_3.out6, DefaultValueIndex=code_block_3.out7, Sorted_optional=code_block_3.out8)  # package Data-Shapes; Create data for DropDown input in UI.MultiInputForm ++ . Check out www.data-shapes.net for more infos.
code_block_4 = CodeBlock()
# ---------- code_block_4.designscript (6 lines) ----------
//InputName
"Espaciamiento";
//DefaultText
"200";
//IsNumberEntry
true;
# ----------------------------------------
textbox_data = Custom[TextBox Data](InputName=code_block_4.out0, DefaultText=code_block_4.out1, IsNumberEntry=code_block_4.out2)  # package Data-Shapes; Create Data for TextBox input in UI.MultipleInputForm ++ . Check out www.data-shapes.net for more informations
list_create = List.Create(item0=dropdown_data, item1=textbox_data)
inputgroup_data_2 = Custom[InputGroup Data](GroupTitle=code_block_2, Inputs=list_create)
code_block_5 = CodeBlock { "Estribos Centrales"; }
element_types_ᶜᵒⁿᵛᵉʳᵗᵉᵈ_ᵈʳᵒᵖᵈᵒʷⁿ_2 = CodeBlock { DSCore.Types.FindTypeByNameInAssembly("RebarBarType", "RevitAPI"); }
all_elements_of_type_2 = ElementsOfType(element_type=element_types_ᶜᵒⁿᵛᵉʳᵗᵉᵈ_ᵈʳᵒᵖᵈᵒʷⁿ_2)
code_block_6 = CodeBlock(elem_type=all_elements_of_type_2)  # same code as code_block_3
dropdown_data_2 = Custom[DropDown Data](InputName=code_block_6.out4, Keys=code_block_6.out5, Values=code_block_6.out6, DefaultValueIndex=code_block_6.out7, Sorted_optional=code_block_6.out8)
code_block_7 = CodeBlock()
# ---------- code_block_7.designscript (6 lines) ----------
//InputName
"Espaciamiento";
//DefaultText
"300";
//IsNumberEntry
true;
# ----------------------------------------
textbox_data_2 = Custom[TextBox Data](InputName=code_block_7.out0, DefaultText=code_block_7.out1, IsNumberEntry=code_block_7.out2)
list_create_2 = List.Create(item0=dropdown_data_2, item1=textbox_data_2)
inputgroup_data_3 = Custom[InputGroup Data](GroupTitle=code_block_5, Inputs=list_create_2)
list_create_3 = List.Create(item0=inputgroup_data, item1=inputgroup_data_2, item2=inputgroup_data_3)
code_block_8 = CodeBlock(inputs=list_create_3)
# ---------- code_block_8.designscript (20 lines) ----------
//Description
"Estribo Simple";
//Logo
"C:\\Arainco\\Arainco.png";
//ButtonText
"INICIAR";
//Inputs
inputs;
//Toggle
true;
//LinkToHelp
null;
//CancelButtonText
"CANCELAR";
//MaxHeight
0;
//Width
430;
//LabelWidth
170;
# ----------------------------------------
multipleinputform = Custom[MultipleInputForm ++](Description_optional=code_block_8.out0, Logo_optional=code_block_8.out1, ButtonText_optional=code_block_8.out2, Inputs=code_block_8.inputs, Toggle=code_block_8.out4, LinkToHelp_optional=code_block_8.out5, CancelButtonText_optional=code_block_8.out6, MaxHeight_optional=code_block_8.out7, Width_optional=code_block_8.out8, LabelWidth_optional=code_block_8.out9)  # package Data-Shapes; Create a form with multiple inputs. see www.data-shapes.net for tutorials and infos!
code_block_9 = CodeBlock(l=multipleinputform.User_Inputs)
# ---------- code_block_9.designscript (12 lines) ----------
l;
[Imperative]
{
	if (l == null)
	{
		return = [[],[],[],[],[],[],[],[],[],[]];
	}
	else
	{
		return = l;
	}
};
# ----------------------------------------
element_types_ᶜᵒⁿᵛᵉʳᵗᵉᵈ_ᵈʳᵒᵖᵈᵒʷⁿ_3 = CodeBlock { DSCore.Types.FindTypeByNameInAssembly("RebarHookType", "RevitAPI"); }
all_elements_of_type_3 = ElementsOfType(element_type=element_types_ᶜᵒⁿᵛᵉʳᵗᵉᵈ_ᵈʳᵒᵖᵈᵒʷⁿ_3)
o_document_activeview_2 = Orchid.RevitProject.Common.Document.ActiveView()
plane = Custom[View.Plane](view=o_document_activeview_2)  # package Clockwork for Dynamo 2.x; Retrieves the plane of a given view
code_block_10 = CodeBlock(x=code_block_9.out1, pata=all_elements_of_type_3, view_plane=plane)
# ---------- code_block_10.designscript (145 lines) ----------
elem = x[0];
tipo_barra_extremos = x[1];
espaciamiento_extremos = x[2];
tipo_barra_centrales = x[3];
espaciamiento_centrales = x[4];
pata;
pata_names = Revit.Elements.Element.Name(pata);
mask = pata_names == "Stirrup/Tie - 135 deg.";
hook = DSCore.List.FilterByBoolMask(pata, mask)["in"][0];

//Normal plano vista actual
view_plane_normal = Autodesk.Plane.Normal(view_plane);

//Variables para filtrar elementos por categoria
elem_category = Revit.Elements.Element.GetCategory(elem);
elem_category_name = Revit.Category.Name(elem_category);

//Filtrar vigas de hormigon paralelos a la vista actual
structural_framing_mask = elem_category_name == "Structural Framing";
structural_framing = DSCore.List.FilterByBoolMask(elem, structural_framing_mask)["in"];
structural_framing_material = DSCore.List.Flatten(Revit.Elements.Element.GetMaterials(structural_framing, false));
structural_framing_material_name = Revit.Material.Name(structural_framing_material);
structural_framing_material_mask = structural_framing_material_name == "Concrete, Cast-in-Place gray";
structural_framing_hormigon = DSCore.List.FilterByBoolMask(structural_framing, structural_framing_material_mask)["in"];
structural_framing_hormigon_location = Revit.Elements.Element.GetLocation(structural_framing_hormigon);
structural_framing_hormigon_vector = Line.Direction(structural_framing_hormigon_location);
structural_framing_hormigon_centroid = Autodesk.Solid.Centroid(DSCore.List.Flatten(Revit.Elements.Element.Geometry(structural_framing_hormigon)));
structural_framing_hormigon_coo_sys = CoordinateSystem.ByOriginVectors(structural_framing_hormigon_centroid, structural_framing_hormigon_vector, Autodesk.Vector.XAxis());
structural_framing_hormigon_vector_mask = Autodesk.Vector.IsParallel(CoordinateSystem.YAxis(structural_framing_hormigon_coo_sys), view_plane_normal);
structural_framing_hormigon_lst = DSCore.List.FilterByBoolMask(structural_framing_hormigon, structural_framing_hormigon_vector_mask)["in"];

//Altura de Vigas seleccionadas
elem_altura = Revit.Elements.Element.GetParameterValueByName(Revit.Elements.Element.GetParameterValueByName(elem, "Type"), "Height");

//Curva de las Vigas
elem_curve_inicial = Revit.Elements.Element.GetLocation(structural_framing_hormigon_lst);
elem_curve_inicial_len = DesignScript.Curve.Length(elem_curve_inicial);
elem_curve = DesignScript.Curve.ExtendEnd(DesignScript.Curve.ExtendStart(Revit.Elements.Element.GetLocation(elem), -50), -50);

//Distancias division de Curva
dist_1 = elem_altura * 2;
dist_2 = elem_curve_inicial_len - (elem_altura * 2);
dist_lst = DSCore.List.Transpose(Maths.Round([dist_1, dist_2]));
param_lst = DesignScript.Curve.ParameterAtSegmentLength(elem_curve_inicial, dist_lst);

//Planos division de Curva
planes = DesignScript.Curve.PlaneAtSegmentLength(elem_curve_inicial, dist_lst);

//Curva dividida
curve_splitted = DesignScript.Curve.SplitByParameter(elem_curve, param_lst);
curve_splitted_start_point = DesignScript.Curve.StartPoint(curve_splitted);
curve_splitted_end_point = DesignScript.Curve.EndPoint(curve_splitted);
curve_splitted_vector = Autodesk.Vector.ByTwoPoints(curve_splitted_start_point, curve_splitted_end_point);

//Geometria a Cortar
g_elem_solid = DSCore.List.Flatten(Revit.Elements.Element.Geometry(structural_framing_hormigon_lst));
g_solid_centroid = Autodesk.Solid.Centroid(g_elem_solid);
g_solid_plane = Autodesk.Plane.ByOriginNormal(g_solid_centroid, view_plane_normal);
g_solid_coo_sys = CoordinateSystem.ByPlane(g_solid_plane);
g_solid_scaled = Autodesk.Geometry.Scale(g_elem_solid, g_solid_plane, 1, 100, 1);

//Geometria Estribo
geom_param_at_point = DesignScript.Curve.ParameterAtPoint(curve_splitted, curve_splitted_start_point);
geom_plane_at_param = DesignScript.Curve.PlaneAtParameter(curve_splitted, geom_param_at_point);
geom_surface = DSCore.List.Flatten(Autodesk.Geometry.Intersect(g_solid_scaled@L1<1L>, geom_plane_at_param@L2<1L>)@L3<1>, -1);
geom_surface_perimeter = Autodesk.Surface.PerimeterCurves(geom_surface);
geom_surface_perimeter_as_polycurve = PolyCurve.ByJoinedCurves(geom_surface_perimeter);
geom_surface_perimeter_curves = Autodesk.Geometry.Explode(PolyCurve.Offset(geom_surface_perimeter_as_polycurve, -25, false));



//Estribos Extermos
estribos_extremos = DSCore.List.GetItemAtIndex(geom_surface_perimeter_curves@@L3<1>, [0, 2]);
estribos_extremos_vector = DSCore.List.GetItemAtIndex(curve_splitted_vector@@L2<1>, [0, 2]);
curve_splitted_len_extremos = DSCore.List.GetItemAtIndex(Autodesk.Curve.Length(curve_splitted)@@L2<1>, [0, 2]);
tag_location_extremos = DSCore.List.GetItemAtIndex(Autodesk.Curve.PointAtParameter(curve_splitted, 0.5)@@L2<1>, [0, 2]);
//curves
estribos_extremos;
//rebarStyle
"StirrupTie";
//rebarBarType
tipo_barra_extremos;
//startHookType
hook;
//endHookType
hook;
//startHookOrientation
"Left";
//endtHookOrientation
"Left";
//hostElement
elem;
//vector
estribos_extremos_vector;
//spacing
espaciamiento_extremos;
//ArrayLength
curve_splitted_len_extremos;
//Punto para posicionar tag
tag_location_extremos;








//Estribos Centrales
estribos_centrales = DSCore.List.GetItemAtIndex(geom_surface_perimeter_curves@@L3<1>, 1);
estribos_centrales_vector = DSCore.List.GetItemAtIndex(curve_splitted_vector@@L2<1>, 1);
curve_splitted_len_centrales = DSCore.List.GetItemAtIndex(Autodesk.Curve.Length(curve_splitted)@@L2<1>, 1);
tag_location_centrales = DSCore.List.GetItemAtIndex(Autodesk.Curve.PointAtParameter(curve_splitted, 0.5)@@L2<1>, 1);
//curves
estribos_centrales;
//rebarStyle
"StirrupTie";
//rebarBarType
tipo_barra_centrales;
//startHookType
hook;
//endHookType
hook;
//startHookOrientation
"Left";
//endtHookOrientation
"Left";
//hostElement
elem;
//vector
estribos_centrales_vector;
//spacing
espaciamiento_centrales;
//ArrayLength
curve_splitted_len_centrales;
//includeFirstBar
false;
//includeLastBar
false;
//Punto para posicionar tag
tag_location_centrales;



//
# ----------------------------------------
fromCurves = StructuralDesign.Rebar.Create.FromCurves(curves=code_block_10.out52, rebarStyle=code_block_10.out53, rebarBarType=code_block_10.out54, startHookType=code_block_10.out55, endHookType=code_block_10.out56, startHookOrientation=code_block_10.out57, endHookOrientation=code_block_10.out58, hostElement=code_block_10.out59, vector=code_block_10.out60)
setLayoutAsMaximumSpacing = StructuralDesign.Rebar.Layout.SetLayoutAsMaximumSpacing(rebar=fromCurves, spacing=code_block_10.out61, arrayLength=code_block_10.out62, lacing=Longest)
code_block_11 = CodeBlock(element=setLayoutAsMaximumSpacing, tag_location_extremos=code_block_10.out63)
# ---------- code_block_11.designscript (15 lines) ----------
//element
element;
//TagLocation
tag_location_extremos;
//TagType
family = Revit.Family.ByName("EST_A_STRUCTURAL REBAR TAG_ESTRIBO");
tag_type = Revit.Elements.FamilyType.ByFamilyAndName(family, "R_E_00");
//horizontal
true;
//addLeader
false;
//LinkInstance
null;
//RunIt
true;
# ----------------------------------------
create_tag = Custom[Create Tag](view=o_document_activeview@L1, element=code_block_11.element@L2, TagLocation=code_block_11.tag_location_extremos@L2, TagType=code_block_11.tag_type@L1, horizontal=code_block_11.out4@L1, addLeader=code_block_11.out5@L1, LinkInstance=code_block_11.out6@L1, RunIt=code_block_11.out7@L1, lacing=Longest)  # package Genius Loci; Works only in Revit 2018 and later. Creates a tag at a given location, of given type and in a supplied view. The node also works with Linked Elements (except space and area), Multi Category tag and Material Tag. Based on an archilab node
o_document_activeview_3 = Orchid.RevitProject.Common.Document.ActiveView()
fromCurves_2 = StructuralDesign.Rebar.Create.FromCurves(curves=code_block_10.out68, rebarStyle=code_block_10.out69, rebarBarType=code_block_10.out70, startHookType=code_block_10.out71, endHookType=code_block_10.out72, startHookOrientation=code_block_10.out73, endHookOrientation=code_block_10.out74, hostElement=code_block_10.out75, vector=code_block_10.out76)
setLayoutAsMaximumSpacing_2 = StructuralDesign.Rebar.Layout.SetLayoutAsMaximumSpacing(rebar=fromCurves_2, spacing=code_block_10.out77, arrayLength=code_block_10.out78, includeFirstBar=code_block_10.out79, includeLastBar=code_block_10.out80)
code_block_12 = CodeBlock(element=setLayoutAsMaximumSpacing_2, tag_location_centrales=code_block_10.out81)
# ---------- code_block_12.designscript (15 lines) ----------
//element
element;
//TagLocation
tag_location_centrales;
//TagType
family = Revit.Family.ByName("EST_A_STRUCTURAL REBAR TAG_ESTRIBO");
tag_type = Revit.Elements.FamilyType.ByFamilyAndName(family, "R_E_00");
//horizontal
true;
//addLeader
false;
//LinkInstance
null;
//RunIt
true;
# ----------------------------------------
create_tag_2 = Custom[Create Tag](view=o_document_activeview_3, element=code_block_12.element, TagLocation=code_block_12.tag_location_centrales, TagType=code_block_12.tag_type, horizontal=code_block_12.out4, addLeader=code_block_12.out5, LinkInstance=code_block_12.out6, RunIt=code_block_12.out7)
