# Dynamo graph script.dyn (Dynamo 2.6.2.15705)
# packages: Structural Design 2021.1.22, Data-Shapes 2022.2.103, Clockwork for Dynamo 2.x 2.4.0

byJoinedCurves = PolyCurve.ByJoinedCurves()  # unwired: curves
code_block = CodeBlock { "Doble Malla"; }
code_block_2 = CodeBlock { "INICIAR"; "CANCELAR"; true; 430; 170; 650; }
categories_ᶜᵒⁿᵛᵉʳᵗᵉᵈ_ᵈʳᵒᵖᵈᵒʷⁿ = CodeBlock { "Seleccionar Muros a Armar"; "SELECCIONAR"; Revit.Category.ByName("Walls"); }
selectmodelelements_data = Custom[SelectModelElements Data](InputName=categories_ᶜᵒⁿᵛᵉʳᵗᵉᵈ_ᵈʳᵒᵖᵈᵒʷⁿ.out0, ButtonText=categories_ᶜᵒⁿᵛᵉʳᵗᵉᵈ_ᵈʳᵒᵖᵈᵒʷⁿ.out1, CategoryFilter=categories_ᶜᵒⁿᵛᵉʳᵗᵉᵈ_ᵈʳᵒᵖᵈᵒʷⁿ.out2)  # package Data-Shapes; Creates a Revit element selection input for UI.MultipleInputForm++ . Check out www.data-shapes.net for more infos!
code_block_3 = CodeBlock { "Malla Vertical"; }
code_block_4 = CodeBlock { "Diametro"; }
element_types_ᶜᵒⁿᵛᵉʳᵗᵉᵈ_ᵈʳᵒᵖᵈᵒʷⁿ = CodeBlock { DSCore.Types.FindTypeByNameInAssembly("RebarBarType", "RevitAPI"); }
all_elements_of_type = ElementsOfType(element_type=element_types_ᶜᵒⁿᵛᵉʳᵗᵉᵈ_ᵈʳᵒᵖᵈᵒʷⁿ)
code_block_5 = CodeBlock(t5=all_elements_of_type)
# ---------- code_block_5.designscript (8 lines) ----------
t4 = t5;
t1 = t4;
num1 = Properties.RebarDiameter(t1);
t2 = DSCore.List.SortByKey(t1, num1);
t3 = Dictionary.ValueAtKey(t2, "sorted list");
t6 = DSCore.List.TakeItems(t3, 5);
str1 = Revit.Elements.Element.Name(t6);
0;
# ----------------------------------------
radiobuttons_data = Custom[RadioButtons Data](InputName=code_block_4, Keys=code_block_5.str1, Values=code_block_5.t6, DefaultValueIndex=code_block_5.out7)  # package Data-Shapes; Create radio buttons input for UI.MultipleInputForm ++ .
code_block_6 = CodeBlock()
# ---------- code_block_6.designscript (8 lines) ----------
"Distanciamiento";
[
100,
150,
200,
250
];
0;
# ----------------------------------------
radiobuttons_data_2 = Custom[RadioButtons Data](InputName=code_block_6.out0, Keys=code_block_6.out1, Values=code_block_6.out1, DefaultValueIndex=code_block_6.out2)
list_create = List.Create(item0=radiobuttons_data, item1=radiobuttons_data_2)
inputgroup_data = Custom[InputGroup Data](GroupTitle=code_block_3, Inputs=list_create)  # package Data-Shapes; Creates a group of inputs for UI.MultipleInputForm ++ . Check out www.data-shapes.net for more infos !
code_block_7 = CodeBlock { "Malla Horizontal"; }
code_block_8 = CodeBlock { "Diametro"; }
element_types_ᶜᵒⁿᵛᵉʳᵗᵉᵈ_ᵈʳᵒᵖᵈᵒʷⁿ_2 = CodeBlock { DSCore.Types.FindTypeByNameInAssembly("RebarBarType", "RevitAPI"); }
all_elements_of_type_2 = ElementsOfType(element_type=element_types_ᶜᵒⁿᵛᵉʳᵗᵉᵈ_ᵈʳᵒᵖᵈᵒʷⁿ_2)
code_block_9 = CodeBlock(t5=all_elements_of_type_2)  # same code as code_block_5
radiobuttons_data_3 = Custom[RadioButtons Data](InputName=code_block_8, Keys=code_block_9.str1, Values=code_block_9.t6, DefaultValueIndex=code_block_9.out7)
code_block_10 = CodeBlock()  # same code as code_block_6
radiobuttons_data_4 = Custom[RadioButtons Data](InputName=code_block_10.out0, Keys=code_block_10.out1, Values=code_block_10.out1, DefaultValueIndex=code_block_10.out2)
list_create_2 = List.Create(item0=radiobuttons_data_3, item1=radiobuttons_data_4)
inputgroup_data_2 = Custom[InputGroup Data](GroupTitle=code_block_7, Inputs=list_create_2)
list_create_3 = List.Create(item0=selectmodelelements_data, item1=inputgroup_data, item2=inputgroup_data_2)
multipleinputform = Custom[MultipleInputForm ++](Description_optional=code_block, ButtonText_optional=code_block_2.out0, Inputs=list_create_3, Toggle=code_block_2.out2, CancelButtonText_optional=code_block_2.out1, MaxHeight_optional=code_block_2.out5, Width_optional=code_block_2.out3, LabelWidth_optional=code_block_2.out4)  # package Data-Shapes; Create a form with multiple inputs. see www.data-shapes.net for tutorials and infos!
code_block_11 = CodeBlock(l=multipleinputform.User_Inputs)
# ---------- code_block_11.designscript (12 lines) ----------
l;
[Imperative]
{
	if (l == null)
	{
		return = [[],[],[],[],[]];
	}
	else
	{
		return = l;
	}
};
# ----------------------------------------
code_block_12 = CodeBlock(x=code_block_11.out1) { x; }
code_block_13 = CodeBlock(malla_horizontal=code_block_12) { malla_horizontal[0]; malla_horizontal[3]; malla_horizontal[4]; }
code_block_14 = CodeBlock(x=code_block_13.out0) { x; }
geometry = Element.Geometry(element=code_block_14)
flatten = List.Flatten(list=geometry)
centroid = Solid.Centroid(solid=flatten)
byOriginNormal = Plane.ByOriginNormal(origin=centroid)
intersect = Geometry.Intersect(geometry=flatten, other=byOriginNormal)
flatten_2 = List.Flatten(list=intersect)
normalAtPoint = Surface.NormalAtPoint(surface=flatten_2, point=centroid)
code_block_15 = CodeBlock { "Unconnected Height"; }
getParameterValueByName = Element.GetParameterValueByName(element=code_block_14, parameterName=code_block_15)
code_block_16 = CodeBlock(t2=getParameterValueByName) { t1 = t2 / 2; t3 = t1 - 100; t4 = t3 * -1; }
translate = Geometry.Translate(geometry=flatten_2, direction=normalAtPoint, distance=code_block_16.t4)
perimeterCurves = Surface.PerimeterCurves(surface=translate)
function_apply = ApplyFunction(func=byJoinedCurves, arg1=perimeterCurves)
code_block_17 = CodeBlock(l=function_apply)
# ---------- code_block_17.designscript (12 lines) ----------
l;
[Imperative]
{
	if (l == null)
	{
		return = [];
	}
	else
	{
		return = l;
	}
};
# ----------------------------------------
code_block_18 = CodeBlock { -20; }
offset = Curve.Offset(curve=code_block_17.out1, distance=code_block_18)
byJoinedCurves_2 = PolyCurve.ByJoinedCurves(curves=offset@L1)
curves = PolyCurve.Curves(polyCurve=byJoinedCurves_2)
code_block_19 = CodeBlock { null; }
replaceEmptyLists = Custom[List.ReplaceEmptyLists](seq=curves, Replacement=code_block_19)  # package Clockwork for Dynamo 2.x; Replaces all empty lists within a given list with a substitute
code_block_20 = CodeBlock(x=replaceEmptyLists)
# ---------- code_block_20.designscript (13 lines) ----------
x;

[Imperative]
{
	if (x == null)
	{
		return = [null,null,null];
	}
	else
	{
		return = x;
	}
};
# ----------------------------------------
code_block_21 = CodeBlock { [0,1]; }
getItemAtIndex = List.GetItemAtIndex(list=code_block_20.out1@L2, index=code_block_21)
code_block_22 = CodeBlock(rebar_bar_type=code_block_13.out1)
# ---------- code_block_22.designscript (8 lines) ----------
//RebaarStyle
"Standard";
//RebarHookOrientation
"Left";
//Rebar Hook Type;
Revit.Elements.ElementSelector.ByElementId(474495);
//RebarBarType
rebar_bar_type;
# ----------------------------------------
fromCurves = StructuralDesign.Rebar.Create.FromCurves(curves=getItemAtIndex@L2, rebarStyle=code_block_22.out0@L1, rebarBarType=code_block_22.rebar_bar_type@L1, startHookType=code_block_22.out2@L1, endHookType=code_block_22.out2@L1, startHookOrientation=code_block_22.out1@L1, endHookOrientation=code_block_22.out1@L1, hostElement=code_block_13.out0@L1, vector=normalAtPoint@L1, lacing=Longest)
distanciamiento_barras = CodeBlock(distanciamiento_barras=code_block_13.out2) { distanciamiento_barras; }
code_block_23 = CodeBlock { 350; }
sub = getParameterValueByName - code_block_23
setLayoutAsMaximumSpacing = StructuralDesign.Rebar.Layout.SetLayoutAsMaximumSpacing(rebar=fromCurves, spacing=distanciamiento_barras, arrayLength=sub)
byJoinedCurves_3 = PolyCurve.ByJoinedCurves()  # unwired: curves
code_block_24 = CodeBlock(x=code_block_11.out1) { x; }
code_block_25 = CodeBlock(malla_vertical=code_block_24) { malla_vertical[0]; malla_vertical[1]; malla_vertical[2]; malla_vertical[3]; }
muros = CodeBlock(x=code_block_25.out0) { x; }
geometry_2 = Element.Geometry(element=muros)
flatten_3 = List.Flatten(list=geometry_2)
getLocation = Element.GetLocation(element=muros)
code_block_26 = CodeBlock { 0.5; }
planeAtParameter = Curve.PlaneAtParameter(curve=getLocation, param=code_block_26)
intersect_2 = Geometry.Intersect(geometry=flatten_3, other=planeAtParameter)
flatten_4 = List.Flatten(list=intersect_2)
centroid_2 = Solid.Centroid(solid=flatten_3)
normalAtPoint_2 = Surface.NormalAtPoint(surface=flatten_4, point=centroid_2)
code_block_27 = CodeBlock { "Length"; }
getParameterValueByName_2 = Element.GetParameterValueByName(element=muros, parameterName=code_block_27)
round = Math.Round(number=getParameterValueByName_2)
code_block_28 = CodeBlock(t2=round) { t1 = t2 / 2; t3 = t1 - 200; t4 = t3 * -1; }
translate_2 = Geometry.Translate(geometry=flatten_4, direction=normalAtPoint_2, distance=code_block_28.t4)
perimeterCurves_2 = Surface.PerimeterCurves(surface=translate_2)
function_apply_2 = ApplyFunction(func=byJoinedCurves_3, arg1=perimeterCurves_2)
code_block_29 = CodeBlock(l=function_apply_2)  # same code as code_block_17
calculo_posicion_malla_vertical = CodeBlock(t1=code_block_25.out1, t3=code_block_25.out3) { num2 = Properties.RebarDiameter(t1); t2 = num2 / 2; num3 = Properties.RebarDiameter(t3); t4 = t2 + num3; }
code_block_30 = CodeBlock(offSetMalla=calculo_posicion_malla_vertical.t4) { -20-offSetMalla; }
offset_2 = Curve.Offset(curve=code_block_29.out1, distance=code_block_30)
byJoinedCurves_4 = PolyCurve.ByJoinedCurves(curves=offset_2@L1)
curves_2 = PolyCurve.Curves(polyCurve=byJoinedCurves_4)
code_block_31 = CodeBlock { null; }
replaceEmptyLists_2 = Custom[List.ReplaceEmptyLists](seq=curves_2, Replacement=code_block_31)
code_block_32 = CodeBlock(x=replaceEmptyLists_2)  # same code as code_block_20
code_block_33 = CodeBlock { 2; }
getItemAtIndex_2 = List.GetItemAtIndex(list=code_block_32.out1@L2, index=code_block_33)
code_block_34 = CodeBlock(l=getItemAtIndex_2)
# ---------- code_block_34.designscript (12 lines) ----------
l;
[Imperative]
{
	if (l[0] == null)
	{
		return = [];
	}
	else
	{
		return = l;
	}
};
# ----------------------------------------
code_block_35 = CodeBlock(t1=code_block_34.out1)
# ---------- code_block_35.designscript (6 lines) ----------
point1 = Autodesk.Curve.StartPoint(t1);
point2 = Autodesk.Curve.EndPoint(t1);
vector1 = Autodesk.Vector.ByTwoPoints(point1, point2);
num2 = Autodesk.Vector.Z(vector1);
t2 = num2 < 0;
curve1 = Autodesk.Curve.Reverse(t1);
# ----------------------------------------
if_ = If(test=code_block_35.t2, true=code_block_35.curve1, false=code_block_34.out1)
traslapo_armadura = CodeBlock(t1=code_block_25.out1, offsetMalla=calculo_posicion_malla_vertical.t4) { num3 = Properties.RebarDiameter(t1); t2 = num3 * 60; t3 = t2 + 100 + 20 + offsetMalla; }
extendEnd = Curve.ExtendEnd(curve=if_, distance=traslapo_armadura.t3)
code_block_36 = CodeBlock(offsetMalla=calculo_posicion_malla_vertical.t4) { 20+offsetMalla; }
extendStart = Curve.ExtendStart(curve=extendEnd, distance=code_block_36)
code_block_37 = CodeBlock(rebar_bar_type=code_block_25.out1)  # same code as code_block_22
fromCurves_2 = StructuralDesign.Rebar.Create.FromCurves(curves=extendStart@L1, rebarStyle=code_block_37.out0@L1, rebarBarType=code_block_37.rebar_bar_type@L1, startHookType=code_block_37.out2@L1, endHookType=code_block_37.out2@L1, startHookOrientation=code_block_37.out1@L1, endHookOrientation=code_block_37.out1@L1, hostElement=code_block_25.out0@L1, vector=normalAtPoint_2@L1, lacing=Longest)
element_types_ᶜᵒⁿᵛᵉʳᵗᵉᵈ_ᵈʳᵒᵖᵈᵒʷⁿ_3 = CodeBlock { DSCore.Types.FindTypeByNameInAssembly("RebarShape", "RevitAPI"); }
all_elements_of_type_3 = ElementsOfType(element_type=element_types_ᶜᵒⁿᵛᵉʳᵗᵉᵈ_ᵈʳᵒᵖᵈᵒʷⁿ_3)
code_block_38 = CodeBlock(t1=all_elements_of_type_3)
# ---------- code_block_38.designscript (5 lines) ----------
str2 = Revit.Elements.Element.Name(t1);
t2 = str2 == "R_M_02";
t3 = DSCore.List.FilterByBoolMask(t1, t2);
t4 = Dictionary.ValueAtKey(t3, "in");
"Shape";
# ----------------------------------------
setParameterByName = Element.SetParameterByName(element=fromCurves_2@L1, parameterName=code_block_38.out4@L1, value=code_block_38.t4@L1, lacing=Longest)
distanciamiento_barras_2 = CodeBlock(distanciamiento_barras=code_block_25.out2) { distanciamiento_barras; }
code_block_39 = CodeBlock { 400; }
sub_2 = round - code_block_39
setLayoutAsMaximumSpacing_2 = StructuralDesign.Rebar.Layout.SetLayoutAsMaximumSpacing(rebar=setParameterByName, spacing=distanciamiento_barras_2, arrayLength=sub_2)
byJoinedCurves_5 = PolyCurve.ByJoinedCurves()  # unwired: curves
code_block_40 = CodeBlock(malla_horizontal=code_block_12) { malla_horizontal[0]; malla_horizontal[3]; malla_horizontal[4]; }
code_block_41 = CodeBlock(x=code_block_40.out0) { x; }
geometry_3 = Element.Geometry(element=code_block_41)
flatten_5 = List.Flatten(list=geometry_3)
centroid_3 = Solid.Centroid(solid=flatten_5)
byOriginNormal_2 = Plane.ByOriginNormal(origin=centroid_3)
intersect_3 = Geometry.Intersect(geometry=flatten_5, other=byOriginNormal_2)
flatten_6 = List.Flatten(list=intersect_3)
normalAtPoint_3 = Surface.NormalAtPoint(surface=flatten_6, point=centroid_3)
code_block_42 = CodeBlock { "Unconnected Height"; }
getParameterValueByName_3 = Element.GetParameterValueByName(element=code_block_41, parameterName=code_block_42)
code_block_43 = CodeBlock(t2=getParameterValueByName_3) { t1 = t2 / 2; t3 = t1 - 100; t4 = t3 * -1; }
translate_3 = Geometry.Translate(geometry=flatten_6, direction=normalAtPoint_3, distance=code_block_43.t4)
perimeterCurves_3 = Surface.PerimeterCurves(surface=translate_3)
function_apply_3 = ApplyFunction(func=byJoinedCurves_5, arg1=perimeterCurves_3)
code_block_44 = CodeBlock(l=function_apply_3)  # same code as code_block_17
code_block_45 = CodeBlock { -20; }
offset_3 = Curve.Offset(curve=code_block_44.out1, distance=code_block_45)
byJoinedCurves_6 = PolyCurve.ByJoinedCurves(curves=offset_3@L1)
curves_3 = PolyCurve.Curves(polyCurve=byJoinedCurves_6)
code_block_46 = CodeBlock { null; }
replaceEmptyLists_3 = Custom[List.ReplaceEmptyLists](seq=curves_3, Replacement=code_block_46)
code_block_47 = CodeBlock(x=replaceEmptyLists_3)
# ---------- code_block_47.designscript (13 lines) ----------
x;

[Imperative]
{
	if (x == null)
	{
		return = [null,null,null,null];
	}
	else
	{
		return = x;
	}
};
# ----------------------------------------
code_block_48 = CodeBlock { [2,3]; }
getItemAtIndex_3 = List.GetItemAtIndex(list=code_block_47.out1@L2, index=code_block_48)
code_block_49 = CodeBlock(rebar_bar_type=code_block_40.out1)  # same code as code_block_22
fromCurves_3 = StructuralDesign.Rebar.Create.FromCurves(curves=getItemAtIndex_3@L2, rebarStyle=code_block_49.out0@L1, rebarBarType=code_block_49.rebar_bar_type@L1, startHookType=code_block_49.out2@L1, endHookType=code_block_49.out2@L1, startHookOrientation=code_block_49.out1@L1, endHookOrientation=code_block_49.out1@L1, hostElement=code_block_40.out0@L1, vector=normalAtPoint_3@L1, lacing=Longest)
distanciamiento_barras_3 = CodeBlock(distanciamiento_barras=code_block_40.out2) { distanciamiento_barras; }
code_block_50 = CodeBlock { 350; }
sub_3 = getParameterValueByName_3 - code_block_50
setLayoutAsMaximumSpacing_3 = StructuralDesign.Rebar.Layout.SetLayoutAsMaximumSpacing(rebar=fromCurves_3, spacing=distanciamiento_barras_3, arrayLength=sub_3)
byJoinedCurves_7 = PolyCurve.ByJoinedCurves()  # unwired: curves
code_block_51 = CodeBlock(malla_vertical=code_block_24) { malla_vertical[0]; malla_vertical[1]; malla_vertical[2]; malla_vertical[3]; }
muros_2 = CodeBlock(x=code_block_51.out0) { x; }
geometry_4 = Element.Geometry(element=muros_2)
flatten_7 = List.Flatten(list=geometry_4)
getLocation_2 = Element.GetLocation(element=muros_2)
code_block_52 = CodeBlock { 0.5; }
planeAtParameter_2 = Curve.PlaneAtParameter(curve=getLocation_2, param=code_block_52)
intersect_4 = Geometry.Intersect(geometry=flatten_7, other=planeAtParameter_2)
flatten_8 = List.Flatten(list=intersect_4)
centroid_4 = Solid.Centroid(solid=flatten_7)
normalAtPoint_4 = Surface.NormalAtPoint(surface=flatten_8, point=centroid_4)
code_block_53 = CodeBlock { "Length"; }
getParameterValueByName_4 = Element.GetParameterValueByName(element=muros_2, parameterName=code_block_53)
round_2 = Math.Round(number=getParameterValueByName_4)
code_block_54 = CodeBlock(t2=round_2) { t1 = t2 / 2; t3 = t1 - 200; t4 = t3 * -1; }
translate_4 = Geometry.Translate(geometry=flatten_8, direction=normalAtPoint_4, distance=code_block_54.t4)
perimeterCurves_4 = Surface.PerimeterCurves(surface=translate_4)
function_apply_4 = ApplyFunction(func=byJoinedCurves_7, arg1=perimeterCurves_4)
code_block_55 = CodeBlock(l=function_apply_4)  # same code as code_block_17
calculo_posicion_malla_vertical_2 = CodeBlock(t1=code_block_51.out1, t3=code_block_51.out3) { num2 = Properties.RebarDiameter(t1); t2 = num2 / 2; num3 = Properties.RebarDiameter(t3); t4 = t2 + num3; }
code_block_56 = CodeBlock(offSetMalla=calculo_posicion_malla_vertical_2.t4) { -20-offSetMalla; }
offset_4 = Curve.Offset(curve=code_block_55.out1, distance=code_block_56)
byJoinedCurves_8 = PolyCurve.ByJoinedCurves(curves=offset_4@L1)
curves_4 = PolyCurve.Curves(polyCurve=byJoinedCurves_8)
code_block_57 = CodeBlock { null; }
replaceEmptyLists_4 = Custom[List.ReplaceEmptyLists](seq=curves_4, Replacement=code_block_57)
code_block_58 = CodeBlock(x=replaceEmptyLists_4)  # same code as code_block_20
code_block_59 = CodeBlock { 0; }
getItemAtIndex_4 = List.GetItemAtIndex(list=code_block_58.out1@L2, index=code_block_59)
code_block_60 = CodeBlock(l=getItemAtIndex_4)  # same code as code_block_34
code_block_61 = CodeBlock(t1=code_block_60.out1)  # same code as code_block_35
if_2 = If(test=code_block_61.t2, true=code_block_61.curve1, false=code_block_60.out1)
traslapo_armadura_2 = CodeBlock(t1=code_block_51.out1, offsetMalla=calculo_posicion_malla_vertical_2.t4) { num3 = Properties.RebarDiameter(t1); t2 = num3 * 60; t3 = t2 + 100 + 20 + offsetMalla; }
extendEnd_2 = Curve.ExtendEnd(curve=if_2, distance=traslapo_armadura_2.t3)
code_block_62 = CodeBlock(offsetMalla=calculo_posicion_malla_vertical_2.t4) { 20+offsetMalla; }
extendStart_2 = Curve.ExtendStart(curve=extendEnd_2, distance=code_block_62)
code_block_63 = CodeBlock(rebar_bar_type=code_block_51.out1)  # same code as code_block_22
fromCurves_4 = StructuralDesign.Rebar.Create.FromCurves(curves=extendStart_2@L1, rebarStyle=code_block_63.out0@L1, rebarBarType=code_block_63.rebar_bar_type@L1, startHookType=code_block_63.out2@L1, endHookType=code_block_63.out2@L1, startHookOrientation=code_block_63.out1@L1, endHookOrientation=code_block_63.out1@L1, hostElement=code_block_51.out0@L1, vector=normalAtPoint_4@L1, lacing=Longest)
element_types_ᶜᵒⁿᵛᵉʳᵗᵉᵈ_ᵈʳᵒᵖᵈᵒʷⁿ_4 = CodeBlock { DSCore.Types.FindTypeByNameInAssembly("RebarShape", "RevitAPI"); }
all_elements_of_type_4 = ElementsOfType(element_type=element_types_ᶜᵒⁿᵛᵉʳᵗᵉᵈ_ᵈʳᵒᵖᵈᵒʷⁿ_4)
code_block_64 = CodeBlock(t1=all_elements_of_type_4)  # same code as code_block_38
setParameterByName_2 = Element.SetParameterByName(element=fromCurves_4@L1, parameterName=code_block_64.out4@L1, value=code_block_64.t4@L1, lacing=Longest)
distanciamiento_barras_4 = CodeBlock(distanciamiento_barras=code_block_51.out2) { distanciamiento_barras; }
code_block_65 = CodeBlock { 400; }
sub_4 = round_2 - code_block_65
setLayoutAsMaximumSpacing_4 = StructuralDesign.Rebar.Layout.SetLayoutAsMaximumSpacing(rebar=setParameterByName_2, spacing=distanciamiento_barras_4, arrayLength=sub_4)
