# Dynamo graph acotadoAnchoFundacion_script.dyn (Dynamo 2.6.2.15705)
# packages: Orchid 200.4.0.7938, Clockwork for Dynamo 2.x 2.4.0, Genius Loci 2021.11.10

activeView = Orchid.RevitProject.Common.Document.ActiveView()
byBestFitThroughPoints = Line.ByBestFitThroughPoints()  # unwired: bestFitPoints
code_block = CodeBlock { "Structural Foundations"; }
byName = Category.ByName(name=code_block)
activeView_2 = Orchid.RevitProject.Common.Document.ActiveView()
all_elements_of_category_in_view = ElementsOfCategoryInView(Category=byName, View=activeView_2)
kind = Custom[StructuralFoundation.Kind](structuralFoundation=all_elements_of_category_in_view)  # package Clockwork for Dynamo 2.x; Retrieves the kind of a given structural foundation (isolated, wall, slab).
code_block_2 = CodeBlock(x=kind) { x == "Wall Footing"; }
filterByBoolMask = List.FilterByBoolMask(list=all_elements_of_category_in_view, mask=code_block_2)
element_surfaces_references = Custom[Element Surfaces References](element=filterByBoolMask.in)  # package Genius Loci; Retrieve the top, bottom, side surfaces and their associated references of the system family. This doesn't work with cylindrical system families (pipe...)
code_block_3 = CodeBlock { null; }
replaceEmptyLists = Custom[List.ReplaceEmptyLists](seq=element_surfaces_references.Vertical_Surface, Replacement=code_block_3)  # package Clockwork for Dynamo 2.x; Replaces all empty lists within a given list with a substitute
code_block_4 = CodeBlock(x=replaceEmptyLists)
# ---------- code_block_4.designscript (12 lines) ----------
x;
[Imperative]
{
	if(x == null)
	{
		return = [null,null];
	}
	else
	{
		return = x;
	}
};
# ----------------------------------------
code_block_5 = CodeBlock { [0,1]; }
getItemAtIndex = List.GetItemAtIndex(list=code_block_4.out1@L2, index=code_block_5)
list_clean = Custom[List Clean](list=getItemAtIndex)  # package Genius Loci; Removes all Null, Empty and Blank from a list or nested list of lists.
code_block_6 = CodeBlock { 0.3; 0.5; }
pointAtParameter = Surface.PointAtParameter(surface=list_clean, u=code_block_6.out1, v=code_block_6.out0)
function_apply = ApplyFunction(func=byBestFitThroughPoints, arg1=pointAtParameter)
code_block_7 = CodeBlock { null; }
replaceEmptyLists_2 = Custom[List.ReplaceEmptyLists](seq=element_surfaces_references.Vertical_Reference, Replacement=code_block_7)
code_block_8 = CodeBlock(x=replaceEmptyLists_2)  # same code as code_block_4
code_block_9 = CodeBlock { [0,1]; }
getItemAtIndex_2 = List.GetItemAtIndex(list=code_block_8.out1@L2, index=code_block_9)
dimension_byreferences = Custom[Dimension ByReferences](view=activeView, line=function_apply, references=getItemAtIndex_2@L2, lacing=Longest)  # package Genius Loci; Creates a new linear dimension from at least two geometric references of an object.
