# Dynamo graph etiquetado_script.dyn (Dynamo 2.6.2.15705)
# packages: Orchid 200.4.0.7938, Clockwork for Dynamo 2.x 2.4.0, Genius Loci 2021.11.10, Crumple 2022.2.13, Rhythm 2020.7.25, archi-lab.net 2022.210.2419

activeView = Orchid.RevitProject.Common.Document.ActiveView()
code_block = CodeBlock(x=activeView) { x; x; }

# group: Etiqueta Muros
code_block_2 = CodeBlock(x=code_block.out1) { x; }
code_block_3 = CodeBlock(x=code_block_2) { x; }
code_block_4 = CodeBlock { "Walls"; }
byName = Category.ByName(name=code_block_4)
all_elements_of_category_in_view = ElementsOfCategoryInView(Category=byName, View=code_block_3)
code_block_5 = CodeBlock { "Basic"; }
name = Material.Name()  # unwired: material
code_block_6 = CodeBlock { "Concrete, Cast-in-Place gray"; }
code_block_7 = CodeBlock(x=code_block_2) { x; }
plane = Custom[View.Plane](view=code_block_7)  # package Clockwork for Dynamo 2.x; Retrieves the plane of a given view
code_block_8 = CodeBlock { "Type"; }
code_block_9 = CodeBlock { "EST_A_WALL TAG_ELEVACION_MHA"; }
byName_2 = Orchid.RevitProject.Elements.Family.ByName(name=code_block_9)
code_block_10 = CodeBlock { "Doble Malla"; }
byFamilyAndName = FamilyType.ByFamilyAndName(family=byName_2, name=code_block_10)

wallType = archilab.Revit.Elements.Walls.WallType(wall=all_elements_of_category_in_view)

# group (continued): Etiqueta Muros
kind = Orchid.RevitProject.Elements.WallType.Kind(wallType=wallType)
eq = kind == code_block_5
filterByBoolMask = List.FilterByBoolMask(list=all_elements_of_category_in_view, mask=eq)
getMaterials = Element.GetMaterials(element=filterByBoolMask.in)
flatten = List.Flatten(list=getMaterials)
function_apply = ApplyFunction(func=name, arg1=flatten)
eq_2 = function_apply == code_block_6
filterByBoolMask_2 = List.FilterByBoolMask(list=filterByBoolMask.in, mask=eq_2)
location = Custom[Element.Location+](element=filterByBoolMask_2.in)  # package Clockwork for Dynamo 2.x; Returns the location of an element as point, curve or curve loop, along with some booleans to help filtering the results. Unlike the OOTB Element.GetLocation node, it also retunrs sketch lines of sketch-based elements like floor slabs as well as the element's rotation property.
code_block_11 = CodeBlock(x=location.curves)
# ---------- code_block_11.designscript (12 lines) ----------
x;
[Imperative]
{
	if(x == null)
	{
		return = [];
	}
	else
	{
		return = x;
	}
};
# ----------------------------------------
direction = Line.Direction(line=code_block_11.out1)
isParallelToPlane = Custom[Vector.IsParallelToPlane](vector=direction, plane=plane)  # package Clockwork for Dynamo 2.x; Checks if a given vector is parallel to a given plane
filterByBoolMask_3 = List.FilterByBoolMask(list=filterByBoolMask_2.in, mask=isParallelToPlane)
element_taggedstatus = Custom[Element TaggedStatus](element=filterByBoolMask_3.in)  # package Genius Loci; Identify the tagged and untagged elements. Please note : This doesn't work with areas and spaces.
elementcentroid = Custom[© ElementCentroid](element=element_taggedstatus.NotTagged)  # package Crumple; Returns the centroid of the element's axis-aligned bounding box.
byElementAndLocation = Tag.ByElementAndLocation(view=code_block_3, element=element_taggedstatus.NotTagged, location=elementcentroid)
setParameterByName = Element.SetParameterByName(element=byElementAndLocation, parameterName=code_block_8, value=byFamilyAndName)

await_ = Orchid.Common.DataStream.Await(pass=code_block.out1, waitFor=setParameterByName)

# group: Columnas Metalicas Rectangulares
code_block_12 = CodeBlock(x=await_) { x; }
code_block_13 = CodeBlock(x=code_block_12) { x; }
code_block_14 = CodeBlock { "Structural Columns"; }
byName_3 = Category.ByName(name=code_block_14)
all_elements_of_category_in_view_2 = ElementsOfCategoryInView(Category=byName_3, View=code_block_13)
familyName = Orchid.RevitProject.Elements.Element.FamilyName(element=all_elements_of_category_in_view_2)
code_block_15 = CodeBlock()
# ---------- code_block_15.designscript (11 lines) ----------
[
"EST_M_STRUCTURAL COLUMN_SOLDADA_IN",
"EST_M_STRUCTURAL COLUMN_LAMINADA_L",
"EST_M_STRUCTURAL COLUMN_PLEGADA_C",
"EST_M_STRUCTURAL COLUMN_PLEGADA_CA",
"EST_M_STRUCTURAL COLUMN_PLEGADA_HSS",
"EST_M_STRUCTURAL COLUMN_PLEGADA_IC",
"EST_M_STRUCTURAL COLUMN_PLEGADA_L",
"EST_M_STRUCTURAL COLUMN_SOLDADA_HN",
"EST_M_STRUCTURAL COLUMN_SOLDADA_T"
];
# ----------------------------------------
eq_3 = familyName@L1 == code_block_15
anyTrue = Orchid.Common.List.AnyTrue(list=eq_3)
filterByBoolMask_4 = List.FilterByBoolMask(list=all_elements_of_category_in_view_2, mask=anyTrue)
name_2 = Material.Name()  # unwired: material
getMaterials_2 = Element.GetMaterials(element=filterByBoolMask_4.in)
flatten_2 = List.Flatten(list=getMaterials_2)
function_apply_2 = ApplyFunction(func=name_2, arg1=flatten_2)
code_block_16 = CodeBlock { "Steel"; }
eq_4 = function_apply_2 == code_block_16
filterByBoolMask_5 = List.FilterByBoolMask(list=filterByBoolMask_4.in, mask=eq_4)
element_taggedstatus_2 = Custom[Element TaggedStatus](element=filterByBoolMask_5.in)
code_block_17 = CodeBlock { "Column Style"; 1; }
setParameterByName_2 = Element.SetParameterByName(element=element_taggedstatus_2.NotTagged, parameterName=code_block_17.out0, value=code_block_17.out1)
location_2 = Custom[Element.Location+](element=setParameterByName_2)
code_block_18 = CodeBlock(x=location_2.curves)  # same code as code_block_11
await_2 = Orchid.Common.DataStream.Await(pass=setParameterByName_2, waitFor=code_block_18.out1)
elementcentroid_2 = Custom[© ElementCentroid](element=await_2)
code_block_19 = CodeBlock { 0.5; }
planeAtParameter = Curve.PlaneAtParameter(curve=code_block_18.out1, param=code_block_19)
code_block_20 = CodeBlock { 0.5; }
pointAtParameter = Curve.PointAtParameter(curve=code_block_18.out1, param=code_block_20)
code_block_21 = CodeBlock(x=code_block_12) { x; }
plane_2 = Custom[View.Plane](view=code_block_21)
normal = Plane.Normal(plane=plane_2)
code_block_22 = CodeBlock { 90; }
rotate = Geometry.Rotate(geometry=planeAtParameter, origin=pointAtParameter, axis=normal, degrees=code_block_22)
normal_2 = Plane.Normal(plane=rotate)
code_block_23 = CodeBlock(z=normal_2) { z.Z; }
code_block_24 = CodeBlock { 0; }
gt = code_block_23 > code_block_24
code_block_25 = CodeBlock { -1; }
ne = code_block_23 != code_block_25
and_ = gt && ne
reverse = Vector.Reverse(vector=normal_2)
scopeIf = Custom[ScopeIf+](test=and_, True=normal_2, False=reverse, lacing=Shortest)  # package Clockwork for Dynamo 2.x; A (hopefully) more robust implementation of ScopeIf. Tests a single boolean and returns a value accordingly.
code_block_26 = CodeBlock(x=await_2) { Revit.Elements.Element.GetParameterValueByName(Revit.Elements.Element.GetParameterValueByName(x,"Type"),"Width")/2; }
translate = Geometry.Translate(geometry=elementcentroid_2, direction=scopeIf, distance=code_block_26)
code_block_27 = CodeBlock()
# ---------- code_block_27.designscript (2 lines) ----------
//horizontal
false;
# ----------------------------------------
byElementAndLocation_2 = Tag.ByElementAndLocation(view=code_block_13, element=await_2, location=translate, horizontal=code_block_27)
code_block_28 = CodeBlock { "Type"; }
code_block_29 = CodeBlock { "EST_A_STRUCTURAL COLUMN TAG_ELEVACION_DIMENSIONES"; }
byName_4 = Orchid.RevitProject.Elements.Family.ByName(name=code_block_29)
code_block_30 = CodeBlock { "Pilar Hormigon"; }
byFamilyAndName_2 = FamilyType.ByFamilyAndName(family=byName_4, name=code_block_30)
setParameterByName_3 = Element.SetParameterByName(element=byElementAndLocation_2, parameterName=code_block_28, value=byFamilyAndName_2)
code_block_31 = CodeBlock { "Column Style"; 0; }
setParameterByName_4 = Element.SetParameterByName(element=await_2, parameterName=code_block_31.out0, value=code_block_31.out1)

await_3 = Orchid.Common.DataStream.Await(pass=code_block.out1, waitFor=setParameterByName_3)

# group: Etiqueta Columna Rectangular hormigon
code_block_32 = CodeBlock(x=await_3) { x; }
code_block_33 = CodeBlock(x=code_block_32) { x; }
code_block_34 = CodeBlock { "Structural Columns"; }
byName_5 = Category.ByName(name=code_block_34)
all_elements_of_category_in_view_3 = ElementsOfCategoryInView(Category=byName_5, View=code_block_33)
familyName_2 = Orchid.RevitProject.Elements.Element.FamilyName(element=all_elements_of_category_in_view_3)
code_block_35 = CodeBlock { "EST_M_STRUCTURAL COLUMN_RECTANGULAR"; }
eq_5 = familyName_2 == code_block_35
filterByBoolMask_6 = List.FilterByBoolMask(list=all_elements_of_category_in_view_3, mask=eq_5)
name_3 = Material.Name()  # unwired: material
getMaterials_3 = Element.GetMaterials(element=filterByBoolMask_6.in)
flatten_3 = List.Flatten(list=getMaterials_3)
function_apply_3 = ApplyFunction(func=name_3, arg1=flatten_3)
code_block_36 = CodeBlock { "Concrete, Cast-in-Place gray"; }
eq_6 = function_apply_3 == code_block_36
filterByBoolMask_7 = List.FilterByBoolMask(list=filterByBoolMask_6.in, mask=eq_6)
element_taggedstatus_3 = Custom[Element TaggedStatus](element=filterByBoolMask_7.in)
code_block_37 = CodeBlock { "Column Style"; 1; }
setParameterByName_5 = Element.SetParameterByName(element=element_taggedstatus_3.NotTagged, parameterName=code_block_37.out0, value=code_block_37.out1)
location_3 = Custom[Element.Location+](element=setParameterByName_5)
code_block_38 = CodeBlock(x=location_3.curves)  # same code as code_block_11
await_4 = Orchid.Common.DataStream.Await(pass=setParameterByName_5, waitFor=code_block_38.out1)
elementcentroid_3 = Custom[© ElementCentroid](element=await_4)
code_block_39 = CodeBlock { 0.5; }
planeAtParameter_2 = Curve.PlaneAtParameter(curve=code_block_38.out1, param=code_block_39)
code_block_40 = CodeBlock { 0.5; }
pointAtParameter_2 = Curve.PointAtParameter(curve=code_block_38.out1, param=code_block_40)
code_block_41 = CodeBlock(x=code_block_32) { x; }
plane_3 = Custom[View.Plane](view=code_block_41)
normal_3 = Plane.Normal(plane=plane_3)
code_block_42 = CodeBlock { 90; }
rotate_2 = Geometry.Rotate(geometry=planeAtParameter_2, origin=pointAtParameter_2, axis=normal_3, degrees=code_block_42)
normal_4 = Plane.Normal(plane=rotate_2)
code_block_43 = CodeBlock(z=normal_4) { z.Z; }
code_block_44 = CodeBlock { 0; }
gt_2 = code_block_43 > code_block_44
code_block_45 = CodeBlock { -1; }
ne_2 = code_block_43 != code_block_45
and_2 = gt_2 && ne_2
reverse_2 = Vector.Reverse(vector=normal_4)
scopeIf_2 = Custom[ScopeIf+](test=and_2, True=normal_4, False=reverse_2, lacing=Shortest)
code_block_46 = CodeBlock(x=await_4) { Revit.Elements.Element.GetParameterValueByName(Revit.Elements.Element.GetParameterValueByName(x,"Type"),"Width")/2; }
translate_2 = Geometry.Translate(geometry=elementcentroid_3, direction=scopeIf_2, distance=code_block_46)
code_block_47 = CodeBlock()  # same code as code_block_27
byElementAndLocation_3 = Tag.ByElementAndLocation(view=code_block_33, element=await_4, location=translate_2, horizontal=code_block_47)
code_block_48 = CodeBlock { "Type"; }
code_block_49 = CodeBlock { "EST_A_STRUCTURAL COLUMN TAG_ELEVACION_DIMENSIONES"; }
byName_6 = Orchid.RevitProject.Elements.Family.ByName(name=code_block_49)
code_block_50 = CodeBlock { "Pilar Hormigon"; }
byFamilyAndName_3 = FamilyType.ByFamilyAndName(family=byName_6, name=code_block_50)
setParameterByName_6 = Element.SetParameterByName(element=byElementAndLocation_3, parameterName=code_block_48, value=byFamilyAndName_3)
code_block_51 = CodeBlock { "Column Style"; 0; }
setParameterByName_7 = Element.SetParameterByName(element=await_4, parameterName=code_block_51.out0, value=code_block_51.out1)

await_5 = Orchid.Common.DataStream.Await(pass=code_block.out1, waitFor=setParameterByName_6)

# group: Etiqueta Columna Circular Hormigon
code_block_52 = CodeBlock(x=await_5) { x; }
code_block_53 = CodeBlock(x=code_block_52) { x; }
code_block_54 = CodeBlock { "Structural Columns"; }
byName_7 = Category.ByName(name=code_block_54)
all_elements_of_category_in_view_4 = ElementsOfCategoryInView(Category=byName_7, View=code_block_53)
familyName_3 = Orchid.RevitProject.Elements.Element.FamilyName(element=all_elements_of_category_in_view_4)
code_block_55 = CodeBlock { "EST_M_STRUCTURAL COLUMN_CIRCULAR"; }
eq_7 = familyName_3 == code_block_55
filterByBoolMask_8 = List.FilterByBoolMask(list=all_elements_of_category_in_view_4, mask=eq_7)
name_4 = Material.Name()  # unwired: material
getMaterials_4 = Element.GetMaterials(element=filterByBoolMask_8.in)
flatten_4 = List.Flatten(list=getMaterials_4)
function_apply_4 = ApplyFunction(func=name_4, arg1=flatten_4)
code_block_56 = CodeBlock { "Concrete, Cast-in-Place gray"; }
eq_8 = function_apply_4 == code_block_56
filterByBoolMask_9 = List.FilterByBoolMask(list=filterByBoolMask_8.in, mask=eq_8)
element_taggedstatus_4 = Custom[Element TaggedStatus](element=filterByBoolMask_9.in)
code_block_57 = CodeBlock { "Column Style"; 1; }
setParameterByName_8 = Element.SetParameterByName(element=element_taggedstatus_4.NotTagged, parameterName=code_block_57.out0, value=code_block_57.out1)
location_4 = Custom[Element.Location+](element=setParameterByName_8)
code_block_58 = CodeBlock(x=location_4.curves)  # same code as code_block_11
await_6 = Orchid.Common.DataStream.Await(pass=setParameterByName_8, waitFor=code_block_58.out1)
elementcentroid_4 = Custom[© ElementCentroid](element=await_6)
code_block_59 = CodeBlock { 0.5; }
planeAtParameter_3 = Curve.PlaneAtParameter(curve=code_block_58.out1, param=code_block_59)
code_block_60 = CodeBlock { 0.5; }
pointAtParameter_3 = Curve.PointAtParameter(curve=code_block_58.out1, param=code_block_60)
code_block_61 = CodeBlock(x=code_block_52) { x; }
plane_4 = Custom[View.Plane](view=code_block_61)
normal_5 = Plane.Normal(plane=plane_4)
code_block_62 = CodeBlock { 90; }
rotate_3 = Geometry.Rotate(geometry=planeAtParameter_3, origin=pointAtParameter_3, axis=normal_5, degrees=code_block_62)
normal_6 = Plane.Normal(plane=rotate_3)
code_block_63 = CodeBlock(z=normal_6) { z.Z; }
code_block_64 = CodeBlock { 0; }
gt_3 = code_block_63 > code_block_64
code_block_65 = CodeBlock { -1; }
ne_3 = code_block_63 != code_block_65
and_3 = gt_3 && ne_3
reverse_3 = Vector.Reverse(vector=normal_6)
scopeIf_3 = Custom[ScopeIf+](test=and_3, True=normal_6, False=reverse_3, lacing=Shortest)
code_block_66 = CodeBlock(x=await_6) { Revit.Elements.Element.GetParameterValueByName(Revit.Elements.Element.GetParameterValueByName(x,"Type"),"Diameter")/2; }
translate_3 = Geometry.Translate(geometry=elementcentroid_4, direction=scopeIf_3, distance=code_block_66)
code_block_67 = CodeBlock()  # same code as code_block_27
byElementAndLocation_4 = Tag.ByElementAndLocation(view=code_block_53, element=await_6, location=translate_3, horizontal=code_block_67)
code_block_68 = CodeBlock { "Type"; }
code_block_69 = CodeBlock { "EST_A_STRUCTURAL COLUMN TAG_ELEVACION_DIMENSIONES"; }
byName_8 = Orchid.RevitProject.Elements.Family.ByName(name=code_block_69)
code_block_70 = CodeBlock { "Pilar Hormigon"; }
byFamilyAndName_4 = FamilyType.ByFamilyAndName(family=byName_8, name=code_block_70)
setParameterByName_9 = Element.SetParameterByName(element=byElementAndLocation_4, parameterName=code_block_68, value=byFamilyAndName_4)
code_block_71 = CodeBlock { "Column Style"; 0; }
setParameterByName_10 = Element.SetParameterByName(element=await_6, parameterName=code_block_71.out0, value=code_block_71.out1)

await_7 = Orchid.Common.DataStream.Await(pass=code_block.out1, waitFor=setParameterByName_9)

# group: Etiqueta Vigas Metalicas
activeView_2 = Orchid.RevitProject.Common.Document.ActiveView()
code_block_72 = CodeBlock { "Structural Framing"; }
byName_9 = Category.ByName(name=code_block_72)
code_block_73 = CodeBlock(x=await_7) { x; }
all_elements_of_category_in_view_5 = ElementsOfCategoryInView(Category=byName_9, View=code_block_73)
familyName_4 = Orchid.RevitProject.Elements.Element.FamilyName(element=all_elements_of_category_in_view_5)
code_block_74 = CodeBlock()
# ---------- code_block_74.designscript (12 lines) ----------
[
"EST_M_STRUCTURAL FRAMING_VIGA LAMINADA_L",
"EST_M_STRUCTURAL FRAMING_VIGA OHM",
"EST_M_STRUCTURAL FRAMING_VIGA PLEGADA_C",
"EST_M_STRUCTURAL FRAMING_VIGA PLEGADA_CA",
"EST_M_STRUCTURAL FRAMING_VIGA PLEGADA_HSS",
"EST_M_STRUCTURAL FRAMING_VIGA PLEGADA_HSSE",
"EST_M_STRUCTURAL FRAMING_VIGA PLEGADA_L",
"EST_M_STRUCTURAL FRAMING_VIGA SOLDADA_HN",
"EST_M_STRUCTURAL FRAMING_VIGA SOLDADA_IN",
"EST_M_STRUCTURAL FRAMING_VIGA SOLDADA_T"
];
# ----------------------------------------
eq_9 = familyName_4@L1 == code_block_74
anyTrue_2 = Orchid.Common.List.AnyTrue(list=eq_9)
filterByBoolMask_10 = List.FilterByBoolMask(list=all_elements_of_category_in_view_5, mask=anyTrue_2)
location_5 = Custom[Element.Location+](element=filterByBoolMask_10.in)
code_block_75 = CodeBlock(x=location_5.curves)  # same code as code_block_11
direction_2 = Line.Direction(line=code_block_75.out1)
activeView_3 = Orchid.RevitProject.Common.Document.ActiveView()
plane_5 = Custom[View.Plane](view=activeView_3)
isParallelToPlane_2 = Custom[Vector.IsParallelToPlane](vector=direction_2, plane=plane_5)
filterByBoolMask_11 = List.FilterByBoolMask(list=filterByBoolMask_10.in, mask=isParallelToPlane_2)
element_taggedstatus_5 = Custom[Element TaggedStatus](element=filterByBoolMask_11.in)
elementcentroid_5 = Custom[© ElementCentroid](element=element_taggedstatus_5.NotTagged)
location_6 = Custom[Element.Location+](element=element_taggedstatus_5.NotTagged)
code_block_76 = CodeBlock(x=location_6.curves)  # same code as code_block_11
code_block_77 = CodeBlock { 0.5; }
planeAtParameter_4 = Curve.PlaneAtParameter(curve=code_block_76.out1, param=code_block_77)
code_block_78 = CodeBlock { 0.5; }
pointAtParameter_4 = Curve.PointAtParameter(curve=code_block_76.out1, param=code_block_78)
activeView_4 = Orchid.RevitProject.Common.Document.ActiveView()
plane_6 = Custom[View.Plane](view=activeView_4)
normal_7 = Plane.Normal(plane=plane_6)
code_block_79 = CodeBlock { 90; }
rotate_4 = Geometry.Rotate(geometry=planeAtParameter_4, origin=pointAtParameter_4, axis=normal_7, degrees=code_block_79)
normal_8 = Plane.Normal(plane=rotate_4)
code_block_80 = CodeBlock(z=normal_8) { z.Z; }
code_block_81 = CodeBlock { 0; }
gt_4 = code_block_80 > code_block_81
code_block_82 = CodeBlock { -1; }
ne_4 = code_block_80 != code_block_82
and_4 = gt_4 && ne_4
reverse_4 = Vector.Reverse(vector=normal_8)
scopeIf_4 = Custom[ScopeIf+](test=and_4, True=normal_8, False=reverse_4, lacing=Shortest)
code_block_83 = CodeBlock(x=element_taggedstatus_5.NotTagged) { Revit.Elements.Element.GetParameterValueByName(Revit.Elements.Element.GetParameterValueByName(x,"Type"),"Height")/2; }
translate_4 = Geometry.Translate(geometry=elementcentroid_5, direction=scopeIf_4, distance=code_block_83)
byElementAndLocation_5 = Tag.ByElementAndLocation(view=activeView_2, element=element_taggedstatus_5.NotTagged, location=translate_4)
code_block_84 = CodeBlock { "Type"; }
code_block_85 = CodeBlock { "EST_A_STRUCTURAL FRAMING TAG_ELEVACION"; }
byName_10 = Orchid.RevitProject.Elements.Family.ByName(name=code_block_85)
code_block_86 = CodeBlock { "Tag Viga"; }
byFamilyAndName_5 = FamilyType.ByFamilyAndName(family=byName_10, name=code_block_86)
setParameterByName_11 = Element.SetParameterByName(element=byElementAndLocation_5, parameterName=code_block_84, value=byFamilyAndName_5)
name_5 = Material.Name()  # unwired: material
getMaterials_5 = Element.GetMaterials(element=filterByBoolMask_10.in)
flatten_5 = List.Flatten(list=getMaterials_5)
function_apply_5 = ApplyFunction(func=name_5, arg1=flatten_5)
code_block_87 = CodeBlock { "Concrete, Cast-in-Place gray"; }
eq_10 = function_apply_5 == code_block_87
filterByBoolMask_12 = List.FilterByBoolMask(list=filterByBoolMask_10.in, mask=eq_10)

await_8 = Orchid.Common.DataStream.Await(pass=code_block.out1, waitFor=setParameterByName_11)

# group: Etiqueta Emplantillado
ʳʰʸᵗʰᵐ_tags = Rhythm.Revit.Elements.Tags.SetLeaderElbowPosition()  # unwired: tag, location
code_block_88 = CodeBlock { "Type"; }
code_block_89 = CodeBlock { "EST_A_STRUCTURAL FOUNDATION TAG_ELEVACION_EMPLANTILLADO"; }
byName_11 = Orchid.RevitProject.Elements.Family.ByName(name=code_block_89)
code_block_90 = CodeBlock { "Emplantillado"; }
byFamilyAndName_6 = FamilyType.ByFamilyAndName(family=byName_11, name=code_block_90)
setParameterByName_12 = Element.SetParameterByName(parameterName=code_block_88, value=byFamilyAndName_6)  # unwired: element
code_block_91 = CodeBlock { "Leader Line"; 1; }
setParameterByName_13 = Element.SetParameterByName(parameterName=code_block_91.out0, value=code_block_91.out1)  # unwired: element
code_block_92 = CodeBlock(x=await_8) { x; }
code_block_93 = CodeBlock(x=code_block_92) { x; }
code_block_94 = CodeBlock { "Structural Foundations"; }
byName_12 = Category.ByName(name=code_block_94)
all_elements_of_category_in_view_6 = ElementsOfCategoryInView(Category=byName_12, View=code_block_93)
kind_2 = Custom[StructuralFoundation.Kind](structuralFoundation=all_elements_of_category_in_view_6)  # package Clockwork for Dynamo 2.x; Retrieves the kind of a given structural foundation (isolated, wall, slab).
code_block_95 = CodeBlock { "Slab"; }
eq_11 = kind_2 == code_block_95
name_6 = Element.Name(element=all_elements_of_category_in_view_6)
code_block_96 = CodeBlock { "EMPLANTILLADO"; }
contains = String.Contains(str=name_6, searchFor=code_block_96)
and_5 = eq_11 && contains
filterByBoolMask_13 = List.FilterByBoolMask(list=all_elements_of_category_in_view_6, mask=and_5)
code_block_97 = CodeBlock { null; }
replaceEmptyLists = Custom[List.ReplaceEmptyLists](seq=filterByBoolMask_13.in, Replacement=code_block_97)  # package Clockwork for Dynamo 2.x; Replaces all empty lists within a given list with a substitute
code_block_98 = CodeBlock { 0; }
getItemAtIndex = List.GetItemAtIndex(index=code_block_98)  # unwired: list
ZAxis = Vector.ZAxis()
code_block_99 = CodeBlock { -300; }
translate_5 = Geometry.Translate(direction=ZAxis@L1, distance=code_block_99@L1, lacing=Longest)  # unwired: geometry
code_block_100 = CodeBlock { 0.5; }
pointAtParameter_5 = Surface.PointAtParameter(u=code_block_100, v=code_block_100)  # unwired: surface
element_surfaces_references = Custom[Element Surfaces References](element=replaceEmptyLists)  # package Genius Loci; Retrieve the top, bottom, side surfaces and their associated references of the system family. This doesn't work with cylindrical system families (pipe...)
code_block_101 = CodeBlock(x=element_surfaces_references.Bottom_Surface)
# ---------- code_block_101.designscript (12 lines) ----------
x;
[Imperative]
{
	if(x == null)
	{
		return = [];
	}
	else
	{
		return = DSCore.List.Flatten(x,1);
	}
};
# ----------------------------------------
function_apply_6 = ApplyFunction(func=pointAtParameter_5, arg1=code_block_101.out1)
function_apply_7 = ApplyFunction(func=translate_5, arg1=function_apply_6)
code_block_102 = CodeBlock { null; }
replaceEmptyLists_2 = Custom[List.ReplaceEmptyLists](seq=function_apply_7, Replacement=code_block_102)
code_block_103 = CodeBlock(x=code_block_92) { x; }
plane_7 = Custom[View.Plane](view=code_block_103)
byBestFitThroughPoints = Line.ByBestFitThroughPoints()  # unwired: bestFitPoints
code_block_104 = CodeBlock { 0.5; }
pointAtParameter_6 = Curve.PointAtParameter(param=code_block_104)  # unwired: curve
code_block_105 = CodeBlock { [1,3]; }
getItemAtIndex_2 = List.GetItemAtIndex(index=code_block_105@L2)  # unwired: list
getCropBox = Orchid.RevitProject.Views.View.GetCropBox(view=code_block_103)
function_apply_8 = ApplyFunction(func=getItemAtIndex_2, arg1=getCropBox.Curve)
function_apply_9 = ApplyFunction(func=pointAtParameter_6, arg1=function_apply_8)
function_apply_10 = ApplyFunction(func=byBestFitThroughPoints, arg1=function_apply_9)
code_block_106 = CodeBlock(x=function_apply_10)  # same code as code_block_11
code_block_107 = CodeBlock { 0.5; }
pointAtParameter_7 = Curve.PointAtParameter(curve=code_block_106.out1, param=code_block_107)
direction_3 = Line.Direction(line=code_block_106.out1)
code_block_108 = CodeBlock { -90; }
rotate_5 = Geometry.Rotate(geometry=plane_7, origin=pointAtParameter_7, axis=direction_3, degrees=code_block_108)
normal_9 = Plane.Normal(plane=rotate_5)
code_block_109 = CodeBlock { 50; }
translate_6 = Geometry.Translate(geometry=replaceEmptyLists_2@L2, direction=normal_9@L1, distance=code_block_109@L1, lacing=Longest)
function_apply_11 = ApplyFunction(func=getItemAtIndex, arg1=translate_6)
byElementAndLocation_6 = Tag.ByElementAndLocation(view=code_block_93@L1, element=replaceEmptyLists@L2, location=function_apply_11@L2, lacing=Longest)
flatten_6 = List.Flatten(list=byElementAndLocation_6)
function_apply_12 = ApplyFunction(func=setParameterByName_13, arg1=flatten_6)
function_apply_13 = ApplyFunction(func=setParameterByName_12, arg1=function_apply_12)
function_apply_14 = ApplyFunction(func=ʳʰʸᵗʰᵐ_tags, arg1=function_apply_13, arg2=replaceEmptyLists_2)

await_9 = Orchid.Common.DataStream.Await(pass=code_block.out1, waitFor=function_apply_14)

# group: Etiqueta Vigas Hormigon
code_block_110 = CodeBlock(x=await_9) { x; }
code_block_111 = CodeBlock(x=code_block_110) { x; }
code_block_112 = CodeBlock { "Structural Framing"; }
byName_13 = Category.ByName(name=code_block_112)
all_elements_of_category_in_view_7 = ElementsOfCategoryInView(Category=byName_13, View=code_block_111)
familyName_5 = Orchid.RevitProject.Elements.Element.FamilyName(element=all_elements_of_category_in_view_7)
code_block_113 = CodeBlock()
# ---------- code_block_113.designscript (6 lines) ----------
[
"EST_M_STRUCTURAL FRAMING_VIGA INVERTIDA",
"EST_M_STRUCTURAL FRAMING_VIGA SEMI INVERTIDA",
"EST_M_STRUCTURAL FRAMING_VIGA TRADICIONAL",
"EST_M_STRUCTURAL FRAMING_VIGA FUNDACION"
];
# ----------------------------------------
eq_12 = familyName_5@L1 == code_block_113
anyTrue_3 = Orchid.Common.List.AnyTrue(list=eq_12)
filterByBoolMask_14 = List.FilterByBoolMask(list=all_elements_of_category_in_view_7, mask=anyTrue_3)
location_7 = Custom[Element.Location+](element=filterByBoolMask_14.in)
code_block_114 = CodeBlock(x=location_7.curves)  # same code as code_block_11
direction_4 = Line.Direction(line=code_block_114.out1)
code_block_115 = CodeBlock(x=code_block_110) { x; }
plane_8 = Custom[View.Plane](view=code_block_115)
isParallelToPlane_3 = Custom[Vector.IsParallelToPlane](vector=direction_4, plane=plane_8)
filterByBoolMask_15 = List.FilterByBoolMask(list=filterByBoolMask_14.in, mask=isParallelToPlane_3)
element_taggedstatus_6 = Custom[Element TaggedStatus](element=filterByBoolMask_15.in)
elementcentroid_6 = Custom[© ElementCentroid](element=element_taggedstatus_6.NotTagged)
location_8 = Custom[Element.Location+](element=element_taggedstatus_6.NotTagged)
code_block_116 = CodeBlock(x=location_8.curves)  # same code as code_block_11
code_block_117 = CodeBlock { 0.5; }
planeAtParameter_5 = Curve.PlaneAtParameter(curve=code_block_116.out1, param=code_block_117)
code_block_118 = CodeBlock { 0.5; }
pointAtParameter_8 = Curve.PointAtParameter(curve=code_block_116.out1, param=code_block_118)
plane_9 = Custom[View.Plane](view=code_block_115)
normal_10 = Plane.Normal(plane=plane_9)
code_block_119 = CodeBlock { 90; }
rotate_6 = Geometry.Rotate(geometry=planeAtParameter_5, origin=pointAtParameter_8, axis=normal_10, degrees=code_block_119)
normal_11 = Plane.Normal(plane=rotate_6)
code_block_120 = CodeBlock(z=normal_11) { z.Z; }
code_block_121 = CodeBlock { 0; }
gt_5 = code_block_120 > code_block_121
code_block_122 = CodeBlock { -1; }
ne_5 = code_block_120 != code_block_122
and_6 = gt_5 && ne_5
reverse_5 = Vector.Reverse(vector=normal_11)
scopeIf_5 = Custom[ScopeIf+](test=and_6, True=normal_11, False=reverse_5, lacing=Shortest)
code_block_123 = CodeBlock(x=element_taggedstatus_6.NotTagged) { Revit.Elements.Element.GetParameterValueByName(Revit.Elements.Element.GetParameterValueByName(x,"Type"),"Height")/2; }
translate_7 = Geometry.Translate(geometry=elementcentroid_6, direction=scopeIf_5, distance=code_block_123)
list_create = List.Create(item0=elementcentroid_6, item1=translate_7)
transpose = List.Transpose(lists=list_create)
byElementAndLocation_7 = Tag.ByElementAndLocation(view=code_block_111@L1, element=element_taggedstatus_6.NotTagged@L1, location=transpose@L2, lacing=Longest)
transpose_2 = List.Transpose(lists=byElementAndLocation_7)
code_block_124 = CodeBlock { null; }
replaceEmptyLists_3 = Custom[List.ReplaceEmptyLists](seq=transpose_2, Replacement=code_block_124)
code_block_125 = CodeBlock(x=replaceEmptyLists_3)
# ---------- code_block_125.designscript (12 lines) ----------
x;
[Imperative]
{
	if(x == null)
	{
		return = [[],[]];
	}
	else
	{
		return = x;
	}
};
# ----------------------------------------
code_block_126 = CodeBlock(x=code_block_125.out1) { x[0]; }
code_block_127 = CodeBlock { "Type"; }
code_block_128 = CodeBlock { "EST_A_STRUCTURAL FRAMING TAG_ELEVACION_ESTRIBO Y LATERAL"; }
byName_14 = Orchid.RevitProject.Elements.Family.ByName(name=code_block_128)
code_block_129 = CodeBlock { "Estribo Simple y Laterales"; }
byFamilyAndName_7 = FamilyType.ByFamilyAndName(family=byName_14, name=code_block_129)
setParameterByName_14 = Element.SetParameterByName(element=code_block_126, parameterName=code_block_127, value=byFamilyAndName_7)
code_block_130 = CodeBlock(x=code_block_125.out1) { x[1]; }
code_block_131 = CodeBlock { "Type"; }
code_block_132 = CodeBlock { "EST_A_STRUCTURAL FRAMING TAG_ELEVACION"; }
byName_15 = Orchid.RevitProject.Elements.Family.ByName(name=code_block_132)
code_block_133 = CodeBlock { "Tag Viga"; }
byFamilyAndName_8 = FamilyType.ByFamilyAndName(family=byName_15, name=code_block_133)
setParameterByName_15 = Element.SetParameterByName(element=code_block_130, parameterName=code_block_131, value=byFamilyAndName_8)

flatten_7 = List.Flatten(list=setParameterByName_15)
await_10 = Orchid.Common.DataStream.Await(pass=code_block_115, waitFor=flatten_7)
openView = Orchid.RevitProject.Common.Document.OpenView(view=await_10)
