# Dynamo graph etiquetado_script.dyn (Dynamo 2.6.2.15705)
# packages: Orchid 200.4.0.7938, Clockwork for Dynamo 2.x 2.4.0, Genius Loci 2021.11.10, Crumple 2022.2.13

activeView = Orchid.RevitProject.Common.Document.ActiveView()

# group: Etiqueta Vigas Hormigon
code_block = CodeBlock(x=activeView) { x; }
code_block_2 = CodeBlock(x=code_block) { x; }
code_block_3 = CodeBlock { "Structural Framing"; }
byName = Category.ByName(name=code_block_3)
all_elements_of_category_in_view = ElementsOfCategoryInView(Category=byName, View=code_block_2)
familyName = Orchid.RevitProject.Elements.Element.FamilyName(element=all_elements_of_category_in_view)
code_block_4 = CodeBlock()
# ---------- code_block_4.designscript (6 lines) ----------
[
"EST_M_STRUCTURAL FRAMING_VIGA INVERTIDA",
"EST_M_STRUCTURAL FRAMING_VIGA SEMI INVERTIDA",
"EST_M_STRUCTURAL FRAMING_VIGA TRADICIONAL",
"EST_M_STRUCTURAL FRAMING_VIGA FUNDACION"
];
# ----------------------------------------
eq = familyName@L1 == code_block_4
anyTrue = Orchid.Common.List.AnyTrue(list=eq)
filterByBoolMask = List.FilterByBoolMask(list=all_elements_of_category_in_view, mask=anyTrue)
location = Custom[Element.Location+](element=filterByBoolMask.in)  # package Clockwork for Dynamo 2.x; Returns the location of an element as point, curve or curve loop, along with some booleans to help filtering the results. Unlike the OOTB Element.GetLocation node, it also retunrs sketch lines of sketch-based elements like floor slabs as well as the element's rotation property.
code_block_5 = CodeBlock(x=location.curves)
# ---------- code_block_5.designscript (12 lines) ----------
x;
[Imperative]
{
	if(x == null)
	{
		return = [];
	}
	else
	{
		return = x;
	}
};
# ----------------------------------------
direction = Line.Direction(line=code_block_5.out1)
code_block_6 = CodeBlock(x=code_block) { x; }
plane = Custom[View.Plane](view=code_block_6)  # package Clockwork for Dynamo 2.x; Retrieves the plane of a given view
isParallelToPlane = Custom[Vector.IsParallelToPlane](vector=direction, plane=plane)  # package Clockwork for Dynamo 2.x; Checks if a given vector is parallel to a given plane
filterByBoolMask_2 = List.FilterByBoolMask(list=filterByBoolMask.in, mask=isParallelToPlane)
element_taggedstatus = Custom[Element TaggedStatus](element=filterByBoolMask_2.in)  # package Genius Loci; Identify the tagged and untagged elements. Please note : This doesn't work with areas and spaces.
elementcentroid = Custom[© ElementCentroid](element=element_taggedstatus.NotTagged)  # package Crumple; Returns the centroid of the element's axis-aligned bounding box.
location_2 = Custom[Element.Location+](element=element_taggedstatus.NotTagged)
code_block_7 = CodeBlock(x=location_2.curves)  # same code as code_block_5
code_block_8 = CodeBlock { 0.5; }
planeAtParameter = Curve.PlaneAtParameter(curve=code_block_7.out1, param=code_block_8)
code_block_9 = CodeBlock { 0.5; }
pointAtParameter = Curve.PointAtParameter(curve=code_block_7.out1, param=code_block_9)
plane_2 = Custom[View.Plane](view=code_block_6)
normal = Plane.Normal(plane=plane_2)
code_block_10 = CodeBlock { 90; }
rotate = Geometry.Rotate(geometry=planeAtParameter, origin=pointAtParameter, axis=normal, degrees=code_block_10)
normal_2 = Plane.Normal(plane=rotate)
code_block_11 = CodeBlock(z=normal_2) { z.Z; }
code_block_12 = CodeBlock { 0; }
gt = code_block_11 > code_block_12
code_block_13 = CodeBlock { -1; }
ne = code_block_11 != code_block_13
and_ = gt && ne
reverse = Vector.Reverse(vector=normal_2)
scopeIf = Custom[ScopeIf+](test=and_, True=normal_2, False=reverse, lacing=Shortest)  # package Clockwork for Dynamo 2.x; A (hopefully) more robust implementation of ScopeIf. Tests a single boolean and returns a value accordingly.
code_block_14 = CodeBlock(x=element_taggedstatus.NotTagged) { Revit.Elements.Element.GetParameterValueByName(Revit.Elements.Element.GetParameterValueByName(x,"Type"),"Height")/2; }
translate = Geometry.Translate(geometry=elementcentroid, direction=scopeIf, distance=code_block_14)
list_create = List.Create(item0=elementcentroid, item1=translate)
transpose = List.Transpose(lists=list_create)
byElementAndLocation = Tag.ByElementAndLocation(view=code_block_2@L1, element=element_taggedstatus.NotTagged@L1, location=transpose@L2, lacing=Longest)
transpose_2 = List.Transpose(lists=byElementAndLocation)
code_block_15 = CodeBlock { null; }
replaceEmptyLists = Custom[List.ReplaceEmptyLists](seq=transpose_2, Replacement=code_block_15)  # package Clockwork for Dynamo 2.x; Replaces all empty lists within a given list with a substitute
code_block_16 = CodeBlock(x=replaceEmptyLists)
# ---------- code_block_16.designscript (12 lines) ----------
x;
[Imperative]
{
	if(x == null)
	{
		return = [[],[]];
	}
	else
	{
		return = x;
	}
};
# ----------------------------------------
code_block_17 = CodeBlock(x=code_block_16.out1) { x[0]; }
code_block_18 = CodeBlock { "Type"; }
code_block_19 = CodeBlock { "EST_A_STRUCTURAL FRAMING TAG_ELEVACION_ESTRIBO Y LATERAL"; }
byName_2 = Orchid.RevitProject.Elements.Family.ByName(name=code_block_19)
code_block_20 = CodeBlock { "Estribo Simple y Laterales"; }
byFamilyAndName = FamilyType.ByFamilyAndName(family=byName_2, name=code_block_20)
setParameterByName = Element.SetParameterByName(element=code_block_17, parameterName=code_block_18, value=byFamilyAndName)
code_block_21 = CodeBlock(x=code_block_16.out1) { x[1]; }
code_block_22 = CodeBlock { "Type"; }
code_block_23 = CodeBlock { "EST_A_STRUCTURAL FRAMING TAG_ELEVACION"; }
byName_3 = Orchid.RevitProject.Elements.Family.ByName(name=code_block_23)
code_block_24 = CodeBlock { "Tag Viga"; }
byFamilyAndName_2 = FamilyType.ByFamilyAndName(family=byName_3, name=code_block_24)
setParameterByName_2 = Element.SetParameterByName(element=code_block_21, parameterName=code_block_22, value=byFamilyAndName_2)

flatten = List.Flatten(list=setParameterByName_2)
await_ = Orchid.Common.DataStream.Await(pass=code_block_6, waitFor=flatten)
openView = Orchid.RevitProject.Common.Document.OpenView(view=await_)
