# Dynamo graph script.dyn (Dynamo 2.6.2.15705)
# packages: Structural Design 2021.1.22, Orchid 206.3.0.8161, Data-Shapes 2022.2.103

categories_ᶜᵒⁿᵛᵉʳᵗᵉᵈ_ᵈʳᵒᵖᵈᵒʷⁿ = CodeBlock { Revit.Elements.Category.ByName("Structural Rebar"); }
o_document_activeview = Orchid.RevitProject.Common.Document.ActiveView()
all_elements_of_category_in_view = ElementsOfCategoryInView(Category=categories_ᶜᵒⁿᵛᵉʳᵗᵉᵈ_ᵈʳᵒᵖᵈᵒʷⁿ, View=o_document_activeview)
code_block = CodeBlock { "Visualización Barras"; }
file_path = Filename("..\..\..\..\..\..\..\..\..\Arainco\Arainco.png")
code_block_2 = CodeBlock { "INICIAR"; "CANCELAR"; true; 430; 170; 650; }
code_block_3 = CodeBlock()
# ---------- code_block_3.designscript (13 lines) ----------
"Tipo de Visualización";

[
"Mostrar",
"Esconder"
];

[
true,
false
];

0;
# ----------------------------------------
radiobuttons_data = Custom[RadioButtons Data](InputName=code_block_3.out0, Keys=code_block_3.out1, Values=code_block_3.out2, DefaultValueIndex=code_block_3.out3)  # package Data-Shapes; Create radio buttons input for UI.MultipleInputForm ++ .
multipleinputform = Custom[MultipleInputForm ++](Description_optional=code_block, Logo_optional=file_path, ButtonText_optional=code_block_2.out0, Inputs=radiobuttons_data, Toggle=code_block_2.out2, CancelButtonText_optional=code_block_2.out1, Width_optional=code_block_2.out3)  # package Data-Shapes; Create a form with multiple inputs. see www.data-shapes.net for tutorials and infos!
code_block_4 = CodeBlock(l=multipleinputform.User_Inputs)
# ---------- code_block_4.designscript (12 lines) ----------
l;
[Imperative]
{
	if (l == null)
	{
		return = [];
	}
	else
	{
		return = l[0];
	}
};
# ----------------------------------------
setSolidInView = StructuralDesign.Rebar.Create.SetSolidInView(rebar=all_elements_of_category_in_view, view=o_document_activeview, solid=code_block_4.out1)
setUnobscuredInView = StructuralDesign.Rebar.Create.SetUnobscuredInView(rebar=setSolidInView, view=o_document_activeview, unobscured=code_block_4.out1)
