# Dynamo graph 3DRebarSolid.dyn (Dynamo 2.6.2.15705)

python_script = Python()  # unwired: IN[0]
# ---------- python_script.python (47 lines) ----------
import clr
clr.AddReference('ProtoGeometry')
clr.AddReference('DSCoreNodes')
clr.AddReference('RevitNodes')
clr.AddReference('DynamoRevitDS')
clr.AddReference('RevitAPI')
clr.AddReference('RevitAPIUI')
clr.AddReference('RevitServices')

from Autodesk.DesignScript.Geometry import *
import DSCore
import Revit
import Dynamo
from Autodesk.Revit.DB import *
from Autodesk.Revit.DB.Architecture import *
from Autodesk.Revit.ApplicationServices import *
from Autodesk.Revit.DB.Structure import *
from Autodesk.Revit.UI import *
from Autodesk.Revit.UI.Selection import *
from RevitServices.Persistence import DocumentManager
from RevitServices.Transactions import TransactionManager

doc = DocumentManager.Instance.CurrentDBDocument
uiapp = DocumentManager.Instance.CurrentUIApplication
app = uiapp.Application
uidoc = uiapp.ActiveUIDocument

import datetime
from datetime import datetime

rebars = [rebar for rebar in FilteredElementCollector(doc).OfCategory(BuiltInCategory.OST_Rebar).WhereElementIsNotElementType()]

view = doc.ActiveView
transaction = Transaction(doc, "Set Rebar Solid and Unobscured In View")
transaction.Start()

try:
    for rebar in rebars:
        rebar.SetSolidInView(view, True)
        rebar.SetUnobscuredInView(view, True)

    transaction.Commit()
except:
    transaction.RollBack()
    raise

OUT = rebars
# ----------------------------------------
