# Dynamo graph script.dyn (Dynamo 2.6.2.15705)
# packages: Orchid 206.3.0.8161, Structural Design 2021.1.22, Genius Loci 2021.11.10, Rhythm 2021.7.2, Clockwork for Dynamo 2.x 2.4.0, Data-Shapes 2022.2.103

o_document_activeview = Orchid.RevitProject.Common.Document.ActiveView()
code_block = CodeBlock { "Structural Rebar"; }
byName = Category.ByName(name=code_block)
o_document_activeview_2 = Orchid.RevitProject.Common.Document.ActiveView()
all_elements_of_category_in_view = ElementsOfCategoryInView(Category=byName, View=o_document_activeview_2)
code_block_2 = CodeBlock { "Shape"; }
getParameterValueByName = Element.GetParameterValueByName(element=all_elements_of_category_in_view, parameterName=code_block_2)
name = Element.Name(element=getParameterValueByName)
code_block_3 = CodeBlock()
# ---------- code_block_3.designscript (4 lines) ----------
[
"R_S_00",
"R_S_01"
];
# ----------------------------------------
eq = name@L1 == code_block_3@L2  # lacing=Longest
o_list_anytrue = Orchid.Common.List.AnyTrue(list=eq@L2)
filterByBoolMask = List.FilterByBoolMask(list=all_elements_of_category_in_view, mask=o_list_anytrue)
rebarCenterlineCurves = StructuralDesign.Rebar.Properties.RebarCenterlineCurves(rebar=filterByBoolMask.in)
flatten = List.Flatten(list=rebarCenterlineCurves)
intersect = Geometry.Intersect(geometry=flatten@L1, other=flatten@L2, lacing=Longest)
flatten_2 = List.Flatten(list=intersect)
length = Curve.Length(curve=flatten_2)
code_block_4 = CodeBlock { [570, 710, 860, 1140, 1290, 1960, 2230, 2500, 2850, 3210]; }
eq_2 = length@L1 == code_block_4@L2  # lacing=Longest
o_list_anytrue_2 = Orchid.Common.List.AnyTrue(list=eq_2@L2)
filterByBoolMask_2 = List.FilterByBoolMask(list=flatten_2, mask=o_list_anytrue_2)
pruneDuplicates = Custom[Geometry.PruneDuplicates](GeometryList=filterByBoolMask_2.in)  # package Data-Shapes; Removes all duplicate geometries from list.
o_document_activeview_3 = Orchid.RevitProject.Common.Document.ActiveView()
plane = Custom[View.Plane](view=o_document_activeview_3)  # package Clockwork for Dynamo 2.x; Retrieves the plane of a given view
pullOntoPlane = Curve.PullOntoPlane(curve=pruneDuplicates, plane=plane)
family_types_ᶜᵒⁿᵛᵉʳᵗᵉᵈ_ᵈʳᵒᵖᵈᵒʷⁿ = CodeBlock { Revit.Elements.FamilyType.ByName("EST_D_DEATIL ITEM_EMPALME"); }
o_document_activeview_4 = Orchid.RevitProject.Common.Document.ActiveView()
byCurve = Custom[DetailComponent.ByCurve](curve=pullOntoPlane, familyType=family_types_ᶜᵒⁿᵛᵉʳᵗᵉᵈ_ᵈʳᵒᵖᵈᵒʷⁿ, view=o_document_activeview_4)  # package Clockwork for Dynamo 2.x; Places a line-based detail component in a given view
end = Revit.Transaction.Transaction.End(input=byCurve)
familyinstance_2d_geometry = Custom[FamilyInstance 2D Geometry](element=end)  # package Genius Loci; Gets the curves of the family instance. Works only with the family categories : Generic Annotation and Detail Item.
code_block_5 = CodeBlock { [1, 3]; }
getItemAtIndex = List.GetItemAtIndex(list=familyinstance_2d_geometry@L2, index=code_block_5)
code_block_6 = CodeBlock { 0.5; }
pointAtParameter = Curve.PointAtParameter(curve=getItemAtIndex, param=code_block_6)
byBestFitThroughPoints = Line.ByBestFitThroughPoints(bestFitPoints=pointAtParameter@L2)
byJoinedCurves = PolyCurve.ByJoinedCurves(curves=familyinstance_2d_geometry)
byPatch = Surface.ByPatch(closedCurve=byJoinedCurves)
code_block_7 = CodeBlock { 0.5; }
normalAtParameter = Surface.NormalAtParameter(surface=byPatch, u=code_block_7, v=code_block_7)
byLine = StructuralDesign.Model.Geom.Vector.ByLine(line=byBestFitThroughPoints)
code_block_8 = CodeBlock { 90; }
rotate = Vector.Rotate(vector=normalAtParameter, axis=byLine, degrees=code_block_8)
code_block_9 = CodeBlock { 300; }
translate = Geometry.Translate(geometry=byBestFitThroughPoints, direction=rotate, distance=code_block_9)
code_block_10 = CodeBlock { "Right"; }
familyinstance_reference_byname = Custom[FamilyInstance Reference ByName](familyInstance=end, name=code_block_10)  # package Genius Loci; Works only in Revit 2018.1 and later. Gets the reference corresponding to the named reference plane in the instance's family.
code_block_11 = CodeBlock { "Left"; }
familyinstance_reference_byname_2 = Custom[FamilyInstance Reference ByName](familyInstance=end, name=code_block_11)
list_create = List.Create(item0=familyinstance_reference_byname.Reference, item1=familyinstance_reference_byname_2.Reference)
transpose = List.Transpose(lists=list_create)
element_types_ᶜᵒⁿᵛᵉʳᵗᵉᵈ_ᵈʳᵒᵖᵈᵒʷⁿ = CodeBlock { DSCore.Types.FindTypeByNameInAssembly("DimensionType", "RevitAPI"); }
all_elements_of_type = ElementsOfType(element_type=element_types_ᶜᵒⁿᵛᵉʳᵗᵉᵈ_ᵈʳᵒᵖᵈᵒʷⁿ)
name_2 = Element.Name(element=all_elements_of_type)
code_block_12 = CodeBlock { "Linear - 2.5mm Arial"; }
eq_3 = name_2 == code_block_12
filterByBoolMask_3 = List.FilterByBoolMask(list=all_elements_of_type, mask=eq_3)
dimension_byreferences = Custom[Dimension ByReferences](view=o_document_activeview@L1, line=translate@L1, references=transpose@L2, dimensionType=filterByBoolMask_3.in@L1, lacing=Longest)  # package Genius Loci; Creates a new linear dimension from at least two geometric references of an object.
end_2 = Revit.Transaction.Transaction.End(input=dimension_byreferences)
code_block_13 = CodeBlock()
# ---------- code_block_13.designscript (6 lines) ----------
[
"Structural Columns",
"Structural Foundations",
"Structural Framing",
"Walls"
];
# ----------------------------------------
byName_2 = Category.ByName(name=code_block_13)
o_document_activeview_5 = Orchid.RevitProject.Common.Document.ActiveView()
all_elements_of_category_in_view_2 = ElementsOfCategoryInView(Category=byName_2, View=o_document_activeview_5)
flatten_3 = List.Flatten(list=all_elements_of_category_in_view_2)
geometry = Element.Geometry(element=flatten_3)
flatten_4 = List.Flatten(list=geometry)
byUnion = Solid.ByUnion(solids=flatten_4)
ʳʰʸᵗʰᵐ_dimensions_getcurve = Rhythm.Revit.Elements.Dimensions.GetCurve(dimension=end_2)
flatten_5 = List.Flatten(list=ʳʰʸᵗʰᵐ_dimensions_getcurve)
code_block_14 = CodeBlock { 0.5; }
pointAtParameter_2 = Curve.PointAtParameter(curve=flatten_5, param=code_block_14)
code_block_15 = CodeBlock { 50; 500; 50; }
byLengths = Cuboid.ByLengths(origin=pointAtParameter_2, width=code_block_15.out0, length=code_block_15.out1, height=code_block_15.out2)
doesIntersect = Geometry.DoesIntersect(geometry=byUnion@L1, other=byLengths@L2, lacing=Longest)
flatten_6 = List.Flatten(list=doesIntersect)
filterByBoolMask_4 = List.FilterByBoolMask(list=end_2, mask=flatten_6)
ʳʰʸᵗʰᵐ_dimensions = Rhythm.Revit.Elements.Dimensions.GetReferenceElements(dimension=filterByBoolMask_4.in)
flatten_7 = List.Flatten(list=ʳʰʸᵗʰᵐ_dimensions)
uniqueItems = List.UniqueItems(list=flatten_7)
familyinstance_2d_geometry_2 = Custom[FamilyInstance 2D Geometry](element=uniqueItems)
code_block_16 = CodeBlock { [1, 3]; }
getItemAtIndex_2 = List.GetItemAtIndex(list=familyinstance_2d_geometry_2@L2, index=code_block_16)
code_block_17 = CodeBlock { 0.5; }
pointAtParameter_3 = Curve.PointAtParameter(curve=getItemAtIndex_2, param=code_block_17)
byBestFitThroughPoints_2 = Line.ByBestFitThroughPoints(bestFitPoints=pointAtParameter_3@L2)
code_block_18 = CodeBlock { 0.5; }
pointAtParameter_4 = Curve.PointAtParameter(curve=byBestFitThroughPoints_2, param=code_block_18)
byJoinedCurves_2 = PolyCurve.ByJoinedCurves(curves=familyinstance_2d_geometry_2)
byPatch_2 = Surface.ByPatch(closedCurve=byJoinedCurves_2)
code_block_19 = CodeBlock { 0.5; }
normalAtParameter_2 = Surface.NormalAtParameter(surface=byPatch_2, u=code_block_19, v=code_block_19)
byLine_2 = StructuralDesign.Model.Geom.Vector.ByLine(line=byBestFitThroughPoints_2)
code_block_20 = CodeBlock { 90; }
rotate_2 = Vector.Rotate(vector=normalAtParameter_2, axis=byLine_2, degrees=code_block_20)
byOriginNormal = Plane.ByOriginNormal(origin=pointAtParameter_4, normal=rotate_2)
mirror = Custom[Element.Mirror](element=filterByBoolMask_4.in@L1, plane=byOriginNormal@L1)  # package Clockwork for Dynamo 2.x; Mirrors an element about a given plane.
