# Dynamo graph armadura_sup_muro_script.dyn (Dynamo 2.6.2.15705)
# packages: Data-Shapes 2022.2.103, Clockwork for Dynamo 2.x 2.4.0, Orchid 206.3.0.8161, Structural Design 2021.1.22, Genius Loci 2021.11.10

o_document_activeview = Orchid.RevitProject.Common.Document.ActiveView()
code_block = CodeBlock { "Corchete Segmento Unico"; }
file_path = Filename("..\..\..\..\..\..\..\..\..\..\Arainco\Arainco.png")
code_block_2 = CodeBlock { "INICIAR"; "CANCELAR"; true; 430; 170; 650; }
categories_ᶜᵒⁿᵛᵉʳᵗᵉᵈ_ᵈʳᵒᵖᵈᵒʷⁿ = CodeBlock { "Seleccionar Muro a Armar"; "SELECCIONAR"; Revit.Category.ByName(["Walls","Structural Foundations"]); }
selectmodelelements_data = Custom[SelectModelElements Data](InputName=categories_ᶜᵒⁿᵛᵉʳᵗᵉᵈ_ᵈʳᵒᵖᵈᵒʷⁿ.out0, ButtonText=categories_ᶜᵒⁿᵛᵉʳᵗᵉᵈ_ᵈʳᵒᵖᵈᵒʷⁿ.out1, CategoryFilter=categories_ᶜᵒⁿᵛᵉʳᵗᵉᵈ_ᵈʳᵒᵖᵈᵒʷⁿ.out2)  # package Data-Shapes; Creates a Revit element selection input for UI.MultipleInputForm++ . Check out www.data-shapes.net for more infos!
code_block_3 = CodeBlock { "Cara de Distribucion"; "SELECCIONAR"; }
selectfaces_data = Custom[SelectFaces Data](InputName=code_block_3.out0, ButtonText=code_block_3.out1)  # package Data-Shapes; Creates a Revit face selection input for UI.MultipleInputForm++. Check out www.data-shapes.net for more infos!
code_block_4 = CodeBlock { "Datos de Armadura"; }
code_block_5 = CodeBlock { "Diametro"; }
element_types_ᶜᵒⁿᵛᵉʳᵗᵉᵈ_ᵈʳᵒᵖᵈᵒʷⁿ = CodeBlock { DSCore.Types.FindTypeByNameInAssembly("RebarBarType", "RevitAPI"); }
all_elements_of_type = ElementsOfType(element_type=element_types_ᶜᵒⁿᵛᵉʳᵗᵉᵈ_ᵈʳᵒᵖᵈᵒʷⁿ)
code_block_6 = CodeBlock(t5=all_elements_of_type)
# ---------- code_block_6.designscript (8 lines) ----------
t4 = t5;
t1 = t4;
num1 = Properties.RebarDiameter(t1);
t2 = DSCore.List.SortByKey(t1, num1);
t3 = Dictionary.ValueAtKey(t2, "sorted list");
str1 = Revit.Elements.Element.Name(t3);
0;
false;
# ----------------------------------------
dropdown_data = Custom[DropDown Data](InputName=code_block_5, Keys=code_block_6.str1, Values=code_block_6.t3, DefaultValueIndex=code_block_6.out6, Sorted_optional=code_block_6.out7)  # package Data-Shapes; Create data for DropDown input in UI.MultiInputForm ++ . Check out www.data-shapes.net for more infos.
code_block_7 = CodeBlock { "Cantidad de Barras"; "2"; true; }
textbox_data = Custom[TextBox Data](InputName=code_block_7.out0, DefaultText=code_block_7.out1, IsNumberEntry=code_block_7.out2)  # package Data-Shapes; Create Data for TextBox input in UI.MultipleInputForm ++ . Check out www.data-shapes.net for more informations
code_block_8 = CodeBlock { "Capa"; ["1ª Capa", "2ª Capa", "3ª Capa", "4ª Capa", "5ª Capa"]; [40, 90, 140, 190, 240]; 0; }
dropdown_data_2 = Custom[DropDown Data](InputName=code_block_8.out0, Keys=code_block_8.out1, Values=code_block_8.out2, DefaultValueIndex=code_block_8.out3)
list_create = List.Create(item0=dropdown_data, item1=textbox_data, item2=dropdown_data_2)
inputgroup_data = Custom[InputGroup Data](GroupTitle=code_block_4, Inputs=list_create)  # package Data-Shapes; Creates a group of inputs for UI.MultipleInputForm ++ . Check out www.data-shapes.net for more infos !
list_create_2 = List.Create(item0=selectmodelelements_data, item1=selectfaces_data, item2=inputgroup_data)
multipleinputform = Custom[MultipleInputForm ++](Description_optional=code_block, Logo_optional=file_path, ButtonText_optional=code_block_2.out0, Inputs=list_create_2, Toggle=code_block_2.out2, CancelButtonText_optional=code_block_2.out1, MaxHeight_optional=code_block_2.out5, Width_optional=code_block_2.out3, LabelWidth_optional=code_block_2.out4)  # package Data-Shapes; Create a form with multiple inputs. see www.data-shapes.net for tutorials and infos!
code_block_9 = CodeBlock(l=multipleinputform.User_Inputs)
# ---------- code_block_9.designscript (12 lines) ----------
l;
[Imperative]
{
	if (l == null)
	{
		return = [[],[],[],[],[],[]];
	}
	else
	{
		return = l;
	}
};
# ----------------------------------------
o_document_activeview_2 = Orchid.RevitProject.Common.Document.ActiveView()
plane = Custom[View.Plane](view=o_document_activeview_2)  # package Clockwork for Dynamo 2.x; Retrieves the plane of a given view
code_block_10 = CodeBlock(x=code_block_9.out1, view_plane=plane)
# ---------- code_block_10.designscript (49 lines) ----------
muros = x[0];
distribucion = x[1];
tipo_barra = x[2];
cant_barras = x[3];
capa = x[4];
view_plane;
view_plane_normal = Autodesk.Plane.Normal(view_plane);

//Superficie de Corte
sup_normal = Autodesk.Surface.NormalAtParameter(distribucion, 0.5, 0.5)[0];
sup_trasldada = Autodesk.Geometry.Translate(distribucion, sup_normal, (capa * -1))[0];
sup_center_point = Autodesk.Surface.PointAtParameter(distribucion, 0.5, 0.5)[0];
sup_plane = Autodesk.Plane.ByOriginNormal(sup_center_point, view_plane_normal);
sup_corte = Autodesk.Geometry.Scale(sup_trasldada, sup_plane, 1, 100, 1);

//Geometria a Cortar
elem_unidos = DSCore.List.Flatten(Rhythm.Elements.JoinedElements(muros), -1);
elem_category = Revit.Elements.Element.GetCategory(elem_unidos);
elem_category_name = Revit.Category.Name(elem_category);
mask_1 = elem_category_name == "Walls";
elem_filtrados = DSCore.List.FilterByBoolMask(elem_unidos, mask_1)["in"];
elem_a_unir = DSCore.List.Flatten(DSCore.List.AddItemToFront(muros@L1<1L>, elem_filtrados@L2<1L>), -1);
geom_inicial = Autodesk.Solid.ByUnion(DSCore.List.Flatten(Revit.Elements.Element.Geometry(elem_a_unir), -1));
geom_centroid = Autodesk.Solid.Centroid(geom_inicial);
geom_plane = Autodesk.Plane.ByOriginNormal(geom_centroid, view_plane_normal);
geom_coo_sys = CoordinateSystem.ByPlane(geom_plane);
geom_a_cortar = Autodesk.Geometry.Scale(geom_inicial, geom_plane, 100, 1, 1);

//Traslacion curva
category = Revit.Elements.Element.GetCategory(muros);
category_name = Revit.Category.Name(category);
mask = category_name == "Walls";
element = DSCore.List.FilterByBoolMask(muros, mask)["in"];
element_type = Revit.Elements.Element.GetParameterValueByName(element, "Type");
element_width = Revit.Elements.Element.GetParameterValueByName(element_type, "Width");
dist_traslacion_curva = (element_width[0] / 2) - 40;

//Curva para Armadura
geom_intersect = Autodesk.Geometry.Intersect(sup_corte, geom_a_cortar)[0];
sup_center_point_2 = Autodesk.Surface.PointAtParameter(geom_intersect, 0.5, 0.5);
sup_plane_2 = Autodesk.Plane.ByOriginNormal(sup_center_point_2, view_plane_normal);
plane_normal_2 = Autodesk.Plane.Normal(sup_plane_2);
plane_normal_reversed = Autodesk.Vector.Reverse(plane_normal_2);
geom_intersect_2 = Autodesk.Geometry.Intersect(geom_intersect, sup_plane_2)[0];
curve_1 = Autodesk.Curve.ExtendStart(Autodesk.Curve.ExtendEnd(geom_intersect_2, -20), -20);
rebar_curve = Autodesk.Geometry.Translate(curve_1, plane_normal_reversed, dist_traslacion_curva);

//ArrayLength
array_length = element_width - 80;
# ----------------------------------------
element_types_ᶜᵒⁿᵛᵉʳᵗᵉᵈ_ᵈʳᵒᵖᵈᵒʷⁿ_2 = CodeBlock { DSCore.Types.FindTypeByNameInAssembly("RebarHookType", "RevitAPI"); }
all_elements_of_type_2 = ElementsOfType(element_type=element_types_ᶜᵒⁿᵛᵉʳᵗᵉᵈ_ᵈʳᵒᵖᵈᵒʷⁿ_2)
rebar_hook_type_at_start = CodeBlock(t3=all_elements_of_type_2)
# ---------- rebar_hook_type_at_start.designscript (5 lines) ----------
t1 = t3;
str2 = Revit.Elements.Element.Name(t1);
t2 = str2 == "Standard - 90 deg.";
t4 = DSCore.List.FilterByBoolMask(t3, t2);
t5 = Dictionary.ValueAtKey(t4, "in");
# ----------------------------------------
code_block_11 = CodeBlock(curves=code_block_10.rebar_curve, rebarBarType=code_block_10.tipo_barra, startHookType=rebar_hook_type_at_start.t5, endHookType=rebar_hook_type_at_start.t5, hostElement=code_block_10.elem_filtrados, vector=code_block_10.plane_normal_2)
# ---------- code_block_11.designscript (18 lines) ----------
//curves
curves;
//rebarStyle
"Standard";
//rebarBarType
rebarBarType;
//startHookType
startHookType;
//endHookType
endHookType;
//startHookOrientation
"Left";
//endtHookOrientation
"Left";
//hostElement
hostElement[0];
//vector
vector;
# ----------------------------------------
fromCurves = StructuralDesign.Rebar.Create.FromCurves(curves=code_block_11.curves@L1, rebarStyle=code_block_11.out1@L1, rebarBarType=code_block_11.rebarBarType@L1, startHookType=code_block_11.startHookType@L1, endHookType=code_block_11.endHookType@L1, startHookOrientation=code_block_11.out5@L1, endHookOrientation=code_block_11.out6@L1, hostElement=code_block_11.out7@L1, vector=code_block_11.vector@L1, lacing=Longest)
setLayoutAsFixedNumber = StructuralDesign.Rebar.Layout.SetLayoutAsFixedNumber(rebar=fromCurves, arrayLength=code_block_10.array_length, numberOfBarPositions=code_block_10.cant_barras)
code_block_12 = CodeBlock { "Capa"; }
string_from_object = FromObject(obj=code_block_10.capa)
numero_de_capa = CodeBlock(capa=string_from_object)
# ---------- numero_de_capa.designscript (4 lines) ----------
key = ["40", "90", "140", "190", "240"];
val = ["1", "2", "3", "4", "5"];
dict_capa = Dictionary.ByKeysValues(key, val);
t3 = Dictionary.ValueAtKey(dict_capa, capa);
# ----------------------------------------
setParameterByName = Element.SetParameterByName(element=setLayoutAsFixedNumber, parameterName=code_block_12, value=numero_de_capa.t3)
element_types_ᶜᵒⁿᵛᵉʳᵗᵉᵈ_ᵈʳᵒᵖᵈᵒʷⁿ_3 = CodeBlock { DSCore.Types.FindTypeByNameInAssembly("RebarShape", "RevitAPI"); }
all_elements_of_type_3 = ElementsOfType(element_type=element_types_ᶜᵒⁿᵛᵉʳᵗᵉᵈ_ᵈʳᵒᵖᵈᵒʷⁿ_3)
code_block_13 = CodeBlock(t1=all_elements_of_type_3)
# ---------- code_block_13.designscript (5 lines) ----------
"Shape";
str2 = Revit.Elements.Element.Name(t1);
t2 = str2 == "R_S_02";
t3 = DSCore.List.FilterByBoolMask(t1, t2);
t4 = Dictionary.ValueAtKey(t3, "in");
# ----------------------------------------
setParameterByName_2 = Element.SetParameterByName(element=setParameterByName, parameterName=code_block_13.out0, value=code_block_13.t4, lacing=Longest)
rebarCenterlineCurves = StructuralDesign.Rebar.Properties.RebarCenterlineCurves(rebar=setParameterByName_2)
o_document_activeview_3 = Orchid.RevitProject.Common.Document.ActiveView()
plane_2 = Custom[View.Plane](view=o_document_activeview_3)
numero_de_capa_2 = CodeBlock(capa=string_from_object)
# ---------- numero_de_capa_2.designscript (4 lines) ----------
key = ["40", "90", "140", "190", "240"];
val = [250, 700, 1310, 1840, 2370];
dict_capa = Dictionary.ByKeysValues(key, val);
t3 = Dictionary.ValueAtKey(dict_capa, capa);
# ----------------------------------------
code_block_14 = CodeBlock(x=rebarCenterlineCurves, view_plane=plane_2, sup_normal=code_block_10.sup_normal, dst=numero_de_capa_2.t3)
# ---------- code_block_14.designscript (11 lines) ----------
rebar_curve = x[0];
view_plane;
sup_normal;
view_plane_normal = Autodesk.Plane.Normal(view_plane);
curve_point = Autodesk.Curve.PointAtParameter(rebar_curve, 0.5);
plane_1 = Autodesk.Plane.ByOriginNormal(curve_point, view_plane_normal);
CoordinateSystem.ByPlane(plane_1);
v_xaxis = Autodesk.Plane.XAxis(plane_1);
v_yaxis = Autodesk.Plane.YAxis(plane_1);
location_x = Autodesk.Geometry.Translate(curve_point, sup_normal, dst);
tag_location = Autodesk.Geometry.Translate(location_x, v_yaxis, 300);
# ----------------------------------------
code_block_15 = CodeBlock()
# ---------- code_block_15.designscript (4 lines) ----------
family1 = Revit.Family.ByName("EST_A_STRUCTURAL REBAR TAG_STANDAR");
familytype1 = Revit.Elements.FamilyType.ByFamilyAndName(family1, "R_S_02");
false;
true;
# ----------------------------------------
create_tag = Custom[Create Tag](view=o_document_activeview@L1, element=setParameterByName_2@L1, TagLocation=code_block_14.tag_location@L1, TagType=code_block_15.familytype1@L1, addLeader=code_block_15.out2@L1, RunIt=code_block_15.out3@L1, lacing=Longest)  # package Genius Loci; Works only in Revit 2018 and later. Creates a tag at a given location, of given type and in a supplied view. The node also works with Linked Elements (except space and area), Multi Category tag and Material Tag. Based on an archilab node
flatten = List.Flatten(list=create_tag)
code_block_16 = CodeBlock { "Leader Line"; 1; }
setParameterByName_3 = Element.SetParameterByName(element=flatten, parameterName=code_block_16.out0, value=code_block_16.out1)
code_block_17 = CodeBlock { "Leader Type"; 1; }
setParameterByName_4 = Element.SetParameterByName(element=setParameterByName_3, parameterName=code_block_17.out0, value=code_block_17.out1)
