# Dynamo graph VerificacionTrianguloRevisionVsCuadroRevision.dyn (Dynamo 2.3.2.15696)
# packages: archi-lab.net 2022.210.2419

categories = Categories("OST_Sheets")
all_elements_of_category = ElementsOfCategory(Category=categories)
code_block = CodeBlock { "Subclasificacion"; }
getParameterValueByName = Element.GetParameterValueByName(element=all_elements_of_category, parameterName=code_block)
code_block_2 = CodeBlock { "MODULO"; }
contains = String.Contains(str=getParameterValueByName, searchFor=code_block_2)
filterByBoolMask = List.FilterByBoolMask(list=all_elements_of_category, mask=contains)
code_block_3 = CodeBlock(x=filterByBoolMask.in) { x; }
revisions = archilab.Revit.Views.Sheets.Revisions(sheet=code_block_3)
name = Element.Name(element=revisions@L1)
code_block_4 = CodeBlock { " "; }
split = String.Split(str=name, separator0=code_block_4)
lastItem = List.LastItem(list=split@L2)
parameters = Element.Parameters(element=code_block_3)
group = Parameter.Group(parameter=parameters)
code_block_5 = CodeBlock { "PG_DATA"; }
eq = group == code_block_5
filterByBoolMask_2 = List.FilterByBoolMask(list=parameters, mask=eq)
code_block_6 = CodeBlock(x=filterByBoolMask_2.in) { x; }
hasValue = Parameter.HasValue(parameter=code_block_6)
filterByBoolMask_3 = List.FilterByBoolMask(list=code_block_6, mask=hasValue)
code_block_7 = CodeBlock(x=filterByBoolMask_3.in) { x; }
string_from_object = FromObject(obj=code_block_7)
code_block_8 = CodeBlock { "NUM"; }
contains_2 = String.Contains(str=string_from_object, searchFor=code_block_8)
filterByBoolMask_4 = List.FilterByBoolMask(list=code_block_7, mask=contains_2)
code_block_9 = CodeBlock(cx=filterByBoolMask_4.in) { cx; }
lastItem_2 = List.LastItem(list=code_block_9@L2)
name_2 = Parameter.Name(parameter=lastItem_2)
getParameterValueByName_2 = Element.GetParameterValueByName(element=code_block_3, parameterName=name_2)
eq_2 = lastItem == getParameterValueByName_2
