# Dynamo graph acotadoEstribos.dyn (Dynamo 2.6.2.15705)
# packages: Genius Loci 2021.11.10, Orchid 206.3.0.8161

o_document_activeview = Orchid.RevitProject.Common.Document.ActiveView()
select_model_element = DSModelElementSelection()  # 1 picked in the model
geometry = Element.Geometry(element=select_model_element)
select_model_element_2 = DSModelElementSelection()  # 1 picked in the model
element_reference = Custom[Element Reference](element=select_model_element_2)  # package Genius Loci; Gets the reference of a geometric object or a dimension or a reference plane.
select_model_element_3 = DSModelElementSelection()  # 1 picked in the model
element_reference_2 = Custom[Element Reference](element=select_model_element_3)
list_create = List.Create(item0=element_reference, item1=element_reference_2)
o_dimensiontype_all = Orchid.RevitProject.Annotations.DimensionType.All()
code_block = CodeBlock(x=o_dimensiontype_all) { x[0]; }
dimension_byreferences = Custom[Dimension ByReferences](view=o_document_activeview, line=geometry, references=list_create, dimensionType=code_block)  # package Genius Loci; Creates a new linear dimension from at least two geometric references of an object.
element_points_references = Custom[Element Points References](linearElement=select_model_element_2)  # package Genius Loci; Returns the references to the start and the end points of the curve based element. (Works best with coarse detail level for cable trays and conduits categories)
code_block_2 = CodeBlock(x=element_points_references.References) { x[0]; }
name = Element.Name(element=code_block)
