# Dynamo graph h_corchete_seg unico.dyn (Dynamo 2.6.2.15705)
# packages: Data-Shapes 2022.2.103, Structural Design 2021.1.22, Genius Loci 2021.11.10, Orchid 206.3.0.8161, archi-lab.net 2022.210.2419, Clockwork for Dynamo 2.x 2.4.0

o_document_activeview = Orchid.RevitProject.Common.Document.ActiveView()
code_block = CodeBlock { x; }  # unwired: x
code_block_2 = CodeBlock(muros=code_block) { muros[0]; }
control_de_flujo = Python(IN[0]=code_block_2)
# ---------- control_de_flujo.python (9 lines) ----------
var = IN[0]
lst = []

if var == lst:
	x = [] 
else:
	x = var[0]

OUT = x
# ----------------------------------------
geometry = Element.Geometry(element=control_de_flujo)
control_de_flujo_2 = Python(IN[0]=geometry)  # same code as control_de_flujo
code_block_3 = CodeBlock(capa=code_block) { capa[4]; }
code_block_4 = CodeBlock(geometry=control_de_flujo_2, capa=code_block_3)
# ---------- code_block_4.designscript (19 lines) ----------
f = Topology.Faces(geometry);
s = Face.SurfaceGeometry(f);
normales_s = Autodesk.Surface.NormalAtParameter(s, 0.5, 0.5);
mask = Autodesk.Vector.IsAlmostEqualTo(normales_s, Autodesk.Vector.ZAxis());
top_surface = DSCore.List.FilterByBoolMask(s, mask)["in"];
top_normal_reverse = Autodesk.Vector.Reverse(DSCore.List.FilterByBoolMask(normales_s, mask)["in"]);
translate_surface = Autodesk.Geometry.Translate(top_surface, top_normal_reverse, capa);
p1 = Autodesk.Surface.PointAtParameter(translate_surface, 0.5, 0.5);
v1 = Autodesk.Surface.NormalAtPoint(translate_surface, p1);
plane_surface = Autodesk.Plane.ByOriginNormal(p1, v1);
scaled_surface = Autodesk.Geometry.Scale(translate_surface, plane_surface, 2, 1, 1);
intersected_geom = Autodesk.Geometry.Intersect(geometry, scaled_surface);
p2 = Autodesk.Surface.PointAtParameter(translate_surface, 0.5, 0.5);
v2 = Autodesk.Surface.NormalAtPoint(translate_surface, p1);
intersected_geom_plane_surface = Autodesk.Plane.ByOriginNormal(p2, v2);
cs_plane = CoordinateSystem.ByPlane(plane_surface);
rotation_plane = CoordinateSystem.YZPlane(cs_plane);
rotated_surface = Autodesk.Geometry.Rotate(translate_surface, rotation_plane, 90);
curve = Autodesk.Curve.ExtendStart(Autodesk.Curve.Reverse(DSCore.List.Flatten(Autodesk.Geometry.Intersect(intersected_geom, rotated_surface), 2)), -20);
# ----------------------------------------
control_de_flujo_3 = Python(IN[0]=code_block_4.curve)  # same code as control_de_flujo
code_block_5 = CodeBlock(empotramiento=code_block) { empotramiento[1]; }
control_de_flujo_4 = Python(IN[0]=code_block_5)  # same code as control_de_flujo
plano_para_empotramiento = CodeBlock(surf_empo=control_de_flujo_4)
# ---------- plano_para_empotramiento.designscript (3 lines) ----------
p1 = Autodesk.Surface.PointAtParameter(surf_empo, 0.5, 0.5);
v1 = Autodesk.Surface.NormalAtPoint(surf_empo, p1);
plane = Autodesk.Plane.ByOriginNormal(p1, v1);
# ----------------------------------------
punto_para_dividir_curva = CodeBlock(c1=control_de_flujo_3, plane_1=plano_para_empotramiento.plane) { Autodesk.Geometry.Intersect(c1, plane_1); }
control_de_flujo_5 = Python(IN[0]=punto_para_dividir_curva)  # same code as control_de_flujo
code_block_6 = CodeBlock(c1=control_de_flujo_3, p1=control_de_flujo_5) { Autodesk.Curve.SplitByPoints(c1, p1); }
control_de_flujo_6 = Python(IN[0]=code_block_6)  # same code as control_de_flujo
code_block_7 = CodeBlock(tip_barra=code_block) { tip_barra[2]; }
traslapo_armadura = CodeBlock(rebar=code_block_7)
# ---------- traslapo_armadura.designscript (5 lines) ----------
diametro_barra = Strings.ToString(Properties.RebarDiameter(rebar),"");
key = ["8","10","12","16","18","22","25","28","32","36"];
val = [570, 710, 860, 1140, 1290, 1960, 2230, 2500, 2850, 3210];
dict_traslapo = Dictionary.ByKeysValues(key, val);
t3 = Dictionary.ValueAtKey(dict_traslapo, diametro_barra);
# ----------------------------------------
code_block_8 = CodeBlock(c1=control_de_flujo_6, extend=traslapo_armadura.t3) { Autodesk.Curve.ExtendEnd(c1, extend); }
code_block_9 = CodeBlock(s=code_block_4.rotated_surface) { s; p1 =Autodesk.Surface.PointAtParameter(s, 0.5, 0.5); Autodesk.Surface.NormalAtPoint(s, p1); }
normal_para_posicionamiento_de = Python(IN[0]=code_block_9.out2)  # "Normal para Posicionamiento de Barra"; same code as control_de_flujo
control_de_flujo_7 = Python(IN[0]=code_block_2)  # same code as control_de_flujo
code_block_10 = CodeBlock(w1=control_de_flujo_7)
# ---------- code_block_10.designscript (3 lines) ----------
wall_type = Revit.Elements.Element.GetParameterValueByName(w1, "Type");
wall_ancho = Revit.Elements.Element.GetParameterValueByName(wall_type, "Width");
des_curve = (wall_ancho / 2) -40;
# ----------------------------------------
translate = Geometry.Translate(geometry=code_block_8, direction=normal_para_posicionamiento_de, distance=code_block_10.des_curve)
code_block_11 = CodeBlock(tip_barra=code_block) { tip_barra[2]; }
element_types_ᶜᵒⁿᵛᵉʳᵗᵉᵈ_ᵈʳᵒᵖᵈᵒʷⁿ = CodeBlock { DSCore.Types.FindTypeByNameInAssembly("RebarHookType", "RevitAPI"); }
all_elements_of_type = ElementsOfType(element_type=element_types_ᶜᵒⁿᵛᵉʳᵗᵉᵈ_ᵈʳᵒᵖᵈᵒʷⁿ)
rebar_hook_type_at_start = CodeBlock(t3=all_elements_of_type)
# ---------- rebar_hook_type_at_start.designscript (5 lines) ----------
t1 = t3;
str2 = Revit.Elements.Element.Name(t1);
t2 = str2 == "Standard - 90 deg.";
t4 = DSCore.List.FilterByBoolMask(t3, t2);
t5 = Dictionary.ValueAtKey(t4, "in");
# ----------------------------------------
code_block_12 = CodeBlock(muros=code_block) { muros[0]; }
control_de_flujo_8 = Python(IN[0]=code_block_12)  # same code as control_de_flujo
reverse = Vector.Reverse(vector=normal_para_posicionamiento_de)
code_block_13 = CodeBlock(curves=translate, rebarBarType=code_block_11, startHoohType=rebar_hook_type_at_start.t5, hostElement=control_de_flujo_8, vector=reverse)
# ---------- code_block_13.designscript (18 lines) ----------
//curves
curves;
//rebarStyle
"Standard";
//rebarBarType
rebarBarType;
//startHookType
startHoohType;
//endHookType
null;
//startHookOrientation
"Left";
//endtHookOrientation
"Left";
//hostElement
hostElement;
//vector
vector;
# ----------------------------------------
fromCurves = StructuralDesign.Rebar.Create.FromCurves(curves=code_block_13.curves@L1, rebarStyle=code_block_13.out1@L1, rebarBarType=code_block_13.rebarBarType@L1, startHookType=code_block_13.startHoohType@L1, endHookType=code_block_13.out4@L1, startHookOrientation=code_block_13.out5@L1, endHookOrientation=code_block_13.out6@L1, hostElement=code_block_13.hostElement@L1, vector=code_block_13.vector@L1, lacing=Longest)
element_types_ᶜᵒⁿᵛᵉʳᵗᵉᵈ_ᵈʳᵒᵖᵈᵒʷⁿ_2 = CodeBlock { DSCore.Types.FindTypeByNameInAssembly("RebarShape", "RevitAPI"); }
all_elements_of_type_2 = ElementsOfType(element_type=element_types_ᶜᵒⁿᵛᵉʳᵗᵉᵈ_ᵈʳᵒᵖᵈᵒʷⁿ_2)
code_block_14 = CodeBlock(t1=all_elements_of_type_2)
# ---------- code_block_14.designscript (5 lines) ----------
"Shape";
str2 = Revit.Elements.Element.Name(t1);
t2 = str2 == "R_S_01";
t3 = DSCore.List.FilterByBoolMask(t1, t2);
t4 = Dictionary.ValueAtKey(t3, "in");
# ----------------------------------------
setParameterByName = Element.SetParameterByName(element=fromCurves, parameterName=code_block_14.out0, value=code_block_14.t4, lacing=Longest)
code_block_15 = CodeBlock { "Capa"; }
code_block_16 = CodeBlock(capa=code_block) { capa[4]; }
string_from_object = FromObject(obj=code_block_16)
numero_de_capa = CodeBlock(capa=string_from_object)
# ---------- numero_de_capa.designscript (4 lines) ----------
key = ["40", "90", "140", "190", "240"];
val = ["1", "2", "3", "4", "5"];
dict_capa = Dictionary.ByKeysValues(key, val);
t3 = Dictionary.ValueAtKey(dict_capa, capa);
# ----------------------------------------
setParameterByName_2 = Element.SetParameterByName(element=setParameterByName, parameterName=code_block_15, value=numero_de_capa.t3)
code_block_17 = CodeBlock { "Override Hook Lengths"; 1; }
setParameterByName_3 = Element.SetParameterByName(element=setParameterByName_2, parameterName=code_block_17.out0, value=code_block_17.out1)
code_block_18 = CodeBlock(muros=code_block) { muros[0]; }
control_de_flujo_9 = Python(IN[0]=code_block_18)  # same code as control_de_flujo
desplazamiento_barra = CodeBlock(t2=control_de_flujo_9)
# ---------- desplazamiento_barra.designscript (3 lines) ----------
t1 = Revit.Elements.Element.GetParameterValueByName(t2, "Type");
t3 = Revit.Elements.Element.GetParameterValueByName(t1, "Width");
t4 = t3 - 80;
# ----------------------------------------
code_block_19 = CodeBlock(cant_barra=code_block) { cant_barra[3]; }
setLayoutAsFixedNumber = StructuralDesign.Rebar.Layout.SetLayoutAsFixedNumber(rebar=setParameterByName_3, arrayLength=desplazamiento_barra.t4, numberOfBarPositions=code_block_19)
code_block_20 = CodeBlock(capa=code_block) { capa[4]; }
string_from_object_2 = FromObject(obj=code_block_20)
code_block_21 = CodeBlock(t3=string_from_object_2)
# ---------- code_block_21.designscript (4 lines) ----------
t1 = ["40", "90", "140", "190", "240"];
t2 = [0.3, 0.27, 0.24, 0.21, 0.18];
dictionary1 = Dictionary.ByKeysValues(t1, t2);
t4 = Dictionary.ValueAtKey(dictionary1, t3);
# ----------------------------------------
code_block_22 = CodeBlock(empotramiento=code_block) { empotramiento[1]; }
offset_entre_tags = CodeBlock(t3=string_from_object_2)
# ---------- offset_entre_tags.designscript (4 lines) ----------
t1 = ["40", "90", "140", "190", "240"];
t2 = [250, 700, 1150, 1550, 2000];
dictionary1 = Dictionary.ByKeysValues(t1, t2);
t4 = Dictionary.ValueAtKey(dictionary1, t3);
# ----------------------------------------
plano_para_ajustar_tag = CodeBlock(t2=code_block_22, offset_tag=offset_entre_tags.t4)
# ---------- plano_para_ajustar_tag.designscript (6 lines) ----------
t1 = t2;
vector1 = Autodesk.Surface.NormalAtParameter(t1, 0.5, 0.5);
geometry1 = Autodesk.Geometry.Translate(t1, vector1, offset_tag);
point1 = Autodesk.Surface.PointAtParameter(geometry1, 0.5, 0.5);
vector2 = Autodesk.Surface.NormalAtPoint(geometry1, point1);
plane1 = Autodesk.Plane.ByOriginNormal(point1, vector2);
# ----------------------------------------
code_block_23 = CodeBlock(element2=setLayoutAsFixedNumber, des_anotacion=code_block_21.t4, plane1=plano_para_ajustar_tag.plane1)
# ---------- code_block_23.designscript (6 lines) ----------
element1 = element2;
curve1 = Properties.RebarCenterlineCurves(element1, false, true, true, true, 0);
t1 = DSCore.List.Flatten(curve1, -1);
point1 = Autodesk.Curve.PointAtParameter(t1, des_anotacion);
t2 = DSCore.List.Flatten(point1, -1);
point2 = Points.PullOntoPlane(t2, plane1);
# ----------------------------------------
code_block_24 = CodeBlock()
# ---------- code_block_24.designscript (4 lines) ----------
family1 = Revit.Family.ByName("EST_A_STRUCTURAL REBAR TAG_STANDAR");
familytype1 = Revit.Elements.FamilyType.ByFamilyAndName(family1, "R_S_01");
true;
true;
# ----------------------------------------
create_tag = Custom[Create Tag](view=o_document_activeview@L1, element=setLayoutAsFixedNumber@L1, TagLocation=code_block_23.t2@L1, TagType=code_block_24.familytype1@L1, addLeader=code_block_24.out2@L1, RunIt=code_block_24.out3@L1, lacing=Longest)  # package Genius Loci; Works only in Revit 2018 and later. Creates a tag at a given location, of given type and in a supplied view. The node also works with Linked Elements (except space and area), Multi Category tag and Material Tag. Based on an archilab node
flatten = List.Flatten(list=create_tag)
code_block_25 = CodeBlock(x=code_block_4.top_surface) { Autodesk.Surface.NormalAtParameter(x, 0.5, 0.5); }
translate_2 = Geometry.Translate(geometry=code_block_23.t2, direction=code_block_25, distance=offset_entre_tags.t4)
direction = Line.Direction(line=code_block_23.t1)
code_block_26 = CodeBlock { 500; }
translate_3 = Geometry.Translate(geometry=translate_2, direction=direction, distance=code_block_26)
tag_setlocation = Custom[Tag SetLocation](tag=flatten, location=translate_3)  # package Genius Loci; Moves the head of the tag to the given location point.
code_block_27 = CodeBlock { "Free"; }
setLeader = archilab.Revit.Elements.Tags.SetLeader(tag=tag_setlocation, leaderEnd=code_block_23.t2, leaderElbow=translate_2, leaderEndCondition=code_block_27)
code_block_28 = CodeBlock { "Recta Segmento Unico"; }
file_path = Filename("..\..\..\..\..\..\..\..\..\..\Arainco\Arainco.png")
code_block_29 = CodeBlock { "INICIAR"; "CANCELAR"; true; 430; 170; 650; }
categories_ᶜᵒⁿᵛᵉʳᵗᵉᵈ_ᵈʳᵒᵖᵈᵒʷⁿ = CodeBlock { "Muros a Armar"; "SELECCIONAR"; Revit.Category.ByName(["Walls","Structural Foundations"]); }
selectmodelelements_data = Custom[SelectModelElements Data](InputName=categories_ᶜᵒⁿᵛᵉʳᵗᵉᵈ_ᵈʳᵒᵖᵈᵒʷⁿ.out0, ButtonText=categories_ᶜᵒⁿᵛᵉʳᵗᵉᵈ_ᵈʳᵒᵖᵈᵒʷⁿ.out1, CategoryFilter=categories_ᶜᵒⁿᵛᵉʳᵗᵉᵈ_ᵈʳᵒᵖᵈᵒʷⁿ.out2)  # package Data-Shapes; Creates a Revit element selection input for UI.MultipleInputForm++ . Check out www.data-shapes.net for more infos!
code_block_30 = CodeBlock { "Cara de Distribucion"; "SELECCIONAR"; }
selectfaces_data = Custom[SelectFaces Data](InputName=code_block_30.out0, ButtonText=code_block_30.out1)  # package Data-Shapes; Creates a Revit face selection input for UI.MultipleInputForm++. Check out www.data-shapes.net for more infos!
code_block_31 = CodeBlock { "Datos de Armadura"; }
code_block_32 = CodeBlock { "Diametro"; }
element_types_ᶜᵒⁿᵛᵉʳᵗᵉᵈ_ᵈʳᵒᵖᵈᵒʷⁿ_3 = CodeBlock { DSCore.Types.FindTypeByNameInAssembly("RebarBarType", "RevitAPI"); }
all_elements_of_type_3 = ElementsOfType(element_type=element_types_ᶜᵒⁿᵛᵉʳᵗᵉᵈ_ᵈʳᵒᵖᵈᵒʷⁿ_3)
code_block_33 = CodeBlock(t5=all_elements_of_type_3)
# ---------- code_block_33.designscript (8 lines) ----------
t4 = t5;
t1 = t4;
num1 = Properties.RebarDiameter(t1);
t2 = DSCore.List.SortByKey(t1, num1);
t3 = Dictionary.ValueAtKey(t2, "sorted list");
str1 = Revit.Elements.Element.Name(t3);
0;
false;
# ----------------------------------------
dropdown_data = Custom[DropDown Data](InputName=code_block_32, Keys=code_block_33.str1, Values=code_block_33.t3, DefaultValueIndex=code_block_33.out6, Sorted_optional=code_block_33.out7)  # package Data-Shapes; Create data for DropDown input in UI.MultiInputForm ++ . Check out www.data-shapes.net for more infos.
code_block_34 = CodeBlock { "Cantidad de Barras"; "2"; true; }
textbox_data = Custom[TextBox Data](InputName=code_block_34.out0, DefaultText=code_block_34.out1, IsNumberEntry=code_block_34.out2)  # package Data-Shapes; Create Data for TextBox input in UI.MultipleInputForm ++ . Check out www.data-shapes.net for more informations
code_block_35 = CodeBlock { "Capa"; ["1ª Capa", "2ª Capa", "3ª Capa", "4ª Capa", "5ª Capa"]; [40, 90, 140, 190, 240]; 0; }
dropdown_data_2 = Custom[DropDown Data](InputName=code_block_35.out0, Keys=code_block_35.out1, Values=code_block_35.out2, DefaultValueIndex=code_block_35.out3)
list_create = List.Create(item0=dropdown_data, item1=textbox_data, item2=dropdown_data_2)
inputgroup_data = Custom[InputGroup Data](GroupTitle=code_block_31, Inputs=list_create)  # package Data-Shapes; Creates a group of inputs for UI.MultipleInputForm ++ . Check out www.data-shapes.net for more infos !
list_create_2 = List.Create(item0=selectmodelelements_data, item1=selectfaces_data, item2=inputgroup_data)
multipleinputform = Custom[MultipleInputForm ++](Description_optional=code_block_28, Logo_optional=file_path, ButtonText_optional=code_block_29.out0, Inputs=list_create_2, Toggle=code_block_29.out2, CancelButtonText_optional=code_block_29.out1, MaxHeight_optional=code_block_29.out5, Width_optional=code_block_29.out3, LabelWidth_optional=code_block_29.out4)  # package Data-Shapes; Create a form with multiple inputs. see www.data-shapes.net for tutorials and infos!
code_block_36 = CodeBlock(l=multipleinputform.User_Inputs)
# ---------- code_block_36.designscript (12 lines) ----------
l;
[Imperative]
{
	if (l == null)
	{
		return = [[],[],[],[],[],[],[]];
	}
	else
	{
		return = l;
	}
};
# ----------------------------------------
planos_vectores_curvas = CodeBlock(wall=code_block_36.out1, surface=code_block_36.out1, offset=code_block_36.out1)
# ---------- planos_vectores_curvas.designscript (21 lines) ----------
host_element = wall[0][0];
wall_geom = Elements.View3D.Geometry(host_element)[0];
elem_type = Revit.Elements.Element.GetParameterValueByName(host_element, "Type");
array_length = Revit.Elements.Element.GetParameterValueByName(elem_type, "Width") - 40;


top_surface = surface[1][0];
vector = Autodesk.Surface.NormalAtParameter(top_surface, 0.5, 0.5);
origin_point = Autodesk.Surface.PointAtParameter(top_surface, 0.5, 0.5);
plane = Autodesk.Plane.ByOriginNormal(origin_point, vector);
plane_cut = Autodesk.Geometry.Translate(plane, vector, offset[4]*-1);
plane_x_axis = Autodesk.Plane.YAxis(plane);

plane_rotated = Autodesk.Geometry.Rotate(plane, origin_point, plane_x_axis, 90);

intersect_geom = Autodesk.Geometry.Intersect(wall_geom, plane_cut)[0];
per_curves = PolyCurve.ByJoinedCurves(Autodesk.Surface.PerimeterCurves(intersect_geom));
off_poly_curves = PolyCurve.ByJoinedCurves(PolyCurve.Offset(per_curves, -20, false));
rebar_curve = PolyCurve.Curves(off_poly_curves)[1];
rebar_curve_reversed = Autodesk.Curve.Reverse(rebar_curve);
rebar_vector = Autodesk.Plane.Normal(plane_rotated);
# ----------------------------------------
code_block_37 = CodeBlock(curve=planos_vectores_curvas.rebar_curve)
# ---------- code_block_37.designscript (4 lines) ----------
startPoint = Autodesk.Curve.StartPoint(curve);
endPoint = Autodesk.Curve.EndPoint(curve);
vector = Autodesk.Vector.ByTwoPoints(startPoint, endPoint);
norm_vector = Autodesk.Vector.Normalized(vector);
# ----------------------------------------
o_document_activeview_2 = Orchid.RevitProject.Common.Document.ActiveView()
plane = Custom[View.Plane](view=o_document_activeview_2)  # package Clockwork for Dynamo 2.x; Retrieves the plane of a given view
code_block_38 = CodeBlock(view_plane=plane)
# ---------- code_block_38.designscript (7 lines) ----------
view_plane;
plane_origin = Autodesk.Plane.Origin(view_plane);
plane_Yvector = Autodesk.Plane.YAxis(view_plane);

new_plane = Autodesk.Plane.ByOriginNormal(plane_origin, plane_Yvector);
new_plane_normal = Autodesk.Plane.Normal(new_plane);
norm_vector = Autodesk.Vector.Normalized(new_plane_normal);
# ----------------------------------------
isAlmostEqualTo = Vector.IsAlmostEqualTo(vector=code_block_37.norm_vector, other=code_block_38.norm_vector)
if_ = If(test=isAlmostEqualTo, true=planos_vectores_curvas.rebar_curve_reversed, false=planos_vectores_curvas.rebar_curve)
element_types_ᶜᵒⁿᵛᵉʳᵗᵉᵈ_ᵈʳᵒᵖᵈᵒʷⁿ_4 = CodeBlock { DSCore.Types.FindTypeByNameInAssembly("RebarHookType", "RevitAPI"); }
all_elements_of_type_4 = ElementsOfType(element_type=element_types_ᶜᵒⁿᵛᵉʳᵗᵉᵈ_ᵈʳᵒᵖᵈᵒʷⁿ_4)
rebar_hook_type_by_name = CodeBlock(t3=all_elements_of_type_4)
# ---------- rebar_hook_type_by_name.designscript (6 lines) ----------
t1 = t3;
str2 = Revit.Elements.Element.Name(t1);
t2 = str2 == "Standard - 90 deg.";
t4 = DSCore.List.FilterByBoolMask(t3, t2);
t5 = Dictionary.ValueAtKey(t4, "in");
t6 = Dictionary.ValueAtKey(t4, "out");
# ----------------------------------------
code_block_39 = CodeBlock(curves=if_, rebarBarType=code_block_36.out1, StartHookType=rebar_hook_type_by_name.t5, EndHookType=rebar_hook_type_by_name.t5, hostElement=code_block_36.out1, vector=planos_vectores_curvas.rebar_vector)
# ---------- code_block_39.designscript (18 lines) ----------
//curves
curves;
//rebarStyle
"Standard";
//rebarBarType
rebarBarType[2];
//startHookType - Standard - 90 deg.
StartHookType;
//endHookType - Standard - 90 deg.
EndHookType;
//startHookOrientation
"Left";
//endtHookOrientation
"Left";
//hostElement
hostElement[0][0];
//vector
vector;
# ----------------------------------------
fromCurves_2 = StructuralDesign.Rebar.Create.FromCurves(curves=code_block_39.curves, rebarStyle=code_block_39.out1, rebarBarType=code_block_39.out2, startHookType=code_block_39.StartHookType, endHookType=code_block_39.EndHookType, startHookOrientation=code_block_39.out5, endHookOrientation=code_block_39.out6, hostElement=code_block_39.out7, vector=code_block_39.vector)
element_types_ᶜᵒⁿᵛᵉʳᵗᵉᵈ_ᵈʳᵒᵖᵈᵒʷⁿ_5 = CodeBlock { DSCore.Types.FindTypeByNameInAssembly("RebarShape", "RevitAPI"); }
all_elements_of_type_5 = ElementsOfType(element_type=element_types_ᶜᵒⁿᵛᵉʳᵗᵉᵈ_ᵈʳᵒᵖᵈᵒʷⁿ_5)
code_block_40 = CodeBlock(t1=all_elements_of_type_5)
# ---------- code_block_40.designscript (5 lines) ----------
"Shape";
str2 = Revit.Elements.Element.Name(t1);
t2 = str2 == "R_S_02";
t3 = DSCore.List.FilterByBoolMask(t1, t2);
t4 = Dictionary.ValueAtKey(t3, "in");
# ----------------------------------------
setParameterByName_4 = Element.SetParameterByName(element=fromCurves_2, parameterName=code_block_40.out0, value=code_block_40.t4, lacing=Longest)
code_block_41 = CodeBlock { "Capa"; }
string_from_object_3 = FromObject(obj=code_block_36.out1)
numero_de_capa_2 = CodeBlock(capa=string_from_object_3)
# ---------- numero_de_capa_2.designscript (4 lines) ----------
key = ["40", "90", "140", "190", "240"];
val = ["1", "2", "3", "4", "5"];
dict_capa = Dictionary.ByKeysValues(key, val);
t3 = Dictionary.ValueAtKey(dict_capa, capa[4]);
# ----------------------------------------
setParameterByName_5 = Element.SetParameterByName(element=setParameterByName_4, parameterName=code_block_41, value=numero_de_capa_2.t3)
