# Dynamo graph hor_corchete_multisegmento.dyn (Dynamo 2.6.2.15705)
# packages: Data-Shapes 2022.2.103, Orchid 206.3.0.8161, Clockwork for Dynamo 2.x 2.4.0, Structural Design 2021.1.22, Genius Loci 2021.11.10, bimorphNodes 3.0.3

code_block = CodeBlock { "Corchete Segmento Unico"; }
file_path = Filename("..\..\..\..\..\..\..\..\..\..\Arainco\Arainco.png")
code_block_2 = CodeBlock { "INICIAR"; "CANCELAR"; true; 430; 170; 700; }
categories_ᶜᵒⁿᵛᵉʳᵗᵉᵈ_ᵈʳᵒᵖᵈᵒʷⁿ = CodeBlock { "Seleccionar Muro a Armar"; "SELECCIONAR"; Revit.Category.ByName("Walls"); }
selectmodelelements_data = Custom[SelectModelElements Data](InputName=categories_ᶜᵒⁿᵛᵉʳᵗᵉᵈ_ᵈʳᵒᵖᵈᵒʷⁿ.out0, ButtonText=categories_ᶜᵒⁿᵛᵉʳᵗᵉᵈ_ᵈʳᵒᵖᵈᵒʷⁿ.out1, CategoryFilter=categories_ᶜᵒⁿᵛᵉʳᵗᵉᵈ_ᵈʳᵒᵖᵈᵒʷⁿ.out2)  # package Data-Shapes; Creates a Revit element selection input for UI.MultipleInputForm++ . Check out www.data-shapes.net for more infos!
code_block_3 = CodeBlock { "Cara de Distribucion"; "SELECCIONAR"; }
selectfaces_data = Custom[SelectFaces Data](InputName=code_block_3.out0, ButtonText=code_block_3.out1)  # package Data-Shapes; Creates a Revit face selection input for UI.MultipleInputForm++. Check out www.data-shapes.net for more infos!
code_block_4 = CodeBlock { "Cara de Inicio"; "SELECCIONAR"; }
selectfaces_data_2 = Custom[SelectFaces Data](InputName=code_block_4.out0, ButtonText=code_block_4.out1)
code_block_5 = CodeBlock { "Cara de Término"; "SELECCIONAR"; }
selectfaces_data_3 = Custom[SelectFaces Data](InputName=code_block_5.out0, ButtonText=code_block_5.out1)
code_block_6 = CodeBlock { "Definir Empalmes"; "SELECCIONAR"; }
selectpointsonface_data = Custom[SelectPointsOnFace data](InputName=code_block_6.out0, ButtonText=code_block_6.out1)  # package Data-Shapes; Creates a UI.MultipleInputForm++ input that allows point on face selection
code_block_7 = CodeBlock { "Datos de Armadura"; }
code_block_8 = CodeBlock { "Diametro"; }
element_types_ᶜᵒⁿᵛᵉʳᵗᵉᵈ_ᵈʳᵒᵖᵈᵒʷⁿ = CodeBlock { DSCore.Types.FindTypeByNameInAssembly("RebarBarType", "RevitAPI"); }
all_elements_of_type = ElementsOfType(element_type=element_types_ᶜᵒⁿᵛᵉʳᵗᵉᵈ_ᵈʳᵒᵖᵈᵒʷⁿ)
code_block_9 = CodeBlock(t5=all_elements_of_type)
# ---------- code_block_9.designscript (8 lines) ----------
t4 = t5;
t1 = t4;
num1 = Properties.RebarDiameter(t1);
t2 = DSCore.List.SortByKey(t1, num1);
t3 = Dictionary.ValueAtKey(t2, "sorted list");
str1 = Revit.Elements.Element.Name(t3);
0;
false;
# ----------------------------------------
dropdown_data = Custom[DropDown Data](InputName=code_block_8, Keys=code_block_9.str1, Values=code_block_9.t3, DefaultValueIndex=code_block_9.out6, Sorted_optional=code_block_9.out7)  # package Data-Shapes; Create data for DropDown input in UI.MultiInputForm ++ . Check out www.data-shapes.net for more infos.
code_block_10 = CodeBlock { "Cantidad de Barras"; "2"; true; }
textbox_data = Custom[TextBox Data](InputName=code_block_10.out0, DefaultText=code_block_10.out1, IsNumberEntry=code_block_10.out2)  # package Data-Shapes; Create Data for TextBox input in UI.MultipleInputForm ++ . Check out www.data-shapes.net for more informations
code_block_11 = CodeBlock { "Capa"; ["1ª Capa", "2ª Capa", "3ª Capa", "4ª Capa", "5ª Capa"]; [40, 90, 140, 190, 240]; 0; }
dropdown_data_2 = Custom[DropDown Data](InputName=code_block_11.out0, Keys=code_block_11.out1, Values=code_block_11.out2, DefaultValueIndex=code_block_11.out3)
list_create = List.Create(item0=dropdown_data, item1=textbox_data, item2=dropdown_data_2)
inputgroup_data = Custom[InputGroup Data](GroupTitle=code_block_7, Inputs=list_create)  # package Data-Shapes; Creates a group of inputs for UI.MultipleInputForm ++ . Check out www.data-shapes.net for more infos !
list_create_2 = List.Create(item0=selectmodelelements_data, item1=selectfaces_data, item2=selectfaces_data_2, item3=selectfaces_data_3, item4=selectpointsonface_data, item5=inputgroup_data)
multipleinputform = Custom[MultipleInputForm ++](Description_optional=code_block, Logo_optional=file_path, ButtonText_optional=code_block_2.out0, Inputs=list_create_2, Toggle=code_block_2.out2, CancelButtonText_optional=code_block_2.out1, MaxHeight_optional=code_block_2.out5, Width_optional=code_block_2.out3, LabelWidth_optional=code_block_2.out4)  # package Data-Shapes; Create a form with multiple inputs. see www.data-shapes.net for tutorials and infos!
code_block_12 = CodeBlock(l=multipleinputform.User_Inputs)
# ---------- code_block_12.designscript (12 lines) ----------
l;
[Imperative]
{
	if (l == null)
	{
		return = [[],[],[],[],[],[],[],[]];
	}
	else
	{
		return = l;
	}
};
# ----------------------------------------
code_block_13 = CodeBlock(x=code_block_12.out1) { x[7]; }
o_document_activeview = Orchid.RevitProject.Common.Document.ActiveView()
o_document_activeview_2 = Orchid.RevitProject.Common.Document.ActiveView()
plane = Custom[View.Plane](view=o_document_activeview_2)  # package Clockwork for Dynamo 2.x; Retrieves the plane of a given view
code_block_14 = CodeBlock(x=code_block_12.out1, view_plane=plane)
# ---------- code_block_14.designscript (11 lines) ----------
muros = x[0];
view_plane;
view_plane_normal = Autodesk.Plane.Normal(view_plane);

//Geometria a Cortar
elem_solid = DSCore.List.Flatten(Revit.Elements.Element.Geometry(muros));
solid_centroid = Autodesk.Solid.Centroid(elem_solid);
solid_plane = Autodesk.Plane.ByOriginNormal(solid_centroid, view_plane_normal);
solid_coo_sys = CoordinateSystem.ByPlane(solid_plane);
solid_scaled = Autodesk.Geometry.Scale(elem_solid, solid_plane, 100, 100, 1);
solid_a_cortar = Autodesk.Solid.ByUnion(solid_scaled);
# ----------------------------------------
code_block_15 = CodeBlock(x=code_block_12.out1, view_plane=plane)
# ---------- code_block_15.designscript (26 lines) ----------
distribucion = x[1];
empotramiento = x[2];
termino = x[3];
capa = x[7] * -1;
view_plane;
view_plane_normal = Autodesk.Plane.Normal(view_plane);

//Vector Normal Caras capturadas
distribucion_normal = Autodesk.Surface.NormalAtParameter(distribucion, 0.5, 0.5)[0];
empotramiento_normal = Autodesk.Surface.NormalAtParameter(empotramiento, 0.5, 0.5)[0];
termino_normal = Autodesk.Surface.NormalAtParameter(termino, 0.5, 0.5)[0];

//Centroide Caras Capturadas
distribucion_point = Autodesk.Surface.PointAtParameter(distribucion, 0.5, 0.5)[0];
empotramiento_point = Autodesk.Surface.PointAtParameter(empotramiento, 0.5, 0.5)[0];
termino_point = Autodesk.Surface.PointAtParameter(termino, 0.5, 0.5)[0];

//Planos caras capturadas
distribucion_plane_1 = Autodesk.Plane.ByOriginNormal(distribucion_point, distribucion_normal);
empotramiento_plane_1 = Autodesk.Plane.ByOriginNormal(empotramiento_point, empotramiento_normal);
termino_plane_1 = Autodesk.Plane.ByOriginNormal(termino_point, termino_normal);

//Planos Trasladados
distribucion_plane = Autodesk.Geometry.Translate(distribucion_plane_1, distribucion_normal, capa);
empotramiento_plane = Autodesk.Geometry.Translate(empotramiento_plane_1, empotramiento_normal, -20);
termino_plane = Autodesk.Geometry.Translate(termino_plane_1, termino_normal, -20);
# ----------------------------------------
element_types_ᶜᵒⁿᵛᵉʳᵗᵉᵈ_ᵈʳᵒᵖᵈᵒʷⁿ_2 = CodeBlock { DSCore.Types.FindTypeByNameInAssembly("RebarHookType", "RevitAPI"); }
all_elements_of_type_2 = ElementsOfType(element_type=element_types_ᶜᵒⁿᵛᵉʳᵗᵉᵈ_ᵈʳᵒᵖᵈᵒʷⁿ_2)
rebar_hook_type_at_start = CodeBlock(t3=all_elements_of_type_2)
# ---------- rebar_hook_type_at_start.designscript (5 lines) ----------
t1 = t3;
str2 = Revit.Elements.Element.Name(t1);
t2 = str2 == "Standard - 90 deg.";
t4 = DSCore.List.FilterByBoolMask(t3, t2);
t5 = Dictionary.ValueAtKey(t4, "in");
# ----------------------------------------
code_block_16 = CodeBlock(x=code_block_12.out1, view_plane=plane, geom_a_cortar=code_block_14.solid_a_cortar, distribucion_plane=code_block_15.distribucion_plane, empotramiento_plane=code_block_15.empotramiento_plane, termino_plane=code_block_15.termino_plane, rebarBarType=code_block_12.out1, p=rebar_hook_type_at_start.t5)
# ---------- code_block_16.designscript (259 lines) ----------
muros = x[0];
dist_traslacion_curva;
tipo_barra = x[5];
empotramiento = x[2][0];
termino = x[3][0];
cantidad_barras = x[6];
capa_as_str = Strings.ToString(x[7], "");
distribucion = x[1];
view_plane;
view_plane_normal = Autodesk.Plane.Normal(view_plane);
view_plane_vector_y = Autodesk.Plane.YAxis(view_plane);
view_plane_normal_reverse = Autodesk.Vector.Reverse(view_plane_normal);
//Vector Normal Cara de Distribucion
normal_distribucion = Autodesk.Surface.NormalAtParameter(distribucion, 0.5, 0.5);

//Numero de Capa
key_2 = ["40", "90", "140", "190", "240"];
val_2 = ["1", "2", "3", "4", "5"];
dict_capa = Dictionary.ByKeysValues(key_2, val_2);
capa = Dictionary.ValueAtKey(dict_capa, capa_as_str);

//Desplazamiento etiqueta
key_1 = ["40", "90", "140", "190", "240"];
val_1 = [450, 700, 1310, 1840, 2370];
dict_desplazamiento = Dictionary.ByKeysValues(key_1, val_1);
despl_etiqueta = Dictionary.ValueAtKey(dict_desplazamiento, capa_as_str);


//PLanos de Corte para generar empalmes
empalmes = x[4];
coo_sys_view_plane = Autodesk.Plane.ToCoordinateSystem(view_plane);
vector_planos_corte = Autodesk.Plane.YAxis(view_plane);
cut_plane = Autodesk.Plane.ByOriginNormal(empalmes, vector_planos_corte);


//Vector Normal Caras capturadas
empotramiento_normal = Autodesk.Surface.NormalAtParameter(empotramiento, 0.5, 0.5);
termino_normal = Autodesk.Surface.NormalAtParameter(termino, 0.5, 0.5);

//Centroide Caras Capturadas
empotramiento_point = Points.PullOntoPlane(Autodesk.Surface.PointAtParameter(empotramiento, 0.5, 0.5), view_plane);
termino_point = Points.PullOntoPlane(Autodesk.Surface.PointAtParameter(termino, 0.5, 0.5), view_plane);
empotramiento_point_z = Autodesk.Point.Z(empotramiento_point);
termino_point_x = Autodesk.Point.X(termino_point);
termino_point_y = Autodesk.Point.Y(termino_point);
termino_point_corregido = Autodesk.Point.ByCoordinates(termino_point_x, termino_point_y, empotramiento_point_z);


//Planos caras capturadas
empotramiento_plane_1 = Autodesk.Plane.ByOriginNormal(empotramiento_point, empotramiento_normal);
termino_plane_1 = Autodesk.Plane.ByOriginNormal(termino_point, termino_normal);

//Vector entre Planos de Empotramiento y Termino
l = Line.ByBestFitThroughPoints([empotramiento_point, termino_point_corregido]);
vector_normalizado = Autodesk.Vector.Normalized(Line.Direction(l));


//Sistema de Coordenadas Vista Actual
view_coo_sys = Autodesk.Plane.ToCoordinateSystem(view_plane);
y_axis = CoordinateSystem.YAxis(view_coo_sys);

//Vector de Traslacion
booleano = Autodesk.Vector.IsAlmostEqualTo(y_axis, vector_normalizado);
vector_traslacion = booleano ? view_plane_normal_reverse : view_plane_normal_reverse;

//Traslacion curva
category = Revit.Elements.Element.GetCategory(muros);
category_name = Revit.Category.Name(category);
mask = category_name == "Walls";
element = DSCore.List.FilterByBoolMask(muros, mask)["in"];
element_type = Revit.Elements.Element.GetParameterValueByName(element, "Type");
element_width = Revit.Elements.Element.GetParameterValueByName(element_type, "Width");
dist_traslacion_curva = (element_width[0] / 2) - 40;


//Empotramiento Armadura
tipo_barra_str = Strings.ToString(Properties.RebarDiameter(tipo_barra),"");
key = ["8","10","12","16","18","22","25","28","32","36"];
val = [570, 710, 860, 1140, 1290, 1960, 2230, 2500, 2850, 3210];
dict_traslapo = Dictionary.ByKeysValues(key, val);
empotramiento_dict = Dictionary.ValueAtKey(dict_traslapo, tipo_barra_str);

//Superficies
surf_distribucion = Autodesk.Geometry.Intersect(geom_a_cortar, distribucion_plane)[0];
surf_empotramiento = Autodesk.Geometry.Intersect(geom_a_cortar, empotramiento_plane)[0];
surf_termino = Autodesk.Geometry.Intersect(geom_a_cortar, termino_plane)[0];

//Intersecciones
intersect_start = Autodesk.Geometry.Intersect(surf_distribucion, surf_empotramiento)[0];
intersect_end = Autodesk.Geometry.Intersect(surf_distribucion, surf_termino)[0];

//Puntos para Generar Curva
point_start = Autodesk.Curve.PointAtParameter(intersect_start, 0.5);
point_end = Autodesk.Curve.PointAtParameter(intersect_end, 0.5);

//Rebar Curve
rebar_curve_init = Line.ByStartPointEndPoint(point_end, point_start);
rebar_curve_init_reverse = Autodesk.Curve.Reverse(rebar_curve_init);
rebar_curve_bool = booleano ? rebar_curve_init : rebar_curve_init_reverse;
rebar_curve = Autodesk.Geometry.Translate(rebar_curve_bool, vector_traslacion, dist_traslacion_curva);
rebar_curve_puntos_division = DSCore.List.Flatten(Autodesk.Geometry.Intersect(rebar_curve, cut_plane));
param_at_point = Autodesk.Curve.ParameterAtPoint(rebar_curve, rebar_curve_puntos_division);
segment_lengths = DSCore.Math.Ceiling(Autodesk.Curve.SegmentLengthAtParameter(rebar_curve, param_at_point) / 100) * 100;
param_at_segment_length = Autodesk.Curve.ParameterAtSegmentLength(rebar_curve, segment_lengths);
rebar_curve_splited = Autodesk.Curve.SplitByParameter(rebar_curve, param_at_segment_length);
distribucion_vector = Autodesk.Surface.NormalAtParameter(distribucion, 0.5, 0.5);
vector_z = Autodesk.Vector.Z(distribucion_vector)[0];

rebar_curve_last = Autodesk.Curve.ExtendEnd(DSCore.List.FirstItem(rebar_curve_splited), empotramiento_dict / 2);
rebar_curve_middle = Autodesk.Curve.ExtendEnd(Autodesk.Curve.ExtendStart(DSCore.List.Slice(rebar_curve_splited, 1, -1, 1), empotramiento_dict / 2), empotramiento_dict / 2);
rebar_curve_first = Autodesk.Curve.ExtendStart(DSCore.List.LastItem(rebar_curve_splited), empotramiento_dict / 2);

orintacion_pata = vector_z < 0 ? "Right" : "Left";

//Buscar Host mas cercano
elem_solid = DSCore.List.Flatten(Revit.Elements.Element.Geometry(muros));
solid_centroid = Autodesk.Solid.Centroid(elem_solid);

//ArrayLength
array_length = DSCore.List.FirstItem(element_width - 80);
cantidad_barras;

//Primera Barra
rebar_curve_first_mid_point = Autodesk.Curve.PointAtParameter(rebar_curve_first, 0.5);
rebar_curve_first_distance_to = Autodesk.Geometry.DistanceTo(solid_centroid, rebar_curve_first_mid_point);
rebar_curve_first_min = DSCore.List.MinimumItem(rebar_curve_first_distance_to);
rebar_curve_first_mask = rebar_curve_first_distance_to == rebar_curve_first_min;
rebar_curve_first_host = DSCore.List.FilterByBoolMask(muros, rebar_curve_first_mask)["in"][0];
//curves
rebar_curve_first;
//rebarStyle
"Standard";
//rebarBarType
rebarBarType[5];
//startHookType
null;
//endHookType
p;
//startHookOrientation
orintacion_pata;
//endtHookOrientation
orintacion_pata;
//hostElement
rebar_curve_first_host;
//vector
view_plane_normal;

//Layout Primera Barra
array_length;
cantidad_barras;

//Capa
capa;

//Vector Normal Cara de Distribucion
normal_distribucion;

//Desplazamiento Etiqueta
despl_etiqueta;
view_plane_vector_y;












//Barras Intermedias
rebar_curve_middle_mid_point = Autodesk.Curve.PointAtParameter(rebar_curve_middle, 0.5);
rebar_curve_middle_distance_to = Autodesk.Geometry.DistanceTo(solid_centroid@L2<1L>, rebar_curve_middle_mid_point@L1<1L>);
rebar_curve_middle_min = DSCore.List.MinimumItem(rebar_curve_middle_distance_to);
rebar_curve_middle_mask = rebar_curve_middle_distance_to@L2<1L> == rebar_curve_middle_min@L1<1L>;
rebar_curve_middle_host = DSCore.List.Flatten(DSCore.List.FilterByBoolMask(muros@L2<1L>, rebar_curve_middle_mask@L2<1L>)["in"]);
//curves
rebar_curve_middle;
//rebarStyle
"Standard";
//rebarBarType
rebarBarType[5];
//startHookType
null;
//endHookType
null;
//startHookOrientation
orintacion_pata;
//endtHookOrientation
orintacion_pata;
//hostElement
rebar_curve_middle_host;
//vector
view_plane_normal;

//Layout Barras Intermedias
array_length;
cantidad_barras;

//Capa
capa;

//Vector Normal Cara de Distribucion
normal_distribucion;

//Desplazamiento Etiqueta
despl_etiqueta;
view_plane_vector_y;











//Ultima Barra
rebar_curve_last_mid_point = Autodesk.Curve.PointAtParameter(rebar_curve_last, 0.5);
rebar_curve_last_distance_to = Autodesk.Geometry.DistanceTo(solid_centroid, rebar_curve_last_mid_point);
rebar_curve_last_min = DSCore.List.MinimumItem(rebar_curve_last_distance_to);
rebar_curve_last_mask = rebar_curve_last_distance_to == rebar_curve_last_min;
rebar_curve_last_host = DSCore.List.FilterByBoolMask(muros, rebar_curve_last_mask)["in"][0];
//curves
rebar_curve_last;
//rebarStyle
"Standard";
//rebarBarType
rebarBarType[5];
//startHookType
p;
//endHookType
null;
//startHookOrientation
orintacion_pata;
//endtHookOrientation
orintacion_pata;
//hostElement
rebar_curve_first_host;
//vector
view_plane_normal;

//Layout Ultima Barra
array_length;
cantidad_barras;

//Capa
capa;

//Vector Normal Cara de Distribucion
normal_distribucion;

//Desplazamiento Etiqueta
despl_etiqueta;
view_plane_vector_y;
# ----------------------------------------
fromCurves = StructuralDesign.Rebar.Create.FromCurves(curves=code_block_16.out84, rebarStyle=code_block_16.out85, rebarBarType=code_block_16.out86, startHookType=code_block_16.out87, endHookType=code_block_16.out88, startHookOrientation=code_block_16.out89, endHookOrientation=code_block_16.out90, hostElement=code_block_16.out91, vector=code_block_16.out92)
code_block_17 = CodeBlock(x=fromCurves) { x[0]; }
setLayoutAsFixedNumber = StructuralDesign.Rebar.Layout.SetLayoutAsFixedNumber(rebar=code_block_17, arrayLength=code_block_16.out93, numberOfBarPositions=code_block_16.out94)
element_types_ᶜᵒⁿᵛᵉʳᵗᵉᵈ_ᵈʳᵒᵖᵈᵒʷⁿ_3 = CodeBlock { DSCore.Types.FindTypeByNameInAssembly("RebarShape", "RevitAPI"); }
all_elements_of_type_3 = ElementsOfType(element_type=element_types_ᶜᵒⁿᵛᵉʳᵗᵉᵈ_ᵈʳᵒᵖᵈᵒʷⁿ_3)
code_block_18 = CodeBlock(rebar=setLayoutAsFixedNumber, capa=code_block_16.out95, elem=all_elements_of_type_3)
# ---------- code_block_18.designscript (8 lines) ----------
//Asigna Numero de Capa
Revit.Elements.Element.SetParameterByName(rebar, "Capa", capa);

//Asigna el Rebar Shape Indicado
elem_names = Revit.Elements.Element.Name(elem);
mask = elem_names == "R_S_01";
rebar_shape_R_S_01 = DSCore.List.FilterByBoolMask(elem, mask)["in"];
Revit.Elements.Element.SetParameterByName(rebar, "Shape", rebar_shape_R_S_01)[0];
# ----------------------------------------
rebarCenterlineCurves = StructuralDesign.Rebar.Properties.RebarCenterlineCurves(rebar=code_block_18.out4)
code_block_19 = CodeBlock(x=rebarCenterlineCurves, normal_distribucion=code_block_16.out96, view_plane_vector_y=code_block_16.out98, element=code_block_18.out4, despl_etiqueta=code_block_16.out97)
# ---------- code_block_19.designscript (20 lines) ----------
rebar_curve = x[0];
normal_distribucion;
view_plane_vector_y;
//element
element;
//TagLocation
point_leader_end = Autodesk.Curve.PointAtParameter(rebar_curve, 0.5);
point_leader_elbow = Autodesk.Geometry.Translate(point_leader_end, normal_distribucion, despl_etiqueta)[0];
point_tag_location = Autodesk.Geometry.Translate(point_leader_elbow, view_plane_vector_y, 500);
//TagType
family = Revit.Family.ByName("EST_A_STRUCTURAL REBAR TAG_STANDAR");
tag_type = Revit.Elements.FamilyType.ByFamilyAndName(family, "R_S_01");
//horizontal
true;
//addLeader
false;
//LinkInstance
null;
//RunIt
true;
# ----------------------------------------
create_tag = Custom[Create Tag](view=o_document_activeview, element=code_block_19.element, TagLocation=code_block_19.point_leader_end, TagType=code_block_19.tag_type, horizontal=code_block_19.out9, addLeader=code_block_19.out10, LinkInstance=code_block_19.out11, RunIt=code_block_19.out12, lacing=Shortest)  # package Genius Loci; Works only in Revit 2018 and later. Creates a tag at a given location, of given type and in a supplied view. The node also works with Linked Elements (except space and area), Multi Category tag and Material Tag. Based on an archilab node
code_block_20 = CodeBlock(x=create_tag, p1=code_block_19.point_tag_location, p2=code_block_19.point_leader_end, p3=code_block_19.point_leader_elbow)
# ---------- code_block_20.designscript (11 lines) ----------
tag = x[0];
//Activa Leader Line
Revit.Elements.Element.SetParameterByName(tag, "Leader Line", 1);
//Leader Line Free End
Revit.Elements.Element.SetParameterByName(tag, "Leader Type", 1);
//Posicion Tag
Rhythm.Tags.SetHeadPosition(tag, p1);
//Leader End Position
Rhythm.Tags.SetLeaderEndPosition(tag, p2);
//Leader Elbow
Rhythm.Tags.SetLeaderElbowPosition(tag, p3);
# ----------------------------------------
o_document_activeview_3 = Orchid.RevitProject.Common.Document.ActiveView()
fromCurves_2 = StructuralDesign.Rebar.Create.FromCurves(curves=code_block_16.out124, rebarStyle=code_block_16.out125, rebarBarType=code_block_16.out126, startHookType=code_block_16.out127, endHookType=code_block_16.out128, startHookOrientation=code_block_16.out129, endHookOrientation=code_block_16.out130, hostElement=code_block_16.out131, vector=code_block_16.out132)
code_block_21 = CodeBlock(x=fromCurves_2) { x[0]; }
setLayoutAsFixedNumber_2 = StructuralDesign.Rebar.Layout.SetLayoutAsFixedNumber(rebar=code_block_21, arrayLength=code_block_16.out133, numberOfBarPositions=code_block_16.out134)
element_types_ᶜᵒⁿᵛᵉʳᵗᵉᵈ_ᵈʳᵒᵖᵈᵒʷⁿ_4 = CodeBlock { DSCore.Types.FindTypeByNameInAssembly("RebarShape", "RevitAPI"); }
all_elements_of_type_4 = ElementsOfType(element_type=element_types_ᶜᵒⁿᵛᵉʳᵗᵉᵈ_ᵈʳᵒᵖᵈᵒʷⁿ_4)
code_block_22 = CodeBlock(rebar=setLayoutAsFixedNumber_2, capa=code_block_16.out135, elem=all_elements_of_type_4)  # same code as code_block_18
rebarCenterlineCurves_2 = StructuralDesign.Rebar.Properties.RebarCenterlineCurves(rebar=code_block_22.out4)
code_block_23 = CodeBlock(x=rebarCenterlineCurves_2, normal_distribucion=code_block_16.out136, view_plane_vector_y=code_block_16.out138, element=code_block_22.out4, despl_etiqueta=code_block_16.out137)  # same code as code_block_19
create_tag_2 = Custom[Create Tag](view=o_document_activeview_3, element=code_block_23.element, TagLocation=code_block_23.point_leader_end, TagType=code_block_23.tag_type, horizontal=code_block_23.out9, addLeader=code_block_23.out10, LinkInstance=code_block_23.out11, RunIt=code_block_23.out12, lacing=Shortest)
code_block_24 = CodeBlock(x=create_tag_2, p1=code_block_23.point_tag_location, p2=code_block_23.point_leader_end, p3=code_block_23.point_leader_elbow)  # same code as code_block_20
o_document_activeview_4 = Orchid.RevitProject.Common.Document.ActiveView()
fromCurves_3 = StructuralDesign.Rebar.Create.FromCurves(curves=code_block_16.out104, rebarStyle=code_block_16.out105, rebarBarType=code_block_16.out106, startHookType=code_block_16.out107, endHookType=code_block_16.out108, startHookOrientation=code_block_16.out109, endHookOrientation=code_block_16.out110, hostElement=code_block_16.out111, vector=code_block_16.out112, lacing=Longest)
setLayoutAsFixedNumber_3 = StructuralDesign.Rebar.Layout.SetLayoutAsFixedNumber(rebar=fromCurves_3, arrayLength=code_block_16.out113, numberOfBarPositions=code_block_16.out114)
element_types_ᶜᵒⁿᵛᵉʳᵗᵉᵈ_ᵈʳᵒᵖᵈᵒʷⁿ_5 = CodeBlock { DSCore.Types.FindTypeByNameInAssembly("RebarShape", "RevitAPI"); }
all_elements_of_type_5 = ElementsOfType(element_type=element_types_ᶜᵒⁿᵛᵉʳᵗᵉᵈ_ᵈʳᵒᵖᵈᵒʷⁿ_5)
code_block_25 = CodeBlock(rebar=setLayoutAsFixedNumber_3, capa=code_block_16.out115, elem=all_elements_of_type_5)
# ---------- code_block_25.designscript (8 lines) ----------
//Asigna Numero de Capa
Revit.Elements.Element.SetParameterByName(rebar, "Capa", capa);

//Asigna el Rebar Shape Indicado
elem_names = Revit.Elements.Element.Name(elem);
mask = elem_names == "R_S_00";
rebar_shape_R_S_00 = DSCore.List.FilterByBoolMask(elem, mask)["in"];
Revit.Elements.Element.SetParameterByName(rebar<1L>, "Shape", rebar_shape_R_S_00<1L>);
# ----------------------------------------
rebarCenterlineCurves_3 = StructuralDesign.Rebar.Properties.RebarCenterlineCurves(rebar=code_block_25.out4)
flatten = List.Flatten(list=rebarCenterlineCurves_3)
code_block_26 = CodeBlock(x=flatten, normal_distribucion=code_block_16.out116, view_plane_vector_y=code_block_16.out118, element=code_block_25.out4, despl_etiqueta=code_block_16.out117)
# ---------- code_block_26.designscript (20 lines) ----------
rebar_curve = x;
normal_distribucion;
view_plane_vector_y;
//element
element;
//TagLocation
point_leader_end = Autodesk.Curve.PointAtParameter(rebar_curve<1L>, 0.5);
point_leader_elbow = Autodesk.Geometry.Translate(point_leader_end<1L>, normal_distribucion<1L>, despl_etiqueta<1L>);
point_tag_location = Autodesk.Geometry.Translate(point_leader_elbow<1L>, view_plane_vector_y<1L>, 500);
//TagType
family = Revit.Family.ByName("EST_A_STRUCTURAL REBAR TAG_STANDAR");
tag_type = Revit.Elements.FamilyType.ByFamilyAndName(family, "R_S_00");
//horizontal
true;
//addLeader
false;
//LinkInstance
null;
//RunIt
true;
# ----------------------------------------
create_tag_3 = Custom[Create Tag](view=o_document_activeview_4, element=code_block_26.element, TagLocation=code_block_26.point_leader_end, TagType=code_block_26.tag_type, horizontal=code_block_26.out9, addLeader=code_block_26.out10, LinkInstance=code_block_26.out11, RunIt=code_block_26.out12, lacing=Longest)
code_block_27 = CodeBlock(x=create_tag_3, p1=code_block_26.point_tag_location, p2=code_block_26.point_leader_end, p3=code_block_26.point_leader_elbow)
# ---------- code_block_27.designscript (11 lines) ----------
tag = DSCore.List.Flatten(x);
//Activa Leader Line
Revit.Elements.Element.SetParameterByName(tag, "Leader Line", 1);
//Leader Line Free End
Revit.Elements.Element.SetParameterByName(tag, "Leader Type", 1);
//Posicion Tag
Rhythm.Tags.SetHeadPosition(tag, p1);
//Leader End Position
Rhythm.Tags.SetLeaderEndPosition(tag, p2);
//Leader Elbow
Rhythm.Tags.SetLeaderElbowPosition(tag, p3);
# ----------------------------------------
o_document_activeview_5 = Orchid.RevitProject.Common.Document.ActiveView()
byBestFitThroughPoints = Line.ByBestFitThroughPoints()  # unwired: bestFitPoints
code_block_28 = CodeBlock(rebar_inicio=rebarCenterlineCurves, rebar_mid=rebarCenterlineCurves_3, rebar_final=rebarCenterlineCurves_2) { rebar_curve_list = DSCore.List.Flatten([rebar_inicio, rebar_mid, rebar_final]); }
intersect = Geometry.Intersect(geometry=code_block_28@L1, other=code_block_28@L2, lacing=Longest)
flatten_2 = List.Flatten(list=intersect)
removeDuplicates = Curve.RemoveDuplicates(curves=flatten_2)
o_document_activeview_6 = Orchid.RevitProject.Common.Document.ActiveView()
plane_2 = Custom[View.Plane](view=o_document_activeview_6)
pullOntoPlane = Curve.PullOntoPlane(curve=removeDuplicates.cleanedCurves, plane=plane_2)
family_types_ᶜᵒⁿᵛᵉʳᵗᵉᵈ_ᵈʳᵒᵖᵈᵒʷⁿ = CodeBlock { Revit.Elements.FamilyType.ByName("EST_D_DEATIL ITEM_EMPALME"); }
o_document_activeview_7 = Orchid.RevitProject.Common.Document.ActiveView()
byCurve = Custom[DetailComponent.ByCurve](curve=pullOntoPlane, familyType=family_types_ᶜᵒⁿᵛᵉʳᵗᵉᵈ_ᵈʳᵒᵖᵈᵒʷⁿ, view=o_document_activeview_7)  # package Clockwork for Dynamo 2.x; Places a line-based detail component in a given view
end = Revit.Transaction.Transaction.End(input=byCurve)
familyinstance_2d_geometry = Custom[FamilyInstance 2D Geometry](element=end)  # package Genius Loci; Gets the curves of the family instance. Works only with the family categories : Generic Annotation and Detail Item.
control_de_flujo = Python(IN[0]=familyinstance_2d_geometry)
# ---------- control_de_flujo.python (9 lines) ----------
var = IN[0]
lst = []

if var == lst:
	x = [] 
else:
	x = 0.001

OUT = x
# ----------------------------------------
byJoinedCurves = PolyCurve.ByJoinedCurves(curves=familyinstance_2d_geometry, joinTolerance=control_de_flujo)
byPatch = Surface.ByPatch(closedCurve=byJoinedCurves)
control_de_flujo_2 = Python(IN[0]=byPatch)
# ---------- control_de_flujo_2.python (9 lines) ----------
var = IN[0]
lst = []

if var == lst:
	x = [] 
else:
	x = [1, 0]

OUT = x
# ----------------------------------------
code_block_29 = CodeBlock { [0.5, 0.5]; }
pointAtParameter = Surface.PointAtParameter(surface=byPatch@L2, u=control_de_flujo_2, v=code_block_29, lacing=Longest)
transpose = List.Transpose(lists=pointAtParameter)
function_apply = ApplyFunction(func=byBestFitThroughPoints, arg1=transpose)
pullOntoPlane_2 = Curve.PullOntoPlane(curve=function_apply)  # unwired: plane
code_block_30 = CodeBlock { ["Right", "Left"]; }
familyinstance_reference_byname = Custom[FamilyInstance Reference ByName](familyInstance=end@L1, name=code_block_30@L2, lacing=Longest)  # package Genius Loci; Works only in Revit 2018.1 and later. Gets the reference corresponding to the named reference plane in the instance's family.
transpose_2 = List.Transpose(lists=familyinstance_reference_byname.Reference@L2)
element_types_ᶜᵒⁿᵛᵉʳᵗᵉᵈ_ᵈʳᵒᵖᵈᵒʷⁿ_6 = CodeBlock { DSCore.Types.FindTypeByNameInAssembly("DimensionType", "RevitAPI"); }
all_elements_of_type_6 = ElementsOfType(element_type=element_types_ᶜᵒⁿᵛᵉʳᵗᵉᵈ_ᵈʳᵒᵖᵈᵒʷⁿ_6)
name = Element.Name(element=all_elements_of_type_6)
code_block_31 = CodeBlock { "Linear - 2.5mm Arial"; }
eq = name == code_block_31
filterByBoolMask = List.FilterByBoolMask(list=all_elements_of_type_6, mask=eq)
dimension_byreferences = Custom[Dimension ByReferences](view=o_document_activeview_5@L1, line=pullOntoPlane_2@L1, references=transpose_2@L2, dimensionType=filterByBoolMask.in@L1, lacing=Longest)  # package Genius Loci; Creates a new linear dimension from at least two geometric references of an object.
