# Dynamo graph hor_expotrada.dyn (Dynamo 2.6.2.15705)
# packages: Data-Shapes 2022.2.103, Structural Design 2021.1.22, Genius Loci 2021.11.10, Orchid 206.3.0.8161, Clockwork for Dynamo 2.x 2.4.0

o_document_activeview = Orchid.RevitProject.Common.Document.ActiveView()
code_block = CodeBlock { "Corchete Segmento Unico"; }
file_path = Filename("..\..\..\..\..\..\..\..\..\..\Arainco\Arainco.png")
code_block_2 = CodeBlock { "INICIAR"; "CANCELAR"; true; 430; 170; 650; }
categories_ᶜᵒⁿᵛᵉʳᵗᵉᵈ_ᵈʳᵒᵖᵈᵒʷⁿ = CodeBlock { "Seleccionar Muro a Armar"; "SELECCIONAR"; Revit.Category.ByName(["Walls","Structural Foundations"]); }
selectmodelelements_data = Custom[SelectModelElements Data](InputName=categories_ᶜᵒⁿᵛᵉʳᵗᵉᵈ_ᵈʳᵒᵖᵈᵒʷⁿ.out0, ButtonText=categories_ᶜᵒⁿᵛᵉʳᵗᵉᵈ_ᵈʳᵒᵖᵈᵒʷⁿ.out1, CategoryFilter=categories_ᶜᵒⁿᵛᵉʳᵗᵉᵈ_ᵈʳᵒᵖᵈᵒʷⁿ.out2)  # package Data-Shapes; Creates a Revit element selection input for UI.MultipleInputForm++ . Check out www.data-shapes.net for more infos!
code_block_3 = CodeBlock { "Cara de Distribucion"; "SELECCIONAR"; }
selectfaces_data = Custom[SelectFaces Data](InputName=code_block_3.out0, ButtonText=code_block_3.out1)  # package Data-Shapes; Creates a Revit face selection input for UI.MultipleInputForm++. Check out www.data-shapes.net for more infos!
code_block_4 = CodeBlock { "Punto de Empotramiento"; "SELECCIONAR"; }
selectfaces_data_2 = Custom[SelectFaces Data](InputName=code_block_4.out0, ButtonText=code_block_4.out1)
code_block_5 = CodeBlock { "Término"; "SELECCIONAR"; }
selectfaces_data_3 = Custom[SelectFaces Data](InputName=code_block_5.out0, ButtonText=code_block_5.out1)
code_block_6 = CodeBlock { "Datos de Armadura"; }
code_block_7 = CodeBlock { "Diametro"; }
element_types_ᶜᵒⁿᵛᵉʳᵗᵉᵈ_ᵈʳᵒᵖᵈᵒʷⁿ = CodeBlock { DSCore.Types.FindTypeByNameInAssembly("RebarBarType", "RevitAPI"); }
all_elements_of_type = ElementsOfType(element_type=element_types_ᶜᵒⁿᵛᵉʳᵗᵉᵈ_ᵈʳᵒᵖᵈᵒʷⁿ)
code_block_8 = CodeBlock(t5=all_elements_of_type)
# ---------- code_block_8.designscript (8 lines) ----------
t4 = t5;
t1 = t4;
num1 = Properties.RebarDiameter(t1);
t2 = DSCore.List.SortByKey(t1, num1);
t3 = Dictionary.ValueAtKey(t2, "sorted list");
str1 = Revit.Elements.Element.Name(t3);
0;
false;
# ----------------------------------------
dropdown_data = Custom[DropDown Data](InputName=code_block_7, Keys=code_block_8.str1, Values=code_block_8.t3, DefaultValueIndex=code_block_8.out6, Sorted_optional=code_block_8.out7)  # package Data-Shapes; Create data for DropDown input in UI.MultiInputForm ++ . Check out www.data-shapes.net for more infos.
code_block_9 = CodeBlock { "Cantidad de Barras"; "2"; true; }
textbox_data = Custom[TextBox Data](InputName=code_block_9.out0, DefaultText=code_block_9.out1, IsNumberEntry=code_block_9.out2)  # package Data-Shapes; Create Data for TextBox input in UI.MultipleInputForm ++ . Check out www.data-shapes.net for more informations
code_block_10 = CodeBlock { "Capa"; ["1ª Capa", "2ª Capa", "3ª Capa", "4ª Capa", "5ª Capa"]; [-40, -90, -140, -190, -240]; 0; }
dropdown_data_2 = Custom[DropDown Data](InputName=code_block_10.out0, Keys=code_block_10.out1, Values=code_block_10.out2, DefaultValueIndex=code_block_10.out3)
list_create = List.Create(item0=dropdown_data, item1=textbox_data, item2=dropdown_data_2)
inputgroup_data = Custom[InputGroup Data](GroupTitle=code_block_6, Inputs=list_create)  # package Data-Shapes; Creates a group of inputs for UI.MultipleInputForm ++ . Check out www.data-shapes.net for more infos !
list_create_2 = List.Create(item0=selectmodelelements_data, item1=selectfaces_data, item2=selectfaces_data_2, item3=selectfaces_data_3, item4=inputgroup_data)
multipleinputform = Custom[MultipleInputForm ++](Description_optional=code_block, Logo_optional=file_path, ButtonText_optional=code_block_2.out0, Inputs=list_create_2, Toggle=code_block_2.out2, CancelButtonText_optional=code_block_2.out1, MaxHeight_optional=code_block_2.out5, Width_optional=code_block_2.out3, LabelWidth_optional=code_block_2.out4)  # package Data-Shapes; Create a form with multiple inputs. see www.data-shapes.net for tutorials and infos!
code_block_11 = CodeBlock(l=multipleinputform.User_Inputs)
# ---------- code_block_11.designscript (12 lines) ----------
l;
[Imperative]
{
	if (l == null)
	{
		return = [[],[],[],[],[],[]];
	}
	else
	{
		return = l;
	}
};
# ----------------------------------------
o_document_activeview_2 = Orchid.RevitProject.Common.Document.ActiveView()
plane = Custom[View.Plane](view=o_document_activeview_2)  # package Clockwork for Dynamo 2.x; Retrieves the plane of a given view
code_block_12 = CodeBlock(x=code_block_11.out1, view_plane=plane)
# ---------- code_block_12.designscript (13 lines) ----------
muros = x[0];
view_plane;
view_plane_normal = Autodesk.Plane.Normal(view_plane);
view_plane_normal_reverse = Autodesk.Vector.Reverse(view_plane_normal);

//Traslacion curva
category = Revit.Elements.Element.GetCategory(muros);
category_name = Revit.Category.Name(category);
mask = category_name == "Walls";
element = DSCore.List.FilterByBoolMask(muros, mask)["in"];
element_type = Revit.Elements.Element.GetParameterValueByName(element, "Type");
element_width = Revit.Elements.Element.GetParameterValueByName(element_type, "Width");
dist_traslacion_curva = (element_width[0] / 2) - 40;
# ----------------------------------------
code_block_13 = CodeBlock(x=code_block_11.out1, view_plane=plane)
# ---------- code_block_13.designscript (15 lines) ----------
muros = x[0];
view_plane;
view_plane_normal = Autodesk.Plane.Normal(view_plane);

//Geometria a Cortar
elem_category = Revit.Elements.Element.GetCategory(muros);
elem_category_name = Revit.Category.Name(elem_category);
mask_1 = elem_category_name == "Walls";
elem_filtrados = DSCore.List.FilterByBoolMask(muros, mask_1)["in"];
elem_a_unir = DSCore.List.Flatten(DSCore.List.AddItemToFront(muros@L1<1L>, elem_filtrados@L2<1L>), -1);
geom_inicial = Autodesk.Solid.ByUnion(DSCore.List.Flatten(Revit.Elements.Element.Geometry(elem_a_unir), -1));
geom_centroid = Autodesk.Solid.Centroid(geom_inicial);
geom_plane = Autodesk.Plane.ByOriginNormal(geom_centroid, view_plane_normal);
geom_coo_sys = CoordinateSystem.ByPlane(geom_plane);
geom_a_cortar = Autodesk.Geometry.Scale(geom_inicial, geom_plane, 100, 100, 1);
# ----------------------------------------
code_block_14 = CodeBlock(x=code_block_11.out1, view_plane=plane)
# ---------- code_block_14.designscript (26 lines) ----------
distribucion = x[1];
empotramiento = x[2];
termino = x[3];
capa = x[6];
view_plane;
view_plane_normal = Autodesk.Plane.Normal(view_plane);

//Vector Normal Caras capturadas
distribucion_normal = Autodesk.Surface.NormalAtParameter(distribucion, 0.5, 0.5)[0];
empotramiento_normal = Autodesk.Surface.NormalAtParameter(empotramiento, 0.5, 0.5)[0];
termino_normal = Autodesk.Surface.NormalAtParameter(termino, 0.5, 0.5)[0];

//Centroide Caras Capturadas
distribucion_point = Autodesk.Surface.PointAtParameter(distribucion, 0.5, 0.5)[0];
empotramiento_point = Autodesk.Surface.PointAtParameter(empotramiento, 0.5, 0.5)[0];
termino_point = Autodesk.Surface.PointAtParameter(termino, 0.5, 0.5)[0];

//Planos caras capturadas
distribucion_plane_1 = Autodesk.Plane.ByOriginNormal(distribucion_point, distribucion_normal);
empotramiento_plane = Autodesk.Plane.ByOriginNormal(empotramiento_point, empotramiento_normal);
termino_plane_1 = Autodesk.Plane.ByOriginNormal(termino_point, termino_normal);

//Planos Trasladados
distribucion_plane = Autodesk.Geometry.Translate(distribucion_plane_1, distribucion_normal, capa);
empotramiento_plane;
termino_plane = Autodesk.Geometry.Translate(termino_plane_1, termino_normal, -20);
# ----------------------------------------
code_block_15 = CodeBlock(dist_traslacion_curva=code_block_12.dist_traslacion_curva, view_plane_normal=code_block_12.view_plane_normal, geom_a_cortar=code_block_13.geom_a_cortar, distribucion_plane=code_block_14.out15, empotramiento_plane=code_block_14.out16, termino_plane=code_block_14.out17)
# ---------- code_block_15.designscript (25 lines) ----------
dist_traslacion_curva;
view_plane_normal;

//Superficies
surf_distribucion = Autodesk.Geometry.Intersect(geom_a_cortar, distribucion_plane)[0];
surf_empotramiento = Autodesk.Geometry.Intersect(geom_a_cortar, empotramiento_plane)[0];
surf_termino = Autodesk.Geometry.Intersect(geom_a_cortar, termino_plane)[0];

//Intersecciones
intersect_end = Autodesk.Geometry.Intersect(surf_distribucion, surf_empotramiento)[0];
intersect_start = Autodesk.Geometry.Intersect(surf_distribucion, surf_termino)[0];

//Puntos para Generar Curva
point_end = Autodesk.Curve.PointAtParameter(intersect_start, 0.5);
point_start = Autodesk.Curve.PointAtParameter(intersect_end, 0.5);

//Rebar Curve
rebar_curve_init = Line.ByStartPointEndPoint(point_end, point_start);
rebar_curve_trans = Autodesk.Geometry.Translate(rebar_curve_init, view_plane_normal, dist_traslacion_curva);
rebar_curve = Autodesk.Curve.ExtendEnd(rebar_curve_trans,1000);

//Rebar Vector
rebar_curve_point = Autodesk.Curve.PointAtParameter(rebar_curve, 0.5);
rebar_curve_plane = Autodesk.Plane.ByOriginNormal(rebar_curve_point, view_plane_normal);
rebar_curve_plane_normal =Autodesk.Plane.Normal(rebar_curve_plane);
# ----------------------------------------
element_types_ᶜᵒⁿᵛᵉʳᵗᵉᵈ_ᵈʳᵒᵖᵈᵒʷⁿ_2 = CodeBlock { DSCore.Types.FindTypeByNameInAssembly("RebarHookType", "RevitAPI"); }
all_elements_of_type_2 = ElementsOfType(element_type=element_types_ᶜᵒⁿᵛᵉʳᵗᵉᵈ_ᵈʳᵒᵖᵈᵒʷⁿ_2)
rebar_hook_type_at_start = CodeBlock(t3=all_elements_of_type_2)
# ---------- rebar_hook_type_at_start.designscript (5 lines) ----------
t1 = t3;
str2 = Revit.Elements.Element.Name(t1);
t2 = str2 == "Standard - 90 deg.";
t4 = DSCore.List.FilterByBoolMask(t3, t2);
t5 = Dictionary.ValueAtKey(t4, "in");
# ----------------------------------------
code_block_16 = CodeBlock(curves=code_block_15.rebar_curve, rebarBarType=code_block_11.out1, startHookType=rebar_hook_type_at_start.t5, hostElement=code_block_11.out1, vector=code_block_15.rebar_curve_plane_normal)
# ---------- code_block_16.designscript (18 lines) ----------
//curves
curves;
//rebarStyle
"Standard";
//rebarBarType
rebarBarType[4];
//startHookType
startHookType;
//endHookType
null;
//startHookOrientation
"Left";
//endtHookOrientation
"Left";
//hostElement
hostElement[0];
//vector
vector;
# ----------------------------------------
fromCurves = StructuralDesign.Rebar.Create.FromCurves(curves=code_block_16.curves@L1, rebarStyle=code_block_16.out1@L1, rebarBarType=code_block_16.out2@L1, startHookType=code_block_16.startHookType@L1, endHookType=code_block_16.out4@L1, startHookOrientation=code_block_16.out5@L1, endHookOrientation=code_block_16.out6@L1, hostElement=code_block_16.out7@L1, vector=code_block_16.vector@L1, lacing=Longest)
code_block_17 = CodeBlock(element_width=code_block_12.element_width)
# ---------- code_block_17.designscript (2 lines) ----------
//ArrayLength
array_length = element_width - 80;
# ----------------------------------------
code_block_18 = CodeBlock(x=code_block_11.out1) { x[5]; }
setLayoutAsFixedNumber = StructuralDesign.Rebar.Layout.SetLayoutAsFixedNumber(rebar=fromCurves, arrayLength=code_block_17, numberOfBarPositions=code_block_18)
code_block_19 = CodeBlock { "Capa"; }
string_from_object = FromObject()  # unwired: obj
numero_de_capa = CodeBlock(capa=string_from_object)
# ---------- numero_de_capa.designscript (4 lines) ----------
key = ["40", "90", "140", "190", "240"];
val = ["1", "2", "3", "4", "5"];
dict_capa = Dictionary.ByKeysValues(key, val);
t3 = Dictionary.ValueAtKey(dict_capa, capa);
# ----------------------------------------
setParameterByName = Element.SetParameterByName(element=setLayoutAsFixedNumber, parameterName=code_block_19, value=numero_de_capa.t3)  # frozen
element_types_ᶜᵒⁿᵛᵉʳᵗᵉᵈ_ᵈʳᵒᵖᵈᵒʷⁿ_3 = CodeBlock { DSCore.Types.FindTypeByNameInAssembly("RebarShape", "RevitAPI"); }
all_elements_of_type_3 = ElementsOfType(element_type=element_types_ᶜᵒⁿᵛᵉʳᵗᵉᵈ_ᵈʳᵒᵖᵈᵒʷⁿ_3)
code_block_20 = CodeBlock(t1=all_elements_of_type_3)
# ---------- code_block_20.designscript (5 lines) ----------
"Shape";
str2 = Revit.Elements.Element.Name(t1);
t2 = str2 == "R_S_02";
t3 = DSCore.List.FilterByBoolMask(t1, t2);
t4 = Dictionary.ValueAtKey(t3, "in");
# ----------------------------------------
setParameterByName_2 = Element.SetParameterByName(element=setParameterByName, parameterName=code_block_20.out0, value=code_block_20.t4, lacing=Longest)
rebarCenterlineCurves = StructuralDesign.Rebar.Properties.RebarCenterlineCurves(rebar=setParameterByName_2)
o_document_activeview_3 = Orchid.RevitProject.Common.Document.ActiveView()
plane_2 = Custom[View.Plane](view=o_document_activeview_3)
numero_de_capa_2 = CodeBlock(capa=string_from_object)
# ---------- numero_de_capa_2.designscript (4 lines) ----------
key = ["40", "90", "140", "190", "240"];
val = [250, 700, 1310, 1840, 2370];
dict_capa = Dictionary.ByKeysValues(key, val);
t3 = Dictionary.ValueAtKey(dict_capa, capa);
# ----------------------------------------
code_block_21 = CodeBlock(x=rebarCenterlineCurves, view_plane=plane_2, dst=numero_de_capa_2.t3)  # unwired: sup_normal
# ---------- code_block_21.designscript (11 lines) ----------
rebar_curve = x[0];
view_plane;
sup_normal;
view_plane_normal = Autodesk.Plane.Normal(view_plane);
curve_point = Autodesk.Curve.PointAtParameter(rebar_curve, 0.5);
plane_1 = Autodesk.Plane.ByOriginNormal(curve_point, view_plane_normal);
CoordinateSystem.ByPlane(plane_1);
v_xaxis = Autodesk.Plane.XAxis(plane_1);
v_yaxis = Autodesk.Plane.YAxis(plane_1);
location_x = Autodesk.Geometry.Translate(curve_point, sup_normal, dst);
tag_location = Autodesk.Geometry.Translate(location_x, v_yaxis, 300);
# ----------------------------------------
code_block_22 = CodeBlock()
# ---------- code_block_22.designscript (4 lines) ----------
family1 = Revit.Family.ByName("EST_A_STRUCTURAL REBAR TAG_STANDAR");
familytype1 = Revit.Elements.FamilyType.ByFamilyAndName(family1, "R_S_02");
false;
true;
# ----------------------------------------
create_tag = Custom[Create Tag](view=o_document_activeview@L1, element=setParameterByName_2@L1, TagLocation=code_block_21.tag_location@L1, TagType=code_block_22.familytype1@L1, addLeader=code_block_22.out2@L1, RunIt=code_block_22.out3@L1, lacing=Longest)  # package Genius Loci; Works only in Revit 2018 and later. Creates a tag at a given location, of given type and in a supplied view. The node also works with Linked Elements (except space and area), Multi Category tag and Material Tag. Based on an archilab node
flatten = List.Flatten(list=create_tag)
code_block_23 = CodeBlock { "Leader Line"; 1; }
setParameterByName_3 = Element.SetParameterByName(element=flatten, parameterName=code_block_23.out0, value=code_block_23.out1)
code_block_24 = CodeBlock { "Leader Type"; 1; }
setParameterByName_4 = Element.SetParameterByName(element=setParameterByName_3, parameterName=code_block_24.out0, value=code_block_24.out1)
